# Grasshopper definition 0_conceptual_city.gh (Grasshopper 1.0.8)
# plug-ins: RhinoCodePluginGH

# ----
# Custom Building Mapping
generic_buildings = Curve([<curve referenced from the Rhino model> x196])
corner_parcels = Curve([<curve referenced from the Rhino model> x38])
corner_buildings = Curve([<curve referenced from the Rhino model> x78])
generic_parcels = Curve([<curve referenced from the Rhino model> x94])
custom_building_mapping = Python3Script(
    corner_parcels=corner_parcels,
    corner_buildings=corner_buildings,
    generic_parcels=generic_parcels,
    generic_buildings=generic_buildings)  # -> corner_buildings_map, generic_buildings_map; inputs corner_parcels: list, corner_buildings: list, generic_parcels: list, generic_buildings: list
# ---------- custom_building_mapping: Python ----------
import Rhino
import rhinoscriptsyntax as rs
import Rhino.Geometry as rg
import math

#####################################################################################

""" FUNCTIONS """

# Function to ensure the vertices of the parcel are ordered counter-clockwise.
def ensure_counterclockwise(parcel):
    polyline = parcel.ToPolyline()
    vertices = polyline.ToArray()  # Get vertices as an array
    signed_area_sum = 0
    # Shoelace theorem to check clockwise or counter-clockwise
    for i in range(len(vertices)):
        v1 = vertices[i]
        v2 = vertices[(i + 1) % len(vertices)]  # Next vertex (with wrap-around)
        signed_area_sum += (v2.X - v1.X) * (v2.Y + v1.Y)
    # If total is positive, the vertices are ordered clockwise
    if signed_area_sum > 0:
        vertices = list(reversed(vertices))  # Reverse the vertices if clockwise
        return rg.PolylineCurve(vertices)  # Return the polyline with counter-clockwise vertices
    else:
        return parcel  # Already counter-clockwise, return the original parcel

# Function to reorder vertices such that the first vertex is closest to corner and ensure counterclockwise order.
def reorder_vertices_to_start_at_corner(vertices, corner, tolerance=1e-6):  
    # Find the index of the vertex closest to the corner
    min_distance = float("inf")
    vertex_0_index = 0
    for i in range(len(vertices)):
        distance = vertices[i].DistanceTo(corner)
        if distance < min_distance:
            min_distance = distance
            vertex_0_index = i
    # Reorder the vertices starting from the closest point
    reordered_vertices = [vertices[(i + vertex_0_index) % len(vertices)] for i in range(len(vertices))]
    # Remove consecutive duplicate vertices (within a small tolerance)
    unique_reordered_vertices = [reordered_vertices[0]]
    for i in range(1, len(vertices)):
        if reordered_vertices[i].DistanceTo(unique_reordered_vertices[-1]) > tolerance:
            unique_reordered_vertices.append(reordered_vertices[i])
    # Ensure the last vertex is not a duplicate of the first vertex
    if unique_reordered_vertices[0].DistanceTo(unique_reordered_vertices[-1]) < tolerance:
        unique_reordered_vertices.pop()
    # Check if the reordered vertices are counterclockwise using the Shoelace theorem
    signed_area_sum = 0
    for i in range(len(unique_reordered_vertices)):
        v1 = unique_reordered_vertices[i]
        v2 = unique_reordered_vertices[(i + 1) % len(unique_reordered_vertices)]  # Next vertex (with wrap-around)
        signed_area_sum += (v2.X - v1.X) * (v2.Y + v1.Y)
    if signed_area_sum > 0:
        unique_reordered_vertices.reverse()
    else:
        unique_reordered_vertices = unique_reordered_vertices
    return unique_reordered_vertices

# Function to generate a grid inside a quadrilateral parcel. Uses a bilinear interpolation between the edges of the quadrilateral.
def generate_grid_in_quadrilateral_parcel(parcel_vertices, grid_resolution):
    grid_points = []
    if len(parcel_vertices) == 5:
        parcel_vertices.pop()
    # Get the four corners of the quadrilateral
    v0, v1, v2, v3 = parcel_vertices
    for u in range(grid_resolution + 1):
        u_ratio = u / grid_resolution  # The relative position along the U direction (horizontal)
        # Interpolate between v0->v3 (left) and v1->v2 (right) edges
        left_interp = v0 + (v3 - v0) * u_ratio
        right_interp = v1 + (v2 - v1) * u_ratio
        for v in range(grid_resolution + 1):
            v_ratio = v / grid_resolution  # The relative position along the V direction (vertical)
            # Interpolate between the left and right edges at the current u_ratio
            grid_point = left_interp + (right_interp - left_interp) * v_ratio
            grid_points.append(grid_point)
    return grid_points

# Function to map the building vertices to the indices of the grid points of the quadrilateral parcel.
def compute_building_indeces_quadrilateral(building_vertices, grid_in):
    building_indices = []
    for building_vertex in building_vertices:
        # Find the closest point in the input grid and get its index
        closest_index_in = min(range(len(grid_in)), key=lambda i: building_vertex.DistanceTo(grid_in[i]))
        building_indices.append(closest_index_in)
    # Returns a list of indices that represent the mapping.
    return building_indices

# Function to find a center point that is roughly equidistant from all vertices by fitting a circle.
def compute_weighted_center(vertices):
    # Compute the bounding box and the center of the bounding box
    bounding_box = rg.BoundingBox(vertices)
    center_point = bounding_box.Center
    # Find the average distance of the vertices to the center point
    average_distance = sum([center_point.DistanceTo(vertex) for vertex in vertices]) / len(vertices)
    # Create a sphere at the center with radius equal to the average distance to the vertices
    sphere = rg.Sphere(center_point, average_distance)
    # Return the center of the sphere (rough center of the pentalateral)
    return sphere.Center

# Function to subdivide a triangle into four smaller triangles by adding midpoints on its edges.
def subdivide_triangle(v0, v1, v2):
    # Compute midpoints
    mid_v0_v1 = v0 + (v1 - v0) * 0.5
    mid_v1_v2 = v1 + (v2 - v1) * 0.5
    mid_v2_v0 = v2 + (v0 - v2) * 0.5
    # Create smaller triangles
    triangles = [
        (v0, mid_v0_v1, mid_v2_v0),
        (mid_v0_v1, v1, mid_v1_v2),
        (mid_v2_v0, mid_v1_v2, v2),
        (mid_v0_v1, mid_v1_v2, mid_v2_v0)
    ]
    # Return triangles and midpoints as potential intersection points
    return triangles, [mid_v0_v1, mid_v1_v2, mid_v2_v0]

# Function to subdivide triangles of a pentalateral iteratively with consistent indexing
def subdivide_pentagon_triangles_with_indexing(vertices, center):
    # Create initial triangles (center to adjacent vertices)
    triangles = []
    indexed_points = []  # Track points in a consistent order
    indexed_points.append(center)  # Start with the centroid having index 0
    iterations = 3
    # Add the original vertices with consistent indexing
    indexed_points.extend(vertices)  # Add pentagon vertices (these will get indices 1-5)
    for i in range(len(vertices)):
        v0 = vertices[i]
        v1 = vertices[(i + 1) % len(vertices)]
        triangles.append((center, v0, v1))
    # Subdivide the triangles iteratively
    for _ in range(iterations):
        new_triangles = []
        for tri in triangles:
            # Subdivide the triangle and get the new midpoints
            subdivided, midpoints = subdivide_triangle(*tri)
            # Check each midpoint and assign it an index if it's new
            for midpoint in midpoints:
                if midpoint not in indexed_points:
                    indexed_points.append(midpoint)
            new_triangles.extend(subdivided)
        triangles = new_triangles
    return triangles, indexed_points

# Function to map the building vertices to the indices of the sorted points of the grid in the parcel
def map_building_to_indices(building_vertices, sorted_points_in):
    building_indices = []
    for building_vertex in building_vertices:
        # Find the closest point in the sorted_points_in and get its index
        closest_index_in = min(range(len(sorted_points_in)), key=lambda i: building_vertex.DistanceTo(sorted_points_in[i]))
        building_indices.append(closest_index_in)
    return building_indices

#####################################################################################



###############
""" INPUTS """

# Set tolerance for geometric comparison
tolerance = 1e-5

# Set grid resolution for mapping
grid_resolution = 25

# Initialize lists for coerced curves
cp = []
cp_buildings = []
gp = []
gp_buildings = []

# Coerce all cruves to polylines
for parcel in corner_parcels:
    cp_parcel = rs.coercecurve(parcel)
    cp.append(cp_parcel)
for parcel in generic_parcels:
    gp_parcel = rs.coercecurve(parcel)
    gp.append(gp_parcel)
for building in corner_buildings:
    cp_building = rs.coercecurve(building)
    cp_buildings.append(cp_building)
for building in generic_buildings:
    gp_building = rs.coercecurve(building)
    gp_buildings.append(gp_building)


# List to store corner parcel configurations
cp_configurations = []

for parcel in cp:
    parcel_vertices = parcel.ToPolyline().ToArray()
    if len(parcel_vertices) == 6:
        cp_configurations.append("pentalateral")
    else:
        cp_configurations.append("quadrilateral")


###################################
""" ASSIGN BUILDINGS TO PARCELS """

# Lists to store buildings in parcels
gp_to_building_map = [[] for _ in range(len(gp))] 
cp_to_building_map = [[] for _ in range(len(cp))]  

# Store all generic buildings in the generic parcel to building map
for building in gp_buildings:
    building_curve = rs.coercecurve(building)
    building_points = building_curve.ToPolyline().ToArray()

    # Map buildings to generic parcels
    for i in range(len(gp)): 
        inside = True
        gp_check = rs.coercecurve(gp[i])
        for pt in building_points:
            result = gp_check.Contains(pt, rg.Plane.WorldXY, tolerance)
            if result != rg.PointContainment.Inside and result != rg.PointContainment.Coincident:
                inside = False  # Set to False if any point is outside
                break  # If any point is outside, stop checking further
        if inside:
            # Append the building to the corresponding parcel in the generic parcel mapping
            gp_to_building_map[i].append(building_curve)


# Store all corner buildings in the corner parcel to building map
for building in cp_buildings:
    building_curve = rs.coercecurve(building)
    building_points = building_curve.ToPolyline().ToArray()

    # Map buildings to corner parcels
    for i in range(len(cp)): 
        inside = True
        cp_check = rs.coercecurve(cp[i])
        for pt in building_points:
            result = cp_check.Contains(pt, rg.Plane.WorldXY, tolerance)
            if result != rg.PointContainment.Inside and result != rg.PointContainment.Coincident:
                inside = False 
                break  
        if inside:
            # Append the building to the corresponding parcel in the corner parcel mapping
            cp_to_building_map[i].append(building_curve)



################################
""" CORNER BUILDING MAPPING """

# Initialize list for corner building UV mapping (each element will be a nested list: dimensions + buildings)
corner_buildings_map = []

# Iterate through all corner parcels and create the building map
for i, buildings in enumerate(cp_to_building_map):

    # Access the corresponding parcel 
    parcel = corner_parcels[i]  
    parcel = rs.coercecurve(parcel)
    parcel = ensure_counterclockwise(parcel)
    parcel_vertices = list(parcel.ToPolyline().ToArray())
    parcel_vertices_python_list = list(parcel.ToArray())

    # Initialize a new list to store the dimension pair and building mappings for this parcel
    parcel_info = []

    # Map buildings in quadrilateral corner parcels
    if cp_configurations[i] == "quadrilateral":

        # Get dimension pair of quadrilateral corner parcel
        cp_dim_1 = round(parcel_vertices[0].DistanceTo(parcel_vertices[1]), 2)
        cp_dim_2 = round(parcel_vertices[1].DistanceTo(parcel_vertices[2]), 2)
        cp_dimensions = [cp_dim_1, cp_dim_2]  # Dimensions for quadrilateral parcel

        # Add the dimension pair as the first element in the list
        parcel_info.append(cp_dimensions)

        # Add aspect ratio as the second element in the list
        aspect_ratio = round(cp_dim_1 / cp_dim_2, 2)
        parcel_info.append(aspect_ratio)

        # Generate a UV mapping grid for the quadrilateral corner parcel
        grid_points = generate_grid_in_quadrilateral_parcel(parcel_vertices, grid_resolution)

        # Initialize mapping_info (which serves as anothera nested list in the building map data structure)
        mapping_info = []

        # Loop through all buildings inside this parcel
        for building in buildings:
            building_curve = rs.coercecurve(building)
            building_vertices = list(building_curve.ToPolyline().ToArray())
            # Compute the U-V coordinates of the footprint vertices within the grid
            building_mapping = compute_building_indeces_quadrilateral(building_vertices, grid_points)
            mapping_info.append(building_mapping)

        # Add the mapping info list to parcel info (ensuring one nested list for all mappings)
        parcel_info.append(mapping_info)

    # Map buildings in pentalateral corner parcels
    elif cp_configurations[i] == "pentalateral":

        # Get dimension trio of pentalateral corner parcel
        cp_dim_1 = round(parcel_vertices[0].DistanceTo(parcel_vertices[1]), 2)
        cp_dim_2 = round(parcel_vertices[1].DistanceTo(parcel_vertices[2]), 2)
        cp_dim_3 = round(parcel_vertices[0].DistanceTo(parcel_vertices[4]), 2)
        cp_dimensions = [cp_dim_1, cp_dim_2, cp_dim_3]  # Dimensions for pentalateral parcel

        # Add the dimension trio as the first element in the list
        parcel_info.append(cp_dimensions)

        # Add aspect ratio as the second element in the list
        aspect_ratio = round(cp_dim_1 / cp_dim_2, 2)
        parcel_info.append(aspect_ratio)

        # Compute the weighted center as centroid of a constrained circumcircle within the pentalateral parcel
        centroid = compute_weighted_center(parcel_vertices)

        # Subdivide the pentalateral triangles iteratively
        triangles, indexed_points = subdivide_pentagon_triangles_with_indexing(parcel_vertices_python_list, centroid)

        # Initialize mapping_info (which serves as anothera nested list in the building map data structure)
        mapping_info = []

        # Loop through all buildings inside this parcel
        for building in buildings:
            building_curve = rs.coercecurve(building)
            building_polyline = building_curve.ToPolyline()
            building_vertices = list(building_polyline.ToArray())

            # Map the building vertices to their corresponding indices in the in-parcel
            building_mapping = map_building_to_indices(building_vertices, indexed_points)
            mapping_info.append(building_mapping)  # Add the building mapping
            
        # Add the mapping info list to parcel info (ensuring one nested list for all mappings)
        parcel_info.append(mapping_info)
        
    # Add the list of parcel_info (dimension + building mappings) to the main list
    corner_buildings_map.append(parcel_info)


################################
""" GENERIC BUILDING MAPPING """

# Initialize list for corner building UV mapping (each element will be a nested list: dimensions + buildings)
generic_buildings_map = []

# Iterate through all corner parcels and create the building map
for i, buildings in enumerate(gp_to_building_map):

    # Access the corresponding parcel 
    parcel = generic_parcels[i]  
    parcel = rs.coercecurve(parcel)
    parcel = ensure_counterclockwise(parcel)
    parcel_vertices = list(parcel.ToPolyline().ToArray())
    parcel_vertices_python_list = list(parcel.ToArray())

    # Initialize a new list to store the dimension pair and building mappings for this parcel
    parcel_info = []

    # Get dimension pair of quadrilateral corner parcel
    cp_dim_1 = round(parcel_vertices[0].DistanceTo(parcel_vertices[1]), 2)
    cp_dim_2 = round(parcel_vertices[1].DistanceTo(parcel_vertices[2]), 2)
    cp_dimensions = [cp_dim_1, cp_dim_2]  # Dimensions for quadrilateral parcel

    # Add the dimension pair as the first element in the list
    parcel_info.append(cp_dimensions)

    # Add aspect ratio as the second element in the list
    aspect_ratio = round(cp_dim_1 / cp_dim_2, 2)
    parcel_info.append(aspect_ratio)

    # Generate a UV mapping grid for the quadrilateral corner parcel
    grid_points = generate_grid_in_quadrilateral_parcel(parcel_vertices, grid_resolution)

    # Initialize mapping_info (which serves as anothera nested list in the building map data structure)
    mapping_info = []

    # Loop through all buildings inside this parcel
    for building in buildings:
        building_curve = rs.coercecurve(building)
        building_vertices = list(building_curve.ToPolyline().ToArray())

        # Compute the U-V coordinates of the footprint vertices within the grid
        building_mapping = compute_building_indeces_quadrilateral(building_vertices, grid_points)
        mapping_info.append(building_mapping)

        # Add the mapping info list to parcel info (ensuring one nested list for all mappings)
        parcel_info.append(mapping_info)

    # Add the list of parcel_info (dimension + building mappings) to the main list
    generic_buildings_map.append(parcel_info)
# ---------- end custom_building_mapping ----------

# ----
# Master Random Seed
# (disable Building Generation
# Component when altering)
random_seed_integer = Slider(90, range=0..100)

# ----
# Custom parcel generation
generic_parcel_length_standard_deviation = Slider(19.5, range=0..100)
generic_parcel_length_standard_deviation_2 = Slider(19.5, range=0..100)
generic_parcel_length_standard_deviation_3 = Slider(10.6, range=0..100)
generic_parcel_length_standard_deviation_4 = Slider(9.5, range=0..100)
generic_parcel_width_standard_deviation = Slider(33.4, range=0..100)
generic_parcel_width_standard_deviation_2 = Slider(5.3, range=0..100)
generic_parcel_width_standard_deviation_3 = Slider(32.5, range=0..100)
generic_parcel_width_standard_deviation_4 = Slider(33.4, range=0..100)
generic_parcel_maximum_length = Slider(26.7, range=0..100)
generic_parcel_maximum_length_2 = Slider(10.3, range=0..100)
generic_parcel_maximum_length_3 = Slider(9.4, range=0..100)
generic_parcel_maximum_length_4 = Slider(9.1, range=0..100)
generic_parcel_minimum_length = Slider(13, range=0..100)
generic_parcel_minimum_length_2 = Slider(13, range=0..100)
generic_parcel_minimum_length_3 = Slider(8, range=0..100)
generic_parcel_minimum_length_4 = Slider(8, range=0..100)
generic_parcel_maximum_width = Slider(21, range=0..100)
generic_parcel_maximum_width_2 = Slider(17.1, range=0..100)
generic_parcel_maximum_width_3 = Slider(8.6, range=0..100)
generic_parcel_maximum_width_4 = Slider(13.8, range=0..100)
generic_parcel_minimum_width = Slider(16.8, range=0..100)
generic_parcel_minimum_width_2 = Slider(96.4, range=0..100)
generic_parcel_minimum_width_3 = Slider(12.8, range=0..100)
# # Enable the Building Generation components to see footprints and extrustions
# (might last 10 seconds to generate)
# 
# # Similar boundaries are fed to the Custom Parcel Generation component, since
# the parameters are volatile, and cannot be chosen throughout strongly varying
# boundary geometries
# 
# # The boundary clusters serve to connect to Building Generation components
# with different heights, to receive varying sizes in the output
# 
# # Alter the parcel generation parameters to your liking. Since some parameters are volatile,
# and the boundary geometries of the reference curves very irregular
# some results are nonsensical.
# Boundary Cluster #1
corner_parcel_minimum_width = Slider(26.2, range=0..100)
corner_parcel_minimum_width_2 = Slider(15.5, range=0..100)
corner_parcel_minimum_width_3 = Slider(13.9, range=0..100)
generic_parcel_minimum_width_4 = Slider(36.4, range=0..100)
corner_parcel_minimum_width_4 = Slider(19.5, range=0..100)
corner_parcel_maximum_width = Slider(30.3, range=0..100)
corner_parcel_maximum_angle = Slider(90, range=0..100)
corner_parcel_maximum_width_2 = Slider(24.9, range=0..100)
corner_parcel_maximum_angle_2 = Slider(90, range=0..100)
corner_parcel_maximum_width_3 = Slider(20, range=0..100)
corner_parcel_maximum_angle_3 = Slider(90, range=0..100)
corner_parcel_maximum_width_4 = Slider(22, range=0..100)
corner_parcel_maximum_angle_4 = Slider(90, range=0..100)
corner_parcel_minimum_angle = Slider(90, range=0..100)
corner_parcel_minimum_angle_2 = Slider(90, range=0..100)
corner_parcel_minimum_angle_3 = Slider(90, range=0..100)
corner_parcel_minimum_angle_4 = Slider(90, range=0..100)
indentation_reference_length = Slider(0, range=0..100)
indentation_reference_length_2 = Slider(0, range=0..100)
indentation_reference_length_3 = Slider(0, range=0..100)
indentation_reference_length_4 = Slider(0, range=0..100)
generic_parcel_mean_length = Slider(13, range=0..100)
generic_parcel_mean_length_2 = Slider(13.3, range=0..100)
generic_parcel_mean_length_3 = Slider(13, range=0..100)
generic_parcel_mean_length_4 = Slider(14, range=0..100)
generic_parcel_mean_width = Slider(17.8, range=0..100)
generic_parcel_mean_width_2 = Slider(10, range=0..100)
generic_parcel_mean_width_3 = Slider(10, range=0..100)
generic_parcel_mean_width_4 = Slider(11.5, range=0..100)
random_seed_integer_2 = Slider(6, range=0..10)
random_seed_integer_3 = Slider(6, range=0..10)
random_seed_integer_4 = Slider(6, range=0..10)
random_seed_integer_5 = Slider(6, range=0..10)
penta_threshold = Slider(18.1, range=0..100)
penta_threshold_2 = Slider(7, range=0..100)
penta_threshold_3 = Slider(18, range=0..100)
penta_threshold_4 = Slider(26, range=0..100)
boundaries = Curve([<curve referenced from the Rhino model> x2])
boundaries_2 = Curve(<curve referenced from the Rhino model>)
boundaries_3 = Curve(<curve referenced from the Rhino model>)
boundaries_4 = Curve(<curve referenced from the Rhino model>)
custom_parcel_generation = Python3Script(
    boundaries=boundaries,
    cp_min_width=corner_parcel_minimum_width,
    cp_max_width=corner_parcel_maximum_width,
    cp_min_angle=corner_parcel_minimum_angle,
    cp_max_angle=corner_parcel_maximum_angle,
    gp_mean_length=generic_parcel_mean_length,
    gp_min_length=generic_parcel_minimum_length,
    gp_max_length=generic_parcel_maximum_length,
    gp_length_std=generic_parcel_length_standard_deviation,
    gp_mean_width=generic_parcel_mean_width,
    gp_min_width=generic_parcel_minimum_width,
    gp_max_width=generic_parcel_maximum_width,
    gp_width_std=generic_parcel_width_standard_deviation,
    ind_ref_length=indentation_reference_length,
    penta_threshold=penta_threshold,
    random_seed=random_seed_integer)  # -> all_parcels, all_parcels_building_generation; inputs boundaries: list, random_seed: Int32
# ---------- custom_parcel_generation: Python ----------
import rhinoscriptsyntax as rs
import Rhino.Geometry as rg
import random
import math

#####################################################################################

""" FUNCTIONS"""

# Function to rotate two lists together
def rotate_list(lst):
    # Get a random index as the new starting point
    random_index = random.randint(0, len(lst) - 1)
    # Rotate the list using slicing
    rotated_list = lst[random_index:] + lst[:random_index]
    return rotated_list

# Function to find the closest first value in each nested list compared to a reference
def find_closest_values(nested_list, reference):
    closest_value = None
    closest_list = None
    min_difference = float('inf')  # Start with a very large value for comparison
    # Iterate over the nested lists
    for sublist in nested_list:
        first_value = sublist[0]  # Get the first value of the current nested list
        difference = abs(first_value - reference)  # Calculate the difference
        # Check if this is the smallest difference so far
        if difference < min_difference:
            min_difference = difference
            closest_value = first_value
            closest_list = sublist
    if closest_list:
        return closest_list[1:]  # Get the other two values from the closest list
    else:
        return None

# Function to calculate signed area to determine polygon orientation
def signed_area(vertices):
    area = 0.0
    n = len(vertices)
    for i in range(n):
        x1, y1, _ = vertices[i]
        x2, y2, _ = vertices[(i + 1) % n]
        area += (x1 * y2 - x2 * y1)
    return area / 2.0

# Function to create unitized vectors refering to the (counter-clockwise) direction of each edge
def compute_vector(edge):
    edge_vector = rs.VectorUnitize(rs.VectorCreate(edge[1], edge[0]))
    return edge_vector

# Function to reverse any vector
def rev_vector(vector):
    reversed_vector = rs.VectorScale(vector, -1)
    return reversed_vector

# Function to get input angle vector
def angle_vec(start_point, end_point, angle):
    direction_vector = rg.Vector3d(end_point.X - start_point.X, end_point.Y - start_point.Y, 0)
    arg = math.radians(angle)
    rotated_x = direction_vector.X * math.cos(arg) - direction_vector.Y * math.sin(arg)
    rotated_y = direction_vector.X * math.sin(arg) + direction_vector.Y * math.cos(arg)
    angle_vector = rg.Vector3d(rotated_x, rotated_y, 0)
    angle_vector.Unitize()
    return angle_vector

# Function to interpolate between two vectors
def interpolate_vectors(vec1, vec2, t):
    interpolated_vec = rg.Vector3d(
        (1 - t) * vec1.X + t * vec2.X,
        (1 - t) * vec1.Y + t * vec2.Y,
        (1 - t) * vec1.Z + t * vec2.Z
    )
    interpolated_vec.Unitize()
    return interpolated_vec

# Function to receive intersection point of two vectors
def find_intersection(start_pt_1, vec_1, start_pt_2, vec_2):
    # Solve for t and s such that start_pt_1 + t*vec_1 = start_pt_2 + s*vec_2
    denom = vec_1.X * vec_2.Y - vec_1.Y * vec_2.X
    if denom == 0:
        return None  # Parallel lines, no intersection
    t = ((start_pt_2.X - start_pt_1.X) * vec_2.Y - (start_pt_2.Y - start_pt_1.Y) * vec_2.X) / denom
    s = ((start_pt_2.X - start_pt_1.X) * vec_1.Y - (start_pt_2.Y - start_pt_1.Y) * vec_1.X) / denom
    intersection = rg.Point3d(start_pt_1.X + t * vec_1.X, start_pt_1.Y + t * vec_1.Y, 0)
    return intersection

# Function to check polyline intersection
def check_polyline_intersection(polyline1, polyline2):
    curve1 = polyline1.ToNurbsCurve()  # Convert the polylines to curve objects
    curve2 = polyline2.ToNurbsCurve()
    intersection_events = rg.Intersect.Intersection.CurveCurve(curve1, curve2, 0.001, 0.0) # Check for curve-curve intersection
    if intersection_events.Count > 0:
        return True # If any intersections are found, return True
    else:
        return False # Otherwise, return False

def calculate_if_angle_between_edges_is_smaller_than_110(unit_vec_1, unit_vec_2): 
    dot_product = rg.Vector3d.Multiply(unit_vec_1, unit_vec_2)  # Compute the dot product
    dot_product = max(min(dot_product, 1.0), -1.0)  # Clamp the value to avoid numerical issues
    # Compute the angle in radians
    angle_radians = math.acos(dot_product)
    # Convert the angle to degrees
    angle_degrees = math.degrees(angle_radians)
    if angle_degrees < 110:
        return True  # Angle is smaller than 110°
    else:
        return False  # Angle is 110° or larger

def calculate_angle_between_edges(unit_vec_1, unit_vec_2): 
    dot_product = rg.Vector3d.Multiply(unit_vec_1, unit_vec_2)  # Compute the dot product
    dot_product = max(min(dot_product, 1.0), -1.0)  # Clamp the value to avoid numerical issues
    # Compute the angle in radians
    angle_radians = math.acos(dot_product)
    # Convert the angle to degrees
    angle_degrees = math.degrees(angle_radians)
    return angle_degrees 

# Function to  clamp value to stay within the given range [min_val, max_val].
def clamp(value, min_val, max_val):
    return max(min(value, max_val), min_val)

# Function to Apply a slight deviation to values in the local domain while ensuring they stay within the global domain.
def apply_deviation_within_domain(global_domain, local_domain, deviation_percentage=0.1):
    # Unpack global and local domains
    min_global, max_global = global_domain
    min_local, max_local = local_domain
    # Calculate the allowable deviation as a percentage of the local domain range
    deviation_range = (max_local - min_local) * deviation_percentage
    # Apply random deviation to the local domain values
    new_min = min_local + random.uniform(-deviation_range, deviation_range)
    new_max = max_local + random.uniform(-deviation_range, deviation_range)
    # Ensure the new values stay within the global domain by clamping
    new_min = clamp(new_min, min_global, max_global)
    new_max = clamp(new_max, min_global, max_global)
    return new_min, new_max

# Function to find corresponding dimensions
def find_matching_lengths(pairs, width):
    # Define tolerance (10% of difference max and min)
    widths = [pair[1] for pair in pairs]
    max_width = max(widths)
    min_width = min(widths)
    tolerance = 0.1*(max_width - min_width)
    # Define the domain around the random width (± tolerance)
    lower_bound = width - tolerance
    upper_bound = width + tolerance
    # Filter the pairs where the length is within the domain
    matching_pairs = [pair for pair in pairs if lower_bound <= pair[1] <= upper_bound]
    # If there are no matching pairs, random choice
    if not matching_pairs:
        selected_pair = random.choice(pairs)
        return selected_pair[0]
    else:
        # Randomly select one of the matching pairs and return the corresponding width
        selected_pair = random.choice(matching_pairs)
        # Return the matching lenght
        return selected_pair[0]

# Function to calculate the angle between 2 lines
def calculate_angle_between_lines(point_start, point_end1, point_end2):
    # Define the vectors based on the starting point and endpoints
    vector1 = [point_end1[0] - point_start[0], point_end1[1] - point_start[1]]
    vector2 = [point_end2[0] - point_start[0], point_end2[1] - point_start[1]]
    # Calculate the dot product of the two vectors
    dot_product = vector1[0] * vector2[0] + vector1[1] * vector2[1]
    # Calculate the magnitudes (lengths) of the two vectors
    magnitude1 = math.sqrt(vector1[0]**2 + vector1[1]**2)
    magnitude2 = math.sqrt(vector2[0]**2 + vector2[1]**2)
    # Calculate the cosine of the angle
    cos_theta = dot_product / (magnitude1 * magnitude2)
    # Calculate the angle in radians
    angle_radians = math.acos(cos_theta)
    # Convert the angle to degrees (optional)
    angle_degrees = math.degrees(angle_radians)
    return angle_degrees

#####################################################################################

# SHORTCUTS FOR LEGIBILITY:
# generic_parcels: "gp"
# corner_parcels: "gp"

###################################
""" INPUTS, LISTS AND CONSTANTS """

# Boundary curves are the input
boundary_curves = boundaries

# Set tolerance for geometric comparison
tolerance = 1e-5

# Set the random seed to ensure reproducible results
random.seed(random_seed)

# Initialize output
all_parcels = []
all_parcels_building_generation = []

# Reference boundary curve
ref_boundary_curve = boundary_curves[0]
ref_area = rs.CurveArea(ref_boundary_curve)[0]


##########################
""" SETTING THE SCENE """

for boundary_curve in boundary_curves:

    # Boundary curve input
    boundary_curve = rs.coercecurve(boundary_curve)  
    boundary_area = rs.CurveArea(boundary_curve)[0]
    boundary_area = round(boundary_area,2)
    boundary_vertices = boundary_curve.ToPolyline().ToArray()

    # Get scalar
    scalar_area = boundary_area / ref_area
    scalar =  round(math.sqrt(scalar_area),2)

    # Input
    corner_parcel_type = "quadrilateral"
    corner_dim = rg.Interval(scalar * cp_min_width, scalar * cp_max_width)
    cp_angle_mean = (cp_min_angle + cp_max_angle)/2
    cp_angles = []
    for i in range(len(boundary_vertices)-1):
        lb_angle = random.uniform(cp_min_angle, cp_angle_mean)
        ub_angle = random.uniform(cp_angle_mean, cp_max_angle)
        cp_angles.append([lb_angle, ub_angle])
    gp_lengths_mean = scalar * gp_mean_length
    gp_length_lb = scalar * gp_min_length
    gp_length_ub = scalar * gp_max_length
    gp_lengths_domain = rg.Interval(gp_length_lb, gp_length_ub)
    gp_lengths_sd = gp_length_std
    gp_widths_mean = scalar * gp_mean_width
    gp_width_lb = scalar * gp_min_width
    gp_width_ub = scalar * gp_max_width
    gp_widths_domain = rg.Interval(gp_width_lb, gp_width_ub)
    gp_widths_sd = gp_width_std
    indentation_reference_length = ind_ref_length * scalar
    gp_dim_pairs = []
    cp_dim_pairs = []
    for i in range(len(boundary_vertices)-1):
        gp_dim_1 = random.uniform(gp_lengths_domain[0], gp_lengths_domain[1])
        gp_dim_2 = random.uniform(gp_widths_domain[0], gp_widths_domain[1])
        gp_dim_pairs.append([gp_dim_1, gp_dim_2])
        cp_dim_1 = random.uniform(corner_dim[0], corner_dim[1])
        cp_dim_2 = random.uniform(corner_dim[0], corner_dim[1])
        cp_dim_3 = random.uniform(corner_dim[0], corner_dim[1])
        cp_dim_pairs.append([cp_dim_1, cp_dim_2])
        cp_dim_pairs.append([cp_dim_1, cp_dim_2, cp_dim_3])
    penta_threshold = penta_threshold

    

    # Initialize lists to store data and geometry
    generic_parcels = []
    corner_parcels = []
    cp_vertices = []
    cp_config = []


    ###################################
    """ BOUNDARY POLYGON DISSECTION """

    # Get the boundary polygon edges and vertices
    boundary_pts = rs.PolylineVertices(boundary_curve)
    if len(boundary_pts) < 4:
        raise ValueError("Invalid Boundary, must have at least three vertices")
    if boundary_pts[0] != boundary_pts[len(boundary_pts)-1]:
        raise ValueError("Boundary Polygon must be a closed Polyline Curve")

    # Ensure counter-clockwise order for consistent polyline construction
    if signed_area(boundary_pts) < 0:
        boundary_pts.reverse()  # Reverse the order to make it counter-clockwise

    # Create a list of edges (based on boundary point index)
    edges = [(boundary_pts[i], boundary_pts[(i + 1) % len(boundary_pts)]) for i in range(len(boundary_pts) - 1)]

    # Create unit vectors, to ensure accurate geometric operations according to the boundary edge vectors.
    unit_vecs = []
    for i in range(len(boundary_pts)-1):
        unit_vecs.append(compute_vector(edges[i]))

    # Determine if angle between edges is less than 110 or obtuse and assign to corresponding boundary point index
    angle_small = []
    for i in range(len(boundary_pts)-1):
        acute_boolean = calculate_if_angle_between_edges_is_smaller_than_110(unit_vecs[i], rev_vector(unit_vecs[(i-1) % len(unit_vecs)]))
        angle_small.append(acute_boolean)

    # Split corner dim lists
    cp_dim_duo = []
    cp_dim_trio = []

    # Iterate over the original list and sort based on the length of each nested list
    for dimension_pair in cp_dim_pairs:
        if len(dimension_pair) == 3:
            cp_dim_trio.append(dimension_pair)
        elif len(dimension_pair) == 2:
            cp_dim_duo.append(dimension_pair)


    ##############################
    """ CREATE CORNER PARCELS """

    # Configurations for while loop
    i = 0 # Initialize the loop counter i
    max_iterations = len(boundary_pts) * 2  # Allow for double the length of boundary points as a safeguard
    safeguard = 0 #  Initialize safeguard to prevent infinite loops
    first_iteration = True
    stored_width = 0

    # Iterate over each corner
    while i < (len(boundary_pts)-1) and safeguard < max_iterations:
        
        # Increment safeguard to track progress
        safeguard += 1

        # For legibility of code
        j = (i-1) % len(edges) 
        k = (i+1) % len(edges)

        if first_iteration:
            control_dist = edges[j][0].DistanceTo(edges[j][1])
            if control_dist <= penta_threshold:
                first_iteration = False
                continue
            else:
                first_iteration = False

        # Establish edge distances
        edge_distance_1 = edges[i][0].DistanceTo(edges[i][1])
        edge_distance_2 = edges[j][0].DistanceTo(edges[j][1])
        edge_distance_3 = edges[k][0].DistanceTo(edges[k][1])  


        # Assign corner config based upon threshold
        control_dist = edges[i][0].DistanceTo(edges[i][1])
        if control_dist > penta_threshold:
            corner_parcel_type = "quadrilateral"
            
        elif control_dist <= penta_threshold:
            corner_parcel_type = "pentalateral"
            

        # Create quadrilateral corner parcel
        if corner_parcel_type == "quadrilateral" and angle_small[i] == True: 
            
            # Get relevant angles of boundary polygon
            bp_angle = calculate_angle_between_edges(rev_vector(unit_vecs[j]), unit_vecs[i])

            # Generate random width and height for each corner parcel based upon the corner dimensions
            cp_dim_choice = random.choice(cp_dim_duo)
            cp_dim_local = rg.Interval(cp_dim_choice[0], cp_dim_choice[1])
 
            # If assigned domain exceeds half of edges dimensions, cap the width
            corner_width_1, corner_width_2 = apply_deviation_within_domain(corner_dim, cp_dim_local, deviation_percentage=0.25)
            if edge_distance_1/2 < corner_width_1:
                corner_width_1 = round(random.uniform(edge_distance_1 * (1/4), edge_distance_1 * (1/3)))
            elif edge_distance_2/2 < corner_width_2:
                corner_width_2 = round(random.uniform(edge_distance_2 * (1/4), edge_distance_2 * (1/3)))

            # Get angles
            r = random.randint(0, (len(cp_angles)-1))
            angle_1 = cp_angles[r][0]
            angle_2 = cp_angles[r][1]

            # Avoid overlap if angle is very acute
            if bp_angle <= 80:
                angle_1 = 90
                angle_2 = 90
                if corner_width_1 > corner_width_2:
                    corner_width_2 = random.uniform(corner_width_1 * 0.7, corner_width_1 * 0.9)
                else:
                    corner_width_1 = random.uniform(corner_width_2 * 0.7, corner_width_2 * 0.9)

            # Adjust corner parcel angles if boundary polygon angle is obtuse
            if bp_angle >= 100:
                angle_correction = (bp_angle - random.uniform(85, 95)) * 0.5
                angle_2 = angle_2 - angle_correction
                     
            # Control stored width
            if corner_width_2 > edge_distance_1 - stored_width:
                corner_width_2 = stored_width                     
            
            # Construct polyline vertices
            cp_0 = edges[i][0] 
            cp_1 = rs.PointAdd(cp_0, unit_vecs[i] * corner_width_1)
            cp_3 = rs.PointAdd(cp_0, rev_vector(unit_vecs[j]) * corner_width_2)
            cp_2 = find_intersection(cp_1, angle_vec(edges[i][0], edges[i][1], angle_1), cp_3, angle_vec(edges[j][0], edges[j][1], angle_2))

            # Create quadrilateral polyline
            corner_polyline = [cp_0, cp_1, cp_2, cp_3, cp_0]
            corner_parcels.append(rs.AddPolyline(corner_polyline))
            cp_vertices.append(corner_polyline)
            cp_config.append("quadrilateral")

            # Increment loop counter by 1
            i += 1

            # Store width to compare in next iteration
            stored_width = corner_width_1

        # Create pentalateral corner parcels if angle is larger than 110°
        elif corner_parcel_type == "quadrilateral" and angle_small[i] == False:


            cp_dim_choice = random.choice(cp_dim_duo)
            cp_dim_local = rg.Interval(cp_dim_choice[0], cp_dim_choice[1])

            # If assigned domain exceeds half of edges dimensions, cap the width
            corner_width_1, corner_width_2 = apply_deviation_within_domain(corner_dim, cp_dim_local, deviation_percentage=0.25)
            if edge_distance_1/2 < corner_width_1:
                corner_width_1 = round(random.uniform(edge_distance_1 * (1/4), edge_distance_1 * (1/3)))
                print("ok")
            elif edge_distance_2/2 < corner_width_2:
                corner_width_2 = round(random.uniform(edge_distance_2 * (1/4), edge_distance_2 * (1/3)))

            # Control geometry by limiting height between corner widths
            corner_height = random.uniform(corner_width_1, corner_width_2)

            # Get angles
            r = random.randint(0, (len(cp_angles)-1))
            angle_1 = cp_angles[r][0]
            angle_2 = cp_angles[r][1]

            # Construct polyline vertices
            cp_0 = edges[i][0]
            cp_1 = rs.PointAdd(cp_0, unit_vecs[i] * corner_width_1)
            cp_2 = rs.PointAdd(cp_1, angle_vec(edges[i][0], edges[i][1], angle_1) * corner_height)
            cp_4 = rs.PointAdd(cp_0, rev_vector(unit_vecs[j]) * corner_width_2)
            cp_3 = rs.PointAdd(cp_4, angle_vec(edges[j][0], edges[j][1], angle_2) * corner_height)

            # Determine possible intersection(s) to ensure appropriate geometry of corner parcel
            control_curve_1 = rg.Polyline([cp_1, cp_2]).ToNurbsCurve() 
            control_curve_2 = rg.Polyline([cp_3, cp_4]).ToNurbsCurve()
            intersection = rg.Intersect.Intersection.CurveCurve(control_curve_1, control_curve_2, tolerance, tolerance)

            # If the curves do not intersect, create pentalateral corner parcel
            if intersection.Count == 0:
                corner_polyline = [cp_0, cp_1, cp_2, cp_3, cp_4, cp_0]
                corner_parcels.append(rs.AddPolyline(corner_polyline)) # Construct current iteration of corner
                cp_vertices.append(corner_polyline)
                cp_config.append("pentalateral_1c")
                test = cp_0

            # If they intersect (since corner_height is too large) create quadrilateral parcel instead, even if the boundary edges' angle is obtuse
            elif intersection[0].IsPoint:
                cp_2 = intersection[0].PointA
                cp_3 = cp_4  # Adjust index, so that it is consistent with the other quadrilateral corner parcels
                corner_polyline = [cp_0, cp_1, cp_2, cp_3, cp_0]
                corner_parcels.append(rs.AddPolyline(corner_polyline))
                cp_vertices.append(corner_polyline)
                cp_config.append("quadrilateral")  

            # Increment loop counter by 1
            i += 1


        # Create pentalateral corner parcel
        elif corner_parcel_type == "pentalateral":

            # Get relevant angles of boundary polygon
            bp_angle_1 = calculate_angle_between_edges(rev_vector(unit_vecs[j]), unit_vecs[i])
            bp_angle_2 = calculate_angle_between_edges(rev_vector(unit_vecs[i]), unit_vecs[k])

            # Generate random width and height for each corner parcel based upon the corner dimensions
            # Establish reference with control distance (and look in cp dim trios)
            corresponding_dim = find_closest_values(cp_dim_trio, control_dist)
            cp_dim_local = rg.Interval(corresponding_dim[0], corresponding_dim[1])
            corner_width_1, corner_width_2 = apply_deviation_within_domain(corner_dim, cp_dim_local, deviation_percentage=0.3)

            # Adjust dimensions according to edge distance
            if corner_width_1 < edge_distance_1/2:
                corner_width_1 = random.uniform(edge_distance_1 * (1/2), edge_distance_1*(3/4))
            if corner_width_2 < edge_distance_1/2:
                corner_width_2 = random.uniform(edge_distance_1 * (1/2), edge_distance_1*(3/4))

            # Make sure that the widths don't deviate too much from each other
            corner_width_2 = random.uniform(corner_width_1 * 0.8, corner_width_2 * 1.2)

            # Adjust widths corresponding to angle deviation for reasonable results
            if bp_angle_1 > 90:
                corner_ratio = 90/bp_angle_1
                corner_width_2 *= corner_ratio * (random.uniform(0.8, 0.9))
            if bp_angle_2 > 90:
                corner_ratio = 90/bp_angle_2
                corner_width_1 *= corner_ratio * (random.uniform(0.8, 0.9))

            # Get angles
            r = random.randint(0, (len(cp_angles)-1))
            angle_1 = cp_angles[r][0]
            angle_2 = cp_angles[r][1]

            # Construct polyline vertices
            cp_0 = edges[i][0]
            cp_1 = edges[i][1]
            cp_2 = rs.PointAdd(cp_1, unit_vecs[k] * corner_width_1)
            cp_4 = rs.PointAdd(cp_0, rev_vector(unit_vecs[j]) * corner_width_2)
            cp_3 = find_intersection(cp_2, angle_vec(edges[k][0], edges[k][1], angle_1), cp_4, angle_vec(edges[j][0], edges[j][1], angle_2))

            # Create pentalateral polyline
            corner_polyline = [cp_0, cp_1, cp_2, cp_3, cp_4, cp_0]
            corner_parcels.append(rs.AddPolyline(corner_polyline))
            cp_vertices.append(corner_polyline)
            cp_config.append("pentalateral_2c")

            # Increment loop counter by 2
            i += 2



    ##############################
    """ SETTING THE SCENE TO CREATE GENERIC PARCELS """

    # Get distances between the corner parcels
    cp_distances = []

    for i in range(len(cp_vertices)):
        # For legibility of code
        j = (i-1) % len(cp_vertices) 
        k = (i+1) % len(cp_vertices)
        # Get start point of distance
        if cp_config[i] == "quadrilateral" or cp_config[i] == "pentalateral_1c":
            start_pt = cp_vertices[i][1]
        elif cp_config[i] == "pentalateral_2c":
            start_pt = cp_vertices[i][2]
        # Get end point of distance
        if cp_config[k] == "quadrilateral":
            end_pt = cp_vertices[k][3]
        elif cp_config[k] == "pentalateral_1c" or cp_config[k] == "pentalateral_2c":
            end_pt = cp_vertices[k][4]
        # Get distance
        distance = rs.Distance(start_pt, end_pt)
        cp_distances.append(distance)

    # Get generic parcel indentation count based upon indentation_reference_length
    gp_indentation_count = []

    # Get generic parcel counts based upon minimum and maximum gp_lengths
    gp_on_edge_count = []

    for cp_distance in cp_distances:

        # Get a random value in the lower and upper bound of gp_lengths
        length_dom_low = int(random.uniform(gp_lengths_domain[0] + (gp_lengths_mean - gp_lengths_domain[0])*(3/4), gp_lengths_mean))
        length_dom_upper = int(random.uniform(gp_lengths_mean, gp_lengths_domain[1] - (gp_lengths_domain[1] - gp_lengths_mean)*(3/4)))

        # Create bounds (these are somewhat arbitrary)
        indentation_ref_lower_bound = int(random.uniform(length_dom_low, indentation_reference_length * 0.8))
        indentation_ref_upper_bound = int(random.uniform(indentation_reference_length * 1.2, length_dom_upper))

        # Get generic parcel counts
        ref_length_gp_counts = random.choice([length_dom_low, length_dom_upper])
        
        # Ensure ref_length_gp_counts is smaller than cp_distance to avoid excessive counts
        if ref_length_gp_counts >= cp_distance:
            ref_length_gp_counts = cp_distance * 0.9  # Ensure it's a bit smaller than cp_distance
        
        gp_count = max(1, cp_distance // ref_length_gp_counts)  # Ensure minimum gp_count is 1
        gp_on_edge_count.append(int(gp_count))
        
        # Get indentation counts
        ref_length_indentation = round(random.uniform(indentation_ref_lower_bound, indentation_ref_upper_bound), 2)
        
        # Ensure ref_length_indentation is smaller than cp_distance to avoid negative indentation count
        if ref_length_indentation >= cp_distance:
            ref_length_indentation = cp_distance * 0.8  # Ensure it's a bit smaller than cp_distance

        if ref_length_indentation != 0: 
            indentation_count = cp_distance // ref_length_indentation
        else:
            indentation_count = 2
        
        # Avoid negative indentation count and ensure it doesn't exceed gp_count
        if indentation_count > (gp_count - 1):
            gp_indentation_count.append(int(gp_count - 1))
        else:
            gp_indentation_count.append(int(max(0, indentation_count)))


    # Ensure no overlap between the adjacent edges:
    control_cp_distance = min(cp_distances)/2
    if (control_cp_distance) < gp_widths_domain[1]:
        gp_widths_domain_cap = round(control_cp_distance*(3/4), 2)
    else:
        gp_widths_domain_cap = gp_widths_domain[1]



    ##############################
    """ CREATE GENERIC PARCELS """

    # ASSIGN WIDTHS OF GENERIC PARCELS

    unbounded = random.choice([False, True])
    avoid_overlap = False
    last_dim_diff = 0

    # Iterate through all corner parcels
    for i in range(len(corner_parcels)):

        # For legibility of code
        j = (i+1) % len(corner_parcels) 

        # Avoid overlap in last chunck of generic parcel generation
        if i == (len(corner_parcels) - 1):
            unbounded = False

        # Apply start pointsand cp_angle_1 according to cp_config
        if cp_config[i] == "quadrilateral" or cp_config[i] == "pentalateral_1c":
            strip_start_pt_bot = cp_vertices[i][1]
            strip_start_pt_top = cp_vertices[i][2]
            cp_angle_1 = calculate_angle_between_lines(cp_vertices[i][2], cp_vertices[i][1], cp_vertices[i][3])
        elif cp_config[i] == "pentalateral_2c":
            strip_start_pt_bot = cp_vertices[i][2]
            strip_start_pt_top = cp_vertices[i][3]
            cp_angle_1 = calculate_angle_between_lines(cp_vertices[i][3], cp_vertices[i][2], cp_vertices[i][4])

        # Apply end points and cp_angle_2 according to cp_config
        if cp_config[j] == "quadrilateral":
            strip_end_pt_bot = cp_vertices[j][3]
            strip_end_pt_top = cp_vertices[j][2]
            cp_angle_2 = calculate_angle_between_lines(cp_vertices[j][2], cp_vertices[j][1], cp_vertices[j][3])
        elif cp_config[j] == "pentalateral_1c" or cp_config[j] == "pentalateral_2c":
            strip_end_pt_bot = cp_vertices[j][4]
            strip_end_pt_top = cp_vertices[j][3]
            cp_angle_2 = calculate_angle_between_lines(cp_vertices[j][3], cp_vertices[j][2], cp_vertices[j][4])

        # Create the geometric domain, in which the generic parcels can be generated (strips)
        strip_length_bot = rs.Distance(strip_start_pt_bot, strip_end_pt_bot)
        strip_length_top = rs.Distance(strip_start_pt_top, strip_end_pt_top)
        strip_width_1 = rs.Distance(strip_start_pt_bot, strip_start_pt_top)
        strip_width_2 = rs.Distance(strip_end_pt_bot, strip_end_pt_top)

        # Append first width separately (to avoid overlap)
        if gp_indentation_count[i] == 0 and gp_widths_domain[0] > strip_width_2:
            first_gp_width = strip_width_2
        elif cp_angle_1 > 90:
            first_gp_width = strip_width_1
        elif cp_angle_1 <= 90 and cp_angle_2 <= 90 and avoid_overlap == False and i != (len(gp_indentation_count) - 1):
            first_gp_width = random.uniform(gp_widths_domain[0], gp_widths_domain_cap)
        else:
            first_gp_width = random.uniform(gp_widths_domain[0], strip_width_1)
        first_gp_length = find_matching_lengths(gp_dim_pairs, first_gp_width)
        if first_gp_length < last_dim_diff:
            first_gp_length = random.uniform(last_dim_diff, gp_lengths_domain[1])
        
        # Initialize generic parcel widths
        gp_widths = [first_gp_width] 

        # Append as many width values as the indentation count
        for indent in range(gp_indentation_count[i]):
            
            if unbounded == False:
                if indent == gp_indentation_count[i] - 1: 
                    if gp_widths_domain[0] > strip_width_2:
                        gp_widths.append(strip_width_2)
                    else:
                        gp_widths.append(random.uniform(gp_widths_domain[0], strip_width_2))
                elif strip_width_1 > strip_width_2:
                    gp_widths.append(random.uniform(gp_widths_domain[0], strip_width_2))
                else:
                    gp_widths.append(random.uniform(gp_widths_domain[0], strip_width_1))

            elif indent == gp_indentation_count[i] - 1:
                if gp_widths_domain[0] > strip_width_2:
                    gp_widths.append(strip_width_2)
                else:
                    gp_widths.append(random.uniform(gp_widths_domain[0], strip_width_2))

            elif cp_angle_1 > 90:         
                gp_random_width = round(random.gauss(gp_widths_mean, gp_widths_sd), 2)
                domain_control = cp_vertices[j][1].DistanceTo(cp_vertices[j][2]) + cp_vertices[j][2].DistanceTo(cp_vertices[j][3]) 
                if domain_control < gp_widths_domain_cap:
                    maximum_domain = domain_control
                elif domain_control >= gp_widths_domain_cap:
                    maximum_domain = gp_widths_domain_cap
                gp_width = max(gp_widths_domain[0], min(gp_random_width, maximum_domain), 2)
                gp_widths.append(round(max(first_gp_width, min(gp_width, maximum_domain)), 2)) # Clamp the random width to the domain

            elif cp_angle_1 < 90 or cp_angle_2 < 90:
                gp_widths.append(strip_width_1 if strip_width_1 > strip_width_2 else strip_width_2)
                unbounded = True

            else:
                gp_widths.append(round(random.uniform(gp_widths_domain[0],gp_widths_domain_cap), 2))

        # Pass over "avoid overlap" boolean for next loop
        last_width = gp_widths[len(gp_widths)-1]
        last_dim_diff = last_width - strip_width_2
        if last_dim_diff > 0:
            avoid_overlap = True
        
        # Every iteration shifts unbounded (to avoid overlap)
        unbounded = not unbounded

        # Make sure that no width falls below 5m
        for min_idx in range(len(gp_widths)-1):
            if gp_widths[min_idx] < 5:
                gp_widths[min_idx] = 5

        # Hard code the width if there is only one parcel
        if len(gp_widths) == 1:
            gp_widths = []
            if strip_width_1 <= strip_width_2:
                hardcoded_width = random.uniform(strip_width_1*(3/4), strip_width_1)
            else:
                hardcoded_width = random.uniform(strip_width_2*(3/4), strip_width_2) 
            gp_widths.append(hardcoded_width)


        # ASSIGN LENGHTS OF GENERIC PARCEL

        # Ensure that first gp length is long enough (to avoid overlap)
        if first_gp_length < last_dim_diff:
            first_gp_length = last_dim_diff

        # Create generic parcel lengths
        gp_lengths = [first_gp_length]

        # Append as many length values as the gp_on_edge_count
        for amount in range(gp_on_edge_count[i]-1):
            gp_random_length = round(random.gauss(gp_lengths_mean, gp_lengths_sd), 2)
            gp_length = max(gp_lengths_domain[0], min(gp_random_length, gp_lengths_domain[1]))
            gp_lengths.append(gp_length)

        # Adjust the generated parcel lengths to ensure their sum matches the length of strip_length_bot
        total_gp_length = sum(gp_lengths)
        scaling_factor = strip_length_bot / total_gp_length

        # Scale the lengths to match the total length of strip_length_bot
        gp_lengths_front = [gp_length * scaling_factor for gp_length in gp_lengths]

        # Clamp the values to ensure they fall within the domain
        for n in range(len(gp_lengths_front)):
            if gp_lengths_front[n] < gp_lengths_domain[0]:
                gp_lengths_front[n] = gp_lengths_domain[0]
            elif gp_lengths_front[n] > gp_lengths_domain[1]:
                gp_lengths_front[n] = gp_lengths_domain[1]
        total_length_after_adjustment = sum(gp_lengths_front)
        deviation = total_length_after_adjustment - strip_length_bot

        # Subtract deviation from the largest length in the list
        if deviation != 0:
            max_index = gp_lengths_front.index(max(gp_lengths_front))
            gp_lengths_front[max_index] -= deviation

        # Calculate proportions of parcel lengths to strip lengths and ensure same proportional distribution for strip rear end
        proportions = [length / strip_length_bot for length in gp_lengths_front]
        gp_lengths_back = [prop * strip_length_top for prop in proportions]


        # CONSTRUCT GENERIC PARCELS

        # Initialize vectors for parcel construction
        gp_vec_front = rg.Vector3d(strip_end_pt_bot.X - strip_start_pt_bot.X, strip_end_pt_bot.Y - strip_start_pt_bot.Y, 0)
        gp_vec_front.Unitize()
        gp_vec_back = rg.Vector3d(strip_end_pt_top.X - strip_start_pt_top.X, strip_end_pt_top.Y - strip_start_pt_top.Y, 0)
        gp_vec_back.Unitize()
        gp_vec_side_1 = rg.Vector3d(strip_start_pt_top.X - strip_start_pt_bot.X, strip_start_pt_top.Y - strip_start_pt_bot.Y, 0)
        gp_vec_side_1.Unitize()
        gp_vec_side_2 = rg.Vector3d(strip_end_pt_top.X - strip_end_pt_bot.X, strip_end_pt_top.Y - strip_end_pt_bot.Y, 0)
        gp_vec_side_2.Unitize()

        # Assign widths according to indentation count
        indentation_bool = [True] * (gp_indentation_count[i]) + [False] * ((gp_on_edge_count[i] - gp_indentation_count[i]) - 2)
        random.shuffle(indentation_bool)
        indentation_bool = [False] + indentation_bool + [False]
        assigned_widths = []
        idx = 0
        for n in range(gp_on_edge_count[i]):
            if indentation_bool[n] == True:
                idx = min(idx + 1, len(gp_widths) - 1)
            assigned_widths.append(gp_widths[idx])
        
        # Initialize lists to store cumulative lengths
        front_offset = 0
        back_offset = 0

        # Create generic parcels by iterating through the lengths
        for n in range(len(gp_lengths_front)):

            # If there is only one very slender generic parcel between corner parcels, skip that parcel
            if len(gp_lengths_front) == 1 and gp_lengths_front[n] < 5:
                continue

            # Skip the parcel if it is shorter than 4 meters
            if gp_lengths_front[n] < 4:
                continue

            # Calculate an interpolation factor based on the current offset:
            t_1 = front_offset / strip_length_bot
            # Interpolate the side vector between gp_vec_side_1 and gp_vec_side_2
            gp_vec_side_interpolated_1 = interpolate_vectors(gp_vec_side_1, gp_vec_side_2, t_1)

            # Calculate an interpolation factor based on the current offset:
            t_2 = (front_offset + gp_lengths_front[n]) / strip_length_bot
            # Interpolate the side vector between gp_vec_side_1 and gp_vec_side_2
            gp_vec_side_interpolated_2 = interpolate_vectors(gp_vec_side_1, gp_vec_side_2, t_2)

            # Calculate the back side reference point based on the assigned width from the gp_widths pool
            back_ref_pt = rs.PointAdd(strip_start_pt_bot, gp_vec_side_interpolated_2 * assigned_widths[n])

            # Calculate the points for the parcel based on the cumulative offsets
            front_start = rs.PointAdd(strip_start_pt_bot, gp_vec_front * front_offset)
            front_end = rs.PointAdd(strip_start_pt_bot, gp_vec_front * (front_offset + gp_lengths_front[n])) 
            back_start = rs.PointAdd(front_start, gp_vec_side_interpolated_1 * assigned_widths[n])
            back_end = rs.PointAdd(front_end, gp_vec_side_interpolated_2 * assigned_widths[n])
            test = back_start
            # back_end = rs.PointAdd(back_ref_pt, gp_vec_front * (back_offset + gp_lengths_back[n]))

            # Define the parcel points
            generic_parcel = [
                front_start,
                front_end,
                back_end,
                back_start,
                front_start
            ]

            # Add the polyline for the parcel
            generic_parcels.append(rs.AddPolyline(generic_parcel))

            # Update the offsets for the next parcel
            front_offset += gp_lengths_front[n]
            back_offset += gp_lengths_back[n]



    ###############
    """ OUTPUTS """

    # Append corner parcels and generic parcels, such that it can be read by building generation component
    all_parcel_list_for_bg = corner_parcels + generic_parcels
    all_parcels_building_generation.append(all_parcel_list_for_bg)

    # Append corner parcels and generic parcels to all parcels
    for cp in corner_parcels:
        all_parcels.append(cp)
    for gp in generic_parcels:
        all_parcels.append(gp)
# ---------- end custom_parcel_generation ----------
custom_parcel_generation_2 = Python3Script(
    boundaries=boundaries_2,
    cp_min_width=corner_parcel_minimum_width_2,
    cp_max_width=corner_parcel_maximum_width_2,
    cp_min_angle=corner_parcel_minimum_angle_2,
    cp_max_angle=corner_parcel_maximum_angle_2,
    gp_mean_length=generic_parcel_mean_length_2,
    gp_min_length=generic_parcel_minimum_length_2,
    gp_max_length=generic_parcel_maximum_length_2,
    gp_length_std=generic_parcel_length_standard_deviation_2,
    gp_mean_width=generic_parcel_mean_width_2,
    gp_min_width=generic_parcel_minimum_width_2,
    gp_max_width=generic_parcel_maximum_width_2,
    gp_width_std=generic_parcel_width_standard_deviation_2,
    ind_ref_length=indentation_reference_length_2,
    penta_threshold=penta_threshold_2,
    random_seed=random_seed_integer)  # -> all_parcels, all_parcels_building_generation; inputs boundaries: list, random_seed: Int32
# ---------- custom_parcel_generation_2: Python ----------
import rhinoscriptsyntax as rs
import Rhino.Geometry as rg
import random
import math

#####################################################################################

""" FUNCTIONS"""

# Function to rotate two lists together
def rotate_list(lst):
    # Get a random index as the new starting point
    random_index = random.randint(0, len(lst) - 1)
    # Rotate the list using slicing
    rotated_list = lst[random_index:] + lst[:random_index]
    return rotated_list

# Function to find the closest first value in each nested list compared to a reference
def find_closest_values(nested_list, reference):
    closest_value = None
    closest_list = None
    min_difference = float('inf')  # Start with a very large value for comparison
    # Iterate over the nested lists
    for sublist in nested_list:
        first_value = sublist[0]  # Get the first value of the current nested list
        difference = abs(first_value - reference)  # Calculate the difference
        # Check if this is the smallest difference so far
        if difference < min_difference:
            min_difference = difference
            closest_value = first_value
            closest_list = sublist
    if closest_list:
        return closest_list[1:]  # Get the other two values from the closest list
    else:
        return None

# Function to calculate signed area to determine polygon orientation
def signed_area(vertices):
    area = 0.0
    n = len(vertices)
    for i in range(n):
        x1, y1, _ = vertices[i]
        x2, y2, _ = vertices[(i + 1) % n]
        area += (x1 * y2 - x2 * y1)
    return area / 2.0

# Function to create unitized vectors refering to the (counter-clockwise) direction of each edge
def compute_vector(edge):
    edge_vector = rs.VectorUnitize(rs.VectorCreate(edge[1], edge[0]))
    return edge_vector

# Function to reverse any vector
def rev_vector(vector):
    reversed_vector = rs.VectorScale(vector, -1)
    return reversed_vector

# Function to get input angle vector
def angle_vec(start_point, end_point, angle):
    direction_vector = rg.Vector3d(end_point.X - start_point.X, end_point.Y - start_point.Y, 0)
    arg = math.radians(angle)
    rotated_x = direction_vector.X * math.cos(arg) - direction_vector.Y * math.sin(arg)
    rotated_y = direction_vector.X * math.sin(arg) + direction_vector.Y * math.cos(arg)
    angle_vector = rg.Vector3d(rotated_x, rotated_y, 0)
    angle_vector.Unitize()
    return angle_vector

# Function to interpolate between two vectors
def interpolate_vectors(vec1, vec2, t):
    interpolated_vec = rg.Vector3d(
        (1 - t) * vec1.X + t * vec2.X,
        (1 - t) * vec1.Y + t * vec2.Y,
        (1 - t) * vec1.Z + t * vec2.Z
    )
    interpolated_vec.Unitize()
    return interpolated_vec

# Function to receive intersection point of two vectors
def find_intersection(start_pt_1, vec_1, start_pt_2, vec_2):
    # Solve for t and s such that start_pt_1 + t*vec_1 = start_pt_2 + s*vec_2
    denom = vec_1.X * vec_2.Y - vec_1.Y * vec_2.X
    if denom == 0:
        return None  # Parallel lines, no intersection
    t = ((start_pt_2.X - start_pt_1.X) * vec_2.Y - (start_pt_2.Y - start_pt_1.Y) * vec_2.X) / denom
    s = ((start_pt_2.X - start_pt_1.X) * vec_1.Y - (start_pt_2.Y - start_pt_1.Y) * vec_1.X) / denom
    intersection = rg.Point3d(start_pt_1.X + t * vec_1.X, start_pt_1.Y + t * vec_1.Y, 0)
    return intersection

# Function to check polyline intersection
def check_polyline_intersection(polyline1, polyline2):
    curve1 = polyline1.ToNurbsCurve()  # Convert the polylines to curve objects
    curve2 = polyline2.ToNurbsCurve()
    intersection_events = rg.Intersect.Intersection.CurveCurve(curve1, curve2, 0.001, 0.0) # Check for curve-curve intersection
    if intersection_events.Count > 0:
        return True # If any intersections are found, return True
    else:
        return False # Otherwise, return False

def calculate_if_angle_between_edges_is_smaller_than_110(unit_vec_1, unit_vec_2): 
    dot_product = rg.Vector3d.Multiply(unit_vec_1, unit_vec_2)  # Compute the dot product
    dot_product = max(min(dot_product, 1.0), -1.0)  # Clamp the value to avoid numerical issues
    # Compute the angle in radians
    angle_radians = math.acos(dot_product)
    # Convert the angle to degrees
    angle_degrees = math.degrees(angle_radians)
    if angle_degrees < 110:
        return True  # Angle is smaller than 110°
    else:
        return False  # Angle is 110° or larger

def calculate_angle_between_edges(unit_vec_1, unit_vec_2): 
    dot_product = rg.Vector3d.Multiply(unit_vec_1, unit_vec_2)  # Compute the dot product
    dot_product = max(min(dot_product, 1.0), -1.0)  # Clamp the value to avoid numerical issues
    # Compute the angle in radians
    angle_radians = math.acos(dot_product)
    # Convert the angle to degrees
    angle_degrees = math.degrees(angle_radians)
    return angle_degrees 

# Function to  clamp value to stay within the given range [min_val, max_val].
def clamp(value, min_val, max_val):
    return max(min(value, max_val), min_val)

# Function to Apply a slight deviation to values in the local domain while ensuring they stay within the global domain.
def apply_deviation_within_domain(global_domain, local_domain, deviation_percentage=0.1):
    # Unpack global and local domains
    min_global, max_global = global_domain
    min_local, max_local = local_domain
    # Calculate the allowable deviation as a percentage of the local domain range
    deviation_range = (max_local - min_local) * deviation_percentage
    # Apply random deviation to the local domain values
    new_min = min_local + random.uniform(-deviation_range, deviation_range)
    new_max = max_local + random.uniform(-deviation_range, deviation_range)
    # Ensure the new values stay within the global domain by clamping
    new_min = clamp(new_min, min_global, max_global)
    new_max = clamp(new_max, min_global, max_global)
    return new_min, new_max

# Function to find corresponding dimensions
def find_matching_lengths(pairs, width):
    # Define tolerance (10% of difference max and min)
    widths = [pair[1] for pair in pairs]
    max_width = max(widths)
    min_width = min(widths)
    tolerance = 0.1*(max_width - min_width)
    # Define the domain around the random width (± tolerance)
    lower_bound = width - tolerance
    upper_bound = width + tolerance
    # Filter the pairs where the length is within the domain
    matching_pairs = [pair for pair in pairs if lower_bound <= pair[1] <= upper_bound]
    # If there are no matching pairs, random choice
    if not matching_pairs:
        selected_pair = random.choice(pairs)
        return selected_pair[0]
    else:
        # Randomly select one of the matching pairs and return the corresponding width
        selected_pair = random.choice(matching_pairs)
        # Return the matching lenght
        return selected_pair[0]

# Function to calculate the angle between 2 lines
def calculate_angle_between_lines(point_start, point_end1, point_end2):
    # Define the vectors based on the starting point and endpoints
    vector1 = [point_end1[0] - point_start[0], point_end1[1] - point_start[1]]
    vector2 = [point_end2[0] - point_start[0], point_end2[1] - point_start[1]]
    # Calculate the dot product of the two vectors
    dot_product = vector1[0] * vector2[0] + vector1[1] * vector2[1]
    # Calculate the magnitudes (lengths) of the two vectors
    magnitude1 = math.sqrt(vector1[0]**2 + vector1[1]**2)
    magnitude2 = math.sqrt(vector2[0]**2 + vector2[1]**2)
    # Calculate the cosine of the angle
    cos_theta = dot_product / (magnitude1 * magnitude2)
    # Calculate the angle in radians
    angle_radians = math.acos(cos_theta)
    # Convert the angle to degrees (optional)
    angle_degrees = math.degrees(angle_radians)
    return angle_degrees

#####################################################################################

# SHORTCUTS FOR LEGIBILITY:
# generic_parcels: "gp"
# corner_parcels: "gp"

###################################
""" INPUTS, LISTS AND CONSTANTS """

# Boundary curves are the input
boundary_curves = boundaries

# Set tolerance for geometric comparison
tolerance = 1e-5

# Set the random seed to ensure reproducible results
random.seed(random_seed)

# Initialize output
all_parcels = []
all_parcels_building_generation = []

# Reference boundary curve
ref_boundary_curve = boundary_curves[0]
ref_area = rs.CurveArea(ref_boundary_curve)[0]


##########################
""" SETTING THE SCENE """

for boundary_curve in boundary_curves:

    # Boundary curve input
    boundary_curve = rs.coercecurve(boundary_curve)  
    boundary_area = rs.CurveArea(boundary_curve)[0]
    boundary_area = round(boundary_area,2)
    boundary_vertices = boundary_curve.ToPolyline().ToArray()

    # Get scalar
    scalar_area = boundary_area / ref_area
    scalar =  round(math.sqrt(scalar_area),2)

    # Custom Inputs
    corner_parcel_type = "quadrilateral"
    corner_dim = rg.Interval(scalar * cp_min_width, scalar * cp_max_width)
    cp_angle_mean = (cp_min_angle + cp_max_angle)/2
    cp_angles = []
    for i in range(len(boundary_vertices)-1):
        lb_angle = random.uniform(cp_min_angle, cp_angle_mean)
        ub_angle = random.uniform(cp_angle_mean, cp_max_angle)
        cp_angles.append([lb_angle, ub_angle])
    gp_lengths_mean = scalar * gp_mean_length
    gp_length_lb = scalar * gp_min_length
    gp_length_ub = scalar * gp_max_length
    gp_lengths_domain = rg.Interval(gp_length_lb, gp_length_ub)
    gp_lengths_sd = gp_length_std
    gp_widths_mean = scalar * gp_mean_width
    gp_width_lb = scalar * gp_min_width
    gp_width_ub = scalar * gp_max_width
    gp_widths_domain = rg.Interval(gp_width_lb, gp_width_ub)
    gp_widths_sd = gp_width_std
    indentation_reference_length = ind_ref_length * scalar
    gp_dim_pairs = []
    cp_dim_pairs = []
    for i in range(len(boundary_vertices)-1):
        gp_dim_1 = random.uniform(gp_lengths_domain[0], gp_lengths_domain[1])
        gp_dim_2 = random.uniform(gp_widths_domain[0], gp_widths_domain[1])
        gp_dim_pairs.append([gp_dim_1, gp_dim_2])
        cp_dim_1 = random.uniform(corner_dim[0], corner_dim[1])
        cp_dim_2 = random.uniform(corner_dim[0], corner_dim[1])
        cp_dim_3 = random.uniform(corner_dim[0], corner_dim[1])
        cp_dim_pairs.append([cp_dim_1, cp_dim_2])
        cp_dim_pairs.append([cp_dim_1, cp_dim_2, cp_dim_3])
    penta_threshold = penta_threshold

    

    # Initialize lists to store data and geometry
    generic_parcels = []
    corner_parcels = []
    cp_vertices = []
    cp_config = []


    ###################################
    """ BOUNDARY POLYGON DISSECTION """

    # Get the boundary polygon edges and vertices
    boundary_pts = rs.PolylineVertices(boundary_curve)
    if len(boundary_pts) < 4:
        raise ValueError("Invalid Boundary, must have at least three vertices")
    if boundary_pts[0] != boundary_pts[len(boundary_pts)-1]:
        raise ValueError("Boundary Polygon must be a closed Polyline Curve")

    # Ensure counter-clockwise order for consistent polyline construction
    if signed_area(boundary_pts) < 0:
        boundary_pts.reverse()  # Reverse the order to make it counter-clockwise

    # Create a list of edges (based on boundary point index)
    edges = [(boundary_pts[i], boundary_pts[(i + 1) % len(boundary_pts)]) for i in range(len(boundary_pts) - 1)]

    # Create unit vectors, to ensure accurate geometric operations according to the boundary edge vectors.
    unit_vecs = []
    for i in range(len(boundary_pts)-1):
        unit_vecs.append(compute_vector(edges[i]))

    # Determine if angle between edges is less than 110 or obtuse and assign to corresponding boundary point index
    angle_small = []
    for i in range(len(boundary_pts)-1):
        acute_boolean = calculate_if_angle_between_edges_is_smaller_than_110(unit_vecs[i], rev_vector(unit_vecs[(i-1) % len(unit_vecs)]))
        angle_small.append(acute_boolean)

    # Split corner dim lists
    cp_dim_duo = []
    cp_dim_trio = []

    # Iterate over the original list and sort based on the length of each nested list
    for dimension_pair in cp_dim_pairs:
        if len(dimension_pair) == 3:
            cp_dim_trio.append(dimension_pair)
        elif len(dimension_pair) == 2:
            cp_dim_duo.append(dimension_pair)


    ##############################
    """ CREATE CORNER PARCELS """

    # Configurations for while loop
    i = 0 # Initialize the loop counter i
    max_iterations = len(boundary_pts) * 2  # Allow for double the length of boundary points as a safeguard
    safeguard = 0 #  Initialize safeguard to prevent infinite loops
    first_iteration = True
    stored_width = 0

    # Iterate over each corner
    while i < (len(boundary_pts)-1) and safeguard < max_iterations:
        
        # Increment safeguard to track progress
        safeguard += 1

        # For legibility of code
        j = (i-1) % len(edges) 
        k = (i+1) % len(edges)

        if first_iteration:
            control_dist = edges[j][0].DistanceTo(edges[j][1])
            if control_dist <= penta_threshold:
                first_iteration = False
                continue
            else:
                first_iteration = False

        # Establish edge distances
        edge_distance_1 = edges[i][0].DistanceTo(edges[i][1])
        edge_distance_2 = edges[j][0].DistanceTo(edges[j][1])
        edge_distance_3 = edges[k][0].DistanceTo(edges[k][1])  


        # Assign corner config based upon threshold
        control_dist = edges[i][0].DistanceTo(edges[i][1])
        if control_dist > penta_threshold:
            corner_parcel_type = "quadrilateral"
            
        elif control_dist <= penta_threshold:
            corner_parcel_type = "pentalateral"
            

        # Create quadrilateral corner parcel
        if corner_parcel_type == "quadrilateral" and angle_small[i] == True: 
            
            # Get relevant angles of boundary polygon
            bp_angle = calculate_angle_between_edges(rev_vector(unit_vecs[j]), unit_vecs[i])

            # Generate random width and height for each corner parcel based upon the corner dimensions
            cp_dim_choice = random.choice(cp_dim_duo)
            cp_dim_local = rg.Interval(cp_dim_choice[0], cp_dim_choice[1])
 
            # If assigned domain exceeds half of edges dimensions, cap the width
            corner_width_1, corner_width_2 = apply_deviation_within_domain(corner_dim, cp_dim_local, deviation_percentage=0.25)
            if edge_distance_1/2 < corner_width_1:
                corner_width_1 = round(random.uniform(edge_distance_1 * (1/4), edge_distance_1 * (1/3)))
            elif edge_distance_2/2 < corner_width_2:
                corner_width_2 = round(random.uniform(edge_distance_2 * (1/4), edge_distance_2 * (1/3)))

            # Get angles
            r = random.randint(0, (len(cp_angles)-1))
            angle_1 = cp_angles[r][0]
            angle_2 = cp_angles[r][1]

            # Avoid overlap if angle is very acute
            if bp_angle <= 80:
                angle_1 = 90
                angle_2 = 90
                if corner_width_1 > corner_width_2:
                    corner_width_2 = random.uniform(corner_width_1 * 0.7, corner_width_1 * 0.9)
                else:
                    corner_width_1 = random.uniform(corner_width_2 * 0.7, corner_width_2 * 0.9)

            # Adjust corner parcel angles if boundary polygon angle is obtuse
            if bp_angle >= 100:
                angle_correction = (bp_angle - random.uniform(85, 95)) * 0.5
                angle_2 = angle_2 - angle_correction
                     
            # Control stored width
            if corner_width_2 > edge_distance_1 - stored_width:
                corner_width_2 = stored_width                     
            
            # Construct polyline vertices
            cp_0 = edges[i][0] 
            cp_1 = rs.PointAdd(cp_0, unit_vecs[i] * corner_width_1)
            cp_3 = rs.PointAdd(cp_0, rev_vector(unit_vecs[j]) * corner_width_2)
            cp_2 = find_intersection(cp_1, angle_vec(edges[i][0], edges[i][1], angle_1), cp_3, angle_vec(edges[j][0], edges[j][1], angle_2))

            # Create quadrilateral polyline
            corner_polyline = [cp_0, cp_1, cp_2, cp_3, cp_0]
            corner_parcels.append(rs.AddPolyline(corner_polyline))
            cp_vertices.append(corner_polyline)
            cp_config.append("quadrilateral")

            # Increment loop counter by 1
            i += 1

            # Store width to compare in next iteration
            stored_width = corner_width_1

        # Create pentalateral corner parcels if angle is larger than 110°
        elif corner_parcel_type == "quadrilateral" and angle_small[i] == False:


            cp_dim_choice = random.choice(cp_dim_duo)
            cp_dim_local = rg.Interval(cp_dim_choice[0], cp_dim_choice[1])

            # If assigned domain exceeds half of edges dimensions, cap the width
            corner_width_1, corner_width_2 = apply_deviation_within_domain(corner_dim, cp_dim_local, deviation_percentage=0.25)
            if edge_distance_1/2 < corner_width_1:
                corner_width_1 = round(random.uniform(edge_distance_1 * (1/4), edge_distance_1 * (1/3)))
                print("ok")
            elif edge_distance_2/2 < corner_width_2:
                corner_width_2 = round(random.uniform(edge_distance_2 * (1/4), edge_distance_2 * (1/3)))

            # Control geometry by limiting height between corner widths
            corner_height = random.uniform(corner_width_1, corner_width_2)

            # Get angles
            r = random.randint(0, (len(cp_angles)-1))
            angle_1 = cp_angles[r][0]
            angle_2 = cp_angles[r][1]

            # Construct polyline vertices
            cp_0 = edges[i][0]
            cp_1 = rs.PointAdd(cp_0, unit_vecs[i] * corner_width_1)
            cp_2 = rs.PointAdd(cp_1, angle_vec(edges[i][0], edges[i][1], angle_1) * corner_height)
            cp_4 = rs.PointAdd(cp_0, rev_vector(unit_vecs[j]) * corner_width_2)
            cp_3 = rs.PointAdd(cp_4, angle_vec(edges[j][0], edges[j][1], angle_2) * corner_height)

            # Determine possible intersection(s) to ensure appropriate geometry of corner parcel
            control_curve_1 = rg.Polyline([cp_1, cp_2]).ToNurbsCurve() 
            control_curve_2 = rg.Polyline([cp_3, cp_4]).ToNurbsCurve()
            intersection = rg.Intersect.Intersection.CurveCurve(control_curve_1, control_curve_2, tolerance, tolerance)

            # If the curves do not intersect, create pentalateral corner parcel
            if intersection.Count == 0:
                corner_polyline = [cp_0, cp_1, cp_2, cp_3, cp_4, cp_0]
                corner_parcels.append(rs.AddPolyline(corner_polyline)) # Construct current iteration of corner
                cp_vertices.append(corner_polyline)
                cp_config.append("pentalateral_1c")
                test = cp_0

            # If they intersect (since corner_height is too large) create quadrilateral parcel instead, even if the boundary edges' angle is obtuse
            elif intersection[0].IsPoint:
                cp_2 = intersection[0].PointA
                cp_3 = cp_4  # Adjust index, so that it is consistent with the other quadrilateral corner parcels
                corner_polyline = [cp_0, cp_1, cp_2, cp_3, cp_0]
                corner_parcels.append(rs.AddPolyline(corner_polyline))
                cp_vertices.append(corner_polyline)
                cp_config.append("quadrilateral")  

            # Increment loop counter by 1
            i += 1


        # Create pentalateral corner parcel
        elif corner_parcel_type == "pentalateral":

            # Get relevant angles of boundary polygon
            bp_angle_1 = calculate_angle_between_edges(rev_vector(unit_vecs[j]), unit_vecs[i])
            bp_angle_2 = calculate_angle_between_edges(rev_vector(unit_vecs[i]), unit_vecs[k])

            # Generate random width and height for each corner parcel based upon the corner dimensions
            # Establish reference with control distance (and look in cp dim trios)
            corresponding_dim = find_closest_values(cp_dim_trio, control_dist)
            cp_dim_local = rg.Interval(corresponding_dim[0], corresponding_dim[1])
            corner_width_1, corner_width_2 = apply_deviation_within_domain(corner_dim, cp_dim_local, deviation_percentage=0.3)

            # Adjust dimensions according to edge distance
            if corner_width_1 < edge_distance_1/2:
                corner_width_1 = random.uniform(edge_distance_1 * (1/2), edge_distance_1*(3/4))
            if corner_width_2 < edge_distance_1/2:
                corner_width_2 = random.uniform(edge_distance_1 * (1/2), edge_distance_1*(3/4))

            # Make sure that the widths don't deviate too much from each other
            corner_width_2 = random.uniform(corner_width_1 * 0.8, corner_width_2 * 1.2)

            # Adjust widths corresponding to angle deviation for reasonable results
            if bp_angle_1 > 90:
                corner_ratio = 90/bp_angle_1
                corner_width_2 *= corner_ratio * (random.uniform(0.8, 0.9))
            if bp_angle_2 > 90:
                corner_ratio = 90/bp_angle_2
                corner_width_1 *= corner_ratio * (random.uniform(0.8, 0.9))

            # Get angles
            r = random.randint(0, (len(cp_angles)-1))
            angle_1 = cp_angles[r][0]
            angle_2 = cp_angles[r][1]

            # Construct polyline vertices
            cp_0 = edges[i][0]
            cp_1 = edges[i][1]
            cp_2 = rs.PointAdd(cp_1, unit_vecs[k] * corner_width_1)
            cp_4 = rs.PointAdd(cp_0, rev_vector(unit_vecs[j]) * corner_width_2)
            cp_3 = find_intersection(cp_2, angle_vec(edges[k][0], edges[k][1], angle_1), cp_4, angle_vec(edges[j][0], edges[j][1], angle_2))

            # Create pentalateral polyline
            corner_polyline = [cp_0, cp_1, cp_2, cp_3, cp_4, cp_0]
            corner_parcels.append(rs.AddPolyline(corner_polyline))
            cp_vertices.append(corner_polyline)
            cp_config.append("pentalateral_2c")

            # Increment loop counter by 2
            i += 2



    ##############################
    """ SETTING THE SCENE TO CREATE GENERIC PARCELS """

    # Get distances between the corner parcels
    cp_distances = []

    for i in range(len(cp_vertices)):
        # For legibility of code
        j = (i-1) % len(cp_vertices) 
        k = (i+1) % len(cp_vertices)
        # Get start point of distance
        if cp_config[i] == "quadrilateral" or cp_config[i] == "pentalateral_1c":
            start_pt = cp_vertices[i][1]
        elif cp_config[i] == "pentalateral_2c":
            start_pt = cp_vertices[i][2]
        # Get end point of distance
        if cp_config[k] == "quadrilateral":
            end_pt = cp_vertices[k][3]
        elif cp_config[k] == "pentalateral_1c" or cp_config[k] == "pentalateral_2c":
            end_pt = cp_vertices[k][4]
        # Get distance
        distance = rs.Distance(start_pt, end_pt)
        cp_distances.append(distance)

    # Get generic parcel indentation count based upon indentation_reference_length
    gp_indentation_count = []

    # Get generic parcel counts based upon minimum and maximum gp_lengths
    gp_on_edge_count = []

    for cp_distance in cp_distances:

        # Get a random value in the lower and upper bound of gp_lengths
        length_dom_low = int(random.uniform(gp_lengths_domain[0] + (gp_lengths_mean - gp_lengths_domain[0])*(3/4), gp_lengths_mean))
        length_dom_upper = int(random.uniform(gp_lengths_mean, gp_lengths_domain[1] - (gp_lengths_domain[1] - gp_lengths_mean)*(3/4)))

        # Create bounds (these are somewhat arbitrary)
        indentation_ref_lower_bound = int(random.uniform(length_dom_low, indentation_reference_length * 0.8))
        indentation_ref_upper_bound = int(random.uniform(indentation_reference_length * 1.2, length_dom_upper))

        # Get generic parcel counts
        ref_length_gp_counts = random.choice([length_dom_low, length_dom_upper])
        
        # Ensure ref_length_gp_counts is smaller than cp_distance to avoid excessive counts
        if ref_length_gp_counts >= cp_distance:
            ref_length_gp_counts = cp_distance * 0.9  # Ensure it's a bit smaller than cp_distance
        
        gp_count = max(1, cp_distance // ref_length_gp_counts)  # Ensure minimum gp_count is 1
        gp_on_edge_count.append(int(gp_count))
        
        # Get indentation counts
        ref_length_indentation = round(random.uniform(indentation_ref_lower_bound, indentation_ref_upper_bound), 2)
        
        # Ensure ref_length_indentation is smaller than cp_distance to avoid negative indentation count
        if ref_length_indentation >= cp_distance:
            ref_length_indentation = cp_distance * 0.8  # Ensure it's a bit smaller than cp_distance

        if ref_length_indentation != 0: 
            indentation_count = cp_distance // ref_length_indentation
        else:
            indentation_count = 2
        
        # Avoid negative indentation count and ensure it doesn't exceed gp_count
        if indentation_count > (gp_count - 1):
            gp_indentation_count.append(int(gp_count - 1))
        else:
            gp_indentation_count.append(int(max(0, indentation_count)))


    # Ensure no overlap between the adjacent edges:
    control_cp_distance = min(cp_distances)/2
    if (control_cp_distance) < gp_widths_domain[1]:
        gp_widths_domain_cap = round(control_cp_distance*(3/4), 2)
    else:
        gp_widths_domain_cap = gp_widths_domain[1]



    ##############################
    """ CREATE GENERIC PARCELS """

    # ASSIGN WIDTHS OF GENERIC PARCELS

    unbounded = random.choice([False, True])
    avoid_overlap = False
    last_dim_diff = 0

    # Iterate through all corner parcels
    for i in range(len(corner_parcels)):

        # For legibility of code
        j = (i+1) % len(corner_parcels) 

        # Avoid overlap in last chunck of generic parcel generation
        if i == (len(corner_parcels) - 1):
            unbounded = False

        # Apply start pointsand cp_angle_1 according to cp_config
        if cp_config[i] == "quadrilateral" or cp_config[i] == "pentalateral_1c":
            strip_start_pt_bot = cp_vertices[i][1]
            strip_start_pt_top = cp_vertices[i][2]
            cp_angle_1 = calculate_angle_between_lines(cp_vertices[i][2], cp_vertices[i][1], cp_vertices[i][3])
        elif cp_config[i] == "pentalateral_2c":
            strip_start_pt_bot = cp_vertices[i][2]
            strip_start_pt_top = cp_vertices[i][3]
            cp_angle_1 = calculate_angle_between_lines(cp_vertices[i][3], cp_vertices[i][2], cp_vertices[i][4])

        # Apply end points and cp_angle_2 according to cp_config
        if cp_config[j] == "quadrilateral":
            strip_end_pt_bot = cp_vertices[j][3]
            strip_end_pt_top = cp_vertices[j][2]
            cp_angle_2 = calculate_angle_between_lines(cp_vertices[j][2], cp_vertices[j][1], cp_vertices[j][3])
        elif cp_config[j] == "pentalateral_1c" or cp_config[j] == "pentalateral_2c":
            strip_end_pt_bot = cp_vertices[j][4]
            strip_end_pt_top = cp_vertices[j][3]
            cp_angle_2 = calculate_angle_between_lines(cp_vertices[j][3], cp_vertices[j][2], cp_vertices[j][4])

        # Create the geometric domain, in which the generic parcels can be generated (strips)
        strip_length_bot = rs.Distance(strip_start_pt_bot, strip_end_pt_bot)
        strip_length_top = rs.Distance(strip_start_pt_top, strip_end_pt_top)
        strip_width_1 = rs.Distance(strip_start_pt_bot, strip_start_pt_top)
        strip_width_2 = rs.Distance(strip_end_pt_bot, strip_end_pt_top)

        # Append first width separately (to avoid overlap)
        if gp_indentation_count[i] == 0 and gp_widths_domain[0] > strip_width_2:
            first_gp_width = strip_width_2
        elif cp_angle_1 > 90:
            first_gp_width = strip_width_1
        elif cp_angle_1 <= 90 and cp_angle_2 <= 90 and avoid_overlap == False and i != (len(gp_indentation_count) - 1):
            first_gp_width = random.uniform(gp_widths_domain[0], gp_widths_domain_cap)
        else:
            first_gp_width = random.uniform(gp_widths_domain[0], strip_width_1)
        first_gp_length = find_matching_lengths(gp_dim_pairs, first_gp_width)
        if first_gp_length < last_dim_diff:
            first_gp_length = random.uniform(last_dim_diff, gp_lengths_domain[1])
        
        # Initialize generic parcel widths
        gp_widths = [first_gp_width] 

        # Append as many width values as the indentation count
        for indent in range(gp_indentation_count[i]):
            
            if unbounded == False:
                if indent == gp_indentation_count[i] - 1: 
                    if gp_widths_domain[0] > strip_width_2:
                        gp_widths.append(strip_width_2)
                    else:
                        gp_widths.append(random.uniform(gp_widths_domain[0], strip_width_2))
                elif strip_width_1 > strip_width_2:
                    gp_widths.append(random.uniform(gp_widths_domain[0], strip_width_2))
                else:
                    gp_widths.append(random.uniform(gp_widths_domain[0], strip_width_1))

            elif indent == gp_indentation_count[i] - 1:
                if gp_widths_domain[0] > strip_width_2:
                    gp_widths.append(strip_width_2)
                else:
                    gp_widths.append(random.uniform(gp_widths_domain[0], strip_width_2))

            elif cp_angle_1 > 90:         
                gp_random_width = round(random.gauss(gp_widths_mean, gp_widths_sd), 2)
                domain_control = cp_vertices[j][1].DistanceTo(cp_vertices[j][2]) + cp_vertices[j][2].DistanceTo(cp_vertices[j][3]) 
                if domain_control < gp_widths_domain_cap:
                    maximum_domain = domain_control
                elif domain_control >= gp_widths_domain_cap:
                    maximum_domain = gp_widths_domain_cap
                gp_width = max(gp_widths_domain[0], min(gp_random_width, maximum_domain), 2)
                gp_widths.append(round(max(first_gp_width, min(gp_width, maximum_domain)), 2)) # Clamp the random width to the domain

            elif cp_angle_1 < 90 or cp_angle_2 < 90:
                gp_widths.append(strip_width_1 if strip_width_1 > strip_width_2 else strip_width_2)
                unbounded = True

            else:
                gp_widths.append(round(random.uniform(gp_widths_domain[0],gp_widths_domain_cap), 2))

        # Pass over "avoid overlap" boolean for next loop
        last_width = gp_widths[len(gp_widths)-1]
        last_dim_diff = last_width - strip_width_2
        if last_dim_diff > 0:
            avoid_overlap = True
        
        # Every iteration shifts unbounded (to avoid overlap)
        unbounded = not unbounded

        # Make sure that no width falls below 5m
        for min_idx in range(len(gp_widths)-1):
            if gp_widths[min_idx] < 5:
                gp_widths[min_idx] = 5

        # Hard code the width if there is only one parcel
        if len(gp_widths) == 1:
            gp_widths = []
            if strip_width_1 <= strip_width_2:
                hardcoded_width = random.uniform(strip_width_1*(3/4), strip_width_1)
            else:
                hardcoded_width = random.uniform(strip_width_2*(3/4), strip_width_2) 
            gp_widths.append(hardcoded_width)


        # ASSIGN LENGHTS OF GENERIC PARCEL

        # Ensure that first gp length is long enough (to avoid overlap)
        if first_gp_length < last_dim_diff:
            first_gp_length = last_dim_diff

        # Create generic parcel lengths
        gp_lengths = [first_gp_length]

        # Append as many length values as the gp_on_edge_count
        for amount in range(gp_on_edge_count[i]-1):
            gp_random_length = round(random.gauss(gp_lengths_mean, gp_lengths_sd), 2)
            gp_length = max(gp_lengths_domain[0], min(gp_random_length, gp_lengths_domain[1]))
            gp_lengths.append(gp_length)

        # Adjust the generated parcel lengths to ensure their sum matches the length of strip_length_bot
        total_gp_length = sum(gp_lengths)
        scaling_factor = strip_length_bot / total_gp_length

        # Scale the lengths to match the total length of strip_length_bot
        gp_lengths_front = [gp_length * scaling_factor for gp_length in gp_lengths]

        # Clamp the values to ensure they fall within the domain
        for n in range(len(gp_lengths_front)):
            if gp_lengths_front[n] < gp_lengths_domain[0]:
                gp_lengths_front[n] = gp_lengths_domain[0]
            elif gp_lengths_front[n] > gp_lengths_domain[1]:
                gp_lengths_front[n] = gp_lengths_domain[1]
        total_length_after_adjustment = sum(gp_lengths_front)
        deviation = total_length_after_adjustment - strip_length_bot

        # Subtract deviation from the largest length in the list
        if deviation != 0:
            max_index = gp_lengths_front.index(max(gp_lengths_front))
            gp_lengths_front[max_index] -= deviation

        # Calculate proportions of parcel lengths to strip lengths and ensure same proportional distribution for strip rear end
        proportions = [length / strip_length_bot for length in gp_lengths_front]
        gp_lengths_back = [prop * strip_length_top for prop in proportions]


        # CONSTRUCT GENERIC PARCELS

        # Initialize vectors for parcel construction
        gp_vec_front = rg.Vector3d(strip_end_pt_bot.X - strip_start_pt_bot.X, strip_end_pt_bot.Y - strip_start_pt_bot.Y, 0)
        gp_vec_front.Unitize()
        gp_vec_back = rg.Vector3d(strip_end_pt_top.X - strip_start_pt_top.X, strip_end_pt_top.Y - strip_start_pt_top.Y, 0)
        gp_vec_back.Unitize()
        gp_vec_side_1 = rg.Vector3d(strip_start_pt_top.X - strip_start_pt_bot.X, strip_start_pt_top.Y - strip_start_pt_bot.Y, 0)
        gp_vec_side_1.Unitize()
        gp_vec_side_2 = rg.Vector3d(strip_end_pt_top.X - strip_end_pt_bot.X, strip_end_pt_top.Y - strip_end_pt_bot.Y, 0)
        gp_vec_side_2.Unitize()

        # Assign widths according to indentation count
        indentation_bool = [True] * (gp_indentation_count[i]) + [False] * ((gp_on_edge_count[i] - gp_indentation_count[i]) - 2)
        random.shuffle(indentation_bool)
        indentation_bool = [False] + indentation_bool + [False]
        assigned_widths = []
        idx = 0
        for n in range(gp_on_edge_count[i]):
            if indentation_bool[n] == True:
                idx = min(idx + 1, len(gp_widths) - 1)
            assigned_widths.append(gp_widths[idx])
        
        # Initialize lists to store cumulative lengths
        front_offset = 0
        back_offset = 0

        # Create generic parcels by iterating through the lengths
        for n in range(len(gp_lengths_front)):

            # If there is only one very slender generic parcel between corner parcels, skip that parcel
            if len(gp_lengths_front) == 1 and gp_lengths_front[n] < 5:
                continue

            # Skip the parcel if it is shorter than 4 meters
            if gp_lengths_front[n] < 4:
                continue

            # Calculate an interpolation factor based on the current offset:
            t_1 = front_offset / strip_length_bot
            # Interpolate the side vector between gp_vec_side_1 and gp_vec_side_2
            gp_vec_side_interpolated_1 = interpolate_vectors(gp_vec_side_1, gp_vec_side_2, t_1)

            # Calculate an interpolation factor based on the current offset:
            t_2 = (front_offset + gp_lengths_front[n]) / strip_length_bot
            # Interpolate the side vector between gp_vec_side_1 and gp_vec_side_2
            gp_vec_side_interpolated_2 = interpolate_vectors(gp_vec_side_1, gp_vec_side_2, t_2)

            # Calculate the back side reference point based on the assigned width from the gp_widths pool
            back_ref_pt = rs.PointAdd(strip_start_pt_bot, gp_vec_side_interpolated_2 * assigned_widths[n])

            # Calculate the points for the parcel based on the cumulative offsets
            front_start = rs.PointAdd(strip_start_pt_bot, gp_vec_front * front_offset)
            front_end = rs.PointAdd(strip_start_pt_bot, gp_vec_front * (front_offset + gp_lengths_front[n])) 
            back_start = rs.PointAdd(front_start, gp_vec_side_interpolated_1 * assigned_widths[n])
            back_end = rs.PointAdd(front_end, gp_vec_side_interpolated_2 * assigned_widths[n])
            test = back_start
            # back_end = rs.PointAdd(back_ref_pt, gp_vec_front * (back_offset + gp_lengths_back[n]))

            # Define the parcel points
            generic_parcel = [
                front_start,
                front_end,
                back_end,
                back_start,
                front_start
            ]

            # Add the polyline for the parcel
            generic_parcels.append(rs.AddPolyline(generic_parcel))

            # Update the offsets for the next parcel
            front_offset += gp_lengths_front[n]
            back_offset += gp_lengths_back[n]



    ###############
    """ OUTPUTS """

    # Append corner parcels and generic parcels, such that it can be read by building generation component
    all_parcel_list_for_bg = corner_parcels + generic_parcels
    all_parcels_building_generation.append(all_parcel_list_for_bg)

    # Append corner parcels and generic parcels to all parcels
    for cp in corner_parcels:
        all_parcels.append(cp)
    for gp in generic_parcels:
        all_parcels.append(gp)
# ---------- end custom_parcel_generation_2 ----------
custom_parcel_generation_3 = Python3Script(
    boundaries=boundaries_3,
    cp_min_width=corner_parcel_minimum_width_3,
    cp_max_width=corner_parcel_maximum_width_3,
    cp_min_angle=corner_parcel_minimum_angle_3,
    cp_max_angle=corner_parcel_maximum_angle_3,
    gp_mean_length=generic_parcel_mean_length_3,
    gp_min_length=generic_parcel_minimum_length_3,
    gp_max_length=generic_parcel_maximum_length_3,
    gp_length_std=generic_parcel_length_standard_deviation_3,
    gp_mean_width=generic_parcel_mean_width_3,
    gp_min_width=generic_parcel_minimum_width_3,
    gp_max_width=generic_parcel_maximum_width_3,
    gp_width_std=generic_parcel_width_standard_deviation_3,
    ind_ref_length=indentation_reference_length_3,
    penta_threshold=penta_threshold_3,
    random_seed=random_seed_integer)  # -> all_parcels, all_parcels_building_generation; inputs boundaries: list, random_seed: Int32; same code as custom_parcel_generation
custom_parcel_generation_4 = Python3Script(
    boundaries=boundaries_4,
    cp_min_width=corner_parcel_minimum_width_4,
    cp_max_width=corner_parcel_maximum_width_4,
    cp_min_angle=corner_parcel_minimum_angle_4,
    cp_max_angle=corner_parcel_maximum_angle_4,
    gp_mean_length=generic_parcel_mean_length_4,
    gp_min_length=generic_parcel_minimum_length_4,
    gp_max_length=generic_parcel_maximum_length_4,
    gp_length_std=generic_parcel_length_standard_deviation_4,
    gp_mean_width=generic_parcel_mean_width_4,
    gp_min_width=generic_parcel_minimum_width_4,
    gp_max_width=generic_parcel_maximum_width_4,
    gp_width_std=generic_parcel_width_standard_deviation_4,
    ind_ref_length=indentation_reference_length_4,
    penta_threshold=penta_threshold_4,
    random_seed=random_seed_integer)  # -> all_parcels, all_parcels_building_generation; inputs boundaries: list, random_seed: Int32; same code as custom_parcel_generation

# ----
# Get Heights
number_slider = Slider(20, range=0..40)
get_heights = Python3Script(
    mean_height=number_slider,
    min_height=Slider(9, range=0..40),
    max_height=Slider(40, range=0..100),
    height_std=Slider(6, range=0..40))  # -> height_info; inputs buildings_3D: list
# ---------- get_heights: Python ----------
import Rhino
import rhinoscriptsyntax as rs
import Rhino.Geometry as rg
import math

#####################################################################################

""" FUNCTIONS """

# Function to retreive building height from 3D buildings
def get_building_height(building_id):
    # Get the bounding box of the object
    bbox = rs.BoundingBox(building_id)
    # Extract Z-coordinates of the bounding box corners
    min_z = bbox[0].Z
    max_z = bbox[4].Z
    # Height is the difference between the maximum and minimum Z values
    height = max_z - min_z
    return height

# Function to calculate mean
def calculate_mean(data):
    return sum(data) / len(data)

# Function to calculate standard deviation
def calculate_std(data):
    mean = calculate_mean(data)
    squared_differences = [(i - mean) ** 2 for i in data]  # Calculate squared differences
    variance = sum(squared_differences) / len(data)  # Find the variance
    return math.sqrt(variance)  # std = square root of the variance


################################
""" EXTRACT BUILDING HEIGHTS """

# Required inputs:
# Either "buildings_3D", which should be Brep extrusion GUIDs
# Or mean_height, min_height, max_height and height_std (integers of floats)

# Analyze building 3D input
if buildings_3D is not None:

    # Initialize list to store building heights
    building_heights = []

    # Iterate through all buildings
    for building in buildings_3D:
        height = get_building_height(building)
        building_heights.append(height)

    bh_mean = round(calculate_mean(building_heights), 2)
    bh_min = min(building_heights)
    bh_max = max(building_heights)
    bh_sd = round(calculate_std(building_heights), 2)

# If there is no building 3D input
else:
    bh_mean = mean_height
    bh_min = min_height
    bh_max = max_height
    bh_sd = height_std


# Outputs

height_info = [
    bh_mean,
    bh_min,
    bh_max,
    bh_sd
]
# ---------- end get_heights ----------

# ----
# Merge parcels and boundaries
merge_boundaries = Merge(Data1=boundaries, Data2=boundaries_2, Data3=boundaries_3, Data4=boundaries_4)
merge_parcels = Merge(
    Data1=custom_parcel_generation.all_parcels_building_generation,
    Data2=custom_parcel_generation_2.all_parcels_building_generation,
    Data3=custom_parcel_generation_3.all_parcels_building_generation,
    Data4=custom_parcel_generation_4.all_parcels_building_generation)

# ----
# Random seed
number_slider_2 = Slider(0, range=0..100)

# ----
# ENABLE
# Building Generation
# Floor-Area-Ratio
building_generation = Python3Script(
    boundaries=merge_boundaries,
    all_parcels_building_generation=merge_parcels,
    floor_area_ratio=Slider(25, range=0..51),
    corner_buildings_map=custom_building_mapping.corner_buildings_map,
    generic_buildings_map=custom_building_mapping.generic_buildings_map,
    height_info=get_heights,
    random_seed=number_slider_2)  # -> footprints, extrusions; inputs boundaries: list, all_parcels_building_generation: list, corner_buildings_map: list, generic_buildings_map: list, height_info: list; disabled
# ---------- building_generation: Python ----------
import Rhino
import rhinoscriptsyntax as rs
import Rhino.Geometry as rg
import Grasshopper
import random

#####################################################################################

""" FUNCTIONS"""

# Function to find the best match for each element in dimension pairs by calculating the deviation 
def find_best_matches(dimensions_list, buildings_map, aspect_ratio_weight):
    def_building_map = []
    # Make a copy of the buildings_map to modify during iteration
    available_buildings = buildings_map.copy() 
    original_buildings = buildings_map.copy()  # Keep the original list to reset later
    # Iterate through each dimension pair in dimensions_list
    for i in range(len(dimensions_list)):
        min_deviation = float("inf")
        best_match_index = None
        # Loop through each element in the available_buildings
        for j in range(len(available_buildings)):
            # Calculate the deviation for dimensions
            dim_deviation = abs(dimensions_list[i][0][0] - available_buildings[j][0][0]) + abs(dimensions_list[i][0][1] - available_buildings[j][0][1])
            # Calculate the aspect ratio deviation with aspect_ratio_weight
            aspect_ratio_deviation = aspect_ratio_weight * abs(dimensions_list[i][1] - available_buildings[j][1])
            # Calculate the total deviation
            total_deviation = dim_deviation + aspect_ratio_deviation
            # Check if this is the best match so far
            if total_deviation < min_deviation:
                min_deviation = total_deviation
                best_match_index = j 
        # Append the best match's building indices to def_building_map
        if best_match_index is not None:
            best_match = available_buildings[best_match_index]
            def_building_map.append(best_match[2])  # Extract and append building indices
            # Remove the matched building from available_buildings list so it can't be reused
            available_buildings.pop(best_match_index)
        # Reset the available_buildings list when its length is less than 2
        if len(available_buildings) < 2:
            available_buildings = original_buildings.copy()  # Reset to the original list
    return def_building_map


# Function to extrude polyline to closed brep
def extrude_polyline(polyline_curve, height):
    # Define tolerance
    tolerance = 0.001
    # Rebuild the polyline if necessary
    if not polyline_curve.IsClosed:
        polyline_curve.MakeClosed(tolerance)
    # Ensure the curve is consistently oriented upwards (positive Z)
    if not polyline_curve.ClosedCurveOrientation(rg.Plane.WorldXY) == rg.CurveOrientation.CounterClockwise:
        polyline_curve.Reverse()
    # Define the extrusion vector along the positive Z-axis, ensuring height is always positive
    extrusion_vector = rg.Vector3d(0, 0, abs(height))
    # Create the extrusion as an Extrusion object
    extrusion = rg.Extrusion.Create(polyline_curve, abs(height), True)
    # Convert the Extrusion object into a Brep
    brep = extrusion.ToBrep()
    # If the Brep is successfully created and is solid, return it
    if brep and brep.IsSolid:
        return brep
    else:
        # Try to cap planar holes if needed
        capped_brep = brep.CapPlanarHoles(tolerance)
        if capped_brep and capped_brep.IsSolid:
            return capped_brep
        else:
            return brep


# Function to check if any building footprint lies inside another and classify their relationship.
def check_building_footprints_inside(building_footprints, building_vertices, tolerance):
    # Initialize variables
    building_footprint_inside = False
    idx_outline_inside = None
    idx_outline_surrounding = None
    # Loop through all building footprints
    for j, footprint in enumerate(building_footprints):
        footprint = rs.coercecurve(footprint)
        # Loop through all other building vertices to check containment
        for k, vertices in enumerate(building_vertices):
            if j == k:
                continue
            # Flag to track if any point is outside
            is_outside = False
            # Check each vertex of the footprint
            for vertex in vertices:
                result = footprint.Contains(vertex, rg.Plane.WorldXY, tolerance)
                # If any point is outside, set the flag and break out of the loop
                if result != rg.PointContainment.Inside and result != rg.PointContainment.Coincident:
                    is_outside = True
                    break  # Break out of the 'vertices' loop and go to the next set of 'vertices' (k)
            # If any point was outside, skip to the next 'k'
            if is_outside:
                continue
            # Otherwise, if no point is outside, consider the footprint as "inside"
            building_footprint_inside = True
            idx_outline_inside = k
            idx_outline_surrounding = j
            return building_footprint_inside, idx_outline_inside, idx_outline_surrounding
    # Return results (False if no footprint was found inside another), and ints for the indeces
    return building_footprint_inside, idx_outline_inside, idx_outline_surrounding


# Clean mapped polyline if there are duplicate vertices
def clean_polyline(polyline):
    # Get the list of vertices of the polyline
    vertices = list(polyline.ToNurbsCurve().Points)
    # Check if the first and last vertices are the same
    if vertices[0].Location.DistanceTo(vertices[-1].Location) < tolerance:
        # Remove any consecutive duplicates from the end
        while len(vertices) > 1 and vertices[-2].Location.DistanceTo(vertices[-1].Location) < tolerance:
            vertices.pop(-1)
    # Ensure the polyline is closed by adding the first vertex at the end
    if vertices[0].Location.DistanceTo(vertices[-1].Location) >= tolerance:
        vertices.append(vertices[0])
    # Create a new polyline from the cleaned vertices
    cleaned_curve = rg.Polyline([v.Location for v in vertices]).ToNurbsCurve()
    return cleaned_curve


### Functions used for quadrilateral building mapping ###

# Function to extract vertices from a curve as a python list
def extract_vertices_from_curve(quadrilateral_curve):
    polyline = quadrilateral_curve.ToPolyline()
    vertices = list(polyline.ToArray())
    # Remove the last vertex if it's identical to the first vertex
    if vertices[0].DistanceTo(vertices[-1]) < 1e-6:
        vertices.pop()  # Remove the last vertex
    return vertices

# Function to generate a grid inside a quadrilateral parcel. Uses a bilinear interpolation between the edges of the quadrilateral.
def generate_grid_in_quadrilateral_parcel(parcel_vertices, grid_resolution):
    grid_points = []
    # Get the four corners of the quadrilateral
    v0, v1, v2, v3 = parcel_vertices
    for u in range(grid_resolution + 1):
        u_ratio = u / grid_resolution  # The relative position along the U direction (horizontal)
        # Interpolate between v0->v3 (left) and v1->v2 (right) edges
        left_interp = v0 + (v3 - v0) * u_ratio
        right_interp = v1 + (v2 - v1) * u_ratio
        for v in range(grid_resolution + 1):
            v_ratio = v / grid_resolution  # The relative position along the V direction (vertical)
            # Interpolate between the left and right edges at the current u_ratio
            grid_point = left_interp + (right_interp - left_interp) * v_ratio
            grid_points.append(grid_point)
    return grid_points

# Function to map the building indices to the corresponding points of the quadrilateral parcel's grid.
def map_indices_to_points(building_indices, grid):
    mapped_building_vertices = [grid[index] for index in building_indices]
    return mapped_building_vertices



### Functions used for pentalateral building mapping ###

# Function to compute the centroid (geometric center) of a list of 3D points (vertices).
def compute_centroid(vertices):
    sum_x = sum(v.X for v in vertices)
    sum_y = sum(v.Y for v in vertices)
    sum_z = sum(v.Z for v in vertices)
    num_vertices = len(vertices)
    return rg.Point3d(sum_x / num_vertices, sum_y / num_vertices, sum_z / num_vertices)

# Function to subdivide a triangle into four smaller triangles by adding midpoints on its edges.
def subdivide_triangle(v0, v1, v2):
    # Compute midpoints
    mid_v0_v1 = v0 + (v1 - v0) * 0.5
    mid_v1_v2 = v1 + (v2 - v1) * 0.5
    mid_v2_v0 = v2 + (v0 - v2) * 0.5
    # Create smaller triangles
    triangles = [
        (v0, mid_v0_v1, mid_v2_v0),
        (mid_v0_v1, v1, mid_v1_v2),
        (mid_v2_v0, mid_v1_v2, v2),
        (mid_v0_v1, mid_v1_v2, mid_v2_v0)
    ]
    # Return triangles and midpoints as potential intersection points
    return triangles, [mid_v0_v1, mid_v1_v2, mid_v2_v0]

# Function to subdivide the triangles of a pentalateral parcel iteratively with consistent indexing.
def generate_grid_in_pentalateral_parcel(vertices, center):
    # Create initial triangles (center to adjacent vertices)
    triangles = []
    indexed_points = []  # Track points in a consistent order
    indexed_points.append(center)  # Start with the centroid having index 0
    iterations = 3
    # Add the original vertices with consistent indexing
    indexed_points.extend(vertices)  # Add pentagon vertices (these will get indices 1-5)
    for i in range(len(vertices)):
        v0 = vertices[i]
        v1 = vertices[(i + 1) % len(vertices)]
        triangles.append((center, v0, v1))
    # Subdivide the triangles iteratively
    for _ in range(iterations):
        new_triangles = []
        for tri in triangles:
            # Subdivide the triangle and get the new midpoints
            subdivided, midpoints = subdivide_triangle(*tri)
            # Check each midpoint and assign it an index if it's new
            for midpoint in midpoints:
                if midpoint not in indexed_points:
                    indexed_points.append(midpoint)
            new_triangles.extend(subdivided)
        triangles = new_triangles
    # Returns the subdivided triangles and indexed intersection points.
    return triangles, indexed_points


#####################################################################################

# SHORTCUTS FOR LEGIBILITY:
# generic_parcels: "gp"
# corner_parcels: "gp"


###################################
""" INPUTS, LISTS AND CONSTANTS """

# Initialize outputs
footprints = []
extrusions = []

# Iterate through all boundaries and respective parcels
for i, boundary in enumerate(boundaries):

    boundary = rs.coercecurve(boundary)

    # Inputs
    boundary_curve = boundary
    boundary_area = round(rs.CurveArea(boundary_curve)[0], 2)
    all_parcels_gh_curve_objects = all_parcels_building_generation[i]
    all_parcels = []
    for gh_curve in all_parcels_gh_curve_objects:
        rhino_curve = gh_curve.Value
        all_parcels.append(rhino_curve)

    floor_area_ratio = float(floor_area_ratio)

    # Extract height data from data package or Get Heights component
    if not height_info:
        b_mean_height = data_package[25]
        b_min_height = data_package[26]
        b_max_height = data_package[27]
        b_height_std = data_package[28]
    elif not data_package:
        b_mean_height = height_info[0]
        b_min_height = height_info[1]
        b_max_height = height_info[2]
        b_height_std = height_info[3]
    else:
        raise ValueError("Component requires data package or height info.")        

    # Set tolerance for geometric comparison
    tolerance = 1e-3

    # Set grid resolution (for mapping). Must be the same as data anylsis component for proper mapping!
    grid_resolution = 25

    # Set random seed for reproducible results
    random.seed(random_seed)

    # Get the boundary polygon edges and vertices
    boundary_pts = rs.PolylineVertices(boundary_curve)
    if len(boundary_pts) < 4:
        raise ValueError("Invalid Boundary, must have at least three vertices")
    if boundary_pts[0] != boundary_pts[len(boundary_pts)-1]:
        raise ValueError("Boundary Polygon must be a closed Polyline Curve")

    # Split the corner_buildings_map to lists for pentalateral and quadrilateral corner parcels
    cp_buildings_map_quad = []
    cp_buildings_map_penta = []

    for nested_list in corner_buildings_map:
        if len(nested_list[0]) == 2:
            cp_buildings_map_quad.append(nested_list)
        elif len(nested_list[0]) == 3:
            cp_buildings_map_penta.append(nested_list)



    #######################
    """ PARCEL ANALYSIS """

    # Ensure the boundary_polygon is a valid curve
    if rs.IsCurve(boundary_curve) and boundary_curve is not None:
        boundary_curve = rs.coercecurve(boundary_curve)  # Convert the boundary polygon to a RhinoCommon curve

        # Initialize lists to store polyline curves
        gp_curves = []
        cp_quad_curves = []
        cp_penta_c1_curves = []
        cp_penta_c2_curves = []

        # Initialize lists to store vertices
        gp_vertices = []
        cp_quad_vertices = []
        cp_penta_c1_vertices = []
        cp_penta_c2_vertices = []

        # Iterate over each parcel curve, received from the input
        # Assign the iterated parcel to their respective list
        for parcel in all_parcels:
            parcel_curve = rs.coercecurve(parcel)  # Convert to RhinoCommon curve
            parcel_vertices = parcel_curve.ToPolyline().ToArray()

            # Explode the parcel into individual segments (edges)
            parcel_edges = parcel_curve.DuplicateSegments()
            boundary_edges = []  # To hold the edges of the parcel that lie on the boundary polygon

            # Check each edge of the parcel to see if it lies close to the boundary polygon
            for edge in parcel_edges:
                start_pt = edge.PointAtStart
                end_pt = edge.PointAtEnd

                # Find the closest points on the boundary polygon to the start and end points of the edge
                success_start, param_start = boundary_curve.ClosestPoint(start_pt)
                success_end, param_end = boundary_curve.ClosestPoint(end_pt)

                # Get the actual points on the boundary polygon for comparison
                boundary_pt_1 = boundary_curve.PointAt(param_start) if success_start else None
                boundary_pt_2 = boundary_curve.PointAt(param_end) if success_end else None

                # Compare the distance between the parcel edge and the boundary polygon
                if boundary_pt_1 and boundary_pt_2:
                    start_dist = start_pt.DistanceTo(boundary_pt_1)
                    end_dist = end_pt.DistanceTo(boundary_pt_2)

                    # If both distances are within the tolerance, consider it a boundary edge
                    if start_dist < tolerance and end_dist < tolerance:
                        boundary_edges.append(edge)

            # After checking the edges, classify each parcel based on the number of boundary edges
            if len(boundary_edges) == 1:
                gp_curves.append(parcel_curve)
                gp_vertices.append(parcel_vertices)

            elif len(boundary_edges) == 2:
                if len(parcel_vertices) == 5:
                    cp_quad_curves.append(parcel_curve)
                    cp_quad_vertices.append(parcel_vertices)
                elif len(parcel_vertices) == 6:
                    cp_penta_c1_curves.append(parcel_curve)
                    cp_penta_c1_vertices.append(parcel_vertices)
                    
            elif len(boundary_edges) == 3:
                cp_penta_c2_curves.append(parcel_curve)
                cp_penta_c2_vertices.append(parcel_vertices)

    # Get dimensions duos or trios for comparison with building maps
    gp_dim_pairs = []
    for vertices in gp_vertices:
        length = round(vertices[0].DistanceTo(vertices[1]),2)
        width = round(vertices[1].DistanceTo(vertices[2]),2)
        ratio = round(length / width, 2)
        gp_dim_pairs.append([[length, width], ratio])

    cp_quad_dim_pairs = []
    for vertices in cp_quad_vertices:
        width_1 = round(vertices[0].DistanceTo(vertices[1]),2)
        width_2 = round(vertices[0].DistanceTo(vertices[3]),2)
        ratio = round(width_1 / width_2, 2)
        cp_quad_dim_pairs.append([[width_1, width_2], ratio])

    cp_penta_dim_trios = []
    for vertices in cp_penta_c1_vertices:
        dim_1 = round(vertices[2].DistanceTo(vertices[3]),2)
        dim_2 = round(vertices[3].DistanceTo(vertices[4]),2)
        dim_3 = round(vertices[2].DistanceTo(vertices[1]),2)
        ratio = round(dim_1 / dim_2, 2)
        cp_penta_dim_trios.append([[dim_1, dim_2, dim_3], ratio])
    for vertices in cp_penta_c2_vertices:
        dim_1 = round(vertices[0].DistanceTo(vertices[1]),2)
        dim_2 = round(vertices[1].DistanceTo(vertices[2]),2)
        dim_3 = round(vertices[0].DistanceTo(vertices[4]),2)
        ratio = round(dim_1 / dim_2, 2)
        cp_penta_dim_trios.append([[dim_1, dim_2, dim_3], ratio])

    # Add lists together (ensuring consistent index)
    cp_penta_curves = cp_penta_c1_curves + cp_penta_c2_curves
    cp_penta_vertices = cp_penta_c1_vertices + cp_penta_c2_vertices

    # Determine new mean height based upon FAR. FAR is abbreviated with the entire parcel area, instead of building area.
    if floor_area_ratio is not None:
        # Get areas of parcels
        gp_areas = []
        for gp_curve in gp_curves:
            gp_curve = rs.coercecurve(gp_curve)
            gp_area = rs.CurveArea(gp_curve)
            gp_areas.append(gp_area[0])

        cp_quad_areas = []
        for cp_curve in cp_quad_curves:
            cp_curve = rs.coercecurve(cp_curve)
            cp_area = rs.CurveArea(cp_curve)
            cp_quad_areas.append(cp_area[0])

        cp_penta_areas = []
        for cp_curve in cp_penta_curves:
            cp_curve = rs.coercecurve(cp_curve)
            cp_area = rs.CurveArea(cp_curve)
            cp_penta_areas.append(cp_area[0])    

        all_areas = gp_areas + cp_quad_areas + cp_penta_areas
        total_parcel_area = round(sum(all_areas), 2)
        # Assumption: floor height = 2.5m
        floor_height = 2.5
        b_mean_height = boundary_area * floor_area_ratio * floor_height / total_parcel_area
        if b_max_height < b_mean_height:
            b_max_height = b_mean_height
        if b_min_height > b_mean_height:
            b_min_height = b_mean_height



    #######################################
    """ ASSING BUILDING MAPS TO PARCELS """

    # When comparing the dimensions and aspect ratios, give aspect ratios more weight:
    aspect_ratio_weight = 100

    # Assign generic building map
    gp_building_map = find_best_matches(gp_dim_pairs, generic_buildings_map, aspect_ratio_weight)

    # Assign quadrilateral corner building map
    cp_quad_building_map = find_best_matches(cp_quad_dim_pairs, cp_buildings_map_quad, aspect_ratio_weight)

    # Assign pentalateral corner building map
    if cp_penta_dim_trios:
        cp_penta_building_map = find_best_matches(cp_penta_dim_trios, cp_buildings_map_penta, aspect_ratio_weight)
    else:
        print(cp_buildings_map_penta)
        cp_penta_building_map = find_best_matches(cp_quad_dim_pairs, cp_buildings_map_penta, aspect_ratio_weight)



    ################################
    """ CREATE GENERIC BUILDINGS """

    # Initialize list to store generic bulidings
    generic_buildings_footprints = []
    generic_buildings_3D = []

    # Loop through all generic parcels
    for i, generic_parcel in enumerate(gp_curves):

        # Extract vertices from generic parcel
        generic_parcel = rs.coercecurve(generic_parcel)
        gp_vertices = extract_vertices_from_curve(generic_parcel)

        # Generate grid for quadrilateral parcel
        gp_grid = generate_grid_in_quadrilateral_parcel(gp_vertices, grid_resolution)

        # Initialize lists for 3D building creation
        building_footprints = []
        building_vertices = []
        building_dist_sum = []
        building_vertices_distance_to_edge = [[] for _ in range(len(gp_building_map[i]))]

        # Loop through all buildings on parcel
        for j in range(len(gp_building_map[i])):
            gp_building_indeces = gp_building_map[i][j]
            mapped_building_vertices = map_indices_to_points(gp_building_indeces, gp_grid)

            # Ensure the polyline is closed by appending the first vertex at the end if needed
            if mapped_building_vertices[0].DistanceTo(mapped_building_vertices[-1]) > tolerance:
                mapped_building_vertices.append(mapped_building_vertices[0])

            # Create generic building footprint and append to generic building footprints
            generic_building_outline = rs.AddPolyline(mapped_building_vertices)
            generic_buildings_footprints.append(generic_building_outline)

            # Measure distance of building footprints to edge
            generic_building_curve = rs.coercecurve(generic_building_outline)
            building_footprints.append(generic_building_curve)
            gb_vertices = generic_building_curve.ToPolyline().ToArray()
            building_vertices.append(gb_vertices)
            for vertex in gb_vertices:
                dist_1 = round(vertex.DistanceTo(gp_vertices[0]), 2)
                dist_2 = round(vertex.DistanceTo(gp_vertices[1]), 2)
                building_vertices_distance_to_edge[j].append(dist_1)
                building_vertices_distance_to_edge[j].append(dist_2)

        # Distance from boundary edge for reasonable height distribution
        for j in range(len(building_vertices_distance_to_edge)):
            weighted_dist = sum(building_vertices_distance_to_edge[j]) / len(building_vertices_distance_to_edge[j])
            dist_sum = round(weighted_dist ,2)
            building_dist_sum.append(dist_sum)

        # Get a height from data package (or from the FAR calculation)
        b_gauss_height = round(random.gauss(b_mean_height, b_height_std))
        height = int(max(b_min_height, min(b_gauss_height, b_max_height)))

        # Figure out if any footprint lies on another one
        building_footprint_inside, idx_outline_inside, idx_outline_surrounding = check_building_footprints_inside(building_footprints, building_vertices, tolerance)

        # Get a height from data package
        b_gauss_height = round(random.gauss(b_mean_height, b_height_std))
        height = int(max(b_min_height, min(b_gauss_height, b_max_height)))

        # Create generic building extrustions
        # Address the buildings with the outline inside:
        if building_footprint_inside == True:
            # First, address the buildings with the outline inside:
            surrounding_footprint = rs.coercecurve(building_footprints[idx_outline_surrounding])
            inside_footprint = rs.coercecurve(building_footprints[idx_outline_inside])
            surrounding_building = extrude_polyline(surrounding_footprint, height)
            inside_building = extrude_polyline(inside_footprint, height + 3)
            generic_buildings_3D.append(surrounding_building)
            generic_buildings_3D.append(inside_building)
            height = height + random.choice([-3, 3])

            # Delete the larger index first to avoid index shift issues
            indices_to_remove = sorted([idx_outline_surrounding, idx_outline_inside], reverse=True)
            for index in indices_to_remove:
                for lst in [building_footprints, building_dist_sum]:
                    del lst[index]

        # Sort lists according to buliding distance to edge sum
        if len(building_footprints) > 0:
            sorted_pairs = sorted(zip(building_dist_sum, building_footprints), key=lambda x: x[0], reverse=True)
            building_dist_sum, building_footprints = zip(*sorted_pairs)

            for footprint in building_footprints:      
                footprint = rs.coercecurve(footprint)
                generic_building = extrude_polyline(footprint, height)
                generic_buildings_3D.append(generic_building)
                rng = random.uniform(0,1)
                if rng < 0.2:
                    if height > 6:
                        height = height - 6
                else:
                    if height > 3:
                        height = height - 3



    ################################
    """ CREATE CORNER BUILDINGS """

    # Initialize list to store generic bulidings
    corner_buildings_footprints = []
    corner_buildings_3D = []

    # Loop through all quadrilateral corner parcels
    for i, corner_parcel_quad in enumerate(cp_quad_curves):

        # Extract vertices from quadrilateral corner parcel
        corner_parcel = rs.coercecurve(corner_parcel_quad)
        cp_vertices = extract_vertices_from_curve(corner_parcel)

        # Generate grid for quadrilateral parcel
        cp_grid = generate_grid_in_quadrilateral_parcel(cp_vertices, grid_resolution)

        # Initialize lists for 3D building creation
        building_footprints = []
        building_vertices = []
        building_dist_sum = []
        building_vertices_distance_to_edge = [[] for _ in range(len(cp_quad_building_map[i]))]   

        # Loop through all buildings on parcel
        for j in range(len(cp_quad_building_map[i])):
            cp_building_indeces = cp_quad_building_map[i][j]
            mapped_building_vertices = map_indices_to_points(cp_building_indeces, cp_grid)

            # Ensure the polyline is closed by appending the first vertex at the end if needed
            if mapped_building_vertices[0].DistanceTo(mapped_building_vertices[-1]) > tolerance:
                mapped_building_vertices.append(mapped_building_vertices[0])

            # Create corner building footprint and append to building footprints
            corner_building_outline = rs.AddPolyline(mapped_building_vertices)
            corner_buildings_footprints.append(corner_building_outline)

            # Measure distance of building footprints edges
            corner_building_curve = rs.coercecurve(corner_building_outline)
            building_footprints.append(corner_building_curve)
            cb_vertices = corner_building_curve.ToPolyline().ToArray()
            building_vertices.append(cb_vertices)
            for vertex in cb_vertices:
                dist_1 = round(vertex.DistanceTo(cp_vertices[0]), 2)
                dist_2 = round(vertex.DistanceTo(cp_vertices[1]), 2)
                dist_3 = round(vertex.DistanceTo(cp_vertices[3]), 2)
                building_vertices_distance_to_edge[j].append(dist_1)
                building_vertices_distance_to_edge[j].append(dist_2)
                building_vertices_distance_to_edge[j].append(dist_3)

        # Distance from boundary edge for reasonable height distribution
        for j in range(len(building_vertices_distance_to_edge)):
            weighted_dist = sum(building_vertices_distance_to_edge[j]) / len(building_vertices_distance_to_edge[j])
            dist_sum = round(weighted_dist ,2)
            building_dist_sum.append(dist_sum)

        # Get a height from data package (or from the FAR calculation)
        b_gauss_height = round(random.gauss(b_mean_height, b_height_std))
        height = int(max(b_min_height, min(b_gauss_height, b_max_height)))

        # Figure out if any footprint lies on another one
        building_footprint_inside, idx_outline_inside, idx_outline_surrounding = check_building_footprints_inside(building_footprints, building_vertices, tolerance)

        # Create corner building extrustions
        # Address the buildings with the outline inside:
        if building_footprint_inside == True:
            surrounding_footprint = rs.coercecurve(building_footprints[idx_outline_surrounding])
            surrounding_footprint = clean_polyline(surrounding_footprint)
            inside_footprint = rs.coercecurve(building_footprints[idx_outline_inside])
            inside_footprint = clean_polyline(inside_footprint)
            surrounding_building = extrude_polyline(surrounding_footprint, height)
            inside_building = extrude_polyline(inside_footprint, height + 3)
            corner_buildings_3D.append(surrounding_building)
            corner_buildings_3D.append(inside_building)
            height = height + random.choice([-3, 3])

            # Delete the larger index first to avoid index shift issues
            indices_to_remove = sorted([idx_outline_surrounding, idx_outline_inside], reverse=True)
            for index in indices_to_remove:
                for lst in [building_footprints, building_dist_sum]:
                    del lst[index]

        # Address rest of the buildings
        # Sort lists according to buliding distance to edge sum
        if len(building_footprints) > 0:
            sorted_pairs = sorted(zip(building_dist_sum, building_footprints), key=lambda x: x[0], reverse=True)
            building_dist_sum, building_footprints = zip(*sorted_pairs)
            for footprint in building_footprints:           
                footprint = rs.coercecurve(footprint)
                footprint = clean_polyline(footprint)
                corner_building = extrude_polyline(footprint, height)
                corner_buildings_3D.append(corner_building)
                rng = random.uniform(0,1)
                if rng < 0.2:
                    if height > 6:
                        height = height - 6
                else:
                    if height > 3:
                        height = height - 3

    # Loop through all pentalateral corner parcels
    for i, corner_parcel in enumerate(cp_penta_curves):
        
        # Extract vertices from pentalateral corner parcel
        cp_polyline = corner_parcel.ToPolyline()
        cp_vertices = list(cp_polyline.ToArray())

        # Compute centroid
        center = compute_centroid(cp_vertices)

        # Generate a "grid" by subdividing the parcel through triangulation
        cp_triangles, cp_indexed_points = generate_grid_in_pentalateral_parcel(cp_vertices, center)

        # Initialize lists for 3D building creation
        building_footprints = []
        building_vertices = []
        building_dist_sum = []
        building_vertices_distance_to_edge = [[] for _ in range(len(cp_penta_building_map[i]))]   

        # Loop through all buildings on parcel
        for j in range(len(cp_penta_building_map[i])):
            cp_building_indeces = cp_penta_building_map[i][j]
            mapped_building_vertices = map_indices_to_points(cp_building_indeces, cp_indexed_points)

            # Ensure the polyline is closed by appending the first vertex at the end if needed
            if mapped_building_vertices[0].DistanceTo(mapped_building_vertices[-1]) > tolerance:
                mapped_building_vertices.append(mapped_building_vertices[0])

            # Create generic building footprint and append to generic building footprints
            corner_building_outline = rs.AddPolyline(mapped_building_vertices)
            corner_buildings_footprints.append(corner_building_outline)

            # Measure distance of building footprints edges
            corner_building_curve = rs.coercecurve(corner_building_outline)
            building_footprints.append(corner_building_curve)
            cb_vertices = corner_building_curve.ToPolyline().ToArray()
            building_vertices.append(cb_vertices)
            for vertex in cb_vertices:
                dist_1 = round(vertex.DistanceTo(cp_vertices[0]), 2)
                dist_2 = round(vertex.DistanceTo(cp_vertices[1]), 2)
                building_vertices_distance_to_edge[j].append(dist_1)
                building_vertices_distance_to_edge[j].append(dist_2)

        # Distance from boundary edge for reasonable height distribution
        for j in range(len(building_vertices_distance_to_edge)):
            weighted_dist = sum(building_vertices_distance_to_edge[j]) / len(building_vertices_distance_to_edge[j])
            dist_sum = round(weighted_dist ,2)
            building_dist_sum.append(dist_sum)      

        # Get a height from data package (or from the FAR calculation)
        b_gauss_height = round(random.gauss(b_mean_height, b_height_std))
        height = random.uniform(b_min_height, b_max_height) 

        # Figure out if any footprint lies on another one
        building_footprint_inside, idx_outline_inside, idx_outline_surrounding = check_building_footprints_inside(building_footprints, building_vertices, tolerance)

        # Create corner building extrustions
        # Address the buildings with the outline inside:
        if building_footprint_inside == True:
            surrounding_footprint = rs.coercecurve(building_footprints[idx_outline_surrounding])
            surrounding_footprint = clean_polyline(surrounding_footprint)
            inside_footprint = rs.coercecurve(building_footprints[idx_outline_inside])
            inside_footprint = clean_polyline(inside_footprint)
            surrounding_building = extrude_polyline(surrounding_footprint, height)
            inside_building = extrude_polyline(inside_footprint, height + 6)
            corner_buildings_3D.append(surrounding_building)
            corner_buildings_3D.append(inside_building)
            height = height + random.choice([-6, 6])

            # Delete the larger index first to avoid index shift issues
            indices_to_remove = sorted([idx_outline_surrounding, idx_outline_inside], reverse=True)
            for index in indices_to_remove:
                for lst in [building_footprints, building_dist_sum]:
                    del lst[index]

        # Address rest of the buildings
        # Sort lists according to buliding distance to edge sum
        if len(building_footprints) > 0:
            sorted_pairs = sorted(zip(building_dist_sum, building_footprints), key=lambda x: x[0], reverse=True)
            building_dist_sum, building_footprints = zip(*sorted_pairs)
            for footprint in building_footprints:
                footprint = rs.coercecurve(footprint)
                footprint = clean_polyline(footprint)
                corner_building = extrude_polyline(footprint, height)
                corner_buildings_3D.append(corner_building)
                rng = random.uniform(0,1)
                if rng < 0.5:
                    if height > 6:
                        height = height - 6
                else:
                    if height > 6:
                        height = height - 3

    ################
    """ OUTPUTS """

    for gb_footprint in generic_buildings_footprints:
        footprints.append(gb_footprint)
    for cb_footprint in corner_buildings_footprints:
        footprints.append(cb_footprint)
    for gb_3D in generic_buildings_3D:
        extrusions.append(gb_3D)
    for cp_3D in corner_buildings_3D:
        extrusions.append(cp_3D)
# ---------- end building_generation ----------

# ----
# Boundary Cluster #3
generic_parcel_length_standard_deviation_5 = Slider(6.4, range=0..100)
generic_parcel_length_standard_deviation_6 = Slider(6.4, range=0..100)
generic_parcel_length_standard_deviation_7 = Slider(6.2, range=0..100)
generic_parcel_width_standard_deviation_5 = Slider(8.4, range=0..100)
generic_parcel_width_standard_deviation_6 = Slider(8.4, range=0..100)
generic_parcel_width_standard_deviation_7 = Slider(33.4, range=0..100)
generic_parcel_maximum_length_5 = Slider(9.7, range=0..100)
generic_parcel_maximum_length_6 = Slider(18.7, range=0..100)
generic_parcel_maximum_length_7 = Slider(16, range=0..100)
generic_parcel_minimum_length_5 = Slider(2, range=0..100)
generic_parcel_minimum_length_6 = Slider(16, range=0..100)
generic_parcel_minimum_length_7 = Slider(5, range=0..100)
generic_parcel_maximum_width_5 = Slider(19.6, range=0..100)
generic_parcel_maximum_width_6 = Slider(37.6, range=0..100)
generic_parcel_maximum_width_7 = Slider(20.6, range=0..100)
generic_parcel_minimum_width_5 = Slider(23.5, range=0..100)
generic_parcel_minimum_width_6 = Slider(40, range=0..100)
generic_parcel_minimum_width_7 = Slider(25.2, range=0..100)
corner_parcel_minimum_width_5 = Slider(11, range=0..100)
corner_parcel_minimum_width_6 = Slider(15.8, range=0..100)
corner_parcel_maximum_width_5 = Slider(24, range=0..100)
corner_parcel_maximum_angle_5 = Slider(90, range=0..100)
corner_parcel_minimum_width_7 = Slider(20.8, range=0..100)
corner_parcel_maximum_width_6 = Slider(28.8, range=0..100)
corner_parcel_maximum_angle_6 = Slider(90, range=0..100)
corner_parcel_maximum_width_7 = Slider(11.2, range=0..100)
corner_parcel_maximum_angle_7 = Slider(90, range=0..100)
corner_parcel_minimum_angle_5 = Slider(90, range=0..100)
corner_parcel_minimum_angle_6 = Slider(90, range=0..100)
corner_parcel_minimum_angle_7 = Slider(90, range=0..100)
indentation_reference_length_5 = Slider(25, range=0..100)
indentation_reference_length_6 = Slider(29, range=0..100)
indentation_reference_length_7 = Slider(0, range=0..100)
generic_parcel_mean_length_5 = Slider(8.9, range=0..100)
generic_parcel_mean_length_6 = Slider(15.7, range=0..100)
generic_parcel_mean_length_7 = Slider(9.9, range=0..100)
generic_parcel_mean_width_5 = Slider(16.6, range=0..100)
generic_parcel_mean_width_6 = Slider(30.3, range=0..100)
generic_parcel_mean_width_7 = Slider(18.5, range=0..100)
random_seed_integer_6 = Slider(2, range=0..10)
random_seed_integer_7 = Slider(5, range=0..10)
random_seed_integer_8 = Slider(6, range=0..10)
penta_threshold_5 = Slider(26, range=0..100)
penta_threshold_6 = Slider(29.8, range=0..100)
penta_threshold_7 = Slider(26, range=0..100)
boundaries_5 = Curve([<curve referenced from the Rhino model> x4])
boundaries_6 = Curve([<curve referenced from the Rhino model> x3])
boundaries_7 = Curve([<curve referenced from the Rhino model> x3])
custom_parcel_generation_5 = Python3Script(
    boundaries=boundaries_6,
    cp_min_width=corner_parcel_minimum_width_6,
    cp_max_width=corner_parcel_maximum_width_7,
    cp_min_angle=corner_parcel_minimum_angle_7,
    cp_max_angle=corner_parcel_maximum_angle_7,
    gp_mean_length=generic_parcel_mean_length_7,
    gp_min_length=generic_parcel_minimum_length_7,
    gp_max_length=generic_parcel_maximum_length_7,
    gp_length_std=generic_parcel_length_standard_deviation_7,
    gp_mean_width=generic_parcel_mean_width_7,
    gp_min_width=generic_parcel_minimum_width_7,
    gp_max_width=generic_parcel_maximum_width_7,
    gp_width_std=generic_parcel_width_standard_deviation_7,
    ind_ref_length=indentation_reference_length_7,
    penta_threshold=penta_threshold_7,
    random_seed=random_seed_integer)  # -> all_parcels, all_parcels_building_generation; inputs boundaries: list, random_seed: Int32; same code as custom_parcel_generation
custom_parcel_generation_6 = Python3Script(
    boundaries=boundaries_5,
    cp_min_width=corner_parcel_minimum_width_5,
    cp_max_width=corner_parcel_maximum_width_5,
    cp_min_angle=corner_parcel_minimum_angle_5,
    cp_max_angle=corner_parcel_maximum_angle_5,
    gp_mean_length=generic_parcel_mean_length_5,
    gp_min_length=generic_parcel_minimum_length_5,
    gp_max_length=generic_parcel_maximum_length_5,
    gp_length_std=generic_parcel_length_standard_deviation_5,
    gp_mean_width=generic_parcel_mean_width_5,
    gp_min_width=generic_parcel_minimum_width_5,
    gp_max_width=generic_parcel_maximum_width_5,
    gp_width_std=generic_parcel_width_standard_deviation_5,
    ind_ref_length=indentation_reference_length_5,
    penta_threshold=penta_threshold_5,
    random_seed=random_seed_integer)  # -> all_parcels, all_parcels_building_generation; inputs boundaries: list, random_seed: Int32; same code as custom_parcel_generation
custom_parcel_generation_7 = Python3Script(
    boundaries=boundaries_7,
    cp_min_width=corner_parcel_minimum_width_7,
    cp_max_width=corner_parcel_maximum_width_6,
    cp_min_angle=corner_parcel_minimum_angle_6,
    cp_max_angle=corner_parcel_maximum_angle_6,
    gp_mean_length=generic_parcel_mean_length_6,
    gp_min_length=generic_parcel_minimum_length_6,
    gp_max_length=generic_parcel_maximum_length_6,
    gp_length_std=generic_parcel_length_standard_deviation_6,
    gp_mean_width=generic_parcel_mean_width_6,
    gp_min_width=generic_parcel_minimum_width_6,
    gp_max_width=generic_parcel_maximum_width_6,
    gp_width_std=generic_parcel_width_standard_deviation_6,
    ind_ref_length=indentation_reference_length_6,
    penta_threshold=penta_threshold_6,
    random_seed=random_seed_integer)  # -> all_parcels, all_parcels_building_generation; inputs boundaries: list, random_seed: Int32; same code as custom_parcel_generation

# ----
# Custom Parcel Generation
generic_parcel_length_standard_deviation_8 = Slider(21.2, range=0..100)
generic_parcel_width_standard_deviation_8 = Slider(30.1, range=0..100)
generic_parcel_maximum_length_8 = Slider(6.9, range=0..100)
generic_parcel_minimum_length_8 = Slider(3, range=0..100)
generic_parcel_maximum_width_8 = Slider(34.5, range=0..100)
generic_parcel_minimum_width_8 = Slider(26.6, range=0..100)
# Boundary Cluster #2
corner_parcel_minimum_width_8 = Slider(13.7, range=0..100)
corner_parcel_maximum_width_8 = Slider(36.4, range=0..100)
corner_parcel_maximum_angle_8 = Slider(90, range=0..100)
corner_parcel_minimum_angle_8 = Slider(90, range=0..100)
indentation_reference_length_8 = Slider(0, range=0..100)
generic_parcel_mean_length_8 = Slider(11.3, range=0..100)
generic_parcel_mean_width_8 = Slider(24.1, range=0..100)
random_seed_integer_9 = Slider(6, range=0..10)
penta_threshold_8 = Slider(18, range=0..100)
boundaries_8 = Curve([<curve referenced from the Rhino model> x2])
custom_parcel_generation_8 = Python3Script(
    boundaries=boundaries_8,
    cp_min_width=corner_parcel_minimum_width_8,
    cp_max_width=corner_parcel_maximum_width_8,
    cp_min_angle=corner_parcel_minimum_angle_8,
    cp_max_angle=corner_parcel_maximum_angle_8,
    gp_mean_length=generic_parcel_mean_length_8,
    gp_min_length=generic_parcel_minimum_length_8,
    gp_max_length=generic_parcel_maximum_length_8,
    gp_length_std=generic_parcel_length_standard_deviation_8,
    gp_mean_width=generic_parcel_mean_width_8,
    gp_min_width=generic_parcel_minimum_width_8,
    gp_max_width=generic_parcel_maximum_width_8,
    gp_width_std=generic_parcel_width_standard_deviation_8,
    ind_ref_length=indentation_reference_length_8,
    penta_threshold=penta_threshold_8,
    random_seed=random_seed_integer)  # -> all_parcels, all_parcels_building_generation; inputs boundaries: list, random_seed: Int32; same code as custom_parcel_generation

# ----
# Get Heights
number_slider_3 = Slider(40, range=0..40)
get_heights_2 = Python3Script(
    mean_height=number_slider_3,
    min_height=Slider(9, range=0..40),
    max_height=Slider(100, range=0..100),
    height_std=Slider(6, range=0..40))  # -> height_info; inputs buildings_3D: list
# ---------- get_heights_2: Python ----------
import Rhino
import rhinoscriptsyntax as rs
import Rhino.Geometry as rg
import math

#####################################################################################

""" FUNCTIONS """

# Function to retreive building height from 3D buildings
def get_building_height(building_id):
    # Get the bounding box of the object
    bbox = rs.BoundingBox(building_id)
    # Extract Z-coordinates of the bounding box corners
    min_z = bbox[0].Z
    max_z = bbox[4].Z
    # Height is the difference between the maximum and minimum Z values
    height = max_z - min_z
    return height

# Function to calculate mean
def calculate_mean(data):
    return sum(data) / len(data)

# Function to calculate standard deviation
def calculate_std(data):
    mean = calculate_mean(data)
    squared_differences = [(i - mean) ** 2 for i in data]  # Calculate squared differences
    variance = sum(squared_differences) / len(data)  # Find the variance
    return math.sqrt(variance)  # std = square root of the variance





################################
""" EXTRACT BUILDING HEIGHTS """

# Analyze building 3D input
if buildings_3D is not None:

    # Initialize list to store building heights
    building_heights = []

    # Iterate through all buildings
    for building in buildings_3D:
        height = get_building_height(building)
        building_heights.append(height)

    bh_mean = round(calculate_mean(building_heights), 2)
    bh_min = min(building_heights)
    bh_max = max(building_heights)
    bh_sd = round(calculate_std(building_heights), 2)

# If there is no building 3D input
else:
    bh_mean = mean_height
    bh_min = min_height
    bh_max = max_height
    bh_sd = height_std


# Outputs

height_info = [
    bh_mean,
    bh_min,
    bh_max,
    bh_sd
]
# ---------- end get_heights_2 ----------

# ----
# Get Heights
number_slider_4 = Slider(9, range=0..40)
get_heights_3 = Python3Script(
    mean_height=number_slider_4,
    min_height=Slider(10, range=0..40),
    max_height=Slider(50, range=0..100),
    height_std=Slider(6, range=0..40))  # -> height_info; inputs buildings_3D: list; same code as get_heights_2

# ----
# Merge parcels and boundaries
merge_boundaries_2 = Merge(Data1=boundaries_6, Data2=boundaries_5, Data3=boundaries_7)
merge_parcels_2 = Merge(
    Data1=custom_parcel_generation_5.all_parcels_building_generation,
    Data2=custom_parcel_generation_6.all_parcels_building_generation,
    Data3=custom_parcel_generation_7.all_parcels_building_generation)

# ----
# Random seed
number_slider_5 = Slider(0, range=0..100)

# ----
# ENABLE
# Building Generation
# Floor-Area-Ratio
building_generation_2 = Python3Script(
    boundaries=boundaries_8,
    all_parcels_building_generation=custom_parcel_generation_8.all_parcels_building_generation,
    floor_area_ratio=Slider(50, range=0..51),
    corner_buildings_map=custom_building_mapping.corner_buildings_map,
    generic_buildings_map=custom_building_mapping.generic_buildings_map,
    height_info=get_heights_2,
    random_seed=number_slider_5)  # -> footprints, extrusions; inputs boundaries: list, all_parcels_building_generation: list, corner_buildings_map: list, generic_buildings_map: list, height_info: list; disabled
# ---------- building_generation_2: Python ----------
import Rhino
import rhinoscriptsyntax as rs
import Rhino.Geometry as rg
import Grasshopper
import random

#####################################################################################

""" FUNCTIONS"""

# Function to find the best match for each element in dimension pairs by calculating the deviation 
def find_best_matches(dimensions_list, buildings_map, aspect_ratio_weight):
    def_building_map = []
    # Make a copy of the buildings_map to modify during iteration
    available_buildings = buildings_map.copy() 
    original_buildings = buildings_map.copy()  # Keep the original list to reset later
    # Iterate through each dimension pair in dimensions_list
    for i in range(len(dimensions_list)):
        min_deviation = float("inf")
        best_match_index = None
        # Loop through each element in the available_buildings
        for j in range(len(available_buildings)):
            # Calculate the deviation for dimensions
            dim_deviation = abs(dimensions_list[i][0][0] - available_buildings[j][0][0]) + abs(dimensions_list[i][0][1] - available_buildings[j][0][1])
            # Calculate the aspect ratio deviation with aspect_ratio_weight
            aspect_ratio_deviation = aspect_ratio_weight * abs(dimensions_list[i][1] - available_buildings[j][1])
            # Calculate the total deviation
            total_deviation = dim_deviation + aspect_ratio_deviation
            # Check if this is the best match so far
            if total_deviation < min_deviation:
                min_deviation = total_deviation
                best_match_index = j 
        # Append the best match's building indices to def_building_map
        if best_match_index is not None:
            best_match = available_buildings[best_match_index]
            def_building_map.append(best_match[2])  # Extract and append building indices
            # Remove the matched building from available_buildings list so it can't be reused
            available_buildings.pop(best_match_index)
        # Reset the available_buildings list when its length is less than 2
        if len(available_buildings) < 2:
            available_buildings = original_buildings.copy()  # Reset to the original list
    return def_building_map


# Function to extrude polyline to closed brep
def extrude_polyline(polyline_curve, height):
    # Define tolerance
    tolerance = 0.001
    # Rebuild the polyline if necessary
    if not polyline_curve.IsClosed:
        polyline_curve.MakeClosed(tolerance)
    # Ensure the curve is consistently oriented upwards (positive Z)
    if not polyline_curve.ClosedCurveOrientation(rg.Plane.WorldXY) == rg.CurveOrientation.CounterClockwise:
        polyline_curve.Reverse()
    # Define the extrusion vector along the positive Z-axis, ensuring height is always positive
    extrusion_vector = rg.Vector3d(0, 0, abs(height))
    # Create the extrusion as an Extrusion object
    extrusion = rg.Extrusion.Create(polyline_curve, abs(height), True)
    # Convert the Extrusion object into a Brep
    brep = extrusion.ToBrep()
    # If the Brep is successfully created and is solid, return it
    if brep and brep.IsSolid:
        return brep
    else:
        # Try to cap planar holes if needed
        capped_brep = brep.CapPlanarHoles(tolerance)
        if capped_brep and capped_brep.IsSolid:
            return capped_brep
        else:
            return brep


# Function to check if any building footprint lies inside another and classify their relationship.
def check_building_footprints_inside(building_footprints, building_vertices, tolerance):
    # Initialize variables
    building_footprint_inside = False
    idx_outline_inside = None
    idx_outline_surrounding = None
    # Loop through all building footprints
    for j, footprint in enumerate(building_footprints):
        footprint = rs.coercecurve(footprint)
        # Loop through all other building vertices to check containment
        for k, vertices in enumerate(building_vertices):
            if j == k:
                continue
            # Flag to track if any point is outside
            is_outside = False
            # Check each vertex of the footprint
            for vertex in vertices:
                result = footprint.Contains(vertex, rg.Plane.WorldXY, tolerance)
                # If any point is outside, set the flag and break out of the loop
                if result != rg.PointContainment.Inside and result != rg.PointContainment.Coincident:
                    is_outside = True
                    break  # Break out of the 'vertices' loop and go to the next set of 'vertices' (k)
            # If any point was outside, skip to the next 'k'
            if is_outside:
                continue
            # Otherwise, if no point is outside, consider the footprint as "inside"
            building_footprint_inside = True
            idx_outline_inside = k
            idx_outline_surrounding = j
            return building_footprint_inside, idx_outline_inside, idx_outline_surrounding
    # Return results (False if no footprint was found inside another), and ints for the indeces
    return building_footprint_inside, idx_outline_inside, idx_outline_surrounding


# Clean mapped polyline if there are duplicate vertices
def clean_polyline(polyline):
    # Get the list of vertices of the polyline
    vertices = list(polyline.ToNurbsCurve().Points)
    # Check if the first and last vertices are the same
    if vertices[0].Location.DistanceTo(vertices[-1].Location) < tolerance:
        # Remove any consecutive duplicates from the end
        while len(vertices) > 1 and vertices[-2].Location.DistanceTo(vertices[-1].Location) < tolerance:
            vertices.pop(-1)
    # Ensure the polyline is closed by adding the first vertex at the end
    if vertices[0].Location.DistanceTo(vertices[-1].Location) >= tolerance:
        vertices.append(vertices[0])
    # Create a new polyline from the cleaned vertices
    cleaned_curve = rg.Polyline([v.Location for v in vertices]).ToNurbsCurve()
    return cleaned_curve


### Functions used for quadrilateral building mapping ###

# Function to extract vertices from a curve as a python list
def extract_vertices_from_curve(quadrilateral_curve):
    polyline = quadrilateral_curve.ToPolyline()
    vertices = list(polyline.ToArray())
    # Remove the last vertex if it's identical to the first vertex
    if vertices[0].DistanceTo(vertices[-1]) < 1e-6:
        vertices.pop()  # Remove the last vertex
    return vertices

# Function to generate a grid inside a quadrilateral parcel. Uses a bilinear interpolation between the edges of the quadrilateral.
def generate_grid_in_quadrilateral_parcel(parcel_vertices, grid_resolution):
    grid_points = []
    # Get the four corners of the quadrilateral
    v0, v1, v2, v3 = parcel_vertices
    for u in range(grid_resolution + 1):
        u_ratio = u / grid_resolution  # The relative position along the U direction (horizontal)
        # Interpolate between v0->v3 (left) and v1->v2 (right) edges
        left_interp = v0 + (v3 - v0) * u_ratio
        right_interp = v1 + (v2 - v1) * u_ratio
        for v in range(grid_resolution + 1):
            v_ratio = v / grid_resolution  # The relative position along the V direction (vertical)
            # Interpolate between the left and right edges at the current u_ratio
            grid_point = left_interp + (right_interp - left_interp) * v_ratio
            grid_points.append(grid_point)
    return grid_points

# Function to map the building indices to the corresponding points of the quadrilateral parcel's grid.
def map_indices_to_points(building_indices, grid):
    mapped_building_vertices = [grid[index] for index in building_indices]
    return mapped_building_vertices



### Functions used for pentalateral building mapping ###

# Function to compute the centroid (geometric center) of a list of 3D points (vertices).
def compute_centroid(vertices):
    sum_x = sum(v.X for v in vertices)
    sum_y = sum(v.Y for v in vertices)
    sum_z = sum(v.Z for v in vertices)
    num_vertices = len(vertices)
    return rg.Point3d(sum_x / num_vertices, sum_y / num_vertices, sum_z / num_vertices)

# Function to subdivide a triangle into four smaller triangles by adding midpoints on its edges.
def subdivide_triangle(v0, v1, v2):
    # Compute midpoints
    mid_v0_v1 = v0 + (v1 - v0) * 0.5
    mid_v1_v2 = v1 + (v2 - v1) * 0.5
    mid_v2_v0 = v2 + (v0 - v2) * 0.5
    # Create smaller triangles
    triangles = [
        (v0, mid_v0_v1, mid_v2_v0),
        (mid_v0_v1, v1, mid_v1_v2),
        (mid_v2_v0, mid_v1_v2, v2),
        (mid_v0_v1, mid_v1_v2, mid_v2_v0)
    ]
    # Return triangles and midpoints as potential intersection points
    return triangles, [mid_v0_v1, mid_v1_v2, mid_v2_v0]

# Function to subdivide the triangles of a pentalateral parcel iteratively with consistent indexing.
def generate_grid_in_pentalateral_parcel(vertices, center):
    # Create initial triangles (center to adjacent vertices)
    triangles = []
    indexed_points = []  # Track points in a consistent order
    indexed_points.append(center)  # Start with the centroid having index 0
    iterations = 3
    # Add the original vertices with consistent indexing
    indexed_points.extend(vertices)  # Add pentagon vertices (these will get indices 1-5)
    for i in range(len(vertices)):
        v0 = vertices[i]
        v1 = vertices[(i + 1) % len(vertices)]
        triangles.append((center, v0, v1))
    # Subdivide the triangles iteratively
    for _ in range(iterations):
        new_triangles = []
        for tri in triangles:
            # Subdivide the triangle and get the new midpoints
            subdivided, midpoints = subdivide_triangle(*tri)
            # Check each midpoint and assign it an index if it's new
            for midpoint in midpoints:
                if midpoint not in indexed_points:
                    indexed_points.append(midpoint)
            new_triangles.extend(subdivided)
        triangles = new_triangles
    # Returns the subdivided triangles and indexed intersection points.
    return triangles, indexed_points


#####################################################################################

# SHORTCUTS FOR LEGIBILITY:
# generic_parcels: "gp"
# corner_parcels: "gp"


###################################
""" INPUTS, LISTS AND CONSTANTS """

# Initialize outputs
footprints = []
extrusions = []

# Iterate through all boundaries and respective parcels
for i, boundary in enumerate(boundaries):

    boundary = rs.coercecurve(boundary)

    # Inputs
    boundary_curve = boundary
    boundary_area = round(rs.CurveArea(boundary_curve)[0], 2)
    all_parcels_gh_curve_objects = all_parcels_building_generation[i]
    all_parcels = []
    for gh_curve in all_parcels_gh_curve_objects:
        rhino_curve = gh_curve.Value
        all_parcels.append(rhino_curve)

    floor_area_ratio = floor_area_ratio
    b_mean_height = height_info[0]
    b_min_height = height_info[1]
    b_max_height = height_info[2]
    b_height_std = height_info[3]

    # Set tolerance for geometric comparison
    tolerance = 1e-3

    # Set grid resolution (for mapping). Must be the same as data anylsis component for proper mapping!
    grid_resolution = 25

    # Set random seed for reproducible results
    random.seed(random_seed)

    # Get the boundary polygon edges and vertices
    boundary_pts = rs.PolylineVertices(boundary_curve)
    if len(boundary_pts) < 4:
        raise ValueError("Invalid Boundary, must have at least three vertices")
    if boundary_pts[0] != boundary_pts[len(boundary_pts)-1]:
        raise ValueError("Boundary Polygon must be a closed Polyline Curve")

    # Split the corner_buildings_map to lists for pentalateral and quadrilateral corner parcels
    cp_buildings_map_quad = []
    cp_buildings_map_penta = []

    for nested_list in corner_buildings_map:
        if len(nested_list[0]) == 2:
            cp_buildings_map_quad.append(nested_list)
        elif len(nested_list[0]) == 3:
            cp_buildings_map_penta.append(nested_list)



    #######################
    """ PARCEL ANALYSIS """

    # Ensure the boundary_polygon is a valid curve
    if rs.IsCurve(boundary_curve) and boundary_curve is not None:
        boundary_curve = rs.coercecurve(boundary_curve)  # Convert the boundary polygon to a RhinoCommon curve

        # Initialize lists to store polyline curves
        gp_curves = []
        cp_quad_curves = []
        cp_penta_c1_curves = []
        cp_penta_c2_curves = []

        # Initialize lists to store vertices
        gp_vertices = []
        cp_quad_vertices = []
        cp_penta_c1_vertices = []
        cp_penta_c2_vertices = []

        # Iterate over each parcel curve, received from the input
        # Assign the iterated parcel to their respective list
        for parcel in all_parcels:
            parcel_curve = rs.coercecurve(parcel)  # Convert to RhinoCommon curve
            parcel_vertices = parcel_curve.ToPolyline().ToArray()

            # Explode the parcel into individual segments (edges)
            parcel_edges = parcel_curve.DuplicateSegments()
            boundary_edges = []  # To hold the edges of the parcel that lie on the boundary polygon

            # Check each edge of the parcel to see if it lies close to the boundary polygon
            for edge in parcel_edges:
                start_pt = edge.PointAtStart
                end_pt = edge.PointAtEnd

                # Find the closest points on the boundary polygon to the start and end points of the edge
                success_start, param_start = boundary_curve.ClosestPoint(start_pt)
                success_end, param_end = boundary_curve.ClosestPoint(end_pt)

                # Get the actual points on the boundary polygon for comparison
                boundary_pt_1 = boundary_curve.PointAt(param_start) if success_start else None
                boundary_pt_2 = boundary_curve.PointAt(param_end) if success_end else None

                # Compare the distance between the parcel edge and the boundary polygon
                if boundary_pt_1 and boundary_pt_2:
                    start_dist = start_pt.DistanceTo(boundary_pt_1)
                    end_dist = end_pt.DistanceTo(boundary_pt_2)

                    # If both distances are within the tolerance, consider it a boundary edge
                    if start_dist < tolerance and end_dist < tolerance:
                        boundary_edges.append(edge)

            # After checking the edges, classify each parcel based on the number of boundary edges
            if len(boundary_edges) == 1:
                gp_curves.append(parcel_curve)
                gp_vertices.append(parcel_vertices)

            elif len(boundary_edges) == 2:
                if len(parcel_vertices) == 5:
                    cp_quad_curves.append(parcel_curve)
                    cp_quad_vertices.append(parcel_vertices)
                elif len(parcel_vertices) == 6:
                    cp_penta_c1_curves.append(parcel_curve)
                    cp_penta_c1_vertices.append(parcel_vertices)
                    
            elif len(boundary_edges) == 3:
                cp_penta_c2_curves.append(parcel_curve)
                cp_penta_c2_vertices.append(parcel_vertices)

    # Get dimensions duos or trios for comparison with building maps
    gp_dim_pairs = []
    for vertices in gp_vertices:
        length = round(vertices[0].DistanceTo(vertices[1]),2)
        width = round(vertices[1].DistanceTo(vertices[2]),2)
        ratio = round(length / width, 2)
        gp_dim_pairs.append([[length, width], ratio])

    cp_quad_dim_pairs = []
    for vertices in cp_quad_vertices:
        width_1 = round(vertices[0].DistanceTo(vertices[1]),2)
        width_2 = round(vertices[0].DistanceTo(vertices[3]),2)
        ratio = round(width_1 / width_2, 2)
        cp_quad_dim_pairs.append([[width_1, width_2], ratio])

    cp_penta_dim_trios = []
    for vertices in cp_penta_c1_vertices:
        dim_1 = round(vertices[2].DistanceTo(vertices[3]),2)
        dim_2 = round(vertices[3].DistanceTo(vertices[4]),2)
        dim_3 = round(vertices[2].DistanceTo(vertices[1]),2)
        ratio = round(dim_1 / dim_2, 2)
        cp_penta_dim_trios.append([[dim_1, dim_2, dim_3], ratio])
    for vertices in cp_penta_c2_vertices:
        dim_1 = round(vertices[0].DistanceTo(vertices[1]),2)
        dim_2 = round(vertices[1].DistanceTo(vertices[2]),2)
        dim_3 = round(vertices[0].DistanceTo(vertices[4]),2)
        ratio = round(dim_1 / dim_2, 2)
        cp_penta_dim_trios.append([[dim_1, dim_2, dim_3], ratio])

    # Add lists together (ensuring consistent index)
    cp_penta_curves = cp_penta_c1_curves + cp_penta_c2_curves
    cp_penta_vertices = cp_penta_c1_vertices + cp_penta_c2_vertices

    # Determine new mean height based upon FAR
    if floor_area_ratio is not None:
        # Get areas of parcels
        gp_areas = []
        for gp_curve in gp_curves:
            gp_curve = rs.coercecurve(gp_curve)
            gp_area = rs.CurveArea(gp_curve)
            gp_areas.append(gp_area[0])

        cp_quad_areas = []
        for cp_curve in cp_quad_curves:
            cp_curve = rs.coercecurve(cp_curve)
            cp_area = rs.CurveArea(cp_curve)
            cp_quad_areas.append(cp_area[0])

        cp_penta_areas = []
        for cp_curve in cp_penta_curves:
            cp_curve = rs.coercecurve(cp_curve)
            cp_area = rs.CurveArea(cp_curve)
            cp_penta_areas.append(cp_area[0])    

        all_areas = gp_areas + cp_quad_areas + cp_penta_areas
        total_parcel_area = round(sum(all_areas), 2)
        # Assumption: floor height = 2.5m
        floor_height = 2.5
        b_mean_height = boundary_area * floor_area_ratio * floor_height / total_parcel_area
        if b_max_height < b_mean_height:
            b_max_height = b_mean_height
        if b_min_height > b_mean_height:
            b_min_height = b_mean_height



    #######################################
    """ ASSING BUILDING MAPS TO PARCELS """

    # When comparing the dimensions and aspect ratios, give aspect ratios more weight:
    aspect_ratio_weight = 100

    # Assign generic building map
    gp_building_map = find_best_matches(gp_dim_pairs, generic_buildings_map, aspect_ratio_weight)

    # Assign quadrilateral corner building map
    cp_quad_building_map = find_best_matches(cp_quad_dim_pairs, cp_buildings_map_quad, aspect_ratio_weight)

    # Assign pentalateral corner building map
    if cp_penta_dim_trios:
        cp_penta_building_map = find_best_matches(cp_penta_dim_trios, cp_buildings_map_penta, aspect_ratio_weight)
    else:
        print(cp_buildings_map_penta)
        cp_penta_building_map = find_best_matches(cp_quad_dim_pairs, cp_buildings_map_penta, aspect_ratio_weight)




    ################################
    """ CREATE GENERIC BUILDINGS """

    # Initialize list to store generic bulidings
    generic_buildings_footprints = []
    generic_buildings_3D = []

    # Loop through all generic parcels
    for i, generic_parcel in enumerate(gp_curves):

        # Extract vertices from generic parcel
        generic_parcel = rs.coercecurve(generic_parcel)
        gp_vertices = extract_vertices_from_curve(generic_parcel)

        # Generate grid for quadrilateral parcel
        gp_grid = generate_grid_in_quadrilateral_parcel(gp_vertices, grid_resolution)

        # Initialize lists for 3D building creation
        building_footprints = []
        building_vertices = []
        building_dist_sum = []
        building_vertices_distance_to_edge = [[] for _ in range(len(gp_building_map[i]))]

        # Loop through all buildings on parcel
        for j in range(len(gp_building_map[i])):
            gp_building_indeces = gp_building_map[i][j]
            mapped_building_vertices = map_indices_to_points(gp_building_indeces, gp_grid)

            # Ensure the polyline is closed by appending the first vertex at the end if needed
            if mapped_building_vertices[0].DistanceTo(mapped_building_vertices[-1]) > tolerance:
                mapped_building_vertices.append(mapped_building_vertices[0])

            # Create generic building footprint and append to generic building footprints
            generic_building_outline = rs.AddPolyline(mapped_building_vertices)
            generic_buildings_footprints.append(generic_building_outline)

            # Measure distance of building footprints to edge
            generic_building_curve = rs.coercecurve(generic_building_outline)
            building_footprints.append(generic_building_curve)
            gb_vertices = generic_building_curve.ToPolyline().ToArray()
            building_vertices.append(gb_vertices)
            for vertex in gb_vertices:
                dist_1 = round(vertex.DistanceTo(gp_vertices[0]), 2)
                dist_2 = round(vertex.DistanceTo(gp_vertices[1]), 2)
                building_vertices_distance_to_edge[j].append(dist_1)
                building_vertices_distance_to_edge[j].append(dist_2)

        # Distance from boundary edge for reasonable height distribution
        for j in range(len(building_vertices_distance_to_edge)):
            weighted_dist = sum(building_vertices_distance_to_edge[j]) / len(building_vertices_distance_to_edge[j])
            dist_sum = round(weighted_dist ,2)
            building_dist_sum.append(dist_sum)

        # Get a height from data package (or from the FAR calculation)
        b_gauss_height = round(random.gauss(b_mean_height, b_height_std))
        height = int(max(b_min_height, min(b_gauss_height, b_max_height)))

        # Figure out if any footprint lies on another one
        building_footprint_inside, idx_outline_inside, idx_outline_surrounding = check_building_footprints_inside(building_footprints, building_vertices, tolerance)

        # Get a height from data package
        b_gauss_height = round(random.gauss(b_mean_height, b_height_std))
        height = int(max(b_min_height, min(b_gauss_height, b_max_height)))

        # Create generic building extrustions
        # Address the buildings with the outline inside:
        if building_footprint_inside == True:
            # First, address the buildings with the outline inside:
            surrounding_footprint = rs.coercecurve(building_footprints[idx_outline_surrounding])
            inside_footprint = rs.coercecurve(building_footprints[idx_outline_inside])
            surrounding_building = extrude_polyline(surrounding_footprint, height)
            inside_building = extrude_polyline(inside_footprint, height + 3)
            generic_buildings_3D.append(surrounding_building)
            generic_buildings_3D.append(inside_building)
            height = height + random.choice([-3, 3])

            # Delete the larger index first to avoid index shift issues
            indices_to_remove = sorted([idx_outline_surrounding, idx_outline_inside], reverse=True)
            for index in indices_to_remove:
                for lst in [building_footprints, building_dist_sum]:
                    del lst[index]

        # Sort lists according to buliding distance to edge sum
        if len(building_footprints) > 0:
            sorted_pairs = sorted(zip(building_dist_sum, building_footprints), key=lambda x: x[0], reverse=True)
            building_dist_sum, building_footprints = zip(*sorted_pairs)

            for footprint in building_footprints:      
                footprint = rs.coercecurve(footprint)
                generic_building = extrude_polyline(footprint, height)
                generic_buildings_3D.append(generic_building)
                rng = random.uniform(0,1)
                if rng < 0.2:
                    if height > 6:
                        height = height - 6
                else:
                    if height > 3:
                        height = height - 3



    ################################
    """ CREATE CORNER BUILDINGS """

    # Initialize list to store generic bulidings
    corner_buildings_footprints = []
    corner_buildings_3D = []

    # Loop through all quadrilateral corner parcels
    for i, corner_parcel_quad in enumerate(cp_quad_curves):

        # Extract vertices from quadrilateral corner parcel
        corner_parcel = rs.coercecurve(corner_parcel_quad)
        cp_vertices = extract_vertices_from_curve(corner_parcel)

        # Generate grid for quadrilateral parcel
        cp_grid = generate_grid_in_quadrilateral_parcel(cp_vertices, grid_resolution)

        # Initialize lists for 3D building creation
        building_footprints = []
        building_vertices = []
        building_dist_sum = []
        building_vertices_distance_to_edge = [[] for _ in range(len(cp_quad_building_map[i]))]   

        # Loop through all buildings on parcel
        for j in range(len(cp_quad_building_map[i])):
            cp_building_indeces = cp_quad_building_map[i][j]
            mapped_building_vertices = map_indices_to_points(cp_building_indeces, cp_grid)

            # Ensure the polyline is closed by appending the first vertex at the end if needed
            if mapped_building_vertices[0].DistanceTo(mapped_building_vertices[-1]) > tolerance:
                mapped_building_vertices.append(mapped_building_vertices[0])

            # Create corner building footprint and append to building footprints
            corner_building_outline = rs.AddPolyline(mapped_building_vertices)
            corner_buildings_footprints.append(corner_building_outline)

            # Measure distance of building footprints edges
            corner_building_curve = rs.coercecurve(corner_building_outline)
            building_footprints.append(corner_building_curve)
            cb_vertices = corner_building_curve.ToPolyline().ToArray()
            building_vertices.append(cb_vertices)
            for vertex in cb_vertices:
                dist_1 = round(vertex.DistanceTo(cp_vertices[0]), 2)
                dist_2 = round(vertex.DistanceTo(cp_vertices[1]), 2)
                dist_3 = round(vertex.DistanceTo(cp_vertices[3]), 2)
                building_vertices_distance_to_edge[j].append(dist_1)
                building_vertices_distance_to_edge[j].append(dist_2)
                building_vertices_distance_to_edge[j].append(dist_3)

        # Distance from boundary edge for reasonable height distribution
        for j in range(len(building_vertices_distance_to_edge)):
            weighted_dist = sum(building_vertices_distance_to_edge[j]) / len(building_vertices_distance_to_edge[j])
            dist_sum = round(weighted_dist ,2)
            building_dist_sum.append(dist_sum)

        # Get a height from data package (or from the FAR calculation)
        b_gauss_height = round(random.gauss(b_mean_height, b_height_std))
        height = int(max(b_min_height, min(b_gauss_height, b_max_height)))

        # Figure out if any footprint lies on another one
        building_footprint_inside, idx_outline_inside, idx_outline_surrounding = check_building_footprints_inside(building_footprints, building_vertices, tolerance)

        # Create corner building extrustions
        # Address the buildings with the outline inside:
        if building_footprint_inside == True:
            surrounding_footprint = rs.coercecurve(building_footprints[idx_outline_surrounding])
            surrounding_footprint = clean_polyline(surrounding_footprint)
            inside_footprint = rs.coercecurve(building_footprints[idx_outline_inside])
            inside_footprint = clean_polyline(inside_footprint)
            surrounding_building = extrude_polyline(surrounding_footprint, height)
            inside_building = extrude_polyline(inside_footprint, height + 3)
            corner_buildings_3D.append(surrounding_building)
            corner_buildings_3D.append(inside_building)
            height = height + random.choice([-3, 3])

            # Delete the larger index first to avoid index shift issues
            indices_to_remove = sorted([idx_outline_surrounding, idx_outline_inside], reverse=True)
            for index in indices_to_remove:
                for lst in [building_footprints, building_dist_sum]:
                    del lst[index]

        # Address rest of the buildings
        # Sort lists according to buliding distance to edge sum
        if len(building_footprints) > 0:
            sorted_pairs = sorted(zip(building_dist_sum, building_footprints), key=lambda x: x[0], reverse=True)
            building_dist_sum, building_footprints = zip(*sorted_pairs)
            for footprint in building_footprints:           
                footprint = rs.coercecurve(footprint)
                footprint = clean_polyline(footprint)
                corner_building = extrude_polyline(footprint, height)
                corner_buildings_3D.append(corner_building)
                rng = random.uniform(0,1)
                if rng < 0.2:
                    if height > 6:
                        height = height - 6
                else:
                    if height > 3:
                        height = height - 3

    print(len(cp_penta_curves))
    print(len(cp_penta_building_map))
    # Loop through all pentalateral corner parcels
    for i, corner_parcel in enumerate(cp_penta_curves):
        
        # Extract vertices from pentalateral corner parcel
        cp_polyline = corner_parcel.ToPolyline()
        cp_vertices = list(cp_polyline.ToArray())

        # Compute centroid
        center = compute_centroid(cp_vertices)

        # Generate a "grid" by subdividing the parcel through triangulation
        cp_triangles, cp_indexed_points = generate_grid_in_pentalateral_parcel(cp_vertices, center)

        # Initialize lists for 3D building creation
        building_footprints = []
        building_vertices = []
        building_dist_sum = []
        building_vertices_distance_to_edge = [[] for _ in range(len(cp_penta_building_map[i]))]   

        # Loop through all buildings on parcel
        for j in range(len(cp_penta_building_map[i])):
            cp_building_indeces = cp_penta_building_map[i][j]
            mapped_building_vertices = map_indices_to_points(cp_building_indeces, cp_indexed_points)

            # Ensure the polyline is closed by appending the first vertex at the end if needed
            if mapped_building_vertices[0].DistanceTo(mapped_building_vertices[-1]) > tolerance:
                mapped_building_vertices.append(mapped_building_vertices[0])

            # Create generic building footprint and append to generic building footprints
            corner_building_outline = rs.AddPolyline(mapped_building_vertices)
            corner_buildings_footprints.append(corner_building_outline)

            # Measure distance of building footprints edges
            corner_building_curve = rs.coercecurve(corner_building_outline)
            building_footprints.append(corner_building_curve)
            cb_vertices = corner_building_curve.ToPolyline().ToArray()
            building_vertices.append(cb_vertices)
            for vertex in cb_vertices:
                dist_1 = round(vertex.DistanceTo(cp_vertices[0]), 2)
                dist_2 = round(vertex.DistanceTo(cp_vertices[1]), 2)
                building_vertices_distance_to_edge[j].append(dist_1)
                building_vertices_distance_to_edge[j].append(dist_2)


        # Distance from boundary edge for reasonable height distribution
        for j in range(len(building_vertices_distance_to_edge)):
            weighted_dist = sum(building_vertices_distance_to_edge[j]) / len(building_vertices_distance_to_edge[j])
            dist_sum = round(weighted_dist ,2)
            building_dist_sum.append(dist_sum)      

        # Get a height from data package (or from the FAR calculation)
        b_gauss_height = round(random.gauss(b_mean_height, b_height_std))
        height = random.uniform(b_min_height, b_max_height) 

        # Figure out if any footprint lies on another one
        building_footprint_inside, idx_outline_inside, idx_outline_surrounding = check_building_footprints_inside(building_footprints, building_vertices, tolerance)

        # Create corner building extrustions
        # Address the buildings with the outline inside:
        if building_footprint_inside == True:
            surrounding_footprint = rs.coercecurve(building_footprints[idx_outline_surrounding])
            surrounding_footprint = clean_polyline(surrounding_footprint)
            inside_footprint = rs.coercecurve(building_footprints[idx_outline_inside])
            inside_footprint = clean_polyline(inside_footprint)
            surrounding_building = extrude_polyline(surrounding_footprint, height)
            inside_building = extrude_polyline(inside_footprint, height + 6)
            corner_buildings_3D.append(surrounding_building)
            corner_buildings_3D.append(inside_building)
            height = height + random.choice([-6, 6])

            # Delete the larger index first to avoid index shift issues
            indices_to_remove = sorted([idx_outline_surrounding, idx_outline_inside], reverse=True)
            for index in indices_to_remove:
                for lst in [building_footprints, building_dist_sum]:
                    del lst[index]

        # Address rest of the buildings
        # Sort lists according to buliding distance to edge sum
        if len(building_footprints) > 0:
            sorted_pairs = sorted(zip(building_dist_sum, building_footprints), key=lambda x: x[0], reverse=True)
            building_dist_sum, building_footprints = zip(*sorted_pairs)
            for footprint in building_footprints:
                footprint = rs.coercecurve(footprint)
                footprint = clean_polyline(footprint)
                corner_building = extrude_polyline(footprint, height)
                corner_buildings_3D.append(corner_building)
                rng = random.uniform(0,1)
                if rng < 0.5:
                    if height > 12:
                        height = height - 12
                else:
                    if height > 6:
                        height = height - 6

    ################
    """ OUTPUTS """

    for gb_footprint in generic_buildings_footprints:
        footprints.append(gb_footprint)
    for cb_footprint in corner_buildings_footprints:
        footprints.append(cb_footprint)
    for gb_3D in generic_buildings_3D:
        extrusions.append(gb_3D)
    for cp_3D in corner_buildings_3D:
        extrusions.append(cp_3D)
# ---------- end building_generation_2 ----------

# ----
# Random seed
number_slider_6 = Slider(0, range=0..100)

# ----
# ENABLE
# Building Generation
# Floor-Area-Ratio
building_generation_3 = Python3Script(
    boundaries=merge_boundaries_2,
    all_parcels_building_generation=merge_parcels_2,
    floor_area_ratio=Slider(15, range=0..51),
    corner_buildings_map=custom_building_mapping.corner_buildings_map,
    generic_buildings_map=custom_building_mapping.generic_buildings_map,
    height_info=get_heights_3,
    random_seed=number_slider_6)  # -> footprints, extrusions; inputs boundaries: list, all_parcels_building_generation: list, corner_buildings_map: list, generic_buildings_map: list, height_info: list; disabled; same code as building_generation_2

# ----
# Boundary Cluster #4
generic_parcel_length_standard_deviation_9 = Slider(6.2, range=0..100)
generic_parcel_length_standard_deviation_10 = Slider(6.2, range=0..100)
generic_parcel_width_standard_deviation_9 = Slider(33.4, range=0..100)
generic_parcel_width_standard_deviation_10 = Slider(33.4, range=0..100)
generic_parcel_maximum_length_9 = Slider(20.5, range=0..100)
generic_parcel_maximum_length_10 = Slider(8.6, range=0..100)
generic_parcel_minimum_length_9 = Slider(15, range=0..100)
generic_parcel_minimum_length_10 = Slider(7, range=0..100)
generic_parcel_maximum_width_9 = Slider(32.2, range=0..100)
generic_parcel_maximum_width_10 = Slider(8.6, range=0..100)
generic_parcel_minimum_width_9 = Slider(21.4, range=0..100)
corner_parcel_minimum_width_9 = Slider(22.1, range=0..100)
generic_parcel_minimum_width_10 = Slider(9.1, range=0..100)
corner_parcel_minimum_width_10 = Slider(9, range=0..100)
corner_parcel_maximum_width_9 = Slider(27.4, range=0..100)
corner_parcel_maximum_angle_9 = Slider(90, range=0..100)
corner_parcel_maximum_width_10 = Slider(28.8, range=0..100)
corner_parcel_maximum_angle_10 = Slider(90, range=0..100)
corner_parcel_minimum_angle_9 = Slider(90, range=0..100)
corner_parcel_minimum_angle_10 = Slider(90, range=0..100)
indentation_reference_length_9 = Slider(0, range=0..100)
indentation_reference_length_10 = Slider(0, range=0..100)
generic_parcel_mean_length_9 = Slider(16.5, range=0..100)
generic_parcel_mean_length_10 = Slider(13.3, range=0..100)
generic_parcel_mean_width_9 = Slider(7, range=0..100)
generic_parcel_mean_width_10 = Slider(10, range=0..100)
random_seed_integer_10 = Slider(3, range=0..10)
random_seed_integer_11 = Slider(3, range=0..10)
penta_threshold_9 = Slider(29.8, range=0..100)
penta_threshold_10 = Slider(29.8, range=0..100)
boundaries_9 = Curve([<curve referenced from the Rhino model> x5])
boundaries_10 = Curve([<curve referenced from the Rhino model> x3])
custom_parcel_generation_9 = Python3Script(
    boundaries=boundaries_9,
    cp_min_width=corner_parcel_minimum_width_9,
    cp_max_width=corner_parcel_maximum_width_9,
    cp_min_angle=corner_parcel_minimum_angle_9,
    cp_max_angle=corner_parcel_maximum_angle_9,
    gp_mean_length=generic_parcel_mean_length_9,
    gp_min_length=generic_parcel_minimum_length_9,
    gp_max_length=generic_parcel_maximum_length_9,
    gp_length_std=generic_parcel_length_standard_deviation_9,
    gp_mean_width=generic_parcel_mean_width_9,
    gp_min_width=generic_parcel_minimum_width_9,
    gp_max_width=generic_parcel_maximum_width_9,
    gp_width_std=generic_parcel_width_standard_deviation_9,
    ind_ref_length=indentation_reference_length_9,
    penta_threshold=penta_threshold_9,
    random_seed=random_seed_integer)  # -> all_parcels, all_parcels_building_generation; inputs boundaries: list, random_seed: Int32
# ---------- custom_parcel_generation_9: Python ----------
import rhinoscriptsyntax as rs
import Rhino.Geometry as rg
import random
import math

#####################################################################################

""" FUNCTIONS"""

# Function to rotate two lists together
def rotate_list(lst):
    # Get a random index as the new starting point
    random_index = random.randint(0, len(lst) - 1)
    # Rotate the list using slicing
    rotated_list = lst[random_index:] + lst[:random_index]
    return rotated_list

# Function to find the closest first value in each nested list compared to a reference
def find_closest_values(nested_list, reference):
    closest_value = None
    closest_list = None
    min_difference = float('inf')  # Start with a very large value for comparison
    # Iterate over the nested lists
    for sublist in nested_list:
        first_value = sublist[0]  # Get the first value of the current nested list
        difference = abs(first_value - reference)  # Calculate the difference
        # Check if this is the smallest difference so far
        if difference < min_difference:
            min_difference = difference
            closest_value = first_value
            closest_list = sublist
    if closest_list:
        return closest_list[1:]  # Get the other two values from the closest list
    else:
        return None

# Function to calculate signed area to determine polygon orientation
def signed_area(vertices):
    area = 0.0
    n = len(vertices)
    for i in range(n):
        x1, y1, _ = vertices[i]
        x2, y2, _ = vertices[(i + 1) % n]
        area += (x1 * y2 - x2 * y1)
    return area / 2.0

# Function to create unitized vectors refering to the (counter-clockwise) direction of each edge
def compute_vector(edge):
    edge_vector = rs.VectorUnitize(rs.VectorCreate(edge[1], edge[0]))
    return edge_vector

# Function to reverse any vector
def rev_vector(vector):
    reversed_vector = rs.VectorScale(vector, -1)
    return reversed_vector

# Function to get input angle vector
def angle_vec(start_point, end_point, angle):
    direction_vector = rg.Vector3d(end_point.X - start_point.X, end_point.Y - start_point.Y, 0)
    arg = math.radians(angle)
    rotated_x = direction_vector.X * math.cos(arg) - direction_vector.Y * math.sin(arg)
    rotated_y = direction_vector.X * math.sin(arg) + direction_vector.Y * math.cos(arg)
    angle_vector = rg.Vector3d(rotated_x, rotated_y, 0)
    angle_vector.Unitize()
    return angle_vector

# Function to interpolate between two vectors
def interpolate_vectors(vec1, vec2, t):
    interpolated_vec = rg.Vector3d(
        (1 - t) * vec1.X + t * vec2.X,
        (1 - t) * vec1.Y + t * vec2.Y,
        (1 - t) * vec1.Z + t * vec2.Z
    )
    interpolated_vec.Unitize()
    return interpolated_vec

# Function to receive intersection point of two vectors
def find_intersection(start_pt_1, vec_1, start_pt_2, vec_2):
    # Solve for t and s such that start_pt_1 + t*vec_1 = start_pt_2 + s*vec_2
    denom = vec_1.X * vec_2.Y - vec_1.Y * vec_2.X
    if denom == 0:
        return None  # Parallel lines, no intersection
    t = ((start_pt_2.X - start_pt_1.X) * vec_2.Y - (start_pt_2.Y - start_pt_1.Y) * vec_2.X) / denom
    s = ((start_pt_2.X - start_pt_1.X) * vec_1.Y - (start_pt_2.Y - start_pt_1.Y) * vec_1.X) / denom
    intersection = rg.Point3d(start_pt_1.X + t * vec_1.X, start_pt_1.Y + t * vec_1.Y, 0)
    return intersection

# Function to check polyline intersection
def check_polyline_intersection(polyline1, polyline2):
    curve1 = polyline1.ToNurbsCurve()  # Convert the polylines to curve objects
    curve2 = polyline2.ToNurbsCurve()
    intersection_events = rg.Intersect.Intersection.CurveCurve(curve1, curve2, 0.001, 0.0) # Check for curve-curve intersection
    if intersection_events.Count > 0:
        return True # If any intersections are found, return True
    else:
        return False # Otherwise, return False

def calculate_if_angle_between_edges_is_smaller_than_110(unit_vec_1, unit_vec_2): 
    dot_product = rg.Vector3d.Multiply(unit_vec_1, unit_vec_2)  # Compute the dot product
    dot_product = max(min(dot_product, 1.0), -1.0)  # Clamp the value to avoid numerical issues
    # Compute the angle in radians
    angle_radians = math.acos(dot_product)
    # Convert the angle to degrees
    angle_degrees = math.degrees(angle_radians)
    if angle_degrees < 110:
        return True  # Angle is smaller than 110°
    else:
        return False  # Angle is 110° or larger

def calculate_angle_between_edges(unit_vec_1, unit_vec_2): 
    dot_product = rg.Vector3d.Multiply(unit_vec_1, unit_vec_2)  # Compute the dot product
    dot_product = max(min(dot_product, 1.0), -1.0)  # Clamp the value to avoid numerical issues
    # Compute the angle in radians
    angle_radians = math.acos(dot_product)
    # Convert the angle to degrees
    angle_degrees = math.degrees(angle_radians)
    return angle_degrees 

# Function to  clamp value to stay within the given range [min_val, max_val].
def clamp(value, min_val, max_val):
    return max(min(value, max_val), min_val)

# Function to Apply a slight deviation to values in the local domain while ensuring they stay within the global domain.
def apply_deviation_within_domain(global_domain, local_domain, deviation_percentage=0.1):
    # Unpack global and local domains
    min_global, max_global = global_domain
    min_local, max_local = local_domain
    # Calculate the allowable deviation as a percentage of the local domain range
    deviation_range = (max_local - min_local) * deviation_percentage
    # Apply random deviation to the local domain values
    new_min = min_local + random.uniform(-deviation_range, deviation_range)
    new_max = max_local + random.uniform(-deviation_range, deviation_range)
    # Ensure the new values stay within the global domain by clamping
    new_min = clamp(new_min, min_global, max_global)
    new_max = clamp(new_max, min_global, max_global)
    return new_min, new_max

# Function to find corresponding dimensions
def find_matching_lengths(pairs, width):
    # Define tolerance (10% of difference max and min)
    widths = [pair[1] for pair in pairs]
    max_width = max(widths)
    min_width = min(widths)
    tolerance = 0.1*(max_width - min_width)
    # Define the domain around the random width (± tolerance)
    lower_bound = width - tolerance
    upper_bound = width + tolerance
    # Filter the pairs where the length is within the domain
    matching_pairs = [pair for pair in pairs if lower_bound <= pair[1] <= upper_bound]
    # If there are no matching pairs, random choice
    if not matching_pairs:
        selected_pair = random.choice(pairs)
        return selected_pair[0]
    else:
        # Randomly select one of the matching pairs and return the corresponding width
        selected_pair = random.choice(matching_pairs)
        # Return the matching lenght
        return selected_pair[0]

# Function to calculate the angle between 2 lines
def calculate_angle_between_lines(point_start, point_end1, point_end2):
    # Define the vectors based on the starting point and endpoints
    vector1 = [point_end1[0] - point_start[0], point_end1[1] - point_start[1]]
    vector2 = [point_end2[0] - point_start[0], point_end2[1] - point_start[1]]
    # Calculate the dot product of the two vectors
    dot_product = vector1[0] * vector2[0] + vector1[1] * vector2[1]
    # Calculate the magnitudes (lengths) of the two vectors
    magnitude1 = math.sqrt(vector1[0]**2 + vector1[1]**2)
    magnitude2 = math.sqrt(vector2[0]**2 + vector2[1]**2)
    # Calculate the cosine of the angle
    cos_theta = dot_product / (magnitude1 * magnitude2)
    # Calculate the angle in radians
    angle_radians = math.acos(cos_theta)
    # Convert the angle to degrees (optional)
    angle_degrees = math.degrees(angle_radians)
    return angle_degrees

#####################################################################################

# SHORTCUTS FOR LEGIBILITY:
# generic_parcels: "gp"
# corner_parcels: "gp"

###################################
""" INPUTS, LISTS AND CONSTANTS """

# Boundary curves are the input
boundary_curves = boundaries

# Set tolerance for geometric comparison
tolerance = 1e-5

# Set the random seed to ensure reproducible results
random.seed(random_seed)

# Initialize output
all_parcels = []
all_parcels_building_generation = []

# Reference boundary curve
ref_boundary_curve = boundary_curves[0]
ref_area = rs.CurveArea(ref_boundary_curve)[0]


##########################
""" SETTING THE SCENE """

for boundary_curve in boundary_curves:

    # Boundary curve input
    boundary_curve = rs.coercecurve(boundary_curve)  
    boundary_area = rs.CurveArea(boundary_curve)[0]
    boundary_area = round(boundary_area,2)
    boundary_vertices = boundary_curve.ToPolyline().ToArray()

    # Get scalar
    scalar_area = boundary_area / ref_area
    scalar =  round(math.sqrt(scalar_area),2)

    # Input
    corner_parcel_type = "quadrilateral"
    corner_dim = rg.Interval(scalar * cp_min_width, scalar * cp_max_width)
    cp_angle_mean = (cp_min_angle + cp_max_angle)/2
    cp_angles = []
    for i in range(len(boundary_vertices)-1):
        lb_angle = random.uniform(cp_min_angle, cp_angle_mean)
        ub_angle = random.uniform(cp_angle_mean, cp_max_angle)
        cp_angles.append([lb_angle, ub_angle])
    gp_lengths_mean = scalar * gp_mean_length
    gp_length_lb = scalar * gp_min_length
    gp_length_ub = scalar * gp_max_length
    gp_lengths_domain = rg.Interval(gp_length_lb, gp_length_ub)
    gp_lengths_sd = gp_length_std
    gp_widths_mean = scalar * gp_mean_width
    gp_width_lb = scalar * gp_min_width
    gp_width_ub = scalar * gp_max_width
    gp_widths_domain = rg.Interval(gp_width_lb, gp_width_ub)
    gp_widths_sd = gp_width_std
    indentation_reference_length = ind_ref_length * scalar
    gp_dim_pairs = []
    cp_dim_pairs = []
    for i in range(len(boundary_vertices)-1):
        gp_dim_1 = random.uniform(gp_lengths_domain[0], gp_lengths_domain[1])
        gp_dim_2 = random.uniform(gp_widths_domain[0], gp_widths_domain[1])
        gp_dim_pairs.append([gp_dim_1, gp_dim_2])
        cp_dim_1 = random.uniform(corner_dim[0], corner_dim[1])
        cp_dim_2 = random.uniform(corner_dim[0], corner_dim[1])
        cp_dim_3 = random.uniform(corner_dim[0], corner_dim[1])
        cp_dim_pairs.append([cp_dim_1, cp_dim_2])
        cp_dim_pairs.append([cp_dim_1, cp_dim_2, cp_dim_3])
    penta_threshold = penta_threshold

    

    # Initialize lists to store data and geometry
    generic_parcels = []
    corner_parcels = []
    cp_vertices = []
    cp_config = []


    ###################################
    """ BOUNDARY POLYGON DISSECTION """

    # Get the boundary polygon edges and vertices
    boundary_pts = rs.PolylineVertices(boundary_curve)
    if len(boundary_pts) < 4:
        raise ValueError("Invalid Boundary, must have at least three vertices")
    if boundary_pts[0] != boundary_pts[len(boundary_pts)-1]:
        raise ValueError("Boundary Polygon must be a closed Polyline Curve")

    # Ensure counter-clockwise order for consistent polyline construction
    if signed_area(boundary_pts) < 0:
        boundary_pts.reverse()  # Reverse the order to make it counter-clockwise

    # Create a list of edges (based on boundary point index)
    edges = [(boundary_pts[i], boundary_pts[(i + 1) % len(boundary_pts)]) for i in range(len(boundary_pts) - 1)]

    # Create unit vectors, to ensure accurate geometric operations according to the boundary edge vectors.
    unit_vecs = []
    for i in range(len(boundary_pts)-1):
        unit_vecs.append(compute_vector(edges[i]))

    # Determine if angle between edges is less than 110 or obtuse and assign to corresponding boundary point index
    angle_small = []
    for i in range(len(boundary_pts)-1):
        acute_boolean = calculate_if_angle_between_edges_is_smaller_than_110(unit_vecs[i], rev_vector(unit_vecs[(i-1) % len(unit_vecs)]))
        angle_small.append(acute_boolean)

    # Split corner dim lists
    cp_dim_duo = []
    cp_dim_trio = []

    # Iterate over the original list and sort based on the length of each nested list
    for dimension_pair in cp_dim_pairs:
        if len(dimension_pair) == 3:
            cp_dim_trio.append(dimension_pair)
        elif len(dimension_pair) == 2:
            cp_dim_duo.append(dimension_pair)


    ##############################
    """ CREATE CORNER PARCELS """

    # Configurations for while loop
    i = 0 # Initialize the loop counter i
    max_iterations = len(boundary_pts) * 2  # Allow for double the length of boundary points as a safeguard
    safeguard = 0 #  Initialize safeguard to prevent infinite loops
    first_iteration = True
    stored_width = 0

    # Iterate over each corner
    while i < (len(boundary_pts)-1) and safeguard < max_iterations:
        
        # Increment safeguard to track progress
        safeguard += 1

        # For legibility of code
        j = (i-1) % len(edges) 
        k = (i+1) % len(edges)

        if first_iteration:
            control_dist = edges[j][0].DistanceTo(edges[j][1])
            if control_dist <= penta_threshold:
                first_iteration = False
                continue
            else:
                first_iteration = False

        # Establish edge distances
        edge_distance_1 = edges[i][0].DistanceTo(edges[i][1])
        edge_distance_2 = edges[j][0].DistanceTo(edges[j][1])
        edge_distance_3 = edges[k][0].DistanceTo(edges[k][1])  


        # Assign corner config based upon threshold
        control_dist = edges[i][0].DistanceTo(edges[i][1])
        if control_dist > penta_threshold:
            corner_parcel_type = "quadrilateral"
            
        elif control_dist <= penta_threshold:
            corner_parcel_type = "pentalateral"
            

        # Create quadrilateral corner parcel
        if corner_parcel_type == "quadrilateral" and angle_small[i] == True: 
            
            # Get relevant angles of boundary polygon
            bp_angle = calculate_angle_between_edges(rev_vector(unit_vecs[j]), unit_vecs[i])

            # Generate random width and height for each corner parcel based upon the corner dimensions
            cp_dim_choice = random.choice(cp_dim_duo)
            cp_dim_local = rg.Interval(cp_dim_choice[0], cp_dim_choice[1])
 
            # If assigned domain exceeds half of edges dimensions, cap the width
            corner_width_1, corner_width_2 = apply_deviation_within_domain(corner_dim, cp_dim_local, deviation_percentage=0.25)
            if edge_distance_1/2 < corner_width_1:
                corner_width_1 = round(random.uniform(edge_distance_1 * (1/4), edge_distance_1 * (1/3)))
            elif edge_distance_2/2 < corner_width_2:
                corner_width_2 = round(random.uniform(edge_distance_2 * (1/4), edge_distance_2 * (1/3)))

            # Get angles
            r = random.randint(0, (len(cp_angles)-1))
            angle_1 = cp_angles[r][0]
            angle_2 = cp_angles[r][1]

            # Avoid overlap if angle is very acute
            if bp_angle <= 80:
                angle_1 = 90
                angle_2 = 90
                if corner_width_1 > corner_width_2:
                    corner_width_2 = random.uniform(corner_width_1 * 0.7, corner_width_1 * 0.9)
                else:
                    corner_width_1 = random.uniform(corner_width_2 * 0.7, corner_width_2 * 0.9)

            # Adjust corner parcel angles if boundary polygon angle is obtuse
            if bp_angle >= 100:
                angle_correction = (bp_angle - random.uniform(85, 95)) * 0.5
                angle_2 = angle_2 - angle_correction
                     
            # Control stored width
            if corner_width_2 > edge_distance_1 - stored_width:
                corner_width_2 = stored_width                     
            
            # Construct polyline vertices
            cp_0 = edges[i][0] 
            cp_1 = rs.PointAdd(cp_0, unit_vecs[i] * corner_width_1)
            cp_3 = rs.PointAdd(cp_0, rev_vector(unit_vecs[j]) * corner_width_2)
            cp_2 = find_intersection(cp_1, angle_vec(edges[i][0], edges[i][1], angle_1), cp_3, angle_vec(edges[j][0], edges[j][1], angle_2))

            # Create quadrilateral polyline
            corner_polyline = [cp_0, cp_1, cp_2, cp_3, cp_0]
            corner_parcels.append(rs.AddPolyline(corner_polyline))
            cp_vertices.append(corner_polyline)
            cp_config.append("quadrilateral")

            # Increment loop counter by 1
            i += 1

            # Store width to compare in next iteration
            stored_width = corner_width_1

        # Create pentalateral corner parcels if angle is larger than 110°
        elif corner_parcel_type == "quadrilateral" and angle_small[i] == False:


            cp_dim_choice = random.choice(cp_dim_duo)
            cp_dim_local = rg.Interval(cp_dim_choice[0], cp_dim_choice[1])

            # If assigned domain exceeds half of edges dimensions, cap the width
            corner_width_1, corner_width_2 = apply_deviation_within_domain(corner_dim, cp_dim_local, deviation_percentage=0.25)
            if edge_distance_1/2 < corner_width_1:
                corner_width_1 = round(random.uniform(edge_distance_1 * (1/4), edge_distance_1 * (1/3)))
                print("ok")
            elif edge_distance_2/2 < corner_width_2:
                corner_width_2 = round(random.uniform(edge_distance_2 * (1/4), edge_distance_2 * (1/3)))

            # Control geometry by limiting height between corner widths
            corner_height = random.uniform(corner_width_1, corner_width_2)

            # Get angles
            r = random.randint(0, (len(cp_angles)-1))
            angle_1 = cp_angles[r][0]
            angle_2 = cp_angles[r][1]

            # Construct polyline vertices
            cp_0 = edges[i][0]
            cp_1 = rs.PointAdd(cp_0, unit_vecs[i] * corner_width_1)
            cp_2 = rs.PointAdd(cp_1, angle_vec(edges[i][0], edges[i][1], angle_1) * corner_height)
            cp_4 = rs.PointAdd(cp_0, rev_vector(unit_vecs[j]) * corner_width_2)
            cp_3 = rs.PointAdd(cp_4, angle_vec(edges[j][0], edges[j][1], angle_2) * corner_height)

            # Determine possible intersection(s) to ensure appropriate geometry of corner parcel
            control_curve_1 = rg.Polyline([cp_1, cp_2]).ToNurbsCurve() 
            control_curve_2 = rg.Polyline([cp_3, cp_4]).ToNurbsCurve()
            intersection = rg.Intersect.Intersection.CurveCurve(control_curve_1, control_curve_2, tolerance, tolerance)

            # If the curves do not intersect, create pentalateral corner parcel
            if intersection.Count == 0:
                corner_polyline = [cp_0, cp_1, cp_2, cp_3, cp_4, cp_0]
                corner_parcels.append(rs.AddPolyline(corner_polyline)) # Construct current iteration of corner
                cp_vertices.append(corner_polyline)
                cp_config.append("pentalateral_1c")
                test = cp_0

            # If they intersect (since corner_height is too large) create quadrilateral parcel instead, even if the boundary edges' angle is obtuse
            elif intersection[0].IsPoint:
                cp_2 = intersection[0].PointA
                cp_3 = cp_4  # Adjust index, so that it is consistent with the other quadrilateral corner parcels
                corner_polyline = [cp_0, cp_1, cp_2, cp_3, cp_0]
                corner_parcels.append(rs.AddPolyline(corner_polyline))
                cp_vertices.append(corner_polyline)
                cp_config.append("quadrilateral")  

            # Increment loop counter by 1
            i += 1


        # Create pentalateral corner parcel
        elif corner_parcel_type == "pentalateral":

            # Get relevant angles of boundary polygon
            bp_angle_1 = calculate_angle_between_edges(rev_vector(unit_vecs[j]), unit_vecs[i])
            bp_angle_2 = calculate_angle_between_edges(rev_vector(unit_vecs[i]), unit_vecs[k])

            # Generate random width and height for each corner parcel based upon the corner dimensions
            # Establish reference with control distance (and look in cp dim trios)
            corresponding_dim = find_closest_values(cp_dim_trio, control_dist)
            cp_dim_local = rg.Interval(corresponding_dim[0], corresponding_dim[1])
            corner_width_1, corner_width_2 = apply_deviation_within_domain(corner_dim, cp_dim_local, deviation_percentage=0.3)

            # Adjust dimensions according to edge distance
            if corner_width_1 < edge_distance_1/2:
                corner_width_1 = random.uniform(edge_distance_1 * (1/2), edge_distance_1*(3/4))
            if corner_width_2 < edge_distance_1/2:
                corner_width_2 = random.uniform(edge_distance_1 * (1/2), edge_distance_1*(3/4))

            # Make sure that the widths don't deviate too much from each other
            corner_width_2 = random.uniform(corner_width_1 * 0.8, corner_width_2 * 1.2)

            # Adjust widths corresponding to angle deviation for reasonable results
            if bp_angle_1 > 90:
                corner_ratio = 90/bp_angle_1
                corner_width_2 *= corner_ratio * (random.uniform(0.8, 0.9))
            if bp_angle_2 > 90:
                corner_ratio = 90/bp_angle_2
                corner_width_1 *= corner_ratio * (random.uniform(0.8, 0.9))

            # Get angles
            r = random.randint(0, (len(cp_angles)-1))
            angle_1 = cp_angles[r][0]
            angle_2 = cp_angles[r][1]

            # Construct polyline vertices
            cp_0 = edges[i][0]
            cp_1 = edges[i][1]
            cp_2 = rs.PointAdd(cp_1, unit_vecs[k] * corner_width_1)
            cp_4 = rs.PointAdd(cp_0, rev_vector(unit_vecs[j]) * corner_width_2)
            cp_3 = find_intersection(cp_2, angle_vec(edges[k][0], edges[k][1], angle_1), cp_4, angle_vec(edges[j][0], edges[j][1], angle_2))

            # Create pentalateral polyline
            corner_polyline = [cp_0, cp_1, cp_2, cp_3, cp_4, cp_0]
            corner_parcels.append(rs.AddPolyline(corner_polyline))
            cp_vertices.append(corner_polyline)
            cp_config.append("pentalateral_2c")

            # Increment loop counter by 2
            i += 2



    ##############################
    """ SETTING THE SCENE TO CREATE GENERIC PARCELS """

    # Get distances between the corner parcels
    cp_distances = []

    for i in range(len(cp_vertices)):
        # For legibility of code
        j = (i-1) % len(cp_vertices) 
        k = (i+1) % len(cp_vertices)
        # Get start point of distance
        if cp_config[i] == "quadrilateral" or cp_config[i] == "pentalateral_1c":
            start_pt = cp_vertices[i][1]
        elif cp_config[i] == "pentalateral_2c":
            start_pt = cp_vertices[i][2]
        # Get end point of distance
        if cp_config[k] == "quadrilateral":
            end_pt = cp_vertices[k][3]
        elif cp_config[k] == "pentalateral_1c" or cp_config[k] == "pentalateral_2c":
            end_pt = cp_vertices[k][4]
        # Get distance
        distance = rs.Distance(start_pt, end_pt)
        cp_distances.append(distance)

    # Get generic parcel indentation count based upon indentation_reference_length
    gp_indentation_count = []

    # Get generic parcel counts based upon minimum and maximum gp_lengths
    gp_on_edge_count = []

    for cp_distance in cp_distances:

        # Get a random value in the lower and upper bound of gp_lengths
        length_dom_low = int(random.uniform(gp_lengths_domain[0] + (gp_lengths_mean - gp_lengths_domain[0])*(3/4), gp_lengths_mean))
        length_dom_upper = int(random.uniform(gp_lengths_mean, gp_lengths_domain[1] - (gp_lengths_domain[1] - gp_lengths_mean)*(3/4)))

        # Create bounds (these are somewhat arbitrary)
        indentation_ref_lower_bound = int(random.uniform(length_dom_low, indentation_reference_length * 0.8))
        indentation_ref_upper_bound = int(random.uniform(indentation_reference_length * 1.2, length_dom_upper))

        # Get generic parcel counts
        ref_length_gp_counts = random.choice([length_dom_low, length_dom_upper])
        
        # Ensure ref_length_gp_counts is smaller than cp_distance to avoid excessive counts
        if ref_length_gp_counts >= cp_distance:
            ref_length_gp_counts = cp_distance * 0.9  # Ensure it's a bit smaller than cp_distance
        
        gp_count = max(1, cp_distance // ref_length_gp_counts)  # Ensure minimum gp_count is 1
        gp_on_edge_count.append(int(gp_count))
        
        # Get indentation counts
        ref_length_indentation = round(random.uniform(indentation_ref_lower_bound, indentation_ref_upper_bound), 2)
        
        # Ensure ref_length_indentation is smaller than cp_distance to avoid negative indentation count
        if ref_length_indentation >= cp_distance:
            ref_length_indentation = cp_distance * 0.8  # Ensure it's a bit smaller than cp_distance

        if ref_length_indentation != 0: 
            indentation_count = cp_distance // ref_length_indentation
        else:
            indentation_count = 2
        
        # Avoid negative indentation count and ensure it doesn't exceed gp_count
        if indentation_count > (gp_count - 1):
            gp_indentation_count.append(int(gp_count - 1))
        else:
            gp_indentation_count.append(int(max(0, indentation_count)))


    # Ensure no overlap between the adjacent edges:
    control_cp_distance = min(cp_distances)/2
    if (control_cp_distance) < gp_widths_domain[1]:
        gp_widths_domain_cap = round(control_cp_distance*(3/4), 2)
    else:
        gp_widths_domain_cap = gp_widths_domain[1]



    ##############################
    """ CREATE GENERIC PARCELS """

    # ASSIGN WIDTHS OF GENERIC PARCELS

    unbounded = random.choice([False, True])
    avoid_overlap = False
    last_dim_diff = 0

    # Iterate through all corner parcels
    for i in range(len(corner_parcels)):

        # For legibility of code
        j = (i+1) % len(corner_parcels) 

        # Avoid overlap in last chunck of generic parcel generation
        if i == (len(corner_parcels) - 1):
            unbounded = False

        # Apply start pointsand cp_angle_1 according to cp_config
        if cp_config[i] == "quadrilateral" or cp_config[i] == "pentalateral_1c":
            strip_start_pt_bot = cp_vertices[i][1]
            strip_start_pt_top = cp_vertices[i][2]
            cp_angle_1 = calculate_angle_between_lines(cp_vertices[i][2], cp_vertices[i][1], cp_vertices[i][3])
        elif cp_config[i] == "pentalateral_2c":
            strip_start_pt_bot = cp_vertices[i][2]
            strip_start_pt_top = cp_vertices[i][3]
            cp_angle_1 = calculate_angle_between_lines(cp_vertices[i][3], cp_vertices[i][2], cp_vertices[i][4])

        # Apply end points and cp_angle_2 according to cp_config
        if cp_config[j] == "quadrilateral":
            strip_end_pt_bot = cp_vertices[j][3]
            strip_end_pt_top = cp_vertices[j][2]
            cp_angle_2 = calculate_angle_between_lines(cp_vertices[j][2], cp_vertices[j][1], cp_vertices[j][3])
        elif cp_config[j] == "pentalateral_1c" or cp_config[j] == "pentalateral_2c":
            strip_end_pt_bot = cp_vertices[j][4]
            strip_end_pt_top = cp_vertices[j][3]
            cp_angle_2 = calculate_angle_between_lines(cp_vertices[j][3], cp_vertices[j][2], cp_vertices[j][4])

        # Create the geometric domain, in which the generic parcels can be generated (strips)
        strip_length_bot = rs.Distance(strip_start_pt_bot, strip_end_pt_bot)
        strip_length_top = rs.Distance(strip_start_pt_top, strip_end_pt_top)
        strip_width_1 = rs.Distance(strip_start_pt_bot, strip_start_pt_top)
        strip_width_2 = rs.Distance(strip_end_pt_bot, strip_end_pt_top)

        # Append first width separately (to avoid overlap)
        if gp_indentation_count[i] == 0 and gp_widths_domain[0] > strip_width_2:
            first_gp_width = strip_width_2
        elif cp_angle_1 > 90:
            first_gp_width = strip_width_1
        elif cp_angle_1 <= 90 and cp_angle_2 <= 90 and avoid_overlap == False and i != (len(gp_indentation_count) - 1):
            first_gp_width = random.uniform(gp_widths_domain[0], gp_widths_domain_cap)
        else:
            first_gp_width = random.uniform(gp_widths_domain[0], strip_width_1)
        first_gp_length = find_matching_lengths(gp_dim_pairs, first_gp_width)
        if first_gp_length < last_dim_diff:
            first_gp_length = random.uniform(last_dim_diff, gp_lengths_domain[1])
        
        # Initialize generic parcel widths
        gp_widths = [first_gp_width] 

        # Append as many width values as the indentation count
        for indent in range(gp_indentation_count[i]):
            
            if unbounded == False:
                if indent == gp_indentation_count[i] - 1: 
                    if gp_widths_domain[0] > strip_width_2:
                        gp_widths.append(strip_width_2)
                    else:
                        gp_widths.append(random.uniform(gp_widths_domain[0], strip_width_2))
                elif strip_width_1 > strip_width_2:
                    gp_widths.append(random.uniform(gp_widths_domain[0], strip_width_2))
                else:
                    gp_widths.append(random.uniform(gp_widths_domain[0], strip_width_1))

            elif indent == gp_indentation_count[i] - 1:
                if gp_widths_domain[0] > strip_width_2:
                    gp_widths.append(strip_width_2)
                else:
                    gp_widths.append(random.uniform(gp_widths_domain[0], strip_width_2))

            elif cp_angle_1 > 90:         
                gp_random_width = round(random.gauss(gp_widths_mean, gp_widths_sd), 2)
                domain_control = cp_vertices[j][1].DistanceTo(cp_vertices[j][2]) + cp_vertices[j][2].DistanceTo(cp_vertices[j][3]) 
                if domain_control < gp_widths_domain_cap:
                    maximum_domain = domain_control
                elif domain_control >= gp_widths_domain_cap:
                    maximum_domain = gp_widths_domain_cap
                gp_width = max(gp_widths_domain[0], min(gp_random_width, maximum_domain), 2)
                gp_widths.append(round(max(first_gp_width, min(gp_width, maximum_domain)), 2)) # Clamp the random width to the domain

            elif cp_angle_1 < 90 or cp_angle_2 < 90:
                gp_widths.append(strip_width_1 if strip_width_1 > strip_width_2 else strip_width_2)
                unbounded = True

            else:
                gp_widths.append(round(random.uniform(gp_widths_domain[0],gp_widths_domain_cap), 2))

        # Pass over "avoid overlap" boolean for next loop
        last_width = gp_widths[len(gp_widths)-1]
        last_dim_diff = last_width - strip_width_2
        if last_dim_diff > 0:
            avoid_overlap = True
        
        # Every iteration shifts unbounded (to avoid overlap)
        unbounded = not unbounded

        # Make sure that no width falls below 5m
        for min_idx in range(len(gp_widths)-1):
            if gp_widths[min_idx] < 5:
                gp_widths[min_idx] = 5

        # Hard code the width if there is only one parcel
        if len(gp_widths) == 1:
            gp_widths = []
            if strip_width_1 <= strip_width_2:
                hardcoded_width = random.uniform(strip_width_1*(3/4), strip_width_1)
            else:
                hardcoded_width = random.uniform(strip_width_2*(3/4), strip_width_2) 
            gp_widths.append(hardcoded_width)


        # ASSIGN LENGHTS OF GENERIC PARCEL

        # Ensure that first gp length is long enough (to avoid overlap)
        if first_gp_length < last_dim_diff:
            first_gp_length = last_dim_diff

        # Create generic parcel lengths
        gp_lengths = [first_gp_length]

        # Append as many length values as the gp_on_edge_count
        for amount in range(gp_on_edge_count[i]-1):
            gp_random_length = round(random.gauss(gp_lengths_mean, gp_lengths_sd), 2)
            gp_length = max(gp_lengths_domain[0], min(gp_random_length, gp_lengths_domain[1]))
            gp_lengths.append(gp_length)

        # Adjust the generated parcel lengths to ensure their sum matches the length of strip_length_bot
        total_gp_length = sum(gp_lengths)
        scaling_factor = strip_length_bot / total_gp_length

        # Scale the lengths to match the total length of strip_length_bot
        gp_lengths_front = [gp_length * scaling_factor for gp_length in gp_lengths]

        # Clamp the values to ensure they fall within the domain
        for n in range(len(gp_lengths_front)):
            if gp_lengths_front[n] < gp_lengths_domain[0]:
                gp_lengths_front[n] = gp_lengths_domain[0]
            elif gp_lengths_front[n] > gp_lengths_domain[1]:
                gp_lengths_front[n] = gp_lengths_domain[1]
        total_length_after_adjustment = sum(gp_lengths_front)
        deviation = total_length_after_adjustment - strip_length_bot

        # Subtract deviation from the largest length in the list
        if deviation != 0:
            max_index = gp_lengths_front.index(max(gp_lengths_front))
            gp_lengths_front[max_index] -= deviation

        # Calculate proportions of parcel lengths to strip lengths and ensure same proportional distribution for strip rear end
        proportions = [length / strip_length_bot for length in gp_lengths_front]
        gp_lengths_back = [prop * strip_length_top for prop in proportions]


        # CONSTRUCT GENERIC PARCELS

        # Initialize vectors for parcel construction
        gp_vec_front = rg.Vector3d(strip_end_pt_bot.X - strip_start_pt_bot.X, strip_end_pt_bot.Y - strip_start_pt_bot.Y, 0)
        gp_vec_front.Unitize()
        gp_vec_back = rg.Vector3d(strip_end_pt_top.X - strip_start_pt_top.X, strip_end_pt_top.Y - strip_start_pt_top.Y, 0)
        gp_vec_back.Unitize()
        gp_vec_side_1 = rg.Vector3d(strip_start_pt_top.X - strip_start_pt_bot.X, strip_start_pt_top.Y - strip_start_pt_bot.Y, 0)
        gp_vec_side_1.Unitize()
        gp_vec_side_2 = rg.Vector3d(strip_end_pt_top.X - strip_end_pt_bot.X, strip_end_pt_top.Y - strip_end_pt_bot.Y, 0)
        gp_vec_side_2.Unitize()

        # Assign widths according to indentation count
        indentation_bool = [True] * (gp_indentation_count[i]) + [False] * ((gp_on_edge_count[i] - gp_indentation_count[i]) - 2)
        random.shuffle(indentation_bool)
        indentation_bool = [False] + indentation_bool + [False]
        assigned_widths = []
        idx = 0
        for n in range(gp_on_edge_count[i]):
            if indentation_bool[n] == True:
                idx = min(idx + 1, len(gp_widths) - 1)
            assigned_widths.append(gp_widths[idx])
        
        # Initialize lists to store cumulative lengths
        front_offset = 0
        back_offset = 0

        # Create generic parcels by iterating through the lengths
        for n in range(len(gp_lengths_front)):

            # If there is only one very slender generic parcel between corner parcels, skip that parcel
            if len(gp_lengths_front) == 1 and gp_lengths_front[n] < 5:
                continue

            # Skip the parcel if it is shorter than 4 meters
            if gp_lengths_front[n] < 4:
                continue

            # Skip parcel if width is less than 4
            if assigned_widths[n] < 4:
                continue

            # Calculate an interpolation factor based on the current offset:
            t_1 = front_offset / strip_length_bot
            # Interpolate the side vector between gp_vec_side_1 and gp_vec_side_2
            gp_vec_side_interpolated_1 = interpolate_vectors(gp_vec_side_1, gp_vec_side_2, t_1)

            # Calculate an interpolation factor based on the current offset:
            t_2 = (front_offset + gp_lengths_front[n]) / strip_length_bot
            # Interpolate the side vector between gp_vec_side_1 and gp_vec_side_2
            gp_vec_side_interpolated_2 = interpolate_vectors(gp_vec_side_1, gp_vec_side_2, t_2)

            # Calculate the back side reference point based on the assigned width from the gp_widths pool
            back_ref_pt = rs.PointAdd(strip_start_pt_bot, gp_vec_side_interpolated_2 * assigned_widths[n])

            # Calculate the points for the parcel based on the cumulative offsets
            front_start = rs.PointAdd(strip_start_pt_bot, gp_vec_front * front_offset)
            front_end = rs.PointAdd(strip_start_pt_bot, gp_vec_front * (front_offset + gp_lengths_front[n])) 
            back_start = rs.PointAdd(front_start, gp_vec_side_interpolated_1 * assigned_widths[n])
            back_end = rs.PointAdd(front_end, gp_vec_side_interpolated_2 * assigned_widths[n])
            test = back_start
            # back_end = rs.PointAdd(back_ref_pt, gp_vec_front * (back_offset + gp_lengths_back[n]))

            # Define the parcel points
            generic_parcel = [
                front_start,
                front_end,
                back_end,
                back_start,
                front_start
            ]

            # Add the polyline for the parcel
            generic_parcels.append(rs.AddPolyline(generic_parcel))

            # Update the offsets for the next parcel
            front_offset += gp_lengths_front[n]
            back_offset += gp_lengths_back[n]



    ###############
    """ OUTPUTS """

    # Append corner parcels and generic parcels, such that it can be read by building generation component
    all_parcel_list_for_bg = corner_parcels + generic_parcels
    all_parcels_building_generation.append(all_parcel_list_for_bg)

    # Append corner parcels and generic parcels to all parcels
    for cp in corner_parcels:
        all_parcels.append(cp)
    for gp in generic_parcels:
        all_parcels.append(gp)
# ---------- end custom_parcel_generation_9 ----------
custom_parcel_generation_10 = Python3Script(
    boundaries=boundaries_10,
    cp_min_width=corner_parcel_minimum_width_10,
    cp_max_width=corner_parcel_maximum_width_10,
    cp_min_angle=corner_parcel_minimum_angle_10,
    cp_max_angle=corner_parcel_maximum_angle_10,
    gp_mean_length=generic_parcel_mean_length_10,
    gp_min_length=generic_parcel_minimum_length_10,
    gp_max_length=generic_parcel_maximum_length_10,
    gp_length_std=generic_parcel_length_standard_deviation_10,
    gp_mean_width=generic_parcel_mean_width_10,
    gp_min_width=generic_parcel_minimum_width_10,
    gp_max_width=generic_parcel_maximum_width_10,
    gp_width_std=generic_parcel_width_standard_deviation_10,
    ind_ref_length=indentation_reference_length_10,
    penta_threshold=penta_threshold_10,
    random_seed=random_seed_integer)  # -> all_parcels, all_parcels_building_generation; inputs boundaries: list, random_seed: Int32; same code as custom_parcel_generation_9

# ----
# Get Heights
number_slider_7 = Slider(80, range=0..100)
get_heights_4 = Python3Script(
    mean_height=Slider(9, range=0..40),
    min_height=Slider(10, range=0..40),
    max_height=number_slider_7,
    height_std=Slider(6, range=0..40))  # -> height_info; inputs buildings_3D: list; same code as get_heights_2

# ----
# Merge parcels and boundaries
merge_boundaries_3 = Merge(Data1=boundaries_9, Data2=boundaries_10)
merge_parcels_3 = Merge(
    Data1=custom_parcel_generation_9.all_parcels_building_generation,
    Data2=custom_parcel_generation_10.all_parcels_building_generation)

# ----
# Random seed
# 08.10.2024
# Current reference analysis
number_slider_8 = Slider(0, range=0..100)

# ----
# ENABLE
# Building Generation
# Floor-Area-Ratio
building_generation_4 = Python3Script(
    boundaries=merge_boundaries_3,
    all_parcels_building_generation=merge_parcels_3,
    floor_area_ratio=Slider(15, range=0..51),
    corner_buildings_map=custom_building_mapping.corner_buildings_map,
    generic_buildings_map=custom_building_mapping.generic_buildings_map,
    height_info=get_heights_4,
    random_seed=number_slider_8)  # -> footprints, extrusions; inputs boundaries: list, all_parcels_building_generation: list, corner_buildings_map: list, generic_buildings_map: list, height_info: list; disabled; same code as building_generation_2
