# Grasshopper definition 1_athens.gh (Grasshopper 1.0.8)
# plug-ins: RhinoCodePluginGH

# ----
# HEIGHTS INFO
number_slider = Slider(20, range=0..100)
get_heights = Python3Script(
    mean_height=number_slider,
    min_height=Slider(9, range=0..100),
    max_height=Slider(27, range=0..100),
    height_std=Slider(3.7, range=0..100))  # -> height_info; inputs buildings_3D: list
# ---------- get_heights: Python ----------
import Rhino
import rhinoscriptsyntax as rs
import Rhino.Geometry as rg
import math

#####################################################################################

""" FUNCTIONS """

# Function to retreive building height from 3D buildings
def get_building_height(building_id):
    # Get the bounding box of the object
    bbox = rs.BoundingBox(building_id)
    # Extract Z-coordinates of the bounding box corners
    min_z = bbox[0].Z
    max_z = bbox[4].Z
    # Height is the difference between the maximum and minimum Z values
    height = max_z - min_z
    return height

# Function to calculate mean
def calculate_mean(data):
    return sum(data) / len(data)

# Function to calculate standard deviation
def calculate_std(data):
    mean = calculate_mean(data)
    squared_differences = [(i - mean) ** 2 for i in data]  # Calculate squared differences
    variance = sum(squared_differences) / len(data)  # Find the variance
    return math.sqrt(variance)  # std = square root of the variance


################################
""" EXTRACT BUILDING HEIGHTS """

# Required inputs:
# Either "buildings_3D", which should be Brep extrusion GUIDs
# Or mean_height, min_height, max_height and height_std (integers of floats)

# Analyze building 3D input
if buildings_3D is not None:

    # Initialize list to store building heights
    building_heights = []

    # Iterate through all buildings
    for building in buildings_3D:
        height = get_building_height(building)
        building_heights.append(height)

    bh_mean = round(calculate_mean(building_heights), 2)
    bh_min = min(building_heights)
    bh_max = max(building_heights)
    bh_sd = round(calculate_std(building_heights), 2)

# If there is no building 3D input
else:
    bh_mean = mean_height
    bh_min = min_height
    bh_max = max_height
    bh_sd = height_std


# Outputs

height_info = [
    bh_mean,
    bh_min,
    bh_max,
    bh_sd
]
# ---------- end get_heights ----------

# ----
# INPUTS
# ATH_reference_5
buildings_footprint = Curve([<curve referenced from the Rhino model> x28])
boundary = Curve(<curve referenced from the Rhino model>)
parcels = Curve([<curve referenced from the Rhino model> x10])

# ----
# INPUTS
# ATH_reference_3
buildings_footprint_2 = Curve([<curve referenced from the Rhino model> x33])
# # Enable the Building Generation components to see footprints and extrustions
# (might last 10 seconds to generate)
# 
# # In order for the data package merging to be successful, each data package
# produced by the block analysis component must reference urban blocks with
# the same number of corner parcels.
# HEIGHTS
# INFO
# REFERENCES WITH 4 CORNER PARCELS
# ATH_reference_1
boundary_2 = Curve(<curve referenced from the Rhino model>)
parcels_2 = Curve([<curve referenced from the Rhino model> x17])

# ----
# INPUTS
# ATH_reference_7
buildings_footprint_3 = Curve([<curve referenced from the Rhino model> x23])
boundary_3 = Curve(<curve referenced from the Rhino model>)
parcels_3 = Curve([<curve referenced from the Rhino model> x9])

# ----
# INPUTS
# REFERENCES WITH 5 CORNER PARCELS
buildings_footprint_4 = Curve([<curve referenced from the Rhino model> x30])
boundary_4 = Curve(<curve referenced from the Rhino model>)
parcels_4 = Curve([<curve referenced from the Rhino model> x15])

# ----
# INPUTS
# REFERENCES WITH 3 CORNER PARCELS
buildings_footprint_5 = Curve([<curve referenced from the Rhino model> x58])
boundary_5 = Curve(<curve referenced from the Rhino model>)
parcels_5 = Curve([<curve referenced from the Rhino model> x21])

# ----
# INPUTS
# ATH_reference_10
buildings_footprint_6 = Curve([<curve referenced from the Rhino model> x26])
# ATH_reference_8
boundary_6 = Curve(<curve referenced from the Rhino model>)
parcels_6 = Curve([<curve referenced from the Rhino model> x15])

# ----
# INPUTS
buildings_footprint_7 = Curve([<curve referenced from the Rhino model> x30])
# ATH_reference_12
boundary_7 = Curve(<curve referenced from the Rhino model>)
parcels_7 = Curve([<curve referenced from the Rhino model> x14])

# ----
# BLOCK ANALYSIS
block_analysis = Python3Script(boundary=boundary_4, parcels=parcels_4, buildings_footprint=buildings_footprint_4, height_info=get_heights)  # -> data_text, data_package, corner_buildings_map, generic_buildings_map; inputs boundary: list, parcels: list, buildings_footprint: list, height_info: list
# ---------- block_analysis: Python ----------
import Rhino
import rhinoscriptsyntax as rs
import Rhino.Geometry as rg
import random
import math
from collections import defaultdict

#####################################################################################

""" FUNCTIONS """

# Function to calculate mean
def calculate_mean(data):
    return sum(data) / len(data)

# Function to calculate standard deviation
def calculate_std(data):
    mean = calculate_mean(data)
    squared_differences = [(i - mean) ** 2 for i in data]  # Calculate squared differences
    variance = sum(squared_differences) / len(data)  # Find the variance
    return math.sqrt(variance)  # std = square root of the variance

# Function to compute the angles between the non-boundary edges and the boundary polygon edges of a corner parcel
def compute_non_boundary_edge_angles(non_boundary_edges, boundary_polygon_edges, tolerance):
    cp_edge_angles = []
    # Iterate through all non-boundary edges
    for nbe in non_boundary_edges:
        nbe_start_pt = nbe.PointAtStart
        nbe_end_pt = nbe.PointAtEnd    
        # Iterate through boundary polygon edges to find the closest edge points
        for edge in boundary_polygon_edges:
            success_start, param_start = edge.ClosestPoint(nbe_start_pt)
            success_end, param_end = edge.ClosestPoint(nbe_end_pt)           
            # Get closest points on the edge if successful
            edge_pt_1 = edge.PointAt(param_start) if success_start else None
            edge_pt_2 = edge.PointAt(param_end) if success_end else None
            # If both start and end points of nbe have close points on the boundary edge
            if edge_pt_1 and edge_pt_2:
                start_dist = nbe_start_pt.DistanceTo(edge_pt_1)
                end_dist = nbe_end_pt.DistanceTo(edge_pt_2)
                # Check if the start distance is within tolerance
                if start_dist < tolerance:
                    if nbe_start_pt.DistanceTo(edge.PointAtStart) < nbe_start_pt.DistanceTo(edge.PointAtEnd):
                        vec_1 = rg.Vector3d(edge.PointAtStart.X - nbe_start_pt.X, edge.PointAtStart.Y - nbe_start_pt.Y, 0)
                    else:
                        vec_1 = rg.Vector3d(edge.PointAtEnd.X - nbe_start_pt.X, edge.PointAtEnd.Y - nbe_start_pt.Y, 0)
                    vec_2 = rg.Vector3d(nbe_end_pt.X - nbe_start_pt.X, nbe_end_pt.Y - nbe_start_pt.Y, 0)                   
                    vec_1.Unitize()
                    vec_2.Unitize()
                    angle_degrees = math.degrees(rg.Vector3d.VectorAngle(vec_1, vec_2))
                    cp_edge_angles.append(round(angle_degrees))
                # Check if the end distance is within tolerance
                elif end_dist < tolerance:
                    if nbe_end_pt.DistanceTo(edge.PointAtStart) < nbe_end_pt.DistanceTo(edge.PointAtEnd):
                        vec_1 = rg.Vector3d(edge.PointAtStart.X - nbe_end_pt.X, edge.PointAtStart.Y - nbe_end_pt.Y, 0)
                    else:
                        vec_1 = rg.Vector3d(edge.PointAtEnd.X - nbe_end_pt.X, edge.PointAtEnd.Y - nbe_end_pt.Y, 0)
                    vec_2 = rg.Vector3d(nbe_start_pt.X - nbe_end_pt.X, nbe_start_pt.Y - nbe_end_pt.Y, 0)
                    vec_1.Unitize()
                    vec_2.Unitize()
                    angle_degrees = math.degrees(rg.Vector3d.VectorAngle(vec_1, vec_2))
                    cp_edge_angles.append(round(angle_degrees))
    # Returns list of angles (in degrees) between the non-boundary edges and boundary edges
    return cp_edge_angles

# Function to create lines that interpolate between two opposite edges
def interpolate_between_edges(edge1, edge2, grid_resolution):
    points = []
    for i in range(grid_resolution + 1):
        step = i / grid_resolution
        start = edge1.PointAt(step)
        end = edge2.PointAt(step)
        points.append(rg.Line(start, end))
    return points

# Function to ensure the vertices of the parcel are ordered counter-clockwise.
def ensure_counterclockwise(parcel):
    polyline = parcel.ToPolyline()
    vertices = polyline.ToArray()  # Get vertices as an array
    signed_area_sum = 0
    # Shoelace theorem to check clockwise or counter-clockwise
    for i in range(len(vertices)):
        v1 = vertices[i]
        v2 = vertices[(i + 1) % len(vertices)]  # Next vertex (with wrap-around)
        signed_area_sum += (v2.X - v1.X) * (v2.Y + v1.Y)
    # If total is positive, the vertices are ordered clockwise
    if signed_area_sum > 0:
        vertices = list(reversed(vertices))  # Reverse the vertices if clockwise
        return rg.PolylineCurve(vertices)  # Return the polyline with counter-clockwise vertices
    else:
        return parcel  # Already counter-clockwise, return the original parcel

# Function to reorder vertices such that the first vertex is closest to corner and ensure counterclockwise order.
def reorder_vertices_to_start_at_corner(vertices, corner, tolerance=1e-6):  
    # Find the index of the vertex closest to the corner
    min_distance = float("inf")
    vertex_0_index = 0
    for i in range(len(vertices)):
        distance = vertices[i].DistanceTo(corner)
        if distance < min_distance:
            min_distance = distance
            vertex_0_index = i
    # Reorder the vertices starting from the closest point
    reordered_vertices = [vertices[(i + vertex_0_index) % len(vertices)] for i in range(len(vertices))]
    # Remove consecutive duplicate vertices (within a small tolerance)
    unique_reordered_vertices = [reordered_vertices[0]]
    for i in range(1, len(vertices)):
        if reordered_vertices[i].DistanceTo(unique_reordered_vertices[-1]) > tolerance:
            unique_reordered_vertices.append(reordered_vertices[i])
    # Ensure the last vertex is not a duplicate of the first vertex
    if unique_reordered_vertices[0].DistanceTo(unique_reordered_vertices[-1]) < tolerance:
        unique_reordered_vertices.pop()
    # Check if the reordered vertices are counterclockwise using the Shoelace theorem
    signed_area_sum = 0
    for i in range(len(unique_reordered_vertices)):
        v1 = unique_reordered_vertices[i]
        v2 = unique_reordered_vertices[(i + 1) % len(unique_reordered_vertices)]  # Next vertex (with wrap-around)
        signed_area_sum += (v2.X - v1.X) * (v2.Y + v1.Y)
    if signed_area_sum > 0:
        unique_reordered_vertices.reverse()
    else:
        unique_reordered_vertices = unique_reordered_vertices
    return unique_reordered_vertices



### Functions used for quadrilateral building mapping ###

# Function to generate a grid inside a quadrilateral parcel. Uses a bilinear interpolation between the edges of the quadrilateral.
def generate_grid_in_quadrilateral_parcel(parcel_vertices, grid_resolution):
    grid_points = []
    parcel_vertices.pop()
    # Get the four corners of the quadrilateral
    v0, v1, v2, v3 = parcel_vertices
    for u in range(grid_resolution + 1):
        u_ratio = u / grid_resolution  # The relative position along the U direction (horizontal)
        # Interpolate between v0->v3 (left) and v1->v2 (right) edges
        left_interp = v0 + (v3 - v0) * u_ratio
        right_interp = v1 + (v2 - v1) * u_ratio
        for v in range(grid_resolution + 1):
            v_ratio = v / grid_resolution  # The relative position along the V direction (vertical)
            # Interpolate between the left and right edges at the current u_ratio
            grid_point = left_interp + (right_interp - left_interp) * v_ratio
            grid_points.append(grid_point)
    return grid_points

# Function to map the building vertices to the indices of the grid points of the quadrilateral parcel.
def compute_building_indeces_quadrilateral(building_vertices, grid_in):
    building_indices = []
    for building_vertex in building_vertices:
        # Find the closest point in the input grid and get its index
        closest_index_in = min(range(len(grid_in)), key=lambda i: building_vertex.DistanceTo(grid_in[i]))
        building_indices.append(closest_index_in)
    # Returns a list of indices that represent the mapping.
    return building_indices


### Functions used for pentalateral building mapping ###

# Function to compute the centroid (geometric center) of a list of 3D points (vertices).
def compute_centroid(vertices):
    sum_x = sum(v.X for v in vertices)
    sum_y = sum(v.Y for v in vertices)
    sum_z = sum(v.Z for v in vertices)
    num_vertices = len(vertices)
    return rg.Point3d(sum_x / num_vertices, sum_y / num_vertices, sum_z / num_vertices)

# Function to subdivide a triangle into four smaller triangles by adding midpoints on its edges.
def subdivide_triangle(v0, v1, v2):
    # Compute midpoints
    mid_v0_v1 = v0 + (v1 - v0) * 0.5
    mid_v1_v2 = v1 + (v2 - v1) * 0.5
    mid_v2_v0 = v2 + (v0 - v2) * 0.5
    # Create smaller triangles
    triangles = [
        (v0, mid_v0_v1, mid_v2_v0),
        (mid_v0_v1, v1, mid_v1_v2),
        (mid_v2_v0, mid_v1_v2, v2),
        (mid_v0_v1, mid_v1_v2, mid_v2_v0)
    ]
    # Return triangles and midpoints as potential intersection points
    return triangles, [mid_v0_v1, mid_v1_v2, mid_v2_v0]

# Function to subdivide the triangles of a pentalateral parcel iteratively with consistent indexing.
def generate_grid_in_pentalateral_parcel(vertices, center):
    # Create initial triangles (center to adjacent vertices)
    triangles = []
    indexed_points = []  # Track points in a consistent order
    indexed_points.append(center)  # Start with the centroid having index 0
    iterations = 3
    # Add the original vertices with consistent indexing
    indexed_points.extend(vertices)  # Add pentagon vertices (these will get indices 1-5)
    for i in range(len(vertices)):
        v0 = vertices[i]
        v1 = vertices[(i + 1) % len(vertices)]
        triangles.append((center, v0, v1))
    # Subdivide the triangles iteratively
    for _ in range(iterations):
        new_triangles = []
        for tri in triangles:
            # Subdivide the triangle and get the new midpoints
            subdivided, midpoints = subdivide_triangle(*tri)
            # Check each midpoint and assign it an index if it's new
            for midpoint in midpoints:
                if midpoint not in indexed_points:
                    indexed_points.append(midpoint)
            new_triangles.extend(subdivided)
        triangles = new_triangles
    # Returns the subdivided triangles and indexed intersection points.
    return triangles, indexed_points

# Function to map the building vertices to the indices of the sorted points of the pentalateral parcel.
def compute_building_indeces_pentalateral(building_vertices, sorted_points_in):
    building_indices = []
    for building_vertex in building_vertices:
        # Find the closest point in the sorted_points_in and get its index
        closest_index_in = min(range(len(sorted_points_in)), key=lambda i: building_vertex.DistanceTo(sorted_points_in[i]))
        building_indices.append(closest_index_in)
    # Returns a list of indices that represent the mapping.
    return building_indices


#####################################################################################

# SHORTCUTS FOR LEGIBILITY:
# generic_parcels: "gp"
# corner_parcels: "gp"


###################################
""" INPUTS, LISTS AND CONSTANTS """

# Inputs
boundary_polygon = boundary  # The large boundary polygon that surrounds all parcels (as a closed curve)
all_parcels = parcels  # List of (irregular) rectangular parcel curves (from the "List Access" in Grasshopper)
buildings = buildings_footprint # List of building footprints
if height_info is not None:
    height_info = height_info
else:
    print("standard building heights will be used")

# Initialize lists for outputs
corner_parcels = []  # List to store corner parcels (Rhino.Geometry type: PolylineCurve)
generic_parcels = []  # List to store generic parcels (Rhino.Geometry type: PolylineCurve)
gp_lengths = []  # List to store generic parcels lengths (the edge, that is adjacent to the boundary polygon)
gp_widths = [] # List to store generic parcels widths (one of the edges, that is connected to the boundary polygon)
gp_nb_edges = [] # List to store all generic parcels' non-boundary edges (for indentation count)
cp_lengths = [] # List to store the corner parcels lengths (for the two edges adjacent to the boundary polygon)
cp_edge_angle = [] # List to store corner parcel angles
cp_configurations = []

# Set tolerance for geometric comparison
tolerance = 1e-3

# Set grid resolution for mapping (shouldn't be set higher than 50 for acceptable performance)
grid_resolution = 30

#######################
""" PARCEL ANALYSIS """


# Ensure the boundary_polygon is a valid curve
if rs.IsCurve(boundary_polygon) and boundary_polygon is not None:
    boundary_curve = rs.coercecurve(boundary_polygon)  # Convert the boundary polygon to a RhinoCommon curve
    boundary_curve = ensure_counterclockwise(boundary_curve)

    # Explode the boundary_polygon into individual edges
    boundary_polygon_corners = boundary_curve.ToPolyline().ToArray()
    boundary_polygon_edges = boundary_curve.DuplicateSegments()
    
    # Initialize empty lists for further analysis and mapping
    gp_on_boundary_edge_count = [0] * len(boundary_polygon_edges)
    gp_map_to_edge = [[] for _ in range(len(boundary_polygon_edges))]
    gp_edge_on_boundary_edge = [[] for _ in range(len(boundary_polygon_edges))]


    # Iterate over each parcel curve, received from the input
    for parcel in all_parcels:
        
        # Convert parcels to RhinoCommon curve (PolylineCurve) and ensure counterclockwise order
        parcel_curve = rs.coercecurve(parcel)
        parcel_curve = ensure_counterclockwise(parcel_curve)
        parcel_vertices = parcel_curve.ToPolyline().ToArray() 

        # Explode the parcel into individual segments (edges)
        parcel_edges = parcel_curve.DuplicateSegments()
        boundary_edges = []  # To hold the edges of the iterated parcel that lie on the boundary polygon
        non_boundary_edges = []  # To hold the non-boundary edges


        # Check each edge of the parcel to see if it lies close to the boundary polygon
        for edge in parcel_edges:
            start_pt = edge.PointAtStart
            end_pt = edge.PointAtEnd

            # Find the closest points on the boundary polygon to the start and end points of the edge
            success_start, param_start = boundary_curve.ClosestPoint(start_pt)
            success_end, param_end = boundary_curve.ClosestPoint(end_pt)

            # Construct points on the boundary polygon to compute distance
            boundary_pt_1 = boundary_curve.PointAt(param_start) if success_start else None
            boundary_pt_2 = boundary_curve.PointAt(param_end) if success_end else None

            # Compare the distance between the parcel edge and the boundary polygon
            if boundary_pt_1 and boundary_pt_2:
                start_dist = start_pt.DistanceTo(boundary_pt_1)
                end_dist = end_pt.DistanceTo(boundary_pt_2)

                # If both distances are within the tolerance, consider it a boundary edge
                if start_dist < tolerance and end_dist < tolerance:
                    boundary_edges.append(edge)

                else:
                    non_boundary_edges.append(edge)



        # Generic parcel has one boundary edge
        if len(boundary_edges) == 1:
            length = boundary_edges[0].GetLength()
            gp_lengths.append(length)
            generic_parcels.append(parcel_curve)
            
            # Add the boundary edge to the respective boundary polygon edge's generic parcels count
            start_pt = boundary_edges[0].PointAtStart
            end_pt = boundary_edges[0].PointAtEnd
            for i, boundary_line in enumerate(boundary_polygon_edges):
                success_start, param_start = boundary_line.ClosestPoint(start_pt)
                success_end, param_end = boundary_line.ClosestPoint(end_pt)
                boundary_line_pt_1 = boundary_line.PointAt(param_start) if success_start else None
                boundary_line_pt_2 = boundary_line.PointAt(param_end) if success_end else None
                if boundary_line_pt_1 and boundary_line_pt_2:
                    start_dist = start_pt.DistanceTo(boundary_line_pt_1)
                    end_dist = end_pt.DistanceTo(boundary_line_pt_2)
                    if start_dist < tolerance and end_dist < tolerance:
                        gp_on_boundary_edge_count[i] += 1
                        gp_map_to_edge[i].append(parcel)
                        gp_edge_on_boundary_edge[i].append(boundary_edges[0])

            # For generic parcels, find the two non-boundary edges connected to the boundary edge
            connected_non_boundary_edges = []
            for edge in non_boundary_edges:
                if (edge.PointAtStart in [boundary_edges[0].PointAtStart, boundary_edges[0].PointAtEnd] or
                    edge.PointAtEnd in [boundary_edges[0].PointAtStart, boundary_edges[0].PointAtEnd]):
                    connected_non_boundary_edges.append(edge)
                    gp_nb_edges.append(edge)

            # Ensure we have exactly two connected non-boundary edges
            # If the connected non boundary edges differ in length, assign the minimum of both
            if len(connected_non_boundary_edges) == 2:
                width = min(connected_non_boundary_edges[0].GetLength(), connected_non_boundary_edges[1].GetLength()) # here condition for crooked line
                gp_widths.append(width)


        # Corner parcel has two boundary edges, if quadrilateral
        elif len(boundary_edges) == 2: 
            if len(parcel_vertices) == 5:
                cp_configurations.append("quadrilateral")           
                cp_lengths.append([boundary_edges[0].GetLength(), boundary_edges[1].GetLength()])
                corner_parcels.append(parcel_curve)
                cp_vertices = parcel_curve.ToPolyline().ToArray()
                angles = compute_non_boundary_edge_angles(non_boundary_edges, boundary_polygon_edges, tolerance)
                cp_edge_angle.append(angles)
            elif len(parcel_vertices) == 6:
                cp_configurations.append("pentalateral")           
                cp_lengths.append([boundary_edges[0].GetLength(), boundary_edges[1].GetLength(), boundary_edges[0].GetLength()])
                corner_parcels.append(parcel_curve)
                cp_vertices = parcel_curve.ToPolyline().ToArray()
                angles = compute_non_boundary_edge_angles(non_boundary_edges, boundary_polygon_edges, tolerance)
                cp_edge_angle.append(angles)   


        # Corner parcel has three boundary edges, if pentalateral
        elif len(boundary_edges) == 3: 
            cp_configurations.append("pentalateral")           
            cp_lengths.append([boundary_edges[0].GetLength(), boundary_edges[1].GetLength(), boundary_edges[2].GetLength()])
            corner_parcels.append(parcel_curve)
            cp_vertices = parcel_curve.ToPolyline().ToArray()
            angles = compute_non_boundary_edge_angles(non_boundary_edges, boundary_polygon_edges, tolerance)
            cp_edge_angle.append(angles)


    # Sort the non boundary edges (or the widths) of the generic parcels to the corresponding boundary polygon edge
    gp_nb_edges_sorted = [[] for _ in range(len(boundary_polygon_edges))] 
    for edge in gp_nb_edges:
        start_pt = edge.PointAtStart
        end_pt = edge.PointAtEnd
        for i, boundary_line in enumerate(boundary_polygon_edges):
            success_start, param_start = boundary_line.ClosestPoint(start_pt)
            success_end, param_end = boundary_line.ClosestPoint(end_pt)
            boundary_line_pt_1 = boundary_line.PointAt(param_start) if success_start else None
            boundary_line_pt_2 = boundary_line.PointAt(param_end) if success_end else None
            if boundary_line_pt_1 and boundary_line_pt_2:
                start_dist = start_pt.DistanceTo(boundary_line_pt_1)
                end_dist = end_pt.DistanceTo(boundary_line_pt_2)
                if start_dist < tolerance or end_dist < tolerance:
                    gp_nb_edges_sorted[i].append(edge)


    
    # Initialize generic parcel indentation count on the back
    # This means, the amount of indentations that occur over all rear sides of the parcels that are aligned to one edge
    gp_indentation_count = [0] * len(boundary_polygon_edges)
    parcel_lengths = []
    for i in range(len(boundary_polygon_edges)):
        edge_infos = [[] for _ in range(len(gp_nb_edges_sorted[i]))]
        point_to_edges = defaultdict(list)
        # Default dictionary to store edges grouped by shared points
        # Automatically initializes a default value for a new key when you try to access it for the first time 
        # Store edge start and end points and lengths
        for m, edge in enumerate(gp_nb_edges_sorted[i]):
            edge_start = edge.PointAtStart
            edge_end = edge.PointAtEnd
            edge_length = edge.GetLength()
            # Append edge data to the list
            edge_infos[m].append(edge_start)
            edge_infos[m].append(edge_end)
            edge_infos[m].append(edge_length)
            # Group edges by shared points (both start and end points)
            # If edge_start is not in the dictionary, defaultdict(list) will automatically create an empty list for this key
            point_to_edges[edge_start].append(edge_length)
            point_to_edges[edge_end].append(edge_length)
        # Compare the lengths of edges that share points
        for point, lengths in point_to_edges.items():
            if len(lengths) > 1:  # Only compare if multiple edges share this point
                if len(set(lengths)) > 1:  # If there are different lengths, increment the counter
                    gp_indentation_count[i] += 1
        # Get the sum of boundary edge lengths to establish proportion
        boundary_edge_lengths = 0
        for gp_edge in gp_edge_on_boundary_edge[i]:
            boundary_edge_lengths += gp_edge.GetLength()
        parcel_lengths.append(boundary_edge_lengths)


    # Find out average length for when indentation occurs
    numerator = 0
    denominator = 0
    if gp_indentation_count[i] < 0:
        for i in range(len(parcel_lengths)):
            # Skip if parcel_lengths[i] = 0 (pentalateral corner parcel)
            if parcel_lengths[i] < tolerance:
                continue
            elif gp_indentation_count == 0: 
                numerator += parcel_lengths[i]
                denominator += 1
            else:
                numerator += (parcel_lengths[i] / gp_indentation_count[i])
                denominator += 1
        indentation_ratio = round(numerator/denominator,2)
    else:
        indentation_ratio = parcel_lengths[0]
        

    #########################
    """ BUILDING ANALYSIS """

    # Dictionary to store parcel to building mapping
    gp_to_building_map = defaultdict(list)  # Mapping from (edge_index, gp_index) -> list of buildings
    cp_to_building_map = [[] for _ in range(len(corner_parcels))]  

    # For all buildings, get building vertices
    for building in buildings:
        building_curve = rs.coercecurve(building)
        building_points = building_curve.ToPolyline().ToArray()   # Convert the curve into a polyline

        # Map buildings to generic parcels of corresponding edge
        for i in range(len(boundary_polygon_edges)):
            for j in range(len(gp_map_to_edge[i])):
                inside = True
                # Coerce the generic parcel curve of the corresponding edge
                gp_check = rs.coercecurve(gp_map_to_edge[i][j])
                for pt in building_points:
                    result = gp_check.Contains(pt, rg.Plane.WorldXY, tolerance)
                    if result != rg.PointContainment.Inside and result != rg.PointContainment.Coincident:
                        inside = False  # Set to False if any point is outside
                        break  # If any point is outside, stop checking further
                if inside:
                    # Append the building to the corresponding parcel in the generic parcel mapping
                    gp_to_building_map[(i, j)].append(building_curve)

        # Map buildings to corner parcels
        for i in range(len(corner_parcels)):  # Iterate over corner parcels
            inside = True
            # Coerce the corner parcel curve of the corresponding corner
            cp_check = rs.coercecurve(corner_parcels[i])
            for pt in building_points:
                result = cp_check.Contains(pt, rg.Plane.WorldXY, tolerance)
                if result != rg.PointContainment.Inside and result != rg.PointContainment.Coincident:
                    inside = False  # Set to False if any point is outside
                    break  # If any point is outside, stop checking further
            if inside:
                # Append the building to the corresponding parcel in the corner parcel mapping
                cp_to_building_map[i].append(building_curve)


    #####################################################
    """ SETTING THE SCENE FOR CORNER BUILDING MAPPING """

    # Establish the reference point, from which the reordering of the vertices should take place
    cp_nb_edges_sorted = [[] for _ in range(len(corner_parcels))] 
    for i, parcel in enumerate(corner_parcels):
        parcel = rs.coercecurve(parcel)
        parcel_edges = parcel.DuplicateSegments()
        for edge in parcel_edges:
            start_pt = edge.PointAtStart
            end_pt = edge.PointAtEnd
            matched = False # Flag
            # Iterate over boundary polygon edges to find matching ones
            for boundary_line in boundary_polygon_edges:
                success_start, param_start = boundary_line.ClosestPoint(start_pt)
                success_end, param_end = boundary_line.ClosestPoint(end_pt)
                boundary_line_pt_1 = boundary_line.PointAt(param_start) if success_start else None
                boundary_line_pt_2 = boundary_line.PointAt(param_end) if success_end else None
                if boundary_line_pt_1 and boundary_line_pt_2:
                    start_dist = start_pt.DistanceTo(boundary_line_pt_1)
                    end_dist = end_pt.DistanceTo(boundary_line_pt_2)
                    if start_dist < tolerance and end_dist < tolerance:
                        matched = True  # Mark as matched
                        break  # No need to check further boundary lines once matched
            # If no match was found after all boundary lines, append to placeholder
            if matched == False:
                cp_nb_edges_sorted[i].append(edge)

    # Get non_boundary_points as first reference
    non_boundary_points = []
    for i in range(len(cp_nb_edges_sorted)):
        edge_1= cp_nb_edges_sorted[i][0]
        edge_2 = cp_nb_edges_sorted[i][1]
        intersection_events = rg.Intersect.Intersection.CurveCurve(edge_1, edge_2, 0.001, 0.0)
        if intersection_events:
            for event in intersection_events:
                if event.IsPoint:
                    intersection_point = event.PointA
                    non_boundary_point = rg.Point3d(intersection_point.X, intersection_point.Y, intersection_point.Z)  # Create Point3d
                    non_boundary_points.append(non_boundary_point) 

    # Assign corner distance threshold, after which we receive pentalateral parcel
    penta_corner_distances = []

    # Reorder vertices, such that they consistently start at reference corner
    for i, parcel in enumerate(corner_parcels):
        parcel = rs.coercecurve(parcel)
        parcel = ensure_counterclockwise(parcel)
        vertices = parcel.ToPolyline().ToArray()
        vertices_ccw = reorder_vertices_to_start_at_corner(vertices, non_boundary_points[i])
        if cp_configurations[i] == "quadrilateral":
            reordered_vertices = [vertices_ccw[2], vertices_ccw[3], vertices_ccw[0], vertices_ccw[1], vertices_ccw[2]]
            reordered_parcel = rg.PolylineCurve(reordered_vertices)
        elif cp_configurations[i] == "pentalateral":
            reordered_vertices = [vertices_ccw[2], vertices_ccw[3], vertices_ccw[4], vertices_ccw[0], vertices_ccw[1], vertices_ccw[2]]
            reordered_parcel = rg.PolylineCurve(reordered_vertices)
            penta_corner_distances.append(reordered_vertices[0].DistanceTo(reordered_vertices[1]))

    if penta_corner_distances:
        penta_threshold = round(max(penta_corner_distances) * 1.2,2)
    else:
        penta_threshold = 20

    ###############################
    """ CORNER BUILDING MAPPING """

    # Initialize list for corner building UV mapping (each element will be a nested list: dimensions + buildings)
    corner_buildings_map = []

    # Initialize list of corner parcel areas (and ensure identical index, to map complex buildings correctly)
    cp_areas = []

    # Initialize corner parcel dimension pairs
    cp_dimension_pairs = []

    # Iterate through all corner parcels and create the building map
    # Index "i" refers to the index of the corner parcel
    for i, buildings in enumerate(cp_to_building_map):
        parcel = corner_parcels[i]  # Access the corresponding parcel 
        parcel = rs.coercecurve(parcel)
        parcel = ensure_counterclockwise(parcel)
        parcel_area = round(rs.CurveArea(parcel)[0], 2)
        cp_areas.append(parcel_area)
        vertices = parcel.ToPolyline().ToArray()
        corner = boundary_polygon_corners[i]  # Access the corresponding corner

        # Reorder the vertices of the corner parcel
        vertices_ccw = reorder_vertices_to_start_at_corner(vertices, non_boundary_points[i])

        # Initialize a new list to store the dimension pair and building mappings for this parcel
        parcel_info = []

        # Map buildings in quadrilateral corner parcels
        if cp_configurations[i] == "quadrilateral":
            # Reorder vertices of quadrilateral corner parcel
            reordered_vertices = [vertices_ccw[2], vertices_ccw[3], vertices_ccw[0], vertices_ccw[1], vertices_ccw[2]]
            reordered_parcel = rg.PolylineCurve(reordered_vertices)

            # Get dimension pair of quadrilateral corner parcel
            cp_dim_1 = round(reordered_vertices[0].DistanceTo(reordered_vertices[1]), 2)
            cp_dim_2 = round(reordered_vertices[1].DistanceTo(reordered_vertices[2]), 2)
            cp_dimensions = [cp_dim_1, cp_dim_2]  # Dimensions for quadrilateral parcel
            cp_dimension_pairs.append(cp_dimensions)

            # Add the dimension pair as the first element in the list
            parcel_info.append(cp_dimensions)

            # Add aspect ratio as the second element in the list
            aspect_ratio = round(cp_dim_1 / cp_dim_2, 2)
            parcel_info.append(aspect_ratio)

            # Generate a UV mapping grid for the quadrilateral corner parcel
            grid_points = generate_grid_in_quadrilateral_parcel(reordered_vertices, grid_resolution)

            # Initialize mapping_info to ensure it's a list
            mapping_info = []

            mapping_info = []
            # Loop through all buildings inside this parcel
            for building in buildings:
                building_curve = rs.coercecurve(building)
                building_vertices = list(building_curve.ToPolyline().ToArray())
                # Compute the U-V coordinates of the footprint vertices within the grid
                #compute_building_indeces_quadrilateral(building_vertices, grid_in)
                building_mapping = compute_building_indeces_quadrilateral(building_vertices, grid_points)
                
                mapping_info.append(building_mapping)

            # Add the mapping info list to parcel info (ensuring one nested list for all mappings)
            parcel_info.append(mapping_info)

        # Map buildings in pentalateral corner parcels
        elif cp_configurations[i] == "pentalateral":
            # Reorder vertices of pentalateral corner parcel
            reordered_vertices = [vertices_ccw[2], vertices_ccw[3], vertices_ccw[4], vertices_ccw[0], vertices_ccw[1], vertices_ccw[2]]
            reordered_parcel = rg.PolylineCurve(reordered_vertices)

            # Get dimension trio of pentalateral corner parcel
            cp_dim_1 = round(reordered_vertices[0].DistanceTo(reordered_vertices[1]), 2)
            cp_dim_2 = round(reordered_vertices[1].DistanceTo(reordered_vertices[2]), 2)
            cp_dim_3 = round(reordered_vertices[0].DistanceTo(reordered_vertices[4]), 2)
            cp_dimensions = [cp_dim_1, cp_dim_2, cp_dim_3]  # Dimensions for pentalateral parcel
            cp_dimension_pairs.append(cp_dimensions)

            # Add the dimension trio as the first element in the list
            parcel_info.append(cp_dimensions)

            # Add aspect ratio as the second element in the list
            aspect_ratio = round(cp_dim_1 / cp_dim_2, 2)
            parcel_info.append(aspect_ratio)

            # Generate a UV mapping grid for the pentalateral corner parcel
            penta_center = compute_centroid(reordered_vertices)
            triangles, indexed_points = generate_grid_in_pentalateral_parcel(reordered_vertices, penta_center)

            mapping_info = []
            # Loop through all buildings inside this parcel
            for building in buildings:
                building_curve = rs.coercecurve(building)
                building_vertices = list(building_curve.ToArray())
                # Compute the U-V coordinates of the footprint vertices within the grid
                building_mapping = compute_building_indeces_pentalateral(building_vertices, indexed_points)
                mapping_info.append(building_mapping)  # Add the building mapping
            
            # Add the mapping info list to parcel info (ensuring one nested list for all mappings)
            parcel_info.append(mapping_info)
        
        # Add the list of parcel_info (dimension + building mappings) to the main list
        corner_buildings_map.append(parcel_info)

    # Remove last area from cp_areas if it is not equal
    if len(cp_areas) > len(corner_parcels):
        cp_areas.pop()
    

################################
""" GENERIC BUILDING MAPPING """

# Initialize list for generic building UV mapping (each element will be a nested list: dimensions + buildings)
generic_buildings_map = []

# Initialize list of generic parcel areas (and ensure identical index, to map complex buildings correctly)
gp_areas = []

# Initialize list of aspect ratios (where the length is in the numerator and the width is in the denominator)
gp_dimension_pairs = []

# Iterate through all generic parcels and create the building map
for (i, j), buildings in gp_to_building_map.items():
    parcel = gp_map_to_edge[i][j]  # Access the corresponding parcel 
    parcel = rs.coercecurve(parcel)
    parcel = ensure_counterclockwise(parcel)
    parcel_area = round(rs.CurveArea(parcel)[0],2)
    gp_areas.append(parcel_area)
    vertices = parcel.ToPolyline().ToArray()
    parcel_boundary_edge = gp_edge_on_boundary_edge[i][j]   # Access the corresponding boundary edge of the parcel
    start_point = parcel_boundary_edge.PointAtStart         # Start point should be vertex at index 0 for reordered vertices
    
    # Reorder the vertices of the corner parcel, such that they are counterclockwise and the vertex at index "0" starts on the corner
    reordered_vertices = reorder_vertices_to_start_at_corner(vertices, start_point)

    # Initialize a new list to store the dimension pair and building mappings for this parcel
    parcel_info = []

    # Get dimension pairs
    gp_length = round(reordered_vertices[0].DistanceTo(reordered_vertices[1]),2)
    gp_width = round(reordered_vertices[1].DistanceTo(reordered_vertices[2]),2)
    gp_dimensions = [gp_length, gp_width]
    gp_dimension_pairs.append(gp_dimensions)

    # Add the dimension pair as the first element in the list
    parcel_info.append(gp_dimensions)

    # Add aspect ratio as the second element in the list
    aspect_ratio = round(gp_length / gp_width, 2)
    parcel_info.append(aspect_ratio)

    # Update the start and end points of the boundary edge if necessary
    start_point = reordered_vertices[0]
    end_point = reordered_vertices[1]  # Assuming the boundary edge is between the first two vertices

    # Create consistent parcels for precise mapping of buildings
    reordered_parcel_outline = [reordered_vertices[0], reordered_vertices[1], reordered_vertices[2], reordered_vertices[3], reordered_vertices[0]]
    reordered_parcel = rg.PolylineCurve(reordered_parcel_outline)

    # Generate a UV mapping grid for the parcel
    grid_points = generate_grid_in_quadrilateral_parcel(reordered_parcel_outline, grid_resolution)
    
    mapping_info = []  # To store the building mappings

    # Loop through all buildings inside this parcel
    for building in buildings:
        building_footprint = rs.coercecurve(building)
        building_vertices = list(building_footprint.ToPolyline().ToArray())

        # Compute the U-V coordinates of the footprint vertices within the grid
        building_mapping = compute_building_indeces_quadrilateral(building_vertices, grid_points)
        mapping_info.append(building_mapping)

        # Get area ratio between building and parcel
        parcel_area = rs.CurveArea(reordered_parcel)[0]  # Get the area of the parcel
        building_area = rs.CurveArea(building)[0]        # Get the area of the building footprint
        building_footprint_to_parcel_area_ratio = round((building_area / parcel_area), 2)

    # Add the mapping info list as the second element in the list (index 1)
    parcel_info.append(mapping_info)

    # Add the list of parcel_info (dimension + building mappings) to the main list
    generic_buildings_map.append(parcel_info)


################
""" OUTPUTS """

### Determine key metrics for generic parcels
gp_lengths_mean = calculate_mean(gp_lengths)
gp_lengths_min = min(gp_lengths)
gp_lengths_max = max(gp_lengths)
gp_lengths_sd = calculate_std(gp_lengths)
gp_widths_mean = calculate_mean(gp_widths)
gp_widths_min = min(gp_widths)
gp_widths_max = max(gp_widths)
gp_widths_sd = calculate_std(gp_widths)

### Determine key metrics for corner parcels
cp_lengths_flattened = [item for sublist in cp_lengths for item in sublist]
cp_edge_mean = calculate_mean(cp_lengths_flattened)
cp_edge_min = min(cp_lengths_flattened)
cp_edge_max = max(cp_lengths_flattened)
cp_edge_sd = calculate_std(cp_lengths_flattened)

### Determine key metrics for building height
if height_info is not None:
    bh_mean = height_info[0]
    bh_min = height_info[1]
    bh_max = height_info[2]
    bh_sd = height_info[3]
else:
    bh_mean = 20
    bh_min = 10
    bh_max = 30
    bh_sd = 5

# Outputs
cp_count = len(corner_parcels)
gp_count = len(generic_parcels)
gp_lengths = gp_lengths
cp_lengths = cp_lengths
cp_edge_max = cp_edge_max
cp_edge_min = cp_edge_min
boundary_area = rs.CurveArea(boundary_curve)
boundary_area = round(boundary_area[0],2)


data_text = [
    f"Corner parcel configurations: {cp_configurations}",
    f"Corner parcel count: {len(corner_parcels)}",
    f"Corner parcel mean length: {round(cp_edge_mean, 2)}",
    f"Corner parcel minimum length: {round(cp_edge_min, 2)}",
    f"Corner parcel maximum length: {round(cp_edge_max, 2)}",
    f"Corner parcel areas: {cp_areas}",
    f"Generic parcel total count: {round(gp_count, 2)}",
    f"Generic parcel mean length: {round(gp_lengths_mean, 2)}",
    f"Generic parcel minimum length: {round(gp_lengths_min, 2)}",
    f"Generic parcel maximum length: {round(gp_lengths_max, 2)}",
    f"Generic parcel lengths standard deviation: {round(gp_lengths_sd, 2)}",
    f"Generic parcel mean widths: {round(gp_widths_mean, 2)}",
    f"Generic parcel minimum widths: {round(gp_widths_min, 2)}",
    f"Generic parcel maximum widths: {round(gp_widths_max, 2)}",
    f"Generic parcel widths standard deviation: {round(gp_widths_sd, 2)}",
    f"Generic parcel count per boundary edge: {gp_on_boundary_edge_count}",
    f"Generic parcel indentations per boundary edge: {gp_indentation_count}",    
    f"Generic parcel dimension pairs (length = index 0, width = index 1): {gp_dimension_pairs}",
    f"Generic parcel areas: {gp_areas}",
    f"Generic parcel to building footprint area ratio: {building_footprint_to_parcel_area_ratio}",
    f"Corner parcel dimension pairs: {cp_dimension_pairs}",
    f"Average length after which an indentation occurs: {indentation_ratio}",
    f"Length threshold, under which two corners create pentalateral: {penta_threshold}",
    f"Corner parcel edges angles: {cp_edge_angle}",
    f"Boundary Polygon Area: {boundary_area}",
    f"Building mean height: {bh_mean}",
    f"Building minimum height: {bh_min}",
    f"Building maximum heigth: {bh_max}",
    f"Building height standard deviation: {bh_sd}",
    f"Buildings count: {len(buildings_footprint)}"
]

data_package = [
    cp_configurations,
    len(corner_parcels),
    round(cp_edge_mean, 2),
    round(cp_edge_min, 2),
    round(cp_edge_max, 2),
    cp_areas,
    round(gp_count, 2),
    round(gp_lengths_mean, 2),
    [round(gp_lengths_min, 2)],
    round(gp_lengths_max, 2),
    round(gp_lengths_sd, 2),
    round(gp_widths_mean, 2),
    round(gp_widths_min, 2),
    round(gp_widths_max, 2),
    round(gp_widths_sd, 2),
    gp_on_boundary_edge_count,
    gp_indentation_count,
    gp_dimension_pairs,
    gp_areas,
    building_footprint_to_parcel_area_ratio,
    cp_dimension_pairs,
    [indentation_ratio],
    penta_threshold,
    cp_edge_angle,
    boundary_area,
    bh_mean,
    bh_min,
    bh_max,
    bh_sd,
    len(buildings_footprint)
]
# ---------- end block_analysis ----------

# ----
# BLOCK ANALYSIS
block_analysis_2 = Python3Script(boundary=boundary, parcels=parcels, buildings_footprint=buildings_footprint, height_info=get_heights)  # -> data_text, data_package, corner_buildings_map, generic_buildings_map; inputs boundary: list, parcels: list, buildings_footprint: list, height_info: list
# ---------- block_analysis_2: Python ----------
import Rhino
import rhinoscriptsyntax as rs
import Rhino.Geometry as rg
import random
import math
from collections import defaultdict

#####################################################################################

""" FUNCTIONS """

# Function to calculate mean
def calculate_mean(data):
    return sum(data) / len(data)

# Function to calculate standard deviation
def calculate_std(data):
    mean = calculate_mean(data)
    squared_differences = [(i - mean) ** 2 for i in data]  # Calculate squared differences
    variance = sum(squared_differences) / len(data)  # Find the variance
    return math.sqrt(variance)  # std = square root of the variance

# Function to compute the angles between the non-boundary edges and the boundary polygon edges of a corner parcel
def compute_non_boundary_edge_angles(non_boundary_edges, boundary_polygon_edges, tolerance):
    cp_edge_angles = []
    # Iterate through all non-boundary edges
    for nbe in non_boundary_edges:
        nbe_start_pt = nbe.PointAtStart
        nbe_end_pt = nbe.PointAtEnd    
        # Iterate through boundary polygon edges to find the closest edge points
        for edge in boundary_polygon_edges:
            success_start, param_start = edge.ClosestPoint(nbe_start_pt)
            success_end, param_end = edge.ClosestPoint(nbe_end_pt)           
            # Get closest points on the edge if successful
            edge_pt_1 = edge.PointAt(param_start) if success_start else None
            edge_pt_2 = edge.PointAt(param_end) if success_end else None
            # If both start and end points of nbe have close points on the boundary edge
            if edge_pt_1 and edge_pt_2:
                start_dist = nbe_start_pt.DistanceTo(edge_pt_1)
                end_dist = nbe_end_pt.DistanceTo(edge_pt_2)
                # Check if the start distance is within tolerance
                if start_dist < tolerance:
                    if nbe_start_pt.DistanceTo(edge.PointAtStart) < nbe_start_pt.DistanceTo(edge.PointAtEnd):
                        vec_1 = rg.Vector3d(edge.PointAtStart.X - nbe_start_pt.X, edge.PointAtStart.Y - nbe_start_pt.Y, 0)
                    else:
                        vec_1 = rg.Vector3d(edge.PointAtEnd.X - nbe_start_pt.X, edge.PointAtEnd.Y - nbe_start_pt.Y, 0)
                    vec_2 = rg.Vector3d(nbe_end_pt.X - nbe_start_pt.X, nbe_end_pt.Y - nbe_start_pt.Y, 0)                   
                    vec_1.Unitize()
                    vec_2.Unitize()
                    angle_degrees = math.degrees(rg.Vector3d.VectorAngle(vec_1, vec_2))
                    cp_edge_angles.append(round(angle_degrees))
                # Check if the end distance is within tolerance
                elif end_dist < tolerance:
                    if nbe_end_pt.DistanceTo(edge.PointAtStart) < nbe_end_pt.DistanceTo(edge.PointAtEnd):
                        vec_1 = rg.Vector3d(edge.PointAtStart.X - nbe_end_pt.X, edge.PointAtStart.Y - nbe_end_pt.Y, 0)
                    else:
                        vec_1 = rg.Vector3d(edge.PointAtEnd.X - nbe_end_pt.X, edge.PointAtEnd.Y - nbe_end_pt.Y, 0)
                    vec_2 = rg.Vector3d(nbe_start_pt.X - nbe_end_pt.X, nbe_start_pt.Y - nbe_end_pt.Y, 0)
                    vec_1.Unitize()
                    vec_2.Unitize()
                    angle_degrees = math.degrees(rg.Vector3d.VectorAngle(vec_1, vec_2))
                    cp_edge_angles.append(round(angle_degrees))
    # Returns list of angles (in degrees) between the non-boundary edges and boundary edges
    return cp_edge_angles

# Function to create lines that interpolate between two opposite edges
def interpolate_between_edges(edge1, edge2, grid_resolution):
    points = []
    for i in range(grid_resolution + 1):
        step = i / grid_resolution
        start = edge1.PointAt(step)
        end = edge2.PointAt(step)
        points.append(rg.Line(start, end))
    return points

# Function to ensure the vertices of the parcel are ordered counter-clockwise.
def ensure_counterclockwise(parcel):
    polyline = parcel.ToPolyline()
    vertices = polyline.ToArray()  # Get vertices as an array
    signed_area_sum = 0
    # Shoelace theorem to check clockwise or counter-clockwise
    for i in range(len(vertices)):
        v1 = vertices[i]
        v2 = vertices[(i + 1) % len(vertices)]  # Next vertex (with wrap-around)
        signed_area_sum += (v2.X - v1.X) * (v2.Y + v1.Y)
    # If total is positive, the vertices are ordered clockwise
    if signed_area_sum > 0:
        vertices = list(reversed(vertices))  # Reverse the vertices if clockwise
        return rg.PolylineCurve(vertices)  # Return the polyline with counter-clockwise vertices
    else:
        return parcel  # Already counter-clockwise, return the original parcel

# Function to reorder vertices such that the first vertex is closest to corner and ensure counterclockwise order.
def reorder_vertices_to_start_at_corner(vertices, corner, tolerance=1e-6):  
    # Find the index of the vertex closest to the corner
    min_distance = float("inf")
    vertex_0_index = 0
    for i in range(len(vertices)):
        distance = vertices[i].DistanceTo(corner)
        if distance < min_distance:
            min_distance = distance
            vertex_0_index = i
    # Reorder the vertices starting from the closest point
    reordered_vertices = [vertices[(i + vertex_0_index) % len(vertices)] for i in range(len(vertices))]
    # Remove consecutive duplicate vertices (within a small tolerance)
    unique_reordered_vertices = [reordered_vertices[0]]
    for i in range(1, len(vertices)):
        if reordered_vertices[i].DistanceTo(unique_reordered_vertices[-1]) > tolerance:
            unique_reordered_vertices.append(reordered_vertices[i])
    # Ensure the last vertex is not a duplicate of the first vertex
    if unique_reordered_vertices[0].DistanceTo(unique_reordered_vertices[-1]) < tolerance:
        unique_reordered_vertices.pop()
    # Check if the reordered vertices are counterclockwise using the Shoelace theorem
    signed_area_sum = 0
    for i in range(len(unique_reordered_vertices)):
        v1 = unique_reordered_vertices[i]
        v2 = unique_reordered_vertices[(i + 1) % len(unique_reordered_vertices)]  # Next vertex (with wrap-around)
        signed_area_sum += (v2.X - v1.X) * (v2.Y + v1.Y)
    if signed_area_sum > 0:
        unique_reordered_vertices.reverse()
    else:
        unique_reordered_vertices = unique_reordered_vertices
    return unique_reordered_vertices



### Functions used for quadrilateral building mapping ###

# Function to generate a grid inside a quadrilateral parcel. Uses a bilinear interpolation between the edges of the quadrilateral.
def generate_grid_in_quadrilateral_parcel(parcel_vertices, grid_resolution):
    grid_points = []
    parcel_vertices.pop()
    # Get the four corners of the quadrilateral
    v0, v1, v2, v3 = parcel_vertices
    for u in range(grid_resolution + 1):
        u_ratio = u / grid_resolution  # The relative position along the U direction (horizontal)
        # Interpolate between v0->v3 (left) and v1->v2 (right) edges
        left_interp = v0 + (v3 - v0) * u_ratio
        right_interp = v1 + (v2 - v1) * u_ratio
        for v in range(grid_resolution + 1):
            v_ratio = v / grid_resolution  # The relative position along the V direction (vertical)
            # Interpolate between the left and right edges at the current u_ratio
            grid_point = left_interp + (right_interp - left_interp) * v_ratio
            grid_points.append(grid_point)
    return grid_points


# Function to map the building vertices to the indices of the grid points of the quadrilateral parcel.
def compute_building_indeces_quadrilateral(building_vertices, grid_in):
    building_indices = []
    for building_vertex in building_vertices:
        # Find the closest point in the input grid and get its index
        closest_index_in = min(range(len(grid_in)), key=lambda i: building_vertex.DistanceTo(grid_in[i]))
        building_indices.append(closest_index_in)
    # Returns a list of indices that represent the mapping.
    return building_indices


### Functions used for pentalateral building mapping ###

# Function to compute the centroid (geometric center) of a list of 3D points (vertices).
def compute_centroid(vertices):
    sum_x = sum(v.X for v in vertices)
    sum_y = sum(v.Y for v in vertices)
    sum_z = sum(v.Z for v in vertices)
    num_vertices = len(vertices)
    return rg.Point3d(sum_x / num_vertices, sum_y / num_vertices, sum_z / num_vertices)

# Function to subdivide a triangle into four smaller triangles by adding midpoints on its edges.
def subdivide_triangle(v0, v1, v2):
    # Compute midpoints
    mid_v0_v1 = v0 + (v1 - v0) * 0.5
    mid_v1_v2 = v1 + (v2 - v1) * 0.5
    mid_v2_v0 = v2 + (v0 - v2) * 0.5
    # Create smaller triangles
    triangles = [
        (v0, mid_v0_v1, mid_v2_v0),
        (mid_v0_v1, v1, mid_v1_v2),
        (mid_v2_v0, mid_v1_v2, v2),
        (mid_v0_v1, mid_v1_v2, mid_v2_v0)
    ]
    # Return triangles and midpoints as potential intersection points
    return triangles, [mid_v0_v1, mid_v1_v2, mid_v2_v0]

# Function to subdivide the triangles of a pentalateral parcel iteratively with consistent indexing.
def generate_grid_in_pentalateral_parcel(vertices, center):
    # Create initial triangles (center to adjacent vertices)
    triangles = []
    indexed_points = []  # Track points in a consistent order
    indexed_points.append(center)  # Start with the centroid having index 0
    iterations = 3
    # Add the original vertices with consistent indexing
    indexed_points.extend(vertices)  # Add pentagon vertices (these will get indices 1-5)
    for i in range(len(vertices)):
        v0 = vertices[i]
        v1 = vertices[(i + 1) % len(vertices)]
        triangles.append((center, v0, v1))
    # Subdivide the triangles iteratively
    for _ in range(iterations):
        new_triangles = []
        for tri in triangles:
            # Subdivide the triangle and get the new midpoints
            subdivided, midpoints = subdivide_triangle(*tri)
            # Check each midpoint and assign it an index if it's new
            for midpoint in midpoints:
                if midpoint not in indexed_points:
                    indexed_points.append(midpoint)
            new_triangles.extend(subdivided)
        triangles = new_triangles
    # Returns the subdivided triangles and indexed intersection points.
    return triangles, indexed_points

# Function to map the building vertices to the indices of the sorted points of the pentalateral parcel.
def compute_building_indeces_pentalateral(building_vertices, sorted_points_in):
    building_indices = []
    for building_vertex in building_vertices:
        # Find the closest point in the sorted_points_in and get its index
        closest_index_in = min(range(len(sorted_points_in)), key=lambda i: building_vertex.DistanceTo(sorted_points_in[i]))
        building_indices.append(closest_index_in)
    # Returns a list of indices that represent the mapping.
    return building_indices


#####################################################################################

# SHORTCUTS FOR LEGIBILITY:
# generic_parcels: "gp"
# corner_parcels: "gp"


###################################
""" INPUTS, LISTS AND CONSTANTS """

# Inputs
boundary_polygon = boundary  # The large boundary polygon that surrounds all parcels (as a closed curve)
all_parcels = parcels  # List of (irregular) rectangular parcel curves (from the "List Access" in Grasshopper)
buildings = buildings_footprint # List of building footprints
if height_info is not None:
    height_info = height_info
else:
    print("standard building heights will be used")

# Initialize lists for outputs
corner_parcels = []  # List to store corner parcels (Rhino.Geometry type: PolylineCurve)
generic_parcels = []  # List to store generic parcels (Rhino.Geometry type: PolylineCurve)
gp_lengths = []  # List to store generic parcels lengths (the edge, that is adjacent to the boundary polygon)
gp_widths = [] # List to store generic parcels widths (one of the edges, that is connected to the boundary polygon)
gp_nb_edges = [] # List to store all generic parcels' non-boundary edges (for indentation count)
cp_lengths = [] # List to store the corner parcels lengths (for the two edges adjacent to the boundary polygon)
cp_edge_angle = [] # List to store corner parcel angles
cp_configurations = []

# Set tolerance for geometric comparison
tolerance = 1e-3

# Set grid resolution for mapping (shouldn't be set higher than 50 for acceptable performance)
grid_resolution = 30

#######################
""" PARCEL ANALYSIS """


# Ensure the boundary_polygon is a valid curve
if rs.IsCurve(boundary_polygon) and boundary_polygon is not None:
    boundary_curve = rs.coercecurve(boundary_polygon)  # Convert the boundary polygon to a RhinoCommon curve
    boundary_curve = ensure_counterclockwise(boundary_curve)

    # Explode the boundary_polygon into individual edges
    boundary_polygon_corners = boundary_curve.ToPolyline().ToArray()
    boundary_polygon_edges = boundary_curve.DuplicateSegments()
    
    # Initialize empty lists for further analysis and mapping
    gp_on_boundary_edge_count = [0] * len(boundary_polygon_edges)
    gp_map_to_edge = [[] for _ in range(len(boundary_polygon_edges))]
    gp_edge_on_boundary_edge = [[] for _ in range(len(boundary_polygon_edges))]


    # Iterate over each parcel curve, received from the input
    for parcel in all_parcels:
        
        # Convert parcels to RhinoCommon curve (PolylineCurve) and ensure counterclockwise order
        parcel_curve = rs.coercecurve(parcel)
        parcel_curve = ensure_counterclockwise(parcel_curve)
        
        # Explode the parcel into individual segments (edges)
        parcel_edges = parcel_curve.DuplicateSegments()
        boundary_edges = []  # To hold the edges of the iterated parcel that lie on the boundary polygon
        non_boundary_edges = []  # To hold the non-boundary edges


        # Check each edge of the parcel to see if it lies close to the boundary polygon
        for edge in parcel_edges:
            start_pt = edge.PointAtStart
            end_pt = edge.PointAtEnd

            # Find the closest points on the boundary polygon to the start and end points of the edge
            success_start, param_start = boundary_curve.ClosestPoint(start_pt)
            success_end, param_end = boundary_curve.ClosestPoint(end_pt)

            # Construct points on the boundary polygon to compute distance
            boundary_pt_1 = boundary_curve.PointAt(param_start) if success_start else None
            boundary_pt_2 = boundary_curve.PointAt(param_end) if success_end else None

            # Compare the distance between the parcel edge and the boundary polygon
            if boundary_pt_1 and boundary_pt_2:
                start_dist = start_pt.DistanceTo(boundary_pt_1)
                end_dist = end_pt.DistanceTo(boundary_pt_2)

                # If both distances are within the tolerance, consider it a boundary edge
                if start_dist < tolerance and end_dist < tolerance:
                    boundary_edges.append(edge)

                else:
                    non_boundary_edges.append(edge)



        # Generic parcel has one boundary edge
        if len(boundary_edges) == 1:
            length = boundary_edges[0].GetLength()
            gp_lengths.append(length)
            generic_parcels.append(parcel_curve)
            
            # Add the boundary edge to the respective boundary polygon edge's generic parcels count
            start_pt = boundary_edges[0].PointAtStart
            end_pt = boundary_edges[0].PointAtEnd
            for i, boundary_line in enumerate(boundary_polygon_edges):
                success_start, param_start = boundary_line.ClosestPoint(start_pt)
                success_end, param_end = boundary_line.ClosestPoint(end_pt)
                boundary_line_pt_1 = boundary_line.PointAt(param_start) if success_start else None
                boundary_line_pt_2 = boundary_line.PointAt(param_end) if success_end else None
                if boundary_line_pt_1 and boundary_line_pt_2:
                    start_dist = start_pt.DistanceTo(boundary_line_pt_1)
                    end_dist = end_pt.DistanceTo(boundary_line_pt_2)
                    if start_dist < tolerance and end_dist < tolerance:
                        gp_on_boundary_edge_count[i] += 1
                        gp_map_to_edge[i].append(parcel)
                        gp_edge_on_boundary_edge[i].append(boundary_edges[0])

            # For generic parcels, find the two non-boundary edges connected to the boundary edge
            connected_non_boundary_edges = []
            for edge in non_boundary_edges:
                if (edge.PointAtStart in [boundary_edges[0].PointAtStart, boundary_edges[0].PointAtEnd] or
                    edge.PointAtEnd in [boundary_edges[0].PointAtStart, boundary_edges[0].PointAtEnd]):
                    connected_non_boundary_edges.append(edge)
                    gp_nb_edges.append(edge)

            # Ensure we have exactly two connected non-boundary edges
            # If the connected non boundary edges differ in length, assign the minimum of both
            if len(connected_non_boundary_edges) == 2:
                width = min(connected_non_boundary_edges[0].GetLength(), connected_non_boundary_edges[1].GetLength()) # here condition for crooked line
                gp_widths.append(width)


        # Corner parcel has two boundary edges, if quadrilateral
        elif len(boundary_edges) == 2: 
            cp_configurations.append("quadrilateral")           
            cp_lengths.append([boundary_edges[0].GetLength(), boundary_edges[1].GetLength()])
            corner_parcels.append(parcel_curve)
            cp_vertices = parcel_curve.ToPolyline().ToArray()
            angles = compute_non_boundary_edge_angles(non_boundary_edges, boundary_polygon_edges, tolerance)
            cp_edge_angle.append(angles)


        # Corner parcel has three boundary edges, if pentalateral
        elif len(boundary_edges) == 3: 
            cp_configurations.append("pentalateral")           
            cp_lengths.append([boundary_edges[0].GetLength(), boundary_edges[1].GetLength(), boundary_edges[2].GetLength()])
            corner_parcels.append(parcel_curve)
            cp_vertices = parcel_curve.ToPolyline().ToArray()
            angles = compute_non_boundary_edge_angles(non_boundary_edges, boundary_polygon_edges, tolerance)
            cp_edge_angle.append(angles)


    # Sort the non boundary edges (or the widths) of the generic parcels to the corresponding boundary polygon edge
    gp_nb_edges_sorted = [[] for _ in range(len(boundary_polygon_edges))] 
    for edge in gp_nb_edges:
        start_pt = edge.PointAtStart
        end_pt = edge.PointAtEnd
        for i, boundary_line in enumerate(boundary_polygon_edges):
            success_start, param_start = boundary_line.ClosestPoint(start_pt)
            success_end, param_end = boundary_line.ClosestPoint(end_pt)
            boundary_line_pt_1 = boundary_line.PointAt(param_start) if success_start else None
            boundary_line_pt_2 = boundary_line.PointAt(param_end) if success_end else None
            if boundary_line_pt_1 and boundary_line_pt_2:
                start_dist = start_pt.DistanceTo(boundary_line_pt_1)
                end_dist = end_pt.DistanceTo(boundary_line_pt_2)
                if start_dist < tolerance or end_dist < tolerance:
                    gp_nb_edges_sorted[i].append(edge)


    
    # Initialize generic parcel indentation count on the back
    # This means, the amount of indentations that occur over all rear sides of the parcels that are aligned to one edge
    gp_indentation_count = [0] * len(boundary_polygon_edges)
    parcel_lengths = []
    for i in range(len(boundary_polygon_edges)):
        edge_infos = [[] for _ in range(len(gp_nb_edges_sorted[i]))]
        point_to_edges = defaultdict(list)
        # Default dictionary to store edges grouped by shared points
        # Automatically initializes a default value for a new key when you try to access it for the first time 
        # Store edge start and end points and lengths
        for m, edge in enumerate(gp_nb_edges_sorted[i]):
            edge_start = edge.PointAtStart
            edge_end = edge.PointAtEnd
            edge_length = edge.GetLength()
            # Append edge data to the list
            edge_infos[m].append(edge_start)
            edge_infos[m].append(edge_end)
            edge_infos[m].append(edge_length)
            # Group edges by shared points (both start and end points)
            # If edge_start is not in the dictionary, defaultdict(list) will automatically create an empty list for this key
            point_to_edges[edge_start].append(edge_length)
            point_to_edges[edge_end].append(edge_length)
        # Compare the lengths of edges that share points
        for point, lengths in point_to_edges.items():
            if len(lengths) > 1:  # Only compare if multiple edges share this point
                if len(set(lengths)) > 1:  # If there are different lengths, increment the counter
                    gp_indentation_count[i] += 1
        # Get the sum of boundary edge lengths to establish proportion
        boundary_edge_lengths = 0
        for gp_edge in gp_edge_on_boundary_edge[i]:
            boundary_edge_lengths += gp_edge.GetLength()
        parcel_lengths.append(boundary_edge_lengths)


    # Find out average length for when indentation occurs
    numerator = 0
    denominator = 0
    if gp_indentation_count[i] < 0:
        for i in range(len(parcel_lengths)):
            # Skip if parcel_lengths[i] = 0 (pentalateral corner parcel)
            if parcel_lengths[i] < tolerance:
                continue
            elif gp_indentation_count == 0: 
                numerator += parcel_lengths[i]
                denominator += 1
            else:
                numerator += (parcel_lengths[i] / gp_indentation_count[i])
                denominator += 1
        indentation_ratio = round(numerator/denominator,2)
    else:
        indentation_ratio = parcel_lengths[0]
        

    #########################
    """ BUILDING ANALYSIS """

    # Dictionary to store parcel to building mapping
    gp_to_building_map = defaultdict(list)  # Mapping from (edge_index, gp_index) -> list of buildings
    cp_to_building_map = [[] for _ in range(len(corner_parcels))]  

    # For all buildings, get building vertices
    for building in buildings:
        building_curve = rs.coercecurve(building)
        building_points = building_curve.ToPolyline().ToArray()   # Convert the curve into a polyline

        # Map buildings to generic parcels of corresponding edge
        for i in range(len(boundary_polygon_edges)):
            for j in range(len(gp_map_to_edge[i])):
                inside = True
                # Coerce the generic parcel curve of the corresponding edge
                gp_check = rs.coercecurve(gp_map_to_edge[i][j])
                for pt in building_points:
                    result = gp_check.Contains(pt, rg.Plane.WorldXY, tolerance)
                    if result != rg.PointContainment.Inside and result != rg.PointContainment.Coincident:
                        inside = False  # Set to False if any point is outside
                        break  # If any point is outside, stop checking further
                if inside:
                    # Append the building to the corresponding parcel in the generic parcel mapping
                    gp_to_building_map[(i, j)].append(building_curve)

        # Map buildings to corner parcels
        for i in range(len(corner_parcels)):  # Iterate over corner parcels
            inside = True
            # Coerce the corner parcel curve of the corresponding corner
            cp_check = rs.coercecurve(corner_parcels[i])
            for pt in building_points:
                result = cp_check.Contains(pt, rg.Plane.WorldXY, tolerance)
                if result != rg.PointContainment.Inside and result != rg.PointContainment.Coincident:
                    inside = False  # Set to False if any point is outside
                    break  # If any point is outside, stop checking further
            if inside:
                # Append the building to the corresponding parcel in the corner parcel mapping
                cp_to_building_map[i].append(building_curve)


    #####################################################
    """ SETTING THE SCENE FOR CORNER BUILDING MAPPING """

    # Establish the reference point, from which the reordering of the vertices should take place
    cp_nb_edges_sorted = [[] for _ in range(len(corner_parcels))] 
    for i, parcel in enumerate(corner_parcels):
        parcel = rs.coercecurve(parcel)
        parcel_edges = parcel.DuplicateSegments()
        for edge in parcel_edges:
            start_pt = edge.PointAtStart
            end_pt = edge.PointAtEnd
            matched = False # Flag
            # Iterate over boundary polygon edges to find matching ones
            for boundary_line in boundary_polygon_edges:
                success_start, param_start = boundary_line.ClosestPoint(start_pt)
                success_end, param_end = boundary_line.ClosestPoint(end_pt)
                boundary_line_pt_1 = boundary_line.PointAt(param_start) if success_start else None
                boundary_line_pt_2 = boundary_line.PointAt(param_end) if success_end else None
                if boundary_line_pt_1 and boundary_line_pt_2:
                    start_dist = start_pt.DistanceTo(boundary_line_pt_1)
                    end_dist = end_pt.DistanceTo(boundary_line_pt_2)
                    if start_dist < tolerance and end_dist < tolerance:
                        matched = True  # Mark as matched
                        break  # No need to check further boundary lines once matched
            # If no match was found after all boundary lines, append to placeholder
            if matched == False:
                cp_nb_edges_sorted[i].append(edge)

    # Get non_boundary_points as first reference
    non_boundary_points = []
    for i in range(len(cp_nb_edges_sorted)):
        edge_1= cp_nb_edges_sorted[i][0]
        edge_2 = cp_nb_edges_sorted[i][1]
        intersection_events = rg.Intersect.Intersection.CurveCurve(edge_1, edge_2, 0.001, 0.0)
        if intersection_events:
            for event in intersection_events:
                if event.IsPoint:
                    intersection_point = event.PointA
                    non_boundary_point = rg.Point3d(intersection_point.X, intersection_point.Y, intersection_point.Z)  # Create Point3d
                    non_boundary_points.append(non_boundary_point) 

    # Assign corner distance threshold, after which we receive pentalateral parcel
    penta_corner_distances = []

    # Reorder vertices, such that they consistently start at reference corner
    for i, parcel in enumerate(corner_parcels):
        parcel = rs.coercecurve(parcel)
        parcel = ensure_counterclockwise(parcel)
        vertices = parcel.ToPolyline().ToArray()
        vertices_ccw = reorder_vertices_to_start_at_corner(vertices, non_boundary_points[i])
        if cp_configurations[i] == "quadrilateral":
            reordered_vertices = [vertices_ccw[2], vertices_ccw[3], vertices_ccw[0], vertices_ccw[1], vertices_ccw[2]]
            reordered_parcel = rg.PolylineCurve(reordered_vertices)
        elif cp_configurations[i] == "pentalateral":
            reordered_vertices = [vertices_ccw[2], vertices_ccw[3], vertices_ccw[4], vertices_ccw[0], vertices_ccw[1], vertices_ccw[2]]
            reordered_parcel = rg.PolylineCurve(reordered_vertices)
            penta_corner_distances.append(reordered_vertices[0].DistanceTo(reordered_vertices[1]))

    if penta_corner_distances:
        penta_threshold = round(max(penta_corner_distances) * 1.2,2)
    else:
        penta_threshold = 20

    ###############################
    """ CORNER BUILDING MAPPING """

    # Initialize list for corner building UV mapping (each element will be a nested list: dimensions + buildings)
    corner_buildings_map = []

    # Initialize list of corner parcel areas (and ensure identical index, to map complex buildings correctly)
    cp_areas = []

    # Initialize corner parcel dimension pairs
    cp_dimension_pairs = []

    # Iterate through all corner parcels and create the building map
    # Index "i" refers to the index of the corner parcel
    for i, buildings in enumerate(cp_to_building_map):
        parcel = corner_parcels[i]  # Access the corresponding parcel 
        parcel = rs.coercecurve(parcel)
        parcel = ensure_counterclockwise(parcel)
        parcel_area = round(rs.CurveArea(parcel)[0], 2)
        cp_areas.append(parcel_area)
        vertices = parcel.ToPolyline().ToArray()
        corner = boundary_polygon_corners[i]  # Access the corresponding corner

        # Reorder the vertices of the corner parcel
        vertices_ccw = reorder_vertices_to_start_at_corner(vertices, non_boundary_points[i])

        # Initialize a new list to store the dimension pair and building mappings for this parcel
        parcel_info = []

        # Map buildings in quadrilateral corner parcels
        if cp_configurations[i] == "quadrilateral":
            # Reorder vertices of quadrilateral corner parcel
            reordered_vertices = [vertices_ccw[2], vertices_ccw[3], vertices_ccw[0], vertices_ccw[1], vertices_ccw[2]]
            reordered_parcel = rg.PolylineCurve(reordered_vertices)

            # Get dimension pair of quadrilateral corner parcel
            cp_dim_1 = round(reordered_vertices[0].DistanceTo(reordered_vertices[1]), 2)
            cp_dim_2 = round(reordered_vertices[1].DistanceTo(reordered_vertices[2]), 2)
            cp_dimensions = [cp_dim_1, cp_dim_2]  # Dimensions for quadrilateral parcel
            cp_dimension_pairs.append(cp_dimensions)

            # Add the dimension pair as the first element in the list
            parcel_info.append(cp_dimensions)

            # Add aspect ratio as the second element in the list
            aspect_ratio = round(cp_dim_1 / cp_dim_2, 2)
            parcel_info.append(aspect_ratio)

            # Generate a UV mapping grid for the quadrilateral corner parcel
            grid_points = generate_grid_in_quadrilateral_parcel(reordered_vertices, grid_resolution)

            # Initialize mapping_info to ensure it's a list
            mapping_info = []

            mapping_info = []
            # Loop through all buildings inside this parcel
            for building in buildings:
                building_curve = rs.coercecurve(building)
                building_vertices = list(building_curve.ToPolyline().ToArray())
                # Compute the U-V coordinates of the footprint vertices within the grid
                #compute_building_indeces_quadrilateral(building_vertices, grid_in)
                building_mapping = compute_building_indeces_quadrilateral(building_vertices, grid_points)
                
                mapping_info.append(building_mapping)

            # Add the mapping info list to parcel info (ensuring one nested list for all mappings)
            parcel_info.append(mapping_info)

        # Map buildings in pentalateral corner parcels
        elif cp_configurations[i] == "pentalateral":
            # Reorder vertices of pentalateral corner parcel
            reordered_vertices = [vertices_ccw[2], vertices_ccw[3], vertices_ccw[4], vertices_ccw[0], vertices_ccw[1], vertices_ccw[2]]
            reordered_parcel = rg.PolylineCurve(reordered_vertices)

            # Get dimension trio of pentalateral corner parcel
            cp_dim_1 = round(reordered_vertices[0].DistanceTo(reordered_vertices[1]), 2)
            cp_dim_2 = round(reordered_vertices[1].DistanceTo(reordered_vertices[2]), 2)
            cp_dim_3 = round(reordered_vertices[0].DistanceTo(reordered_vertices[4]), 2)
            cp_dimensions = [cp_dim_1, cp_dim_2, cp_dim_3]  # Dimensions for pentalateral parcel
            cp_dimension_pairs.append(cp_dimensions)

            # Add the dimension trio as the first element in the list
            parcel_info.append(cp_dimensions)

            # Add aspect ratio as the second element in the list
            aspect_ratio = round(cp_dim_1 / cp_dim_2, 2)
            parcel_info.append(aspect_ratio)

            # Generate a UV mapping grid for the pentalateral corner parcel
            penta_center = compute_centroid(reordered_vertices)
            triangles, indexed_points = generate_grid_in_pentalateral_parcel(reordered_vertices, penta_center)

            mapping_info = []
            # Loop through all buildings inside this parcel
            for building in buildings:
                building_curve = rs.coercecurve(building)
                building_vertices = list(building_curve.ToArray())
                # Compute the U-V coordinates of the footprint vertices within the grid
                building_mapping = compute_building_indeces_pentalateral(building_vertices, indexed_points)
                mapping_info.append(building_mapping)  # Add the building mapping
            
            # Add the mapping info list to parcel info (ensuring one nested list for all mappings)
            parcel_info.append(mapping_info)
        
        # Add the list of parcel_info (dimension + building mappings) to the main list
        corner_buildings_map.append(parcel_info)

    # Remove last area from cp_areas if it is not equal
    if len(cp_areas) > len(corner_parcels):
        cp_areas.pop()
    

################################
""" GENERIC BUILDING MAPPING """

# Initialize list for generic building UV mapping (each element will be a nested list: dimensions + buildings)
generic_buildings_map = []

# Initialize list of generic parcel areas (and ensure identical index, to map complex buildings correctly)
gp_areas = []

# Initialize list of aspect ratios (where the length is in the numerator and the width is in the denominator)
gp_dimension_pairs = []

# Iterate through all generic parcels and create the building map
for (i, j), buildings in gp_to_building_map.items():
    parcel = gp_map_to_edge[i][j]  # Access the corresponding parcel 
    parcel = rs.coercecurve(parcel)
    parcel = ensure_counterclockwise(parcel)
    parcel_area = round(rs.CurveArea(parcel)[0],2)
    gp_areas.append(parcel_area)
    vertices = parcel.ToPolyline().ToArray()
    parcel_boundary_edge = gp_edge_on_boundary_edge[i][j]   # Access the corresponding boundary edge of the parcel
    start_point = parcel_boundary_edge.PointAtStart         # Start point should be vertex at index 0 for reordered vertices
    
    # Reorder the vertices of the corner parcel, such that they are counterclockwise and the vertex at index "0" starts on the corner
    reordered_vertices = reorder_vertices_to_start_at_corner(vertices, start_point)

    # Initialize a new list to store the dimension pair and building mappings for this parcel
    parcel_info = []

    # Get dimension pairs
    gp_length = round(reordered_vertices[0].DistanceTo(reordered_vertices[1]),2)
    gp_width = round(reordered_vertices[1].DistanceTo(reordered_vertices[2]),2)
    gp_dimensions = [gp_length, gp_width]
    gp_dimension_pairs.append(gp_dimensions)

    # Add the dimension pair as the first element in the list
    parcel_info.append(gp_dimensions)

    # Add aspect ratio as the second element in the list
    aspect_ratio = round(gp_length / gp_width, 2)
    parcel_info.append(aspect_ratio)

    # Update the start and end points of the boundary edge if necessary
    start_point = reordered_vertices[0]
    end_point = reordered_vertices[1]  # Assuming the boundary edge is between the first two vertices

    # Create consistent parcels for precise mapping of buildings
    reordered_parcel_outline = [reordered_vertices[0], reordered_vertices[1], reordered_vertices[2], reordered_vertices[3], reordered_vertices[0]]
    reordered_parcel = rg.PolylineCurve(reordered_parcel_outline)

    # Generate a UV mapping grid for the parcel
    grid_points = generate_grid_in_quadrilateral_parcel(reordered_parcel_outline, grid_resolution)
    
    mapping_info = []  # To store the building mappings

    # Loop through all buildings inside this parcel
    for building in buildings:
        building_footprint = rs.coercecurve(building)
        building_vertices = list(building_footprint.ToPolyline().ToArray())

        # Compute the U-V coordinates of the footprint vertices within the grid
        building_mapping = compute_building_indeces_quadrilateral(building_vertices, grid_points)
        mapping_info.append(building_mapping)

        # Get area ratio between building and parcel
        parcel_area = rs.CurveArea(reordered_parcel)[0]  # Get the area of the parcel
        building_area = rs.CurveArea(building)[0]        # Get the area of the building footprint
        building_footprint_to_parcel_area_ratio = round((building_area / parcel_area), 2)

    # Add the mapping info list as the second element in the list (index 1)
    parcel_info.append(mapping_info)

    # Add the list of parcel_info (dimension + building mappings) to the main list
    generic_buildings_map.append(parcel_info)


################
""" OUTPUTS """

### Determine key metrics for generic parcels
gp_lengths_mean = calculate_mean(gp_lengths)
gp_lengths_min = min(gp_lengths)
gp_lengths_max = max(gp_lengths)
gp_lengths_sd = calculate_std(gp_lengths)
gp_widths_mean = calculate_mean(gp_widths)
gp_widths_min = min(gp_widths)
gp_widths_max = max(gp_widths)
gp_widths_sd = calculate_std(gp_widths)

### Determine key metrics for corner parcels
cp_lengths_flattened = [item for sublist in cp_lengths for item in sublist]
cp_edge_mean = calculate_mean(cp_lengths_flattened)
cp_edge_min = min(cp_lengths_flattened)
cp_edge_max = max(cp_lengths_flattened)
cp_edge_sd = calculate_std(cp_lengths_flattened)

### Determine key metrics for building height
if height_info is not None:
    bh_mean = height_info[0]
    bh_min = height_info[1]
    bh_max = height_info[2]
    bh_sd = height_info[3]
else:
    bh_mean = 20
    bh_min = 10
    bh_max = 30
    bh_sd = 5

# Outputs
cp_count = len(corner_parcels)
gp_count = len(generic_parcels)
gp_lengths = gp_lengths
cp_lengths = cp_lengths
cp_edge_max = cp_edge_max
cp_edge_min = cp_edge_min
boundary_area = rs.CurveArea(boundary_curve)
boundary_area = round(boundary_area[0],2)


data_text = [
    f"Corner parcel configurations: {cp_configurations}",
    f"Corner parcel count: {len(corner_parcels)}",
    f"Corner parcel mean length: {round(cp_edge_mean, 2)}",
    f"Corner parcel minimum length: {round(cp_edge_min, 2)}",
    f"Corner parcel maximum length: {round(cp_edge_max, 2)}",
    f"Corner parcel areas: {cp_areas}",
    f"Generic parcel total count: {round(gp_count, 2)}",
    f"Generic parcel mean length: {round(gp_lengths_mean, 2)}",
    f"Generic parcel minimum length: {round(gp_lengths_min, 2)}",
    f"Generic parcel maximum length: {round(gp_lengths_max, 2)}",
    f"Generic parcel lengths standard deviation: {round(gp_lengths_sd, 2)}",
    f"Generic parcel mean widths: {round(gp_widths_mean, 2)}",
    f"Generic parcel minimum widths: {round(gp_widths_min, 2)}",
    f"Generic parcel maximum widths: {round(gp_widths_max, 2)}",
    f"Generic parcel widths standard deviation: {round(gp_widths_sd, 2)}",
    f"Generic parcel count per boundary edge: {gp_on_boundary_edge_count}",
    f"Generic parcel indentations per boundary edge: {gp_indentation_count}",    
    f"Generic parcel dimension pairs (length = index 0, width = index 1): {gp_dimension_pairs}",
    f"Generic parcel areas: {gp_areas}",
    f"Generic parcel to building footprint area ratio: {building_footprint_to_parcel_area_ratio}",
    f"Corner parcel dimension pairs: {cp_dimension_pairs}",
    f"Average length after which an indentation occurs: {indentation_ratio}",
    f"Length threshold, under which two corners create pentalateral: {penta_threshold}",
    f"Corner parcel edges angles: {cp_edge_angle}",
    f"Boundary Polygon Area: {boundary_area}",
    f"Building mean height: {bh_mean}",
    f"Building minimum height: {bh_min}",
    f"Building maximum heigth: {bh_max}",
    f"Building height standard deviation: {bh_sd}",
    f"Buildings count: {len(buildings_footprint)}"
]

data_package = [
    cp_configurations,
    len(corner_parcels),
    round(cp_edge_mean, 2),
    round(cp_edge_min, 2),
    round(cp_edge_max, 2),
    cp_areas,
    round(gp_count, 2),
    round(gp_lengths_mean, 2),
    [round(gp_lengths_min, 2)],
    round(gp_lengths_max, 2),
    round(gp_lengths_sd, 2),
    round(gp_widths_mean, 2),
    round(gp_widths_min, 2),
    round(gp_widths_max, 2),
    round(gp_widths_sd, 2),
    gp_on_boundary_edge_count,
    gp_indentation_count,
    gp_dimension_pairs,
    gp_areas,
    building_footprint_to_parcel_area_ratio,
    cp_dimension_pairs,
    [indentation_ratio],
    penta_threshold,
    cp_edge_angle,
    boundary_area,
    bh_mean,
    bh_min,
    bh_max,
    bh_sd,
    len(buildings_footprint)
]
# ---------- end block_analysis_2 ----------

# ----
# BLOCK ANALYSIS
block_analysis_3 = Python3Script(boundary=boundary_3, parcels=parcels_3, buildings_footprint=buildings_footprint_3, height_info=get_heights)  # -> data_text, data_package, corner_buildings_map, generic_buildings_map; inputs boundary: list, parcels: list, buildings_footprint: list, height_info: list; same code as block_analysis_2

# ----
# BLOCK ANALYSIS
block_analysis_4 = Python3Script(boundary=boundary_5, parcels=parcels_5, buildings_footprint=buildings_footprint_5, height_info=get_heights)  # -> data_text, data_package, corner_buildings_map, generic_buildings_map; inputs boundary: list, parcels: list, buildings_footprint: list, height_info: list; same code as block_analysis_2

# ----
# BLOCK ANALYSIS
block_analysis_5 = Python3Script(boundary=boundary_6, parcels=parcels_6, buildings_footprint=buildings_footprint_6, height_info=get_heights)  # -> data_text, data_package, corner_buildings_map, generic_buildings_map; inputs boundary: list, parcels: list, buildings_footprint: list, height_info: list; same code as block_analysis

# ----
# BLOCK ANALYSIS
block_analysis_6 = Python3Script(boundary=boundary_7, parcels=parcels_7, buildings_footprint=buildings_footprint_7, height_info=get_heights)  # -> data_text, data_package, corner_buildings_map, generic_buildings_map; inputs boundary: list, parcels: list, buildings_footprint: list, height_info: list; same code as block_analysis
# ----
# BLOCK ANALYSIS
# REFERENCES
# BLOCK ANALYSIS
block_analysis_7 = Python3Script(boundary=boundary_2, parcels=parcels_2, buildings_footprint=buildings_footprint_2, height_info=get_heights)  # -> data_text, data_package, corner_buildings_map, generic_buildings_map; inputs boundary: list, parcels: list, buildings_footprint: list, height_info: list
# ---------- block_analysis_7: Python ----------
# Block Analysis component

# Required inputs:
# 1. boundary (closed polyline curve GUID)
# 2. parcels (closed polyline curve GUIDs, set input to list access)
# 3. buildings_footprint (closed polyline curve GUIDs, set input to list access)
# 4. height info (inherited data structure from Get Heights, set input to list access)

# Important information:
# Parcels must have at least one edge (or two vertices) coincident with boundary polygon
# Parcels cannot intersect boundary polyon.
# In order to map building, building curve cannot be outside of a parcel or range over two parcels
# Building vertices must be either inside or coincident with parcel curve.

import Rhino
import rhinoscriptsyntax as rs
import Rhino.Geometry as rg
import random
import math
from collections import defaultdict

#####################################################################################

""" FUNCTIONS """

# Function to calculate mean
def calculate_mean(data):
    return sum(data) / len(data)

# Function to calculate standard deviation
def calculate_std(data):
    mean = calculate_mean(data)
    squared_differences = [(i - mean) ** 2 for i in data]  # Calculate squared differences
    variance = sum(squared_differences) / len(data)  # Find the variance
    return math.sqrt(variance)  # std = square root of the variance

# Function to compute the angles between the non-boundary edges and the boundary polygon edges of a corner parcel
def compute_non_boundary_edge_angles(non_boundary_edges, boundary_polygon_edges, tolerance):
    cp_edge_angles = []
    # Iterate through all non-boundary edges
    for nbe in non_boundary_edges:
        nbe_start_pt = nbe.PointAtStart
        nbe_end_pt = nbe.PointAtEnd    
        # Iterate through boundary polygon edges to find the closest edge points
        for edge in boundary_polygon_edges:
            success_start, param_start = edge.ClosestPoint(nbe_start_pt)
            success_end, param_end = edge.ClosestPoint(nbe_end_pt)           
            # Get closest points on the edge if successful
            edge_pt_1 = edge.PointAt(param_start) if success_start else None
            edge_pt_2 = edge.PointAt(param_end) if success_end else None
            # If both start and end points of nbe have close points on the boundary edge
            if edge_pt_1 and edge_pt_2:
                start_dist = nbe_start_pt.DistanceTo(edge_pt_1)
                end_dist = nbe_end_pt.DistanceTo(edge_pt_2)
                # Check if the start distance is within tolerance
                if start_dist < tolerance:
                    if nbe_start_pt.DistanceTo(edge.PointAtStart) < nbe_start_pt.DistanceTo(edge.PointAtEnd):
                        vec_1 = rg.Vector3d(edge.PointAtStart.X - nbe_start_pt.X, edge.PointAtStart.Y - nbe_start_pt.Y, 0)
                    else:
                        vec_1 = rg.Vector3d(edge.PointAtEnd.X - nbe_start_pt.X, edge.PointAtEnd.Y - nbe_start_pt.Y, 0)
                    vec_2 = rg.Vector3d(nbe_end_pt.X - nbe_start_pt.X, nbe_end_pt.Y - nbe_start_pt.Y, 0)                   
                    vec_1.Unitize()
                    vec_2.Unitize()
                    angle_degrees = math.degrees(rg.Vector3d.VectorAngle(vec_1, vec_2))
                    cp_edge_angles.append(round(angle_degrees))
                # Check if the end distance is within tolerance
                elif end_dist < tolerance:
                    if nbe_end_pt.DistanceTo(edge.PointAtStart) < nbe_end_pt.DistanceTo(edge.PointAtEnd):
                        vec_1 = rg.Vector3d(edge.PointAtStart.X - nbe_end_pt.X, edge.PointAtStart.Y - nbe_end_pt.Y, 0)
                    else:
                        vec_1 = rg.Vector3d(edge.PointAtEnd.X - nbe_end_pt.X, edge.PointAtEnd.Y - nbe_end_pt.Y, 0)
                    vec_2 = rg.Vector3d(nbe_start_pt.X - nbe_end_pt.X, nbe_start_pt.Y - nbe_end_pt.Y, 0)
                    vec_1.Unitize()
                    vec_2.Unitize()
                    angle_degrees = math.degrees(rg.Vector3d.VectorAngle(vec_1, vec_2))
                    cp_edge_angles.append(round(angle_degrees))
    # Returns list of angles (in degrees) between the non-boundary edges and boundary edges
    return cp_edge_angles

# Function to create lines that interpolate between two opposite edges
def interpolate_between_edges(edge1, edge2, grid_resolution):
    points = []
    for i in range(grid_resolution + 1):
        step = i / grid_resolution
        start = edge1.PointAt(step)
        end = edge2.PointAt(step)
        points.append(rg.Line(start, end))
    return points

# Function to ensure the vertices of the parcel are ordered counter-clockwise.
def ensure_counterclockwise(parcel):
    polyline = parcel.ToPolyline()
    vertices = polyline.ToArray()  # Get vertices as an array
    signed_area_sum = 0
    # Shoelace theorem to check clockwise or counter-clockwise
    for i in range(len(vertices)):
        v1 = vertices[i]
        v2 = vertices[(i + 1) % len(vertices)]  # Next vertex (with wrap-around)
        signed_area_sum += (v2.X - v1.X) * (v2.Y + v1.Y)
    # If total is positive, the vertices are ordered clockwise
    if signed_area_sum > 0:
        vertices = list(reversed(vertices))  # Reverse the vertices if clockwise
        return rg.PolylineCurve(vertices)  # Return the polyline with counter-clockwise vertices
    else:
        return parcel  # Already counter-clockwise, return the original parcel

# Function to reorder vertices such that the first vertex is closest to corner and ensure counterclockwise order.
def reorder_vertices_to_start_at_corner(vertices, corner, tolerance=1e-6):  
    # Find the index of the vertex closest to the corner
    min_distance = float("inf")
    vertex_0_index = 0
    for i in range(len(vertices)):
        distance = vertices[i].DistanceTo(corner)
        if distance < min_distance:
            min_distance = distance
            vertex_0_index = i
    # Reorder the vertices starting from the closest point
    reordered_vertices = [vertices[(i + vertex_0_index) % len(vertices)] for i in range(len(vertices))]
    # Remove consecutive duplicate vertices (within a small tolerance)
    unique_reordered_vertices = [reordered_vertices[0]]
    for i in range(1, len(vertices)):
        if reordered_vertices[i].DistanceTo(unique_reordered_vertices[-1]) > tolerance:
            unique_reordered_vertices.append(reordered_vertices[i])
    # Ensure the last vertex is not a duplicate of the first vertex
    if unique_reordered_vertices[0].DistanceTo(unique_reordered_vertices[-1]) < tolerance:
        unique_reordered_vertices.pop()
    # Check if the reordered vertices are counterclockwise using the Shoelace theorem
    signed_area_sum = 0
    for i in range(len(unique_reordered_vertices)):
        v1 = unique_reordered_vertices[i]
        v2 = unique_reordered_vertices[(i + 1) % len(unique_reordered_vertices)]  # Next vertex (with wrap-around)
        signed_area_sum += (v2.X - v1.X) * (v2.Y + v1.Y)
    if signed_area_sum > 0:
        unique_reordered_vertices.reverse()
    else:
        unique_reordered_vertices = unique_reordered_vertices
    return unique_reordered_vertices



### Functions used for quadrilateral building mapping ###

# Function to generate a grid inside a quadrilateral parcel. Uses a bilinear interpolation between the edges of the quadrilateral.
def generate_grid_in_quadrilateral_parcel(parcel_vertices, grid_resolution):
    grid_points = []
    parcel_vertices.pop()
    # Get the four corners of the quadrilateral
    v0, v1, v2, v3 = parcel_vertices
    for u in range(grid_resolution + 1):
        u_ratio = u / grid_resolution  # The relative position along the U direction (horizontal)
        # Interpolate between v0->v3 (left) and v1->v2 (right) edges
        left_interp = v0 + (v3 - v0) * u_ratio
        right_interp = v1 + (v2 - v1) * u_ratio
        for v in range(grid_resolution + 1):
            v_ratio = v / grid_resolution  # The relative position along the V direction (vertical)
            # Interpolate between the left and right edges at the current u_ratio
            grid_point = left_interp + (right_interp - left_interp) * v_ratio
            grid_points.append(grid_point)
    return grid_points


# Function to map the building vertices to the indices of the grid points of the quadrilateral parcel.
def compute_building_indeces_quadrilateral(building_vertices, grid_in):
    building_indices = []
    for building_vertex in building_vertices:
        # Find the closest point in the input grid and get its index
        closest_index_in = min(range(len(grid_in)), key=lambda i: building_vertex.DistanceTo(grid_in[i]))
        building_indices.append(closest_index_in)
    # Returns a list of indices that represent the mapping.
    return building_indices


### Functions used for pentalateral building mapping ###

# Function to compute the centroid (geometric center) of a list of 3D points (vertices).
def compute_centroid(vertices):
    sum_x = sum(v.X for v in vertices)
    sum_y = sum(v.Y for v in vertices)
    sum_z = sum(v.Z for v in vertices)
    num_vertices = len(vertices)
    return rg.Point3d(sum_x / num_vertices, sum_y / num_vertices, sum_z / num_vertices)

# Function to subdivide a triangle into four smaller triangles by adding midpoints on its edges.
def subdivide_triangle(v0, v1, v2):
    # Compute midpoints
    mid_v0_v1 = v0 + (v1 - v0) * 0.5
    mid_v1_v2 = v1 + (v2 - v1) * 0.5
    mid_v2_v0 = v2 + (v0 - v2) * 0.5
    # Create smaller triangles
    triangles = [
        (v0, mid_v0_v1, mid_v2_v0),
        (mid_v0_v1, v1, mid_v1_v2),
        (mid_v2_v0, mid_v1_v2, v2),
        (mid_v0_v1, mid_v1_v2, mid_v2_v0)
    ]
    # Return triangles and midpoints as potential intersection points
    return triangles, [mid_v0_v1, mid_v1_v2, mid_v2_v0]

# Function to subdivide the triangles of a pentalateral parcel iteratively with consistent indexing.
def generate_grid_in_pentalateral_parcel(vertices, center):
    # Create initial triangles (center to adjacent vertices)
    triangles = []
    indexed_points = []  # Track points in a consistent order
    indexed_points.append(center)  # Start with the centroid having index 0
    iterations = 3
    # Add the original vertices with consistent indexing
    indexed_points.extend(vertices)  # Add pentagon vertices (these will get indices 1-5)
    for i in range(len(vertices)):
        v0 = vertices[i]
        v1 = vertices[(i + 1) % len(vertices)]
        triangles.append((center, v0, v1))
    # Subdivide the triangles iteratively
    for _ in range(iterations):
        new_triangles = []
        for tri in triangles:
            # Subdivide the triangle and get the new midpoints
            subdivided, midpoints = subdivide_triangle(*tri)
            # Check each midpoint and assign it an index if it's new
            for midpoint in midpoints:
                if midpoint not in indexed_points:
                    indexed_points.append(midpoint)
            new_triangles.extend(subdivided)
        triangles = new_triangles
    # Returns the subdivided triangles and indexed intersection points.
    return triangles, indexed_points

# Function to map the building vertices to the indices of the sorted points of the pentalateral parcel.
def compute_building_indeces_pentalateral(building_vertices, sorted_points_in):
    building_indices = []
    for building_vertex in building_vertices:
        # Find the closest point in the sorted_points_in and get its index
        closest_index_in = min(range(len(sorted_points_in)), key=lambda i: building_vertex.DistanceTo(sorted_points_in[i]))
        building_indices.append(closest_index_in)
    # Returns a list of indices that represent the mapping.
    return building_indices


#####################################################################################

# SHORTCUTS FOR LEGIBILITY:
# generic_parcels: "gp"
# corner_parcels: "gp"


###################################
""" INPUTS, LISTS AND CONSTANTS """

# Inputs
boundary_polygon = boundary  # The large boundary polygon that surrounds all parcels (as a closed curve)
all_parcels = parcels  # List of (irregular) rectangular parcel curves (from the "List Access" in Grasshopper)
buildings = buildings_footprint # List of building footprints
if height_info is not None:
    height_info = height_info
else:
    print("standard building heights will be used")

# Initialize lists for outputs
corner_parcels = []  # List to store corner parcels (Rhino.Geometry type: PolylineCurve)
generic_parcels = []  # List to store generic parcels (Rhino.Geometry type: PolylineCurve)
gp_lengths = []  # List to store generic parcels lengths (the edge, that is adjacent to the boundary polygon)
gp_widths = [] # List to store generic parcels widths (one of the edges, that is connected to the boundary polygon)
gp_nb_edges = [] # List to store all generic parcels' non-boundary edges (for indentation count)
cp_lengths = [] # List to store the corner parcels lengths (for the two edges adjacent to the boundary polygon)
cp_edge_angle = [] # List to store corner parcel angles
cp_configurations = []

# Set tolerance for geometric comparison
tolerance = 1e-3

# Set grid resolution for mapping (shouldn't be set higher than 50 for acceptable performance)
grid_resolution = 30

#######################
""" PARCEL ANALYSIS """


# Ensure the boundary_polygon is a valid curve
if rs.IsCurve(boundary_polygon) and boundary_polygon is not None:
    boundary_curve = rs.coercecurve(boundary_polygon)  # Convert the boundary polygon to a RhinoCommon curve
    boundary_curve = ensure_counterclockwise(boundary_curve)

    # Explode the boundary_polygon into individual edges
    boundary_polygon_corners = boundary_curve.ToPolyline().ToArray()
    boundary_polygon_edges = boundary_curve.DuplicateSegments()
    
    # Initialize empty lists for further analysis and mapping
    gp_on_boundary_edge_count = [0] * len(boundary_polygon_edges)
    gp_map_to_edge = [[] for _ in range(len(boundary_polygon_edges))]
    gp_edge_on_boundary_edge = [[] for _ in range(len(boundary_polygon_edges))]


    # Iterate over each parcel curve, received from the input
    for parcel in all_parcels:
        
        # Convert parcels to RhinoCommon curve (PolylineCurve) and ensure counterclockwise order
        parcel_curve = rs.coercecurve(parcel)
        parcel_curve = ensure_counterclockwise(parcel_curve)
        
        # Explode the parcel into individual segments (edges)
        parcel_edges = parcel_curve.DuplicateSegments()
        boundary_edges = []  # To hold the edges of the iterated parcel that lie on the boundary polygon
        non_boundary_edges = []  # To hold the non-boundary edges


        # Check each edge of the parcel to see if it lies close to the boundary polygon
        for edge in parcel_edges:
            start_pt = edge.PointAtStart
            end_pt = edge.PointAtEnd

            # Find the closest points on the boundary polygon to the start and end points of the edge
            success_start, param_start = boundary_curve.ClosestPoint(start_pt)
            success_end, param_end = boundary_curve.ClosestPoint(end_pt)

            # Construct points on the boundary polygon to compute distance
            boundary_pt_1 = boundary_curve.PointAt(param_start) if success_start else None
            boundary_pt_2 = boundary_curve.PointAt(param_end) if success_end else None

            # Compare the distance between the parcel edge and the boundary polygon
            if boundary_pt_1 and boundary_pt_2:
                start_dist = start_pt.DistanceTo(boundary_pt_1)
                end_dist = end_pt.DistanceTo(boundary_pt_2)

                # If both distances are within the tolerance, consider it a boundary edge
                if start_dist < tolerance and end_dist < tolerance:
                    boundary_edges.append(edge)

                else:
                    non_boundary_edges.append(edge)



        # Generic parcel has one boundary edge
        if len(boundary_edges) == 1:
            length = boundary_edges[0].GetLength()
            gp_lengths.append(length)
            generic_parcels.append(parcel_curve)
            
            # Add the boundary edge to the respective boundary polygon edge's generic parcels count
            start_pt = boundary_edges[0].PointAtStart
            end_pt = boundary_edges[0].PointAtEnd
            for i, boundary_line in enumerate(boundary_polygon_edges):
                success_start, param_start = boundary_line.ClosestPoint(start_pt)
                success_end, param_end = boundary_line.ClosestPoint(end_pt)
                boundary_line_pt_1 = boundary_line.PointAt(param_start) if success_start else None
                boundary_line_pt_2 = boundary_line.PointAt(param_end) if success_end else None
                if boundary_line_pt_1 and boundary_line_pt_2:
                    start_dist = start_pt.DistanceTo(boundary_line_pt_1)
                    end_dist = end_pt.DistanceTo(boundary_line_pt_2)
                    if start_dist < tolerance and end_dist < tolerance:
                        gp_on_boundary_edge_count[i] += 1
                        gp_map_to_edge[i].append(parcel)
                        gp_edge_on_boundary_edge[i].append(boundary_edges[0])

            # For generic parcels, find the two non-boundary edges connected to the boundary edge
            connected_non_boundary_edges = []
            for edge in non_boundary_edges:
                if (edge.PointAtStart in [boundary_edges[0].PointAtStart, boundary_edges[0].PointAtEnd] or
                    edge.PointAtEnd in [boundary_edges[0].PointAtStart, boundary_edges[0].PointAtEnd]):
                    connected_non_boundary_edges.append(edge)
                    gp_nb_edges.append(edge)

            # Ensure we have exactly two connected non-boundary edges
            # If the connected non boundary edges differ in length, assign the minimum of both
            if len(connected_non_boundary_edges) == 2:
                width = min(connected_non_boundary_edges[0].GetLength(), connected_non_boundary_edges[1].GetLength()) # here condition for crooked line
                gp_widths.append(width)


        # Corner parcel has two boundary edges, if quadrilateral
        elif len(boundary_edges) == 2: 
            cp_configurations.append("quadrilateral")           
            cp_lengths.append([boundary_edges[0].GetLength(), boundary_edges[1].GetLength()])
            corner_parcels.append(parcel_curve)
            cp_vertices = parcel_curve.ToPolyline().ToArray()
            angles = compute_non_boundary_edge_angles(non_boundary_edges, boundary_polygon_edges, tolerance)
            cp_edge_angle.append(angles)


        # Corner parcel has three boundary edges, if pentalateral
        elif len(boundary_edges) == 3: 
            cp_configurations.append("pentalateral")           
            cp_lengths.append([boundary_edges[0].GetLength(), boundary_edges[1].GetLength(), boundary_edges[2].GetLength()])
            corner_parcels.append(parcel_curve)
            cp_vertices = parcel_curve.ToPolyline().ToArray()
            angles = compute_non_boundary_edge_angles(non_boundary_edges, boundary_polygon_edges, tolerance)
            cp_edge_angle.append(angles)


    # Sort the non boundary edges (or the widths) of the generic parcels to the corresponding boundary polygon edge
    gp_nb_edges_sorted = [[] for _ in range(len(boundary_polygon_edges))] 
    for edge in gp_nb_edges:
        start_pt = edge.PointAtStart
        end_pt = edge.PointAtEnd
        for i, boundary_line in enumerate(boundary_polygon_edges):
            success_start, param_start = boundary_line.ClosestPoint(start_pt)
            success_end, param_end = boundary_line.ClosestPoint(end_pt)
            boundary_line_pt_1 = boundary_line.PointAt(param_start) if success_start else None
            boundary_line_pt_2 = boundary_line.PointAt(param_end) if success_end else None
            if boundary_line_pt_1 and boundary_line_pt_2:
                start_dist = start_pt.DistanceTo(boundary_line_pt_1)
                end_dist = end_pt.DistanceTo(boundary_line_pt_2)
                if start_dist < tolerance or end_dist < tolerance:
                    gp_nb_edges_sorted[i].append(edge)


    
    # Initialize generic parcel indentation count on the back
    # This means, the amount of indentations that occur over all rear sides of the parcels that are aligned to one edge
    gp_indentation_count = [0] * len(boundary_polygon_edges)
    parcel_lengths = []
    for i in range(len(boundary_polygon_edges)):
        edge_infos = [[] for _ in range(len(gp_nb_edges_sorted[i]))]
        point_to_edges = defaultdict(list)
        # Default dictionary to store edges grouped by shared points
        # Automatically initializes a default value for a new key when you try to access it for the first time 
        # Store edge start and end points and lengths
        for m, edge in enumerate(gp_nb_edges_sorted[i]):
            edge_start = edge.PointAtStart
            edge_end = edge.PointAtEnd
            edge_length = edge.GetLength()
            # Append edge data to the list
            edge_infos[m].append(edge_start)
            edge_infos[m].append(edge_end)
            edge_infos[m].append(edge_length)
            # Group edges by shared points (both start and end points)
            # If edge_start is not in the dictionary, defaultdict(list) will automatically create an empty list for this key
            point_to_edges[edge_start].append(edge_length)
            point_to_edges[edge_end].append(edge_length)
        # Compare the lengths of edges that share points
        for point, lengths in point_to_edges.items():
            if len(lengths) > 1:  # Only compare if multiple edges share this point
                if len(set(lengths)) > 1:  # If there are different lengths, increment the counter
                    gp_indentation_count[i] += 1
        # Get the sum of boundary edge lengths to establish proportion
        boundary_edge_lengths = 0
        for gp_edge in gp_edge_on_boundary_edge[i]:
            boundary_edge_lengths += gp_edge.GetLength()
        parcel_lengths.append(boundary_edge_lengths)


    # Find out average length for when indentation occurs
    numerator = 0
    denominator = 0
    if gp_indentation_count[i] < 0:
        for i in range(len(parcel_lengths)):
            # Skip if parcel_lengths[i] = 0 (pentalateral corner parcel)
            if parcel_lengths[i] < tolerance:
                continue
            elif gp_indentation_count == 0: 
                numerator += parcel_lengths[i]
                denominator += 1
            else:
                numerator += (parcel_lengths[i] / gp_indentation_count[i])
                denominator += 1
        indentation_ratio = round(numerator/denominator,2)
    else:
        indentation_ratio = parcel_lengths[0]
        

    #########################
    """ BUILDING ANALYSIS """

    # Dictionary to store parcel to building mapping
    gp_to_building_map = defaultdict(list)  # Mapping from (edge_index, gp_index) -> list of buildings
    cp_to_building_map = [[] for _ in range(len(corner_parcels))]  

    # For all buildings, get building vertices
    for building in buildings:
        building_curve = rs.coercecurve(building)
        building_points = building_curve.ToPolyline().ToArray()   # Convert the curve into a polyline

        # Map buildings to generic parcels of corresponding edge
        for i in range(len(boundary_polygon_edges)):
            for j in range(len(gp_map_to_edge[i])):
                inside = True
                # Coerce the generic parcel curve of the corresponding edge
                gp_check = rs.coercecurve(gp_map_to_edge[i][j])
                for pt in building_points:
                    result = gp_check.Contains(pt, rg.Plane.WorldXY, tolerance)
                    if result != rg.PointContainment.Inside and result != rg.PointContainment.Coincident:
                        inside = False  # Set to False if any point is outside
                        break  # If any point is outside, stop checking further
                if inside:
                    # Append the building to the corresponding parcel in the generic parcel mapping
                    gp_to_building_map[(i, j)].append(building_curve)

        # Map buildings to corner parcels
        for i in range(len(corner_parcels)):  # Iterate over corner parcels
            inside = True
            # Coerce the corner parcel curve of the corresponding corner
            cp_check = rs.coercecurve(corner_parcels[i])
            for pt in building_points:
                result = cp_check.Contains(pt, rg.Plane.WorldXY, tolerance)
                if result != rg.PointContainment.Inside and result != rg.PointContainment.Coincident:
                    inside = False  # Set to False if any point is outside
                    break  # If any point is outside, stop checking further
            if inside:
                # Append the building to the corresponding parcel in the corner parcel mapping
                cp_to_building_map[i].append(building_curve)


    #####################################################
    """ SETTING THE SCENE FOR CORNER BUILDING MAPPING """

    # Establish the reference point, from which the reordering of the vertices should take place
    cp_nb_edges_sorted = [[] for _ in range(len(corner_parcels))] 
    for i, parcel in enumerate(corner_parcels):
        parcel = rs.coercecurve(parcel)
        parcel_edges = parcel.DuplicateSegments()
        for edge in parcel_edges:
            start_pt = edge.PointAtStart
            end_pt = edge.PointAtEnd
            matched = False # Flag
            # Iterate over boundary polygon edges to find matching ones
            for boundary_line in boundary_polygon_edges:
                success_start, param_start = boundary_line.ClosestPoint(start_pt)
                success_end, param_end = boundary_line.ClosestPoint(end_pt)
                boundary_line_pt_1 = boundary_line.PointAt(param_start) if success_start else None
                boundary_line_pt_2 = boundary_line.PointAt(param_end) if success_end else None
                if boundary_line_pt_1 and boundary_line_pt_2:
                    start_dist = start_pt.DistanceTo(boundary_line_pt_1)
                    end_dist = end_pt.DistanceTo(boundary_line_pt_2)
                    if start_dist < tolerance and end_dist < tolerance:
                        matched = True  # Mark as matched
                        break  # No need to check further boundary lines once matched
            # If no match was found after all boundary lines, append to placeholder
            if matched == False:
                cp_nb_edges_sorted[i].append(edge)

    # Get non_boundary_points as first reference
    non_boundary_points = []
    for i in range(len(cp_nb_edges_sorted)):
        edge_1= cp_nb_edges_sorted[i][0]
        edge_2 = cp_nb_edges_sorted[i][1]
        intersection_events = rg.Intersect.Intersection.CurveCurve(edge_1, edge_2, 0.001, 0.0)
        if intersection_events:
            for event in intersection_events:
                if event.IsPoint:
                    intersection_point = event.PointA
                    non_boundary_point = rg.Point3d(intersection_point.X, intersection_point.Y, intersection_point.Z)  # Create Point3d
                    non_boundary_points.append(non_boundary_point) 

    # Assign corner distance threshold, after which we receive pentalateral parcel
    penta_corner_distances = []

    # Reorder vertices, such that they consistently start at reference corner
    for i, parcel in enumerate(corner_parcels):
        parcel = rs.coercecurve(parcel)
        parcel = ensure_counterclockwise(parcel)
        vertices = parcel.ToPolyline().ToArray()
        vertices_ccw = reorder_vertices_to_start_at_corner(vertices, non_boundary_points[i])
        if cp_configurations[i] == "quadrilateral":
            reordered_vertices = [vertices_ccw[2], vertices_ccw[3], vertices_ccw[0], vertices_ccw[1], vertices_ccw[2]]
            reordered_parcel = rg.PolylineCurve(reordered_vertices)
        elif cp_configurations[i] == "pentalateral":
            reordered_vertices = [vertices_ccw[2], vertices_ccw[3], vertices_ccw[4], vertices_ccw[0], vertices_ccw[1], vertices_ccw[2]]
            reordered_parcel = rg.PolylineCurve(reordered_vertices)
            penta_corner_distances.append(reordered_vertices[0].DistanceTo(reordered_vertices[1]))

    if penta_corner_distances:
        penta_threshold = round(max(penta_corner_distances) * 1.2,2)
    else:
        penta_threshold = 20

    ###############################
    """ CORNER BUILDING MAPPING """

    # Initialize list for corner building UV mapping (each element will be a nested list: dimensions + buildings)
    corner_buildings_map = []

    # Initialize list of corner parcel areas (and ensure identical index, to map complex buildings correctly)
    cp_areas = []

    # Initialize corner parcel dimension pairs
    cp_dimension_pairs = []

    # Iterate through all corner parcels and create the building map
    # Index "i" refers to the index of the corner parcel
    for i, buildings in enumerate(cp_to_building_map):
        parcel = corner_parcels[i]  # Access the corresponding parcel 
        parcel = rs.coercecurve(parcel)
        parcel = ensure_counterclockwise(parcel)
        parcel_area = round(rs.CurveArea(parcel)[0], 2)
        cp_areas.append(parcel_area)
        vertices = parcel.ToPolyline().ToArray()
        corner = boundary_polygon_corners[i]  # Access the corresponding corner

        # Reorder the vertices of the corner parcel
        vertices_ccw = reorder_vertices_to_start_at_corner(vertices, non_boundary_points[i])

        # Initialize a new list to store the dimension pair and building mappings for this parcel
        parcel_info = []

        # Map buildings in quadrilateral corner parcels
        if cp_configurations[i] == "quadrilateral":
            # Reorder vertices of quadrilateral corner parcel
            reordered_vertices = [vertices_ccw[2], vertices_ccw[3], vertices_ccw[0], vertices_ccw[1], vertices_ccw[2]]
            reordered_parcel = rg.PolylineCurve(reordered_vertices)

            # Get dimension pair of quadrilateral corner parcel
            cp_dim_1 = round(reordered_vertices[0].DistanceTo(reordered_vertices[1]), 2)
            cp_dim_2 = round(reordered_vertices[1].DistanceTo(reordered_vertices[2]), 2)
            cp_dimensions = [cp_dim_1, cp_dim_2]  # Dimensions for quadrilateral parcel
            cp_dimension_pairs.append(cp_dimensions)

            # Add the dimension pair as the first element in the list
            parcel_info.append(cp_dimensions)

            # Add aspect ratio as the second element in the list
            aspect_ratio = round(cp_dim_1 / cp_dim_2, 2)
            parcel_info.append(aspect_ratio)

            # Generate a UV mapping grid for the quadrilateral corner parcel
            grid_points = generate_grid_in_quadrilateral_parcel(reordered_vertices, grid_resolution)

            # Initialize mapping_info to ensure it's a list
            mapping_info = []

            mapping_info = []
            # Loop through all buildings inside this parcel
            for building in buildings:
                building_curve = rs.coercecurve(building)
                building_vertices = list(building_curve.ToPolyline().ToArray())
                # Compute the U-V coordinates of the footprint vertices within the grid
                #compute_building_indeces_quadrilateral(building_vertices, grid_in)
                building_mapping = compute_building_indeces_quadrilateral(building_vertices, grid_points)
                
                mapping_info.append(building_mapping)

            # Add the mapping info list to parcel info (ensuring one nested list for all mappings)
            parcel_info.append(mapping_info)

        # Map buildings in pentalateral corner parcels
        elif cp_configurations[i] == "pentalateral":
            # Reorder vertices of pentalateral corner parcel
            reordered_vertices = [vertices_ccw[2], vertices_ccw[3], vertices_ccw[4], vertices_ccw[0], vertices_ccw[1], vertices_ccw[2]]
            reordered_parcel = rg.PolylineCurve(reordered_vertices)

            # Get dimension trio of pentalateral corner parcel
            cp_dim_1 = round(reordered_vertices[0].DistanceTo(reordered_vertices[1]), 2)
            cp_dim_2 = round(reordered_vertices[1].DistanceTo(reordered_vertices[2]), 2)
            cp_dim_3 = round(reordered_vertices[0].DistanceTo(reordered_vertices[4]), 2)
            cp_dimensions = [cp_dim_1, cp_dim_2, cp_dim_3]  # Dimensions for pentalateral parcel
            cp_dimension_pairs.append(cp_dimensions)

            # Add the dimension trio as the first element in the list
            parcel_info.append(cp_dimensions)

            # Add aspect ratio as the second element in the list
            aspect_ratio = round(cp_dim_1 / cp_dim_2, 2)
            parcel_info.append(aspect_ratio)

            # Generate a UV mapping grid for the pentalateral corner parcel
            penta_center = compute_centroid(reordered_vertices)
            triangles, indexed_points = generate_grid_in_pentalateral_parcel(reordered_vertices, penta_center)

            mapping_info = []
            # Loop through all buildings inside this parcel
            for building in buildings:
                building_curve = rs.coercecurve(building)
                building_vertices = list(building_curve.ToArray())
                # Compute the U-V coordinates of the footprint vertices within the grid
                building_mapping = compute_building_indeces_pentalateral(building_vertices, indexed_points)
                mapping_info.append(building_mapping)  # Add the building mapping
            
            # Add the mapping info list to parcel info (ensuring one nested list for all mappings)
            parcel_info.append(mapping_info)
        
        # Add the list of parcel_info (dimension + building mappings) to the main list
        corner_buildings_map.append(parcel_info)

    # Remove last area from cp_areas if it is not equal
    if len(cp_areas) > len(corner_parcels):
        cp_areas.pop()
    

################################
""" GENERIC BUILDING MAPPING """

# Initialize list for generic building UV mapping (each element will be a nested list: dimensions + buildings)
generic_buildings_map = []

# Initialize list of generic parcel areas (and ensure identical index, to map complex buildings correctly)
gp_areas = []

# Initialize list of aspect ratios (where the length is in the numerator and the width is in the denominator)
gp_dimension_pairs = []

# Iterate through all generic parcels and create the building map
for (i, j), buildings in gp_to_building_map.items():
    parcel = gp_map_to_edge[i][j]  # Access the corresponding parcel 
    parcel = rs.coercecurve(parcel)
    parcel = ensure_counterclockwise(parcel)
    parcel_area = round(rs.CurveArea(parcel)[0],2)
    gp_areas.append(parcel_area)
    vertices = parcel.ToPolyline().ToArray()
    parcel_boundary_edge = gp_edge_on_boundary_edge[i][j]   # Access the corresponding boundary edge of the parcel
    start_point = parcel_boundary_edge.PointAtStart         # Start point should be vertex at index 0 for reordered vertices
    
    # Reorder the vertices of the corner parcel, such that they are counterclockwise and the vertex at index "0" starts on the corner
    reordered_vertices = reorder_vertices_to_start_at_corner(vertices, start_point)

    # Initialize a new list to store the dimension pair and building mappings for this parcel
    parcel_info = []

    # Get dimension pairs
    gp_length = round(reordered_vertices[0].DistanceTo(reordered_vertices[1]),2)
    gp_width = round(reordered_vertices[1].DistanceTo(reordered_vertices[2]),2)
    gp_dimensions = [gp_length, gp_width]
    gp_dimension_pairs.append(gp_dimensions)

    # Add the dimension pair as the first element in the list
    parcel_info.append(gp_dimensions)

    # Add aspect ratio as the second element in the list
    aspect_ratio = round(gp_length / gp_width, 2)
    parcel_info.append(aspect_ratio)

    # Update the start and end points of the boundary edge if necessary
    start_point = reordered_vertices[0]
    end_point = reordered_vertices[1]  # Assuming the boundary edge is between the first two vertices

    # Create consistent parcels for precise mapping of buildings
    reordered_parcel_outline = [reordered_vertices[0], reordered_vertices[1], reordered_vertices[2], reordered_vertices[3], reordered_vertices[0]]
    reordered_parcel = rg.PolylineCurve(reordered_parcel_outline)

    # Generate a UV mapping grid for the parcel
    grid_points = generate_grid_in_quadrilateral_parcel(reordered_parcel_outline, grid_resolution)
    
    mapping_info = []  # To store the building mappings

    # Loop through all buildings inside this parcel
    for building in buildings:
        building_footprint = rs.coercecurve(building)
        building_vertices = list(building_footprint.ToPolyline().ToArray())

        # Compute the U-V coordinates of the footprint vertices within the grid
        building_mapping = compute_building_indeces_quadrilateral(building_vertices, grid_points)
        mapping_info.append(building_mapping)

        # Get area ratio between building and parcel
        parcel_area = rs.CurveArea(reordered_parcel)[0]  # Get the area of the parcel
        building_area = rs.CurveArea(building)[0]        # Get the area of the building footprint
        building_footprint_to_parcel_area_ratio = round((building_area / parcel_area), 2)

    # Add the mapping info list as the second element in the list (index 1)
    parcel_info.append(mapping_info)

    # Add the list of parcel_info (dimension + building mappings) to the main list
    generic_buildings_map.append(parcel_info)


################
""" OUTPUTS """

### Determine key metrics for generic parcels
gp_lengths_mean = calculate_mean(gp_lengths)
gp_lengths_min = min(gp_lengths)
gp_lengths_max = max(gp_lengths)
gp_lengths_sd = calculate_std(gp_lengths)
gp_widths_mean = calculate_mean(gp_widths)
gp_widths_min = min(gp_widths)
gp_widths_max = max(gp_widths)
gp_widths_sd = calculate_std(gp_widths)

### Determine key metrics for corner parcels
cp_lengths_flattened = [item for sublist in cp_lengths for item in sublist]
cp_edge_mean = calculate_mean(cp_lengths_flattened)
cp_edge_min = min(cp_lengths_flattened)
cp_edge_max = max(cp_lengths_flattened)
cp_edge_sd = calculate_std(cp_lengths_flattened)

### Determine key metrics for building height
if height_info is not None:
    bh_mean = height_info[0]
    bh_min = height_info[1]
    bh_max = height_info[2]
    bh_sd = height_info[3]
else:
    bh_mean = 20
    bh_min = 10
    bh_max = 30
    bh_sd = 5

# Outputs
cp_count = len(corner_parcels)
gp_count = len(generic_parcels)
gp_lengths = gp_lengths
cp_lengths = cp_lengths
cp_edge_max = cp_edge_max
cp_edge_min = cp_edge_min
boundary_area = rs.CurveArea(boundary_curve)
boundary_area = round(boundary_area[0],2)


data_text = [
    f"Corner parcel configurations: {cp_configurations}",
    f"Corner parcel count: {len(corner_parcels)}",
    f"Corner parcel mean length: {round(cp_edge_mean, 2)}",
    f"Corner parcel minimum length: {round(cp_edge_min, 2)}",
    f"Corner parcel maximum length: {round(cp_edge_max, 2)}",
    f"Corner parcel areas: {cp_areas}",
    f"Generic parcel total count: {round(gp_count, 2)}",
    f"Generic parcel mean length: {round(gp_lengths_mean, 2)}",
    f"Generic parcel minimum length: {round(gp_lengths_min, 2)}",
    f"Generic parcel maximum length: {round(gp_lengths_max, 2)}",
    f"Generic parcel lengths standard deviation: {round(gp_lengths_sd, 2)}",
    f"Generic parcel mean widths: {round(gp_widths_mean, 2)}",
    f"Generic parcel minimum widths: {round(gp_widths_min, 2)}",
    f"Generic parcel maximum widths: {round(gp_widths_max, 2)}",
    f"Generic parcel widths standard deviation: {round(gp_widths_sd, 2)}",
    f"Generic parcel count per boundary edge: {gp_on_boundary_edge_count}",
    f"Generic parcel indentations per boundary edge: {gp_indentation_count}",    
    f"Generic parcel dimension pairs (length = index 0, width = index 1): {gp_dimension_pairs}",
    f"Generic parcel areas: {gp_areas}",
    f"Generic parcel to building footprint area ratio: {building_footprint_to_parcel_area_ratio}",
    f"Corner parcel dimension pairs: {cp_dimension_pairs}",
    f"Average length after which an indentation occurs: {indentation_ratio}",
    f"Length threshold, under which two corners create pentalateral: {penta_threshold}",
    f"Corner parcel edges angles: {cp_edge_angle}",
    f"Boundary Polygon Area: {boundary_area}",
    f"Building mean height: {bh_mean}",
    f"Building minimum height: {bh_min}",
    f"Building maximum heigth: {bh_max}",
    f"Building height standard deviation: {bh_sd}",
    f"Buildings count: {len(buildings_footprint)}"
]

data_package = [
    cp_configurations,
    len(corner_parcels),
    round(cp_edge_mean, 2),
    round(cp_edge_min, 2),
    round(cp_edge_max, 2),
    cp_areas,
    round(gp_count, 2),
    round(gp_lengths_mean, 2),
    [round(gp_lengths_min, 2)],
    round(gp_lengths_max, 2),
    round(gp_lengths_sd, 2),
    round(gp_widths_mean, 2),
    round(gp_widths_min, 2),
    round(gp_widths_max, 2),
    round(gp_widths_sd, 2),
    gp_on_boundary_edge_count,
    gp_indentation_count,
    gp_dimension_pairs,
    gp_areas,
    building_footprint_to_parcel_area_ratio,
    cp_dimension_pairs,
    [indentation_ratio],
    penta_threshold,
    cp_edge_angle,
    boundary_area,
    bh_mean,
    bh_min,
    bh_max,
    bh_sd,
    len(buildings_footprint)
]
# ---------- end block_analysis_7 ----------

# ----
# INPUTS
# ATH_reference_4
buildings_footprint_8 = Curve([<curve referenced from the Rhino model> x36])
# ATH_reference_2
boundary_8 = Curve(<curve referenced from the Rhino model>)
parcels_8 = Curve([<curve referenced from the Rhino model> x12])

# ----
# INPUTS
# ATH_reference_6
buildings_footprint_9 = Curve([<curve referenced from the Rhino model> x42])
boundary_9 = Curve(<curve referenced from the Rhino model>)
parcels_9 = Curve([<curve referenced from the Rhino model> x17])

# ----
# INPUTS
buildings_footprint_10 = Curve([<curve referenced from the Rhino model> x21])
boundary_10 = Curve(<curve referenced from the Rhino model>)
parcels_10 = Curve([<curve referenced from the Rhino model> x10])

# ----
# INPUTS
buildings_footprint_11 = Curve([<curve referenced from the Rhino model> x33])
boundary_11 = Curve(<curve referenced from the Rhino model>)
parcels_11 = Curve([<curve referenced from the Rhino model> x10])

# ----
# INPUTS
# ATH_reference_11
buildings_footprint_12 = Curve([<curve referenced from the Rhino model> x15])
# ATH_reference_9
boundary_12 = Curve(<curve referenced from the Rhino model>)
parcels_12 = Curve([<curve referenced from the Rhino model> x8])

# ----
# INPUTS
buildings_footprint_13 = Curve([<curve referenced from the Rhino model> x32])
# ATH_reference_13
boundary_13 = Curve(<curve referenced from the Rhino model>)
parcels_13 = Curve([<curve referenced from the Rhino model> x17])

# ----
# BLOCK ANALYSIS
block_analysis_8 = Python3Script(boundary=boundary_10, parcels=parcels_10, buildings_footprint=buildings_footprint_10, height_info=get_heights)  # -> data_text, data_package, corner_buildings_map, generic_buildings_map; inputs boundary: list, parcels: list, buildings_footprint: list, height_info: list; same code as block_analysis

# ----
# BLOCK ANALYSIS
block_analysis_9 = Python3Script(boundary=boundary_12, parcels=parcels_12, buildings_footprint=buildings_footprint_12, height_info=get_heights)  # -> data_text, data_package, corner_buildings_map, generic_buildings_map; inputs boundary: list, parcels: list, buildings_footprint: list, height_info: list; same code as block_analysis

# ----
# BLOCK ANALYSIS
block_analysis_10 = Python3Script(boundary=boundary_13, parcels=parcels_13, buildings_footprint=buildings_footprint_13, height_info=get_heights)  # -> data_text, data_package, corner_buildings_map, generic_buildings_map; inputs boundary: list, parcels: list, buildings_footprint: list, height_info: list; same code as block_analysis

# ----
# Data structure for "data_package"
panel = Panel(block_analysis_10.data_text)

# ----
# BLOCK ANALYSIS
block_analysis_11 = Python3Script(boundary=boundary_9, parcels=parcels_9, buildings_footprint=buildings_footprint_9, height_info=get_heights)  # -> data_text, data_package, corner_buildings_map, generic_buildings_map; inputs boundary: list, parcels: list, buildings_footprint: list, height_info: list
# ---------- block_analysis_11: Python ----------
import Rhino
import rhinoscriptsyntax as rs
import Rhino.Geometry as rg
import random
import math
from collections import defaultdict

#####################################################################################

""" FUNCTIONS """

# Function to calculate mean
def calculate_mean(data):
    return sum(data) / len(data)

# Function to calculate standard deviation
def calculate_std(data):
    mean = calculate_mean(data)
    squared_differences = [(i - mean) ** 2 for i in data]  # Calculate squared differences
    variance = sum(squared_differences) / len(data)  # Find the variance
    return math.sqrt(variance)  # std = square root of the variance

# Function to compute the angles between the non-boundary edges and the boundary polygon edges of a corner parcel
def compute_non_boundary_edge_angles(non_boundary_edges, boundary_polygon_edges, tolerance):
    cp_edge_angles = []
    # Iterate through all non-boundary edges
    for nbe in non_boundary_edges:
        nbe_start_pt = nbe.PointAtStart
        nbe_end_pt = nbe.PointAtEnd    
        # Iterate through boundary polygon edges to find the closest edge points
        for edge in boundary_polygon_edges:
            success_start, param_start = edge.ClosestPoint(nbe_start_pt)
            success_end, param_end = edge.ClosestPoint(nbe_end_pt)           
            # Get closest points on the edge if successful
            edge_pt_1 = edge.PointAt(param_start) if success_start else None
            edge_pt_2 = edge.PointAt(param_end) if success_end else None
            # If both start and end points of nbe have close points on the boundary edge
            if edge_pt_1 and edge_pt_2:
                start_dist = nbe_start_pt.DistanceTo(edge_pt_1)
                end_dist = nbe_end_pt.DistanceTo(edge_pt_2)
                # Check if the start distance is within tolerance
                if start_dist < tolerance:
                    if nbe_start_pt.DistanceTo(edge.PointAtStart) < nbe_start_pt.DistanceTo(edge.PointAtEnd):
                        vec_1 = rg.Vector3d(edge.PointAtStart.X - nbe_start_pt.X, edge.PointAtStart.Y - nbe_start_pt.Y, 0)
                    else:
                        vec_1 = rg.Vector3d(edge.PointAtEnd.X - nbe_start_pt.X, edge.PointAtEnd.Y - nbe_start_pt.Y, 0)
                    vec_2 = rg.Vector3d(nbe_end_pt.X - nbe_start_pt.X, nbe_end_pt.Y - nbe_start_pt.Y, 0)                   
                    vec_1.Unitize()
                    vec_2.Unitize()
                    angle_degrees = math.degrees(rg.Vector3d.VectorAngle(vec_1, vec_2))
                    cp_edge_angles.append(round(angle_degrees))
                # Check if the end distance is within tolerance
                elif end_dist < tolerance:
                    if nbe_end_pt.DistanceTo(edge.PointAtStart) < nbe_end_pt.DistanceTo(edge.PointAtEnd):
                        vec_1 = rg.Vector3d(edge.PointAtStart.X - nbe_end_pt.X, edge.PointAtStart.Y - nbe_end_pt.Y, 0)
                    else:
                        vec_1 = rg.Vector3d(edge.PointAtEnd.X - nbe_end_pt.X, edge.PointAtEnd.Y - nbe_end_pt.Y, 0)
                    vec_2 = rg.Vector3d(nbe_start_pt.X - nbe_end_pt.X, nbe_start_pt.Y - nbe_end_pt.Y, 0)
                    vec_1.Unitize()
                    vec_2.Unitize()
                    angle_degrees = math.degrees(rg.Vector3d.VectorAngle(vec_1, vec_2))
                    cp_edge_angles.append(round(angle_degrees))
    # Returns list of angles (in degrees) between the non-boundary edges and boundary edges
    return cp_edge_angles

# Function to create lines that interpolate between two opposite edges
def interpolate_between_edges(edge1, edge2, grid_resolution):
    points = []
    for i in range(grid_resolution + 1):
        step = i / grid_resolution
        start = edge1.PointAt(step)
        end = edge2.PointAt(step)
        points.append(rg.Line(start, end))
    return points

# Function to ensure the vertices of the parcel are ordered counter-clockwise.
def ensure_counterclockwise(parcel):
    polyline = parcel.ToPolyline()
    vertices = polyline.ToArray()  # Get vertices as an array
    signed_area_sum = 0
    # Shoelace theorem to check clockwise or counter-clockwise
    for i in range(len(vertices)):
        v1 = vertices[i]
        v2 = vertices[(i + 1) % len(vertices)]  # Next vertex (with wrap-around)
        signed_area_sum += (v2.X - v1.X) * (v2.Y + v1.Y)
    # If total is positive, the vertices are ordered clockwise
    if signed_area_sum > 0:
        vertices = list(reversed(vertices))  # Reverse the vertices if clockwise
        return rg.PolylineCurve(vertices)  # Return the polyline with counter-clockwise vertices
    else:
        return parcel  # Already counter-clockwise, return the original parcel

# Function to reorder vertices such that the first vertex is closest to corner and ensure counterclockwise order.
def reorder_vertices_to_start_at_corner(vertices, corner, tolerance=1e-6):  
    # Find the index of the vertex closest to the corner
    min_distance = float("inf")
    vertex_0_index = 0
    for i in range(len(vertices)):
        distance = vertices[i].DistanceTo(corner)
        if distance < min_distance:
            min_distance = distance
            vertex_0_index = i
    # Reorder the vertices starting from the closest point
    reordered_vertices = [vertices[(i + vertex_0_index) % len(vertices)] for i in range(len(vertices))]
    # Remove consecutive duplicate vertices (within a small tolerance)
    unique_reordered_vertices = [reordered_vertices[0]]
    for i in range(1, len(vertices)):
        if reordered_vertices[i].DistanceTo(unique_reordered_vertices[-1]) > tolerance:
            unique_reordered_vertices.append(reordered_vertices[i])
    # Ensure the last vertex is not a duplicate of the first vertex
    if unique_reordered_vertices[0].DistanceTo(unique_reordered_vertices[-1]) < tolerance:
        unique_reordered_vertices.pop()
    # Check if the reordered vertices are counterclockwise using the Shoelace theorem
    signed_area_sum = 0
    for i in range(len(unique_reordered_vertices)):
        v1 = unique_reordered_vertices[i]
        v2 = unique_reordered_vertices[(i + 1) % len(unique_reordered_vertices)]  # Next vertex (with wrap-around)
        signed_area_sum += (v2.X - v1.X) * (v2.Y + v1.Y)
    if signed_area_sum > 0:
        unique_reordered_vertices.reverse()
    else:
        unique_reordered_vertices = unique_reordered_vertices
    return unique_reordered_vertices



### Functions used for quadrilateral building mapping ###

# Function to generate a grid inside a quadrilateral parcel. Uses a bilinear interpolation between the edges of the quadrilateral.
def generate_grid_in_quadrilateral_parcel(parcel_vertices, grid_resolution):
    grid_points = []
    parcel_vertices.pop()
    # Get the four corners of the quadrilateral
    v0, v1, v2, v3 = parcel_vertices
    for u in range(grid_resolution + 1):
        u_ratio = u / grid_resolution  # The relative position along the U direction (horizontal)
        # Interpolate between v0->v3 (left) and v1->v2 (right) edges
        left_interp = v0 + (v3 - v0) * u_ratio
        right_interp = v1 + (v2 - v1) * u_ratio
        for v in range(grid_resolution + 1):
            v_ratio = v / grid_resolution  # The relative position along the V direction (vertical)
            # Interpolate between the left and right edges at the current u_ratio
            grid_point = left_interp + (right_interp - left_interp) * v_ratio
            grid_points.append(grid_point)
    return grid_points


# Function to map the building vertices to the indices of the grid points of the quadrilateral parcel.
def compute_building_indeces_quadrilateral(building_vertices, grid_in):
    building_indices = []
    for building_vertex in building_vertices:
        # Find the closest point in the input grid and get its index
        closest_index_in = min(range(len(grid_in)), key=lambda i: building_vertex.DistanceTo(grid_in[i]))
        building_indices.append(closest_index_in)
    # Returns a list of indices that represent the mapping.
    return building_indices


### Functions used for pentalateral building mapping ###

# Function to compute the centroid (geometric center) of a list of 3D points (vertices).
def compute_centroid(vertices):
    sum_x = sum(v.X for v in vertices)
    sum_y = sum(v.Y for v in vertices)
    sum_z = sum(v.Z for v in vertices)
    num_vertices = len(vertices)
    return rg.Point3d(sum_x / num_vertices, sum_y / num_vertices, sum_z / num_vertices)

# Function to subdivide a triangle into four smaller triangles by adding midpoints on its edges.
def subdivide_triangle(v0, v1, v2):
    # Compute midpoints
    mid_v0_v1 = v0 + (v1 - v0) * 0.5
    mid_v1_v2 = v1 + (v2 - v1) * 0.5
    mid_v2_v0 = v2 + (v0 - v2) * 0.5
    # Create smaller triangles
    triangles = [
        (v0, mid_v0_v1, mid_v2_v0),
        (mid_v0_v1, v1, mid_v1_v2),
        (mid_v2_v0, mid_v1_v2, v2),
        (mid_v0_v1, mid_v1_v2, mid_v2_v0)
    ]
    # Return triangles and midpoints as potential intersection points
    return triangles, [mid_v0_v1, mid_v1_v2, mid_v2_v0]

# Function to subdivide the triangles of a pentalateral parcel iteratively with consistent indexing.
def generate_grid_in_pentalateral_parcel(vertices, center):
    # Create initial triangles (center to adjacent vertices)
    triangles = []
    indexed_points = []  # Track points in a consistent order
    indexed_points.append(center)  # Start with the centroid having index 0
    iterations = 3
    # Add the original vertices with consistent indexing
    indexed_points.extend(vertices)  # Add pentagon vertices (these will get indices 1-5)
    for i in range(len(vertices)):
        v0 = vertices[i]
        v1 = vertices[(i + 1) % len(vertices)]
        triangles.append((center, v0, v1))
    # Subdivide the triangles iteratively
    for _ in range(iterations):
        new_triangles = []
        for tri in triangles:
            # Subdivide the triangle and get the new midpoints
            subdivided, midpoints = subdivide_triangle(*tri)
            # Check each midpoint and assign it an index if it's new
            for midpoint in midpoints:
                if midpoint not in indexed_points:
                    indexed_points.append(midpoint)
            new_triangles.extend(subdivided)
        triangles = new_triangles
    # Returns the subdivided triangles and indexed intersection points.
    return triangles, indexed_points

# Function to map the building vertices to the indices of the sorted points of the pentalateral parcel.
def compute_building_indeces_pentalateral(building_vertices, sorted_points_in):
    building_indices = []
    for building_vertex in building_vertices:
        # Find the closest point in the sorted_points_in and get its index
        closest_index_in = min(range(len(sorted_points_in)), key=lambda i: building_vertex.DistanceTo(sorted_points_in[i]))
        building_indices.append(closest_index_in)
    # Returns a list of indices that represent the mapping.
    return building_indices


#####################################################################################

# SHORTCUTS FOR LEGIBILITY:
# generic_parcels: "gp"
# corner_parcels: "gp"


###################################
""" INPUTS, LISTS AND CONSTANTS """

# Inputs
boundary_polygon = boundary  # The large boundary polygon that surrounds all parcels (as a closed curve)
all_parcels = parcels  # List of (irregular) rectangular parcel curves (from the "List Access" in Grasshopper)
buildings = buildings_footprint # List of building footprints
if height_info is not None:
    height_info = height_info
else:
    print("standard building heights will be used")

# Initialize lists for outputs
corner_parcels = []  # List to store corner parcels (Rhino.Geometry type: PolylineCurve)
generic_parcels = []  # List to store generic parcels (Rhino.Geometry type: PolylineCurve)
gp_lengths = []  # List to store generic parcels lengths (the edge, that is adjacent to the boundary polygon)
gp_widths = [] # List to store generic parcels widths (one of the edges, that is connected to the boundary polygon)
gp_nb_edges = [] # List to store all generic parcels' non-boundary edges (for indentation count)
cp_lengths = [] # List to store the corner parcels lengths (for the two edges adjacent to the boundary polygon)
cp_edge_angle = [] # List to store corner parcel angles
cp_configurations = []

# Set tolerance for geometric comparison
tolerance = 1e-3

# Set grid resolution for mapping (shouldn't be set higher than 50 for acceptable performance)
grid_resolution = 30

#######################
""" PARCEL ANALYSIS """


# Ensure the boundary_polygon is a valid curve
if rs.IsCurve(boundary_polygon) and boundary_polygon is not None:
    boundary_curve = rs.coercecurve(boundary_polygon)  # Convert the boundary polygon to a RhinoCommon curve
    boundary_curve = ensure_counterclockwise(boundary_curve)

    # Explode the boundary_polygon into individual edges
    boundary_polygon_corners = boundary_curve.ToPolyline().ToArray()
    boundary_polygon_edges = boundary_curve.DuplicateSegments()
    
    # Initialize empty lists for further analysis and mapping
    gp_on_boundary_edge_count = [0] * len(boundary_polygon_edges)
    gp_map_to_edge = [[] for _ in range(len(boundary_polygon_edges))]
    gp_edge_on_boundary_edge = [[] for _ in range(len(boundary_polygon_edges))]


    # Iterate over each parcel curve, received from the input
    for parcel in all_parcels:
        
        # Convert parcels to RhinoCommon curve (PolylineCurve) and ensure counterclockwise order
        parcel_curve = rs.coercecurve(parcel)
        parcel_curve = ensure_counterclockwise(parcel_curve)
        
        # Explode the parcel into individual segments (edges)
        parcel_edges = parcel_curve.DuplicateSegments()
        boundary_edges = []  # To hold the edges of the iterated parcel that lie on the boundary polygon
        non_boundary_edges = []  # To hold the non-boundary edges


        # Check each edge of the parcel to see if it lies close to the boundary polygon
        for edge in parcel_edges:
            start_pt = edge.PointAtStart
            end_pt = edge.PointAtEnd

            # Find the closest points on the boundary polygon to the start and end points of the edge
            success_start, param_start = boundary_curve.ClosestPoint(start_pt)
            success_end, param_end = boundary_curve.ClosestPoint(end_pt)

            # Construct points on the boundary polygon to compute distance
            boundary_pt_1 = boundary_curve.PointAt(param_start) if success_start else None
            boundary_pt_2 = boundary_curve.PointAt(param_end) if success_end else None

            # Compare the distance between the parcel edge and the boundary polygon
            if boundary_pt_1 and boundary_pt_2:
                start_dist = start_pt.DistanceTo(boundary_pt_1)
                end_dist = end_pt.DistanceTo(boundary_pt_2)

                # If both distances are within the tolerance, consider it a boundary edge
                if start_dist < tolerance and end_dist < tolerance:
                    boundary_edges.append(edge)

                else:
                    non_boundary_edges.append(edge)



        # Generic parcel has one boundary edge
        if len(boundary_edges) == 1:
            length = boundary_edges[0].GetLength()
            gp_lengths.append(length)
            generic_parcels.append(parcel_curve)
            
            # Add the boundary edge to the respective boundary polygon edge's generic parcels count
            start_pt = boundary_edges[0].PointAtStart
            end_pt = boundary_edges[0].PointAtEnd
            for i, boundary_line in enumerate(boundary_polygon_edges):
                success_start, param_start = boundary_line.ClosestPoint(start_pt)
                success_end, param_end = boundary_line.ClosestPoint(end_pt)
                boundary_line_pt_1 = boundary_line.PointAt(param_start) if success_start else None
                boundary_line_pt_2 = boundary_line.PointAt(param_end) if success_end else None
                if boundary_line_pt_1 and boundary_line_pt_2:
                    start_dist = start_pt.DistanceTo(boundary_line_pt_1)
                    end_dist = end_pt.DistanceTo(boundary_line_pt_2)
                    if start_dist < tolerance and end_dist < tolerance:
                        gp_on_boundary_edge_count[i] += 1
                        gp_map_to_edge[i].append(parcel)
                        gp_edge_on_boundary_edge[i].append(boundary_edges[0])

            # For generic parcels, find the two non-boundary edges connected to the boundary edge
            connected_non_boundary_edges = []
            for edge in non_boundary_edges:
                if (edge.PointAtStart in [boundary_edges[0].PointAtStart, boundary_edges[0].PointAtEnd] or
                    edge.PointAtEnd in [boundary_edges[0].PointAtStart, boundary_edges[0].PointAtEnd]):
                    connected_non_boundary_edges.append(edge)
                    gp_nb_edges.append(edge)

            # Ensure we have exactly two connected non-boundary edges
            # If the connected non boundary edges differ in length, assign the minimum of both
            if len(connected_non_boundary_edges) == 2:
                width = min(connected_non_boundary_edges[0].GetLength(), connected_non_boundary_edges[1].GetLength()) # here condition for crooked line
                gp_widths.append(width)


        # Corner parcel has two boundary edges, if quadrilateral
        elif len(boundary_edges) == 2: 
            cp_configurations.append("quadrilateral")           
            cp_lengths.append([boundary_edges[0].GetLength(), boundary_edges[1].GetLength()])
            corner_parcels.append(parcel_curve)
            cp_vertices = parcel_curve.ToPolyline().ToArray()
            angles = compute_non_boundary_edge_angles(non_boundary_edges, boundary_polygon_edges, tolerance)
            cp_edge_angle.append(angles)


        # Corner parcel has three boundary edges, if pentalateral
        elif len(boundary_edges) == 3: 
            cp_configurations.append("pentalateral")           
            cp_lengths.append([boundary_edges[0].GetLength(), boundary_edges[1].GetLength(), boundary_edges[2].GetLength()])
            corner_parcels.append(parcel_curve)
            cp_vertices = parcel_curve.ToPolyline().ToArray()
            angles = compute_non_boundary_edge_angles(non_boundary_edges, boundary_polygon_edges, tolerance)
            cp_edge_angle.append(angles)


    # Sort the non boundary edges (or the widths) of the generic parcels to the corresponding boundary polygon edge
    gp_nb_edges_sorted = [[] for _ in range(len(boundary_polygon_edges))] 
    for edge in gp_nb_edges:
        start_pt = edge.PointAtStart
        end_pt = edge.PointAtEnd
        for i, boundary_line in enumerate(boundary_polygon_edges):
            success_start, param_start = boundary_line.ClosestPoint(start_pt)
            success_end, param_end = boundary_line.ClosestPoint(end_pt)
            boundary_line_pt_1 = boundary_line.PointAt(param_start) if success_start else None
            boundary_line_pt_2 = boundary_line.PointAt(param_end) if success_end else None
            if boundary_line_pt_1 and boundary_line_pt_2:
                start_dist = start_pt.DistanceTo(boundary_line_pt_1)
                end_dist = end_pt.DistanceTo(boundary_line_pt_2)
                if start_dist < tolerance or end_dist < tolerance:
                    gp_nb_edges_sorted[i].append(edge)


    
    # Initialize generic parcel indentation count on the back
    # This means, the amount of indentations that occur over all rear sides of the parcels that are aligned to one edge
    gp_indentation_count = [0] * len(boundary_polygon_edges)
    parcel_lengths = []
    for i in range(len(boundary_polygon_edges)):
        edge_infos = [[] for _ in range(len(gp_nb_edges_sorted[i]))]
        point_to_edges = defaultdict(list)
        # Default dictionary to store edges grouped by shared points
        # Automatically initializes a default value for a new key when you try to access it for the first time 
        # Store edge start and end points and lengths
        for m, edge in enumerate(gp_nb_edges_sorted[i]):
            edge_start = edge.PointAtStart
            edge_end = edge.PointAtEnd
            edge_length = edge.GetLength()
            # Append edge data to the list
            edge_infos[m].append(edge_start)
            edge_infos[m].append(edge_end)
            edge_infos[m].append(edge_length)
            # Group edges by shared points (both start and end points)
            # If edge_start is not in the dictionary, defaultdict(list) will automatically create an empty list for this key
            point_to_edges[edge_start].append(edge_length)
            point_to_edges[edge_end].append(edge_length)
        # Compare the lengths of edges that share points
        for point, lengths in point_to_edges.items():
            if len(lengths) > 1:  # Only compare if multiple edges share this point
                if len(set(lengths)) > 1:  # If there are different lengths, increment the counter
                    gp_indentation_count[i] += 1
        # Get the sum of boundary edge lengths to establish proportion
        boundary_edge_lengths = 0
        for gp_edge in gp_edge_on_boundary_edge[i]:
            boundary_edge_lengths += gp_edge.GetLength()
        parcel_lengths.append(boundary_edge_lengths)


    # Find out average length for when indentation occurs
    numerator = 0
    denominator = 0
    if gp_indentation_count[i] < 0:
        for i in range(len(parcel_lengths)):
            # Skip if parcel_lengths[i] = 0 (pentalateral corner parcel)
            if parcel_lengths[i] < tolerance:
                continue
            elif gp_indentation_count == 0: 
                numerator += parcel_lengths[i]
                denominator += 1
            else:
                numerator += (parcel_lengths[i] / gp_indentation_count[i])
                denominator += 1
        indentation_ratio = round(numerator/denominator,2)
    else:
        indentation_ratio = parcel_lengths[0]
        

    #########################
    """ BUILDING ANALYSIS """

    # Dictionary to store parcel to building mapping
    gp_to_building_map = defaultdict(list)  # Mapping from (edge_index, gp_index) -> list of buildings
    cp_to_building_map = [[] for _ in range(len(corner_parcels))]  

    # For all buildings, get building vertices
    for building in buildings:
        building_curve = rs.coercecurve(building)
        building_points = building_curve.ToPolyline().ToArray()   # Convert the curve into a polyline

        # Map buildings to generic parcels of corresponding edge
        for i in range(len(boundary_polygon_edges)):
            for j in range(len(gp_map_to_edge[i])):
                inside = True
                # Coerce the generic parcel curve of the corresponding edge
                gp_check = rs.coercecurve(gp_map_to_edge[i][j])
                for pt in building_points:
                    result = gp_check.Contains(pt, rg.Plane.WorldXY, tolerance)
                    if result != rg.PointContainment.Inside and result != rg.PointContainment.Coincident:
                        inside = False  # Set to False if any point is outside
                        break  # If any point is outside, stop checking further
                if inside:
                    # Append the building to the corresponding parcel in the generic parcel mapping
                    gp_to_building_map[(i, j)].append(building_curve)

        # Map buildings to corner parcels
        for i in range(len(corner_parcels)):  # Iterate over corner parcels
            inside = True
            # Coerce the corner parcel curve of the corresponding corner
            cp_check = rs.coercecurve(corner_parcels[i])
            for pt in building_points:
                result = cp_check.Contains(pt, rg.Plane.WorldXY, tolerance)
                if result != rg.PointContainment.Inside and result != rg.PointContainment.Coincident:
                    inside = False  # Set to False if any point is outside
                    break  # If any point is outside, stop checking further
            if inside:
                # Append the building to the corresponding parcel in the corner parcel mapping
                cp_to_building_map[i].append(building_curve)


    #####################################################
    """ SETTING THE SCENE FOR CORNER BUILDING MAPPING """

    # Establish the reference point, from which the reordering of the vertices should take place
    cp_nb_edges_sorted = [[] for _ in range(len(corner_parcels))] 
    for i, parcel in enumerate(corner_parcels):
        parcel = rs.coercecurve(parcel)
        parcel_edges = parcel.DuplicateSegments()
        for edge in parcel_edges:
            start_pt = edge.PointAtStart
            end_pt = edge.PointAtEnd
            matched = False # Flag
            # Iterate over boundary polygon edges to find matching ones
            for boundary_line in boundary_polygon_edges:
                success_start, param_start = boundary_line.ClosestPoint(start_pt)
                success_end, param_end = boundary_line.ClosestPoint(end_pt)
                boundary_line_pt_1 = boundary_line.PointAt(param_start) if success_start else None
                boundary_line_pt_2 = boundary_line.PointAt(param_end) if success_end else None
                if boundary_line_pt_1 and boundary_line_pt_2:
                    start_dist = start_pt.DistanceTo(boundary_line_pt_1)
                    end_dist = end_pt.DistanceTo(boundary_line_pt_2)
                    if start_dist < tolerance and end_dist < tolerance:
                        matched = True  # Mark as matched
                        break  # No need to check further boundary lines once matched
            # If no match was found after all boundary lines, append to placeholder
            if matched == False:
                cp_nb_edges_sorted[i].append(edge)

    # Get non_boundary_points as first reference
    non_boundary_points = []
    for i in range(len(cp_nb_edges_sorted)):
        edge_1= cp_nb_edges_sorted[i][0]
        edge_2 = cp_nb_edges_sorted[i][1]
        intersection_events = rg.Intersect.Intersection.CurveCurve(edge_1, edge_2, 0.001, 0.0)
        if intersection_events:
            for event in intersection_events:
                if event.IsPoint:
                    intersection_point = event.PointA
                    non_boundary_point = rg.Point3d(intersection_point.X, intersection_point.Y, intersection_point.Z)  # Create Point3d
                    non_boundary_points.append(non_boundary_point) 

    # Assign corner distance threshold, after which we receive pentalateral parcel
    penta_corner_distances = []

    # Reorder vertices, such that they consistently start at reference corner
    for i, parcel in enumerate(corner_parcels):
        parcel = rs.coercecurve(parcel)
        parcel = ensure_counterclockwise(parcel)
        vertices = parcel.ToPolyline().ToArray()
        vertices_ccw = reorder_vertices_to_start_at_corner(vertices, non_boundary_points[i])
        if cp_configurations[i] == "quadrilateral":
            reordered_vertices = [vertices_ccw[2], vertices_ccw[3], vertices_ccw[0], vertices_ccw[1], vertices_ccw[2]]
            reordered_parcel = rg.PolylineCurve(reordered_vertices)
        elif cp_configurations[i] == "pentalateral":
            reordered_vertices = [vertices_ccw[2], vertices_ccw[3], vertices_ccw[4], vertices_ccw[0], vertices_ccw[1], vertices_ccw[2]]
            reordered_parcel = rg.PolylineCurve(reordered_vertices)
            penta_corner_distances.append(reordered_vertices[0].DistanceTo(reordered_vertices[1]))

    if penta_corner_distances:
        penta_threshold = round(max(penta_corner_distances) * 1.2,2)
    else:
        penta_threshold = 30

    ###############################
    """ CORNER BUILDING MAPPING """

    # Initialize list for corner building UV mapping (each element will be a nested list: dimensions + buildings)
    corner_buildings_map = []

    # Initialize list of corner parcel areas (and ensure identical index, to map complex buildings correctly)
    cp_areas = []

    # Initialize corner parcel dimension pairs
    cp_dimension_pairs = []

    # Iterate through all corner parcels and create the building map
    # Index "i" refers to the index of the corner parcel
    for i, buildings in enumerate(cp_to_building_map):
        parcel = corner_parcels[i]  # Access the corresponding parcel 
        parcel = rs.coercecurve(parcel)
        parcel = ensure_counterclockwise(parcel)
        parcel_area = round(rs.CurveArea(parcel)[0], 2)
        cp_areas.append(parcel_area)
        vertices = parcel.ToPolyline().ToArray()
        corner = boundary_polygon_corners[i]  # Access the corresponding corner

        # Reorder the vertices of the corner parcel
        vertices_ccw = reorder_vertices_to_start_at_corner(vertices, non_boundary_points[i])

        # Initialize a new list to store the dimension pair and building mappings for this parcel
        parcel_info = []

        # Map buildings in quadrilateral corner parcels
        if cp_configurations[i] == "quadrilateral":
            # Reorder vertices of quadrilateral corner parcel
            reordered_vertices = [vertices_ccw[2], vertices_ccw[3], vertices_ccw[0], vertices_ccw[1], vertices_ccw[2]]
            reordered_parcel = rg.PolylineCurve(reordered_vertices)

            # Get dimension pair of quadrilateral corner parcel
            cp_dim_1 = round(reordered_vertices[0].DistanceTo(reordered_vertices[1]), 2)
            cp_dim_2 = round(reordered_vertices[1].DistanceTo(reordered_vertices[2]), 2)
            cp_dimensions = [cp_dim_1, cp_dim_2]  # Dimensions for quadrilateral parcel
            cp_dimension_pairs.append(cp_dimensions)

            # Add the dimension pair as the first element in the list
            parcel_info.append(cp_dimensions)

            # Add aspect ratio as the second element in the list
            aspect_ratio = round(cp_dim_1 / cp_dim_2, 2)
            parcel_info.append(aspect_ratio)

            # Generate a UV mapping grid for the quadrilateral corner parcel
            grid_points = generate_grid_in_quadrilateral_parcel(reordered_vertices, grid_resolution)

            # Initialize mapping_info to ensure it's a list
            mapping_info = []

            mapping_info = []
            # Loop through all buildings inside this parcel
            for building in buildings:
                building_curve = rs.coercecurve(building)
                building_vertices = list(building_curve.ToPolyline().ToArray())
                # Compute the U-V coordinates of the footprint vertices within the grid
                #compute_building_indeces_quadrilateral(building_vertices, grid_in)
                building_mapping = compute_building_indeces_quadrilateral(building_vertices, grid_points)
                
                mapping_info.append(building_mapping)

            # Add the mapping info list to parcel info (ensuring one nested list for all mappings)
            parcel_info.append(mapping_info)

        # Map buildings in pentalateral corner parcels
        elif cp_configurations[i] == "pentalateral":
            # Reorder vertices of pentalateral corner parcel
            reordered_vertices = [vertices_ccw[2], vertices_ccw[3], vertices_ccw[4], vertices_ccw[0], vertices_ccw[1], vertices_ccw[2]]
            reordered_parcel = rg.PolylineCurve(reordered_vertices)

            # Get dimension trio of pentalateral corner parcel
            cp_dim_1 = round(reordered_vertices[0].DistanceTo(reordered_vertices[1]), 2)
            cp_dim_2 = round(reordered_vertices[1].DistanceTo(reordered_vertices[2]), 2)
            cp_dim_3 = round(reordered_vertices[0].DistanceTo(reordered_vertices[4]), 2)
            cp_dimensions = [cp_dim_1, cp_dim_2, cp_dim_3]  # Dimensions for pentalateral parcel
            cp_dimension_pairs.append(cp_dimensions)

            # Add the dimension trio as the first element in the list
            parcel_info.append(cp_dimensions)

            # Add aspect ratio as the second element in the list
            aspect_ratio = round(cp_dim_1 / cp_dim_2, 2)
            parcel_info.append(aspect_ratio)

            # Generate a UV mapping grid for the pentalateral corner parcel
            penta_center = compute_centroid(reordered_vertices)
            triangles, indexed_points = generate_grid_in_pentalateral_parcel(reordered_vertices, penta_center)

            mapping_info = []
            # Loop through all buildings inside this parcel
            for building in buildings:
                building_curve = rs.coercecurve(building)
                building_vertices = list(building_curve.ToArray())
                # Compute the U-V coordinates of the footprint vertices within the grid
                building_mapping = compute_building_indeces_pentalateral(building_vertices, indexed_points)
                mapping_info.append(building_mapping)  # Add the building mapping
            
            # Add the mapping info list to parcel info (ensuring one nested list for all mappings)
            parcel_info.append(mapping_info)
        
        # Add the list of parcel_info (dimension + building mappings) to the main list
        corner_buildings_map.append(parcel_info)

    # Remove last area from cp_areas if it is not equal
    if len(cp_areas) > len(corner_parcels):
        cp_areas.pop()
    

################################
""" GENERIC BUILDING MAPPING """

# Initialize list for generic building UV mapping (each element will be a nested list: dimensions + buildings)
generic_buildings_map = []

# Initialize list of generic parcel areas (and ensure identical index, to map complex buildings correctly)
gp_areas = []

# Initialize list of aspect ratios (where the length is in the numerator and the width is in the denominator)
gp_dimension_pairs = []

# Iterate through all generic parcels and create the building map
for (i, j), buildings in gp_to_building_map.items():
    parcel = gp_map_to_edge[i][j]  # Access the corresponding parcel 
    parcel = rs.coercecurve(parcel)
    parcel = ensure_counterclockwise(parcel)
    parcel_area = round(rs.CurveArea(parcel)[0],2)
    gp_areas.append(parcel_area)
    vertices = parcel.ToPolyline().ToArray()
    parcel_boundary_edge = gp_edge_on_boundary_edge[i][j]   # Access the corresponding boundary edge of the parcel
    start_point = parcel_boundary_edge.PointAtStart         # Start point should be vertex at index 0 for reordered vertices
    
    # Reorder the vertices of the corner parcel, such that they are counterclockwise and the vertex at index "0" starts on the corner
    reordered_vertices = reorder_vertices_to_start_at_corner(vertices, start_point)

    # Initialize a new list to store the dimension pair and building mappings for this parcel
    parcel_info = []

    # Get dimension pairs
    gp_length = round(reordered_vertices[0].DistanceTo(reordered_vertices[1]),2)
    gp_width = round(reordered_vertices[1].DistanceTo(reordered_vertices[2]),2)
    gp_dimensions = [gp_length, gp_width]
    gp_dimension_pairs.append(gp_dimensions)

    # Add the dimension pair as the first element in the list
    parcel_info.append(gp_dimensions)

    # Add aspect ratio as the second element in the list
    aspect_ratio = round(gp_length / gp_width, 2)
    parcel_info.append(aspect_ratio)

    # Update the start and end points of the boundary edge if necessary
    start_point = reordered_vertices[0]
    end_point = reordered_vertices[1]  # Assuming the boundary edge is between the first two vertices

    # Create consistent parcels for precise mapping of buildings
    reordered_parcel_outline = [reordered_vertices[0], reordered_vertices[1], reordered_vertices[2], reordered_vertices[3], reordered_vertices[0]]
    reordered_parcel = rg.PolylineCurve(reordered_parcel_outline)

    # Generate a UV mapping grid for the parcel
    grid_points = generate_grid_in_quadrilateral_parcel(reordered_parcel_outline, grid_resolution)
    
    mapping_info = []  # To store the building mappings

    # Loop through all buildings inside this parcel
    for building in buildings:
        building_footprint = rs.coercecurve(building)
        building_vertices = list(building_footprint.ToPolyline().ToArray())

        # Compute the U-V coordinates of the footprint vertices within the grid
        building_mapping = compute_building_indeces_quadrilateral(building_vertices, grid_points)
        mapping_info.append(building_mapping)

        # Get area ratio between building and parcel
        parcel_area = rs.CurveArea(reordered_parcel)[0]  # Get the area of the parcel
        building_area = rs.CurveArea(building)[0]        # Get the area of the building footprint
        building_footprint_to_parcel_area_ratio = round((building_area / parcel_area), 2)

    # Add the mapping info list as the second element in the list (index 1)
    parcel_info.append(mapping_info)

    # Add the list of parcel_info (dimension + building mappings) to the main list
    generic_buildings_map.append(parcel_info)


################
""" OUTPUTS """

### Determine key metrics for generic parcels
gp_lengths_mean = calculate_mean(gp_lengths)
gp_lengths_min = min(gp_lengths)
gp_lengths_max = max(gp_lengths)
gp_lengths_sd = calculate_std(gp_lengths)
gp_widths_mean = calculate_mean(gp_widths)
gp_widths_min = min(gp_widths)
gp_widths_max = max(gp_widths)
gp_widths_sd = calculate_std(gp_widths)

### Determine key metrics for corner parcels
cp_lengths_flattened = [item for sublist in cp_lengths for item in sublist]
cp_edge_mean = calculate_mean(cp_lengths_flattened)
cp_edge_min = min(cp_lengths_flattened)
cp_edge_max = max(cp_lengths_flattened)
cp_edge_sd = calculate_std(cp_lengths_flattened)

### Determine key metrics for building height
if height_info is not None:
    bh_mean = height_info[0]
    bh_min = height_info[1]
    bh_max = height_info[2]
    bh_sd = height_info[3]
else:
    bh_mean = 20
    bh_min = 10
    bh_max = 30
    bh_sd = 5

# Outputs
cp_count = len(corner_parcels)
gp_count = len(generic_parcels)
gp_lengths = gp_lengths
cp_lengths = cp_lengths
cp_edge_max = cp_edge_max
cp_edge_min = cp_edge_min
boundary_area = rs.CurveArea(boundary_curve)
boundary_area = round(boundary_area[0],2)


data_text = [
    f"Corner parcel configurations: {cp_configurations}",
    f"Corner parcel count: {len(corner_parcels)}",
    f"Corner parcel mean length: {round(cp_edge_mean, 2)}",
    f"Corner parcel minimum length: {round(cp_edge_min, 2)}",
    f"Corner parcel maximum length: {round(cp_edge_max, 2)}",
    f"Corner parcel areas: {cp_areas}",
    f"Generic parcel total count: {round(gp_count, 2)}",
    f"Generic parcel mean length: {round(gp_lengths_mean, 2)}",
    f"Generic parcel minimum length: {round(gp_lengths_min, 2)}",
    f"Generic parcel maximum length: {round(gp_lengths_max, 2)}",
    f"Generic parcel lengths standard deviation: {round(gp_lengths_sd, 2)}",
    f"Generic parcel mean widths: {round(gp_widths_mean, 2)}",
    f"Generic parcel minimum widths: {round(gp_widths_min, 2)}",
    f"Generic parcel maximum widths: {round(gp_widths_max, 2)}",
    f"Generic parcel widths standard deviation: {round(gp_widths_sd, 2)}",
    f"Generic parcel count per boundary edge: {gp_on_boundary_edge_count}",
    f"Generic parcel indentations per boundary edge: {gp_indentation_count}",    
    f"Generic parcel dimension pairs (length = index 0, width = index 1): {gp_dimension_pairs}",
    f"Generic parcel areas: {gp_areas}",
    f"Generic parcel to building footprint area ratio: {building_footprint_to_parcel_area_ratio}",
    f"Corner parcel dimension pairs: {cp_dimension_pairs}",
    f"Average length after which an indentation occurs: {indentation_ratio}",
    f"Length threshold, under which two corners create pentalateral: {penta_threshold}",
    f"Corner parcel edges angles: {cp_edge_angle}",
    f"Boundary Polygon Area: {boundary_area}",
    f"Building mean height: {bh_mean}",
    f"Building minimum height: {bh_min}",
    f"Building maximum heigth: {bh_max}",
    f"Building height standard deviation: {bh_sd}",
    f"Buildings count: {len(buildings_footprint)}"
]

data_package = [
    cp_configurations,
    len(corner_parcels),
    round(cp_edge_mean, 2),
    round(cp_edge_min, 2),
    round(cp_edge_max, 2),
    cp_areas,
    round(gp_count, 2),
    round(gp_lengths_mean, 2),
    [round(gp_lengths_min, 2)],
    round(gp_lengths_max, 2),
    round(gp_lengths_sd, 2),
    round(gp_widths_mean, 2),
    round(gp_widths_min, 2),
    round(gp_widths_max, 2),
    round(gp_widths_sd, 2),
    gp_on_boundary_edge_count,
    gp_indentation_count,
    gp_dimension_pairs,
    gp_areas,
    building_footprint_to_parcel_area_ratio,
    cp_dimension_pairs,
    [indentation_ratio],
    penta_threshold,
    cp_edge_angle,
    boundary_area,
    bh_mean,
    bh_min,
    bh_max,
    bh_sd,
    len(buildings_footprint)
]
# ---------- end block_analysis_11 ----------

# ----
# BLOCK ANALYSIS
block_analysis_12 = Python3Script(boundary=boundary_11, parcels=parcels_11, buildings_footprint=buildings_footprint_11, height_info=get_heights)  # -> data_text, data_package, corner_buildings_map, generic_buildings_map; inputs boundary: list, parcels: list, buildings_footprint: list, height_info: list; same code as block_analysis_11

# ----
# BLOCK ANALYSIS
block_analysis_13 = Python3Script(boundary=boundary_8, parcels=parcels_8, buildings_footprint=buildings_footprint_8, height_info=get_heights)  # -> data_text, data_package, corner_buildings_map, generic_buildings_map; inputs boundary: list, parcels: list, buildings_footprint: list, height_info: list; same code as block_analysis_2

# ----
# MERGE BUILDING DATA
# (this component can
# also be substituted with
# default merge component
# from grasshopper, since
# the data structure is still
# valid)
merge_building_data = Python3Script(
    corner_buildings_map=[block_analysis_7.corner_buildings_map, block_analysis_13.corner_buildings_map, block_analysis_2.corner_buildings_map, block_analysis_11.corner_buildings_map, block_analysis_6.corner_buildings_map, block_analysis_10.corner_buildings_map, block_analysis_3.corner_buildings_map, block_analysis_12.corner_buildings_map, block_analysis_4.corner_buildings_map, block_analysis_5.corner_buildings_map, block_analysis_9.corner_buildings_map, block_analysis.corner_buildings_map, block_analysis_8.corner_buildings_map],
    generic_buildings_map=[block_analysis_7.generic_buildings_map, block_analysis_13.generic_buildings_map, block_analysis_2.generic_buildings_map, block_analysis_11.generic_buildings_map, block_analysis_6.generic_buildings_map, block_analysis_10.generic_buildings_map, block_analysis_3.generic_buildings_map, block_analysis_12.generic_buildings_map, block_analysis_4.generic_buildings_map, block_analysis_5.generic_buildings_map, block_analysis_9.generic_buildings_map, block_analysis.generic_buildings_map, block_analysis_8.generic_buildings_map])  # -> flatten(corner_buildings_map_merged), flatten(generic_buildings_map_merged); inputs corner_buildings_map: list, generic_buildings_map: list
# ---------- merge_building_data: Python ----------
corner_buildings_map_merged = corner_buildings_map
generic_buildings_map_merged = generic_buildings_map
# ---------- end merge_building_data ----------

# ----
# Random seed
number_slider_2 = Slider(52, range=0..100)
# ----
# MERGE DATA PACKAGES
merge_data_package = Python3Script(
    data_package=[block_analysis_5.data_package, block_analysis_9.data_package, block_analysis.data_package, block_analysis_8.data_package],
    random_seed=number_slider_2)  # -> merged_data_text, merged_data_package; inputs data_package: tree
# ---------- merge_data_package: Python ----------
import random
import math
from collections import Counter

######################################################

# Functions

def proportional_split(number, reference_list):
    # Calculate the total sum of the reference list
    reference_sum = sum(reference_list)
    # Calculate the proportional values
    new_list = [round((number * x) / reference_sum) for x in reference_list]
    # Adjust to make sure the sum of the new list equals the target number
    difference = number - sum(new_list)
    # Distribute the remaining difference, if any, to the largest elements in the new list
    for i in range(abs(difference)):
        index_to_adjust = new_list.index(max(new_list)) if difference > 0 else new_list.index(min(new_list))
        new_list[index_to_adjust] += 1 if difference > 0 else -1
    return new_list

# Function to calculate mean
def calculate_mean(data):
    return sum(data) / len(data)

# Function to calculate standard deviation
def calculate_std(data):
    mean = calculate_mean(data)
    squared_differences = [(i - mean) ** 2 for i in data]  # Calculate squared differences
    variance = sum(squared_differences) / len(data)  # Find the variance
    return math.sqrt(variance)  # std = square root of the variance

######################################################

# NOTE:
# This component can only work for data analysis that have the same amount of corners, corner parcels and corner parcel configurations!


# Convert the DataTree to a flat list
flat_list = []

# Iterate over each branch in the DataTree
for path in data_package.Paths:
    branch = data_package.Branch(path)
    flat_list.extend(branch)  # Add the items in the branch to the flat list

# Set the random seed to ensure reproducible results
random.seed(random_seed)

# Weighting factor (0 ≤ w ≤ 1), where w determines how much weight is given to the mean
w = random.uniform(0.1, 0.5)  # Can change this value to adjust the weight

# Number of items per list
number_of_items = 30    # Can change this in case data_package_analysis has different item count

# Split the flat list into chunks of 23 items each
data_lists = [flat_list[i:i + number_of_items] for i in range(0, len(flat_list), number_of_items)]

# Initialize merged data package analysis list
merged_data_package = []



### CREATE MERGED DATA PACKAGE ANALYSIS ###

# Get scalar (the first boundary polygon area is the reference)
scalar_area = []
scalar = []
for i in range(len(data_lists)):
    area_to_scale = data_lists[i][24]
    area_reference = data_lists[0][24]
    ratio = data_lists[0][24]/data_lists[i][24]
    scalar_area.append(ratio)
    one_dim_ratio = round(math.sqrt(ratio),2)
    scalar.append(one_dim_ratio)


# Index 0: Corner parcel type (must be the same for every data package)
corner_parcel_config = []
for i in range(len(data_lists[0][0])):
    corner_parcel_config.append(data_lists[0][0][i])
merged_data_package.append(corner_parcel_config)

# Index 1: Corner parcel count
cp_count_store = []
for i in range(len(data_lists)):
    cp_count_store.append(data_lists[i][1])
counter = Counter(cp_count_store)
most_common_cp_count, frequency = counter.most_common(1)[0]
merged_data_package.append(most_common_cp_count)


# Index 2: Corner parcel mean length
cp_mean_lengths_store = []
for i in range(len(data_lists)):
    mean_length = scalar[i] * data_lists[i][2]
    cp_mean_lengths_store.append(mean_length)

mean_length = calculate_mean(cp_mean_lengths_store)
mean_length = round(mean_length, 2)
merged_data_package.append(mean_length)


# Index 3: Corner parcel minimum length
# Index 4: Corner parcel maximum length
cp_minimum_lengths_store = []
cp_maximum_lengths_store = []
for i in range(len(data_lists)):
    cp_minimum_length = scalar[i] * data_lists[i][3]
    cp_minimum_lengths_store.append(cp_minimum_length)
    cp_maximum_length = scalar[i] * data_lists[i][4]
    cp_maximum_lengths_store.append(cp_maximum_length)
# For minimum values
mean_min = sum(cp_minimum_lengths_store) / len(cp_minimum_lengths_store)  
lower_bound_min = min(cp_minimum_lengths_store)
weighted_min = round((w * mean_min) + ((1 - w) * lower_bound_min),2)
merged_data_package.append(weighted_min)
# For maximum values
mean_max = sum(cp_maximum_lengths_store) / len(cp_maximum_lengths_store)  # Mean of the maximum values
upper_bound_max = max(cp_maximum_lengths_store)  # Largest (upper bound) of the maximum values
weighted_max = round((w * mean_max) + ((1 - w) * upper_bound_max),2)
merged_data_package.append(weighted_max)

# Index 5: Corner parcel areas (arbitraray)
cp_areas = []
for i in range(len(data_lists[0][5])):
    cp_areas.append(data_lists[0][5][i])
merged_data_package.append(cp_areas)

# Index 6: Generic parcel count
gp_count_store = []
for i in range(len(data_lists)):
    gp_count_store.append(data_lists[i][6])
generic_parcels_count = int(sum(gp_count_store) / len(gp_count_store))
merged_data_package.append(generic_parcels_count)

# Index 7: Generic parcel mean length
gp_mean_lengths_store = []
for i in range(len(data_lists)):
    gp_mean_length = scalar[i] * data_lists[i][7]
    gp_mean_lengths_store.append(round(gp_mean_length,2))
merged_data_package.append(gp_mean_lengths_store)

# Index 8: Generic parcel minimum length
# Index 9: Generic parcel maximum length
gp_minimum_lengths_store = []
gp_maximum_lengths_store = []
for i in range(len(data_lists)):
    gp_minimum_lengths_store.append(round(scalar[i] * data_lists[i][8][0]))
    gp_maximum_lengths_store.append(round(scalar[i] * data_lists[i][9]))
# For minimum values
merged_data_package.append(gp_minimum_lengths_store)
# For maximum values
merged_data_package.append(gp_maximum_lengths_store)

# Index 10: Generic parcel lengths standard deviation
# Use a weighed pooled standard deviation
std_devs_lengths = []
for i in range(len(data_lists)):
    std_devs_lengths.append(data_lists[i][10])
merged_data_package.append(std_devs_lengths)

# Index 11: Generic parcel mean width
gp_mean_widths_store = []
for i in range(len(data_lists)):
    gp_mean_widths_store.append(scalar[i] * data_lists[i][11])
merged_data_package.append(round(sum(gp_mean_widths_store)/len(gp_mean_widths_store), 2))


# Index 12: Generic parcel minimum width
# Index 13: Generic parcel maximum width
gp_minimum_widths_store = []
gp_maximum_widths_store = []
for i in range(len(data_lists)):
    gp_minimum_widths_store.append(scalar[i] * data_lists[i][12])
    gp_maximum_widths_store.append(scalar[i] * data_lists[i][13])
# For minimum values
mean_min = sum(gp_minimum_widths_store) / len(gp_minimum_widths_store)  
lower_bound_min = min(gp_minimum_widths_store)
weighted_min = round((w * mean_min) + ((1 - w) * lower_bound_min),2)
merged_data_package.append(weighted_min)
# For maximum values
mean_max = sum(gp_maximum_widths_store) / len(gp_maximum_widths_store)  # Mean of the maximum values
upper_bound_max = max(gp_maximum_widths_store)  # Largest (upper bound) of the maximum values
weighted_max = round((w * mean_max) + ((1 - w) * upper_bound_max),2)
merged_data_package.append(weighted_max)


# Index 14: Generic parcel widths standard deviation
# Use a weighed pooled standard deviation
std_devs_widhts = []
sample_sizes = []
for i in range(len(data_lists)):
    std_devs_widhts.append(data_lists[i][14])
    sample_sizes.append(data_lists[i][6])
weighted_variance_sum = sum([(n - 1) * (sd**2) for sd, n in zip(std_devs_widhts, sample_sizes)])
total_degrees_of_freedom = sum([n - 1 for n in sample_sizes])
pooled_std_dev = math.sqrt(weighted_variance_sum / total_degrees_of_freedom)
merged_data_package.append(round(pooled_std_dev, 2))

# Index 15: Generic parcel count per boundary edge
gp_count_per_be_stored = []
for i in range(len(data_lists)):
    python_list = list(data_lists[i][15])
    python_list.sort()
    gp_count_per_be_stored.append(python_list)
gp_count_means = []
for i in range(len(data_lists[0][15])):
    individual_count_store = []
    for j in range(len(gp_count_per_be_stored)):
        individual_count_store.append(gp_count_per_be_stored[j][i])
    gp_count_means.append(round(sum(individual_count_store)/len(individual_count_store), 0))
generic_parcels_per_boundary_edge = proportional_split(generic_parcels_count, gp_count_means)

merged_data_package.append(generic_parcels_per_boundary_edge)


# Index 16: Generic parcel indentations per boundary edge:
indentation_counts_stored = []
for i in range(len(data_lists)):
    for j in range(len(data_lists[i][16])):
        indentation_counts_stored.append(data_lists[i][16][j])
gp_indentation_counts_per_be = []
for i in range(len(data_lists[0][16])):
    gp_indentation_counts_per_be.append(random.choice(indentation_counts_stored))

merged_data_package.append(gp_indentation_counts_per_be)


# Index 17: Generic parcel dimension pairs (irrelevant)
stored = []
dim_pairs = []
for i in range(len(data_lists)):
    for j in range(len(data_lists[i][17])):
        length = round(scalar[i] * data_lists[i][17][j][0],2)
        width = round(scalar[i] * data_lists[i][17][j][1],2)
        stored.append([length, width])
for i in range(generic_parcels_count):
    chosen_pair = random.choice(stored)
    dim_pairs.append(chosen_pair)
merged_data_package.append(dim_pairs)

# Index 18: Generic parcel areas
areas = []
for i in range(len(dim_pairs)):
    length = dim_pairs[i][0]
    width = dim_pairs[i][1]
    area = round(length * width, 2)
    areas.append(area)
merged_data_package.append(areas)

# Index 19: Generic parcel to building footprint area ratio (irrelevant)
var = data_lists[0][19]
merged_data_package.append(var)

# Index 20: corner parcel dimension pairs
cp_dims = []
for i in range(len(data_lists)):
    for j in range(len(data_lists[i][20])):
        scaled_dims = [round(x * scalar[i],2) for x in data_lists[i][20][j]]
        cp_dims.append(scaled_dims)
merged_data_package.append(cp_dims)


# Index 21: Average length after which an indentation occurs:
ind_lengths = []
for i in range(len(data_lists)):
    ind_length = data_lists[i][21][0]
    ind_lengths.append(round(ind_length,2))
merged_data_package.append(ind_lengths)

# Index 22: Length threshold, under which two corners create pentalateral
penta_lengths = []
for i in range(len(data_lists)):
    penta_length = data_lists[i][22]
    penta_lengths.append(penta_length)
merged_data_package.append(max(penta_lengths))


# Index 23: Corner parcel edges angles:
cp_edge_angles_pairs = []
for i in range(len(data_lists)):
    for j in range(len(data_lists[i][23])):
        corner_1 = data_lists[i][23][j][0]
        corner_2 = data_lists[i][23][j][0]
        cp_edge_angles_pairs.append([corner_1, corner_2])
cp_angles_choice = []
for i in range(most_common_cp_count):
    cp_angles_choice.append(random.choice(cp_edge_angles_pairs))
merged_data_package.append(cp_angles_choice)

# Index 24: Boundary area to scale towards
merged_data_package.append(data_lists[0][24])

# Index 25: Building mean height
building_heights_store = []
for i in range(len(data_lists)):
    building_mean_heigths = data_lists[i][25]
    building_heights_store.append(building_mean_heigths)
building_mean_heigth = calculate_mean(building_heights_store)
building_mean_heigth = round(building_mean_heigth, 2)
merged_data_package.append(building_mean_heigth)

# Index 26: Building minimum heigth
# Index 27: Building maximum heigth
b_minimum_heights_store = []
b_maximum_heights_store = []
for i in range(len(data_lists)):
    b_minimum_heights_store.append(data_lists[i][26])
    b_maximum_heights_store.append(data_lists[i][27])
# For minimum values
mean_min = sum(b_minimum_heights_store ) / len(b_minimum_heights_store )  
lower_bound_min = min(b_minimum_heights_store)
weighted_min = round((w * mean_min) + ((1 - w) * lower_bound_min),2)
merged_data_package.append(weighted_min)
# For maximum values
mean_max = sum(b_maximum_heights_store) / len(b_maximum_heights_store)  # Mean of the maximum values
upper_bound_max = max(b_maximum_heights_store)  # Largest (upper bound) of the maximum values
weighted_max = round((w * mean_max) + ((1 - w) * upper_bound_max),2)
merged_data_package.append(weighted_max)

# Index 28: Building heights standard deviation
# Use a weighed pooled standard deviation
std_devs_b_heights = []
sample_sizes = []
for i in range(len(data_lists)):
    std_devs_b_heights.append(data_lists[i][28])
    sample_sizes.append(data_lists[i][29])
weighted_variance_sum = sum([(n - 1) * (sd**2) for sd, n in zip(std_devs_b_heights, sample_sizes)])
total_degrees_of_freedom = sum([n - 1 for n in sample_sizes])
pooled_std_dev = math.sqrt(weighted_variance_sum / total_degrees_of_freedom)
merged_data_package.append(round(pooled_std_dev, 2))

merged_data_text = [
    f"Corner parcel configurations: {merged_data_package[0]}",
    f"Corner parcel count: {merged_data_package[1]}",
    f"Corner parcel mean length: {merged_data_package[2]}",
    f"Corner parcel minimum length: {merged_data_package[3]}",
    f"Corner parcel maximum length: {merged_data_package[4]}",
    f"Corner parcel areas: {merged_data_package[5]}",
    f"Generic parcel total count: {merged_data_package[6]}",
    f"Generic parcel mean length: {merged_data_package[7]}",
    f"Generic parcel minimum length: {merged_data_package[8]}",
    f"Generic parcel maximum length: {merged_data_package[9]}",
    f"Generic parcel lengths standard deviation: {merged_data_package[10]}",
    f"Generic parcel mean widths: {merged_data_package[11]}",
    f"Generic parcel minimum widths: {merged_data_package[12]}",
    f"Generic parcel maximum widths: {merged_data_package[13]}",
    f"Generic parcel widths standard deviation: {merged_data_package[14]}",
    f"Generic parcel count per boundary edge: {merged_data_package[15]}",
    f"Generic parcel indentations per boundary edge: {merged_data_package[16]}",    
    f"Generic parcel dimension pairs (length = index 0, width = index 1): {merged_data_package[17]}",
    f"Generic parcel areas: {merged_data_package[18]}",
    f"Generic parcel to building footprint area ratio: {merged_data_package[19]}",
    f"Corner parcel dimension pairs: {merged_data_package[20]}",
    f"Average length after which an indentation occurs: {merged_data_package[21]}",
    f"Length threshold, under which two corners create pentalateral: {merged_data_package[22]}",
    f"Corner parcel edges angles: {merged_data_package[23]}",
    f"Boundary Polygon Area: {merged_data_package[24]}",
    f"Building mean height: {merged_data_package[25]}",
    f"Building minimum height: {merged_data_package[26]}",
    f"Building maximum heigth: {merged_data_package[27]}",
    f"Building height standard deviation: {merged_data_package[28]}"
]
# ---------- end merge_data_package ----------

# ----
# Random seed
number_slider_3 = Slider(52, range=0..100)

# ----
# MERGE DATA PACKAGES
merge_data_package_2 = Python3Script(data_package=[block_analysis_6.data_package, block_analysis_10.data_package], random_seed=number_slider_3)  # -> merged_data_text, merged_data_package; inputs data_package: tree; same code as merge_data_package

# ----
# Random seed
number_slider_4 = Slider(52, range=0..100)

# ----
# MERGE
# BUILDING
# MAPS
# MERGE
# PARCEL
# DATA
# MERGE DATA PACKAGES
merge_data_package_3 = Python3Script(
    data_package=[block_analysis_11.data_package, block_analysis_2.data_package, block_analysis_13.data_package, block_analysis_7.data_package, block_analysis_3.data_package, block_analysis_12.data_package],
    random_seed=number_slider_4)  # -> merged_data_text, merged_data_package; inputs data_package: tree
# ---------- merge_data_package_3: Python ----------
# Merge Data Package component

# Required inputs:
# 1. Multiple data packages (inherited from Block Analysis component, set input to list access)
# 2. Random seed (integer)


import random
import math
from collections import Counter

######################################################

# Functions

def proportional_split(number, reference_list):
    # Calculate the total sum of the reference list
    reference_sum = sum(reference_list)
    # Calculate the proportional values
    new_list = [round((number * x) / reference_sum) for x in reference_list]
    # Adjust to make sure the sum of the new list equals the target number
    difference = number - sum(new_list)
    # Distribute the remaining difference, if any, to the largest elements in the new list
    for i in range(abs(difference)):
        index_to_adjust = new_list.index(max(new_list)) if difference > 0 else new_list.index(min(new_list))
        new_list[index_to_adjust] += 1 if difference > 0 else -1
    return new_list

# Function to calculate mean
def calculate_mean(data):
    return sum(data) / len(data)

# Function to calculate standard deviation
def calculate_std(data):
    mean = calculate_mean(data)
    squared_differences = [(i - mean) ** 2 for i in data]  # Calculate squared differences
    variance = sum(squared_differences) / len(data)  # Find the variance
    return math.sqrt(variance)  # std = square root of the variance

######################################################

# NOTE:
# This component can only work for data analysis that have the same amount of corners, corner parcels and corner parcel configurations!


# Convert the DataTree to a flat list
flat_list = []

# Iterate over each branch in the DataTree
for path in data_package.Paths:
    branch = data_package.Branch(path)
    flat_list.extend(branch)  # Add the items in the branch to the flat list

# Set the random seed to ensure reproducible results
random.seed(random_seed)

# Weighting factor (0 ≤ w ≤ 1), where w determines how much weight is given to the mean
w = random.uniform(0.1, 0.5)  # Can change this value to adjust the weight

# Number of items per list
number_of_items = 30    # Can change this in case data_package_analysis has different item count

# Split the flat list into chunks of 23 items each
data_lists = [flat_list[i:i + number_of_items] for i in range(0, len(flat_list), number_of_items)]

# Initialize merged data package analysis list
merged_data_package = []



### CREATE MERGED DATA PACKAGE ANALYSIS ###

# Get scalar (the first boundary polygon area is the reference)
scalar_area = []
scalar = []
for i in range(len(data_lists)):
    area_to_scale = data_lists[i][24]
    area_reference = data_lists[0][24]
    ratio = data_lists[0][24]/data_lists[i][24]
    scalar_area.append(ratio)
    one_dim_ratio = round(math.sqrt(ratio),2)
    scalar.append(one_dim_ratio)


# Index 0: Corner parcel type (must be the same for every data package)
corner_parcel_config = []
for i in range(len(data_lists[0][0])):
    corner_parcel_config.append(data_lists[0][0][i])
merged_data_package.append(corner_parcel_config)

# Index 1: Corner parcel count
cp_count_store = []
for i in range(len(data_lists)):
    cp_count_store.append(data_lists[i][1])
counter = Counter(cp_count_store)
most_common_cp_count, frequency = counter.most_common(1)[0]
merged_data_package.append(most_common_cp_count)


# Index 2: Corner parcel mean length
cp_mean_lengths_store = []
for i in range(len(data_lists)):
    mean_length = scalar[i] * data_lists[i][2]
    cp_mean_lengths_store.append(mean_length)

mean_length = calculate_mean(cp_mean_lengths_store)
mean_length = round(mean_length, 2)
merged_data_package.append(mean_length)


# Index 3: Corner parcel minimum length
# Index 4: Corner parcel maximum length
cp_minimum_lengths_store = []
cp_maximum_lengths_store = []
for i in range(len(data_lists)):
    cp_minimum_length = scalar[i] * data_lists[i][3]
    cp_minimum_lengths_store.append(cp_minimum_length)
    cp_maximum_length = scalar[i] * data_lists[i][4]
    cp_maximum_lengths_store.append(cp_maximum_length)
# For minimum values
mean_min = sum(cp_minimum_lengths_store) / len(cp_minimum_lengths_store)  
lower_bound_min = min(cp_minimum_lengths_store)
weighted_min = round((w * mean_min) + ((1 - w) * lower_bound_min),2)
merged_data_package.append(weighted_min)
# For maximum values
mean_max = sum(cp_maximum_lengths_store) / len(cp_maximum_lengths_store)  # Mean of the maximum values
upper_bound_max = max(cp_maximum_lengths_store)  # Largest (upper bound) of the maximum values
weighted_max = round((w * mean_max) + ((1 - w) * upper_bound_max),2)
merged_data_package.append(weighted_max)

# Index 5: Corner parcel areas (arbitraray)
cp_areas = []
for i in range(len(data_lists[0][5])):
    cp_areas.append(data_lists[0][5][i])
merged_data_package.append(cp_areas)

# Index 6: Generic parcel count
gp_count_store = []
for i in range(len(data_lists)):
    gp_count_store.append(data_lists[i][6])
generic_parcels_count = int(sum(gp_count_store) / len(gp_count_store))
merged_data_package.append(generic_parcels_count)

# Index 7: Generic parcel mean length
gp_mean_lengths_store = []
for i in range(len(data_lists)):
    gp_mean_length = scalar[i] * data_lists[i][7]
    gp_mean_lengths_store.append(round(gp_mean_length,2))
merged_data_package.append(gp_mean_lengths_store)

# Index 8: Generic parcel minimum length
# Index 9: Generic parcel maximum length
gp_minimum_lengths_store = []
gp_maximum_lengths_store = []
for i in range(len(data_lists)):
    gp_minimum_lengths_store.append(round(scalar[i] * data_lists[i][8][0]))
    gp_maximum_lengths_store.append(round(scalar[i] * data_lists[i][9]))
# For minimum values
merged_data_package.append(gp_minimum_lengths_store)
# For maximum values
merged_data_package.append(gp_maximum_lengths_store)

# Index 10: Generic parcel lengths standard deviation
# Use a weighed pooled standard deviation
std_devs_lengths = []
for i in range(len(data_lists)):
    std_devs_lengths.append(data_lists[i][10])
merged_data_package.append(std_devs_lengths)

# Index 11: Generic parcel mean width
gp_mean_widths_store = []
for i in range(len(data_lists)):
    gp_mean_widths_store.append(scalar[i] * data_lists[i][11])
merged_data_package.append(round(sum(gp_mean_widths_store)/len(gp_mean_widths_store), 2))


# Index 12: Generic parcel minimum width
# Index 13: Generic parcel maximum width
gp_minimum_widths_store = []
gp_maximum_widths_store = []
for i in range(len(data_lists)):
    gp_minimum_widths_store.append(scalar[i] * data_lists[i][12])
    gp_maximum_widths_store.append(scalar[i] * data_lists[i][13])
# For minimum values
mean_min = sum(gp_minimum_widths_store) / len(gp_minimum_widths_store)  
lower_bound_min = min(gp_minimum_widths_store)
weighted_min = round((w * mean_min) + ((1 - w) * lower_bound_min),2)
merged_data_package.append(weighted_min)
# For maximum values
mean_max = sum(gp_maximum_widths_store) / len(gp_maximum_widths_store)  # Mean of the maximum values
upper_bound_max = max(gp_maximum_widths_store)  # Largest (upper bound) of the maximum values
weighted_max = round((w * mean_max) + ((1 - w) * upper_bound_max),2)
merged_data_package.append(weighted_max)


# Index 14: Generic parcel widths standard deviation
# Use a weighed pooled standard deviation
std_devs_widhts = []
sample_sizes = []
for i in range(len(data_lists)):
    std_devs_widhts.append(data_lists[i][14])
    sample_sizes.append(data_lists[i][6])
weighted_variance_sum = sum([(n - 1) * (sd**2) for sd, n in zip(std_devs_widhts, sample_sizes)])
total_degrees_of_freedom = sum([n - 1 for n in sample_sizes])
pooled_std_dev = math.sqrt(weighted_variance_sum / total_degrees_of_freedom)
merged_data_package.append(round(pooled_std_dev, 2))

# Index 15: Generic parcel count per boundary edge
gp_count_per_be_stored = []
for i in range(len(data_lists)):
    python_list = list(data_lists[i][15])
    python_list.sort()
    gp_count_per_be_stored.append(python_list)
gp_count_means = []
for i in range(len(data_lists[0][15])):
    individual_count_store = []
    for j in range(len(gp_count_per_be_stored)):
        individual_count_store.append(gp_count_per_be_stored[j][i])
    gp_count_means.append(round(sum(individual_count_store)/len(individual_count_store), 0))
generic_parcels_per_boundary_edge = proportional_split(generic_parcels_count, gp_count_means)

merged_data_package.append(generic_parcels_per_boundary_edge)


# Index 16: Generic parcel indentations per boundary edge:
indentation_counts_stored = []
for i in range(len(data_lists)):
    for j in range(len(data_lists[i][16])):
        indentation_counts_stored.append(data_lists[i][16][j])
gp_indentation_counts_per_be = []
for i in range(len(data_lists[0][16])):
    gp_indentation_counts_per_be.append(random.choice(indentation_counts_stored))

merged_data_package.append(gp_indentation_counts_per_be)


# Index 17: Generic parcel dimension pairs (irrelevant)
stored = []
dim_pairs = []
for i in range(len(data_lists)):
    for j in range(len(data_lists[i][17])):
        length = round(scalar[i] * data_lists[i][17][j][0],2)
        width = round(scalar[i] * data_lists[i][17][j][1],2)
        stored.append([length, width])
for i in range(generic_parcels_count):
    chosen_pair = random.choice(stored)
    dim_pairs.append(chosen_pair)
merged_data_package.append(dim_pairs)

# Index 18: Generic parcel areas
areas = []
for i in range(len(dim_pairs)):
    length = dim_pairs[i][0]
    width = dim_pairs[i][1]
    area = round(length * width, 2)
    areas.append(area)
merged_data_package.append(areas)

# Index 19: Generic parcel to building footprint area ratio (irrelevant)
var = data_lists[0][19]
merged_data_package.append(var)

# Index 20: corner parcel dimension pairs
cp_dims = []
for i in range(len(data_lists)):
    for j in range(len(data_lists[i][20])):
        scaled_dims = [round(x * scalar[i],2) for x in data_lists[i][20][j]]
        cp_dims.append(scaled_dims)
merged_data_package.append(cp_dims)


# Index 21: Average length after which an indentation occurs:
ind_lengths = []
for i in range(len(data_lists)):
    ind_length = data_lists[i][21][0]
    ind_lengths.append(round(ind_length,2))
merged_data_package.append(ind_lengths)

# Index 22: Length threshold, under which two corners create pentalateral
penta_lengths = []
for i in range(len(data_lists)):
    penta_length = data_lists[i][22]
    penta_lengths.append(penta_length)
merged_data_package.append(max(penta_lengths))


# Index 23: Corner parcel edges angles:
cp_edge_angles_pairs = []
for i in range(len(data_lists)):
    for j in range(len(data_lists[i][23])):
        corner_1 = data_lists[i][23][j][0]
        corner_2 = data_lists[i][23][j][0]
        cp_edge_angles_pairs.append([corner_1, corner_2])
cp_angles_choice = []
for i in range(most_common_cp_count):
    cp_angles_choice.append(random.choice(cp_edge_angles_pairs))
merged_data_package.append(cp_angles_choice)

# Index 24: Boundary area to scale towards
merged_data_package.append(data_lists[0][24])

# Index 25: Building mean height
building_heights_store = []
for i in range(len(data_lists)):
    building_mean_heigths = data_lists[i][25]
    building_heights_store.append(building_mean_heigths)
building_mean_heigth = calculate_mean(building_heights_store)
building_mean_heigth = round(building_mean_heigth, 2)
merged_data_package.append(building_mean_heigth)

# Index 26: Building minimum heigth
# Index 27: Building maximum heigth
b_minimum_heights_store = []
b_maximum_heights_store = []
for i in range(len(data_lists)):
    b_minimum_heights_store.append(data_lists[i][26])
    b_maximum_heights_store.append(data_lists[i][27])
# For minimum values
mean_min = sum(b_minimum_heights_store ) / len(b_minimum_heights_store )  
lower_bound_min = min(b_minimum_heights_store)
weighted_min = round((w * mean_min) + ((1 - w) * lower_bound_min),2)
merged_data_package.append(weighted_min)
# For maximum values
mean_max = sum(b_maximum_heights_store) / len(b_maximum_heights_store)  # Mean of the maximum values
upper_bound_max = max(b_maximum_heights_store)  # Largest (upper bound) of the maximum values
weighted_max = round((w * mean_max) + ((1 - w) * upper_bound_max),2)
merged_data_package.append(weighted_max)

# Index 28: Building heights standard deviation
# Use a weighed pooled standard deviation
std_devs_b_heights = []
sample_sizes = []
for i in range(len(data_lists)):
    std_devs_b_heights.append(data_lists[i][28])
    sample_sizes.append(data_lists[i][29])
weighted_variance_sum = sum([(n - 1) * (sd**2) for sd, n in zip(std_devs_b_heights, sample_sizes)])
total_degrees_of_freedom = sum([n - 1 for n in sample_sizes])
pooled_std_dev = math.sqrt(weighted_variance_sum / total_degrees_of_freedom)
merged_data_package.append(round(pooled_std_dev, 2))

merged_data_text = [
    f"Corner parcel configurations: {merged_data_package[0]}",
    f"Corner parcel count: {merged_data_package[1]}",
    f"Corner parcel mean length: {merged_data_package[2]}",
    f"Corner parcel minimum length: {merged_data_package[3]}",
    f"Corner parcel maximum length: {merged_data_package[4]}",
    f"Corner parcel areas: {merged_data_package[5]}",
    f"Generic parcel total count: {merged_data_package[6]}",
    f"Generic parcel mean length: {merged_data_package[7]}",
    f"Generic parcel minimum length: {merged_data_package[8]}",
    f"Generic parcel maximum length: {merged_data_package[9]}",
    f"Generic parcel lengths standard deviation: {merged_data_package[10]}",
    f"Generic parcel mean widths: {merged_data_package[11]}",
    f"Generic parcel minimum widths: {merged_data_package[12]}",
    f"Generic parcel maximum widths: {merged_data_package[13]}",
    f"Generic parcel widths standard deviation: {merged_data_package[14]}",
    f"Generic parcel count per boundary edge: {merged_data_package[15]}",
    f"Generic parcel indentations per boundary edge: {merged_data_package[16]}",    
    f"Generic parcel dimension pairs (length = index 0, width = index 1): {merged_data_package[17]}",
    f"Generic parcel areas: {merged_data_package[18]}",
    f"Generic parcel to building footprint area ratio: {merged_data_package[19]}",
    f"Corner parcel dimension pairs: {merged_data_package[20]}",
    f"Average length after which an indentation occurs: {merged_data_package[21]}",
    f"Length threshold, under which two corners create pentalateral: {merged_data_package[22]}",
    f"Corner parcel edges angles: {merged_data_package[23]}",
    f"Boundary Polygon Area: {merged_data_package[24]}",
    f"Building mean height: {merged_data_package[25]}",
    f"Building minimum height: {merged_data_package[26]}",
    f"Building maximum heigth: {merged_data_package[27]}",
    f"Building height standard deviation: {merged_data_package[28]}"
]
# ---------- end merge_data_package_3 ----------

# ----
# INPUTS
boundaries = Curve([<curve referenced from the Rhino model> x3])

# ----
# INPUTS
boundaries_2 = Curve([<curve referenced from the Rhino model> x6])

# ----
# INPUTS
boundaries_3 = Curve([<curve referenced from the Rhino model> x25])

# ----
# Random seed
number_slider_5 = Slider(58, range=0..100)

# ----
# PARCEL GENERATION
parcel_generation = Python3Script(boundaries=boundaries, data_package=merge_data_package.merged_data_package, random_seed=number_slider_5)  # -> all_parcels, all_parcels_building_generation; inputs boundaries: list, data_package: list, random_seed: Int32
# ---------- parcel_generation: Python ----------
import rhinoscriptsyntax as rs
import Rhino.Geometry as rg
import random
import math

#####################################################################################

""" FUNCTIONS"""

# Function to rotate two lists together
def rotate_list(lst):
    # Get a random index as the new starting point
    random_index = random.randint(0, len(lst) - 1)
    # Rotate the list using slicing
    rotated_list = lst[random_index:] + lst[:random_index]
    return rotated_list

# Function to find the closest first value in each nested list compared to a reference
def find_closest_values(nested_list, reference):
    closest_value = None
    closest_list = None
    min_difference = float('inf')  # Start with a very large value for comparison
    # Iterate over the nested lists
    for sublist in nested_list:
        first_value = sublist[0]  # Get the first value of the current nested list
        difference = abs(first_value - reference)  # Calculate the difference
        # Check if this is the smallest difference so far
        if difference < min_difference:
            min_difference = difference
            closest_value = first_value
            closest_list = sublist
    if closest_list:
        return closest_list[1:]  # Get the other two values from the closest list
    else:
        return None

# Function to calculate signed area to determine polygon orientation
def signed_area(vertices):
    area = 0.0
    n = len(vertices)
    for i in range(n):
        x1, y1, _ = vertices[i]
        x2, y2, _ = vertices[(i + 1) % n]
        area += (x1 * y2 - x2 * y1)
    return area / 2.0

# Function to create unitized vectors refering to the (counter-clockwise) direction of each edge
def compute_vector(edge):
    edge_vector = rs.VectorUnitize(rs.VectorCreate(edge[1], edge[0]))
    return edge_vector

# Function to reverse any vector
def rev_vector(vector):
    reversed_vector = rs.VectorScale(vector, -1)
    return reversed_vector

# Function to get input angle vector
def angle_vec(start_point, end_point, angle):
    direction_vector = rg.Vector3d(end_point.X - start_point.X, end_point.Y - start_point.Y, 0)
    arg = math.radians(angle)
    rotated_x = direction_vector.X * math.cos(arg) - direction_vector.Y * math.sin(arg)
    rotated_y = direction_vector.X * math.sin(arg) + direction_vector.Y * math.cos(arg)
    angle_vector = rg.Vector3d(rotated_x, rotated_y, 0)
    angle_vector.Unitize()
    return angle_vector

# Function to interpolate between two vectors
def interpolate_vectors(vec1, vec2, t):
    interpolated_vec = rg.Vector3d(
        (1 - t) * vec1.X + t * vec2.X,
        (1 - t) * vec1.Y + t * vec2.Y,
        (1 - t) * vec1.Z + t * vec2.Z
    )
    interpolated_vec.Unitize()
    return interpolated_vec

# Function to receive intersection point of two vectors
def find_intersection(start_pt_1, vec_1, start_pt_2, vec_2):
    # Solve for t and s such that start_pt_1 + t*vec_1 = start_pt_2 + s*vec_2
    denom = vec_1.X * vec_2.Y - vec_1.Y * vec_2.X
    if denom == 0:
        return None  # Parallel lines, no intersection
    t = ((start_pt_2.X - start_pt_1.X) * vec_2.Y - (start_pt_2.Y - start_pt_1.Y) * vec_2.X) / denom
    s = ((start_pt_2.X - start_pt_1.X) * vec_1.Y - (start_pt_2.Y - start_pt_1.Y) * vec_1.X) / denom
    intersection = rg.Point3d(start_pt_1.X + t * vec_1.X, start_pt_1.Y + t * vec_1.Y, 0)
    return intersection

# Function to check polyline intersection
def check_polyline_intersection(polyline1, polyline2):
    curve1 = polyline1.ToNurbsCurve()  # Convert the polylines to curve objects
    curve2 = polyline2.ToNurbsCurve()
    intersection_events = rg.Intersect.Intersection.CurveCurve(curve1, curve2, 0.001, 0.0) # Check for curve-curve intersection
    if intersection_events.Count > 0:
        return True # If any intersections are found, return True
    else:
        return False # Otherwise, return False

def calculate_if_angle_between_edges_is_smaller_than_110(unit_vec_1, unit_vec_2): 
    dot_product = rg.Vector3d.Multiply(unit_vec_1, unit_vec_2)  # Compute the dot product
    dot_product = max(min(dot_product, 1.0), -1.0)  # Clamp the value to avoid numerical issues
    # Compute the angle in radians
    angle_radians = math.acos(dot_product)
    # Convert the angle to degrees
    angle_degrees = math.degrees(angle_radians)
    if angle_degrees < 110:
        return True  # Angle is smaller than 110°
    else:
        return False  # Angle is 110° or larger

def calculate_angle_between_edges(unit_vec_1, unit_vec_2): 
    dot_product = rg.Vector3d.Multiply(unit_vec_1, unit_vec_2)  # Compute the dot product
    dot_product = max(min(dot_product, 1.0), -1.0)  # Clamp the value to avoid numerical issues
    # Compute the angle in radians
    angle_radians = math.acos(dot_product)
    # Convert the angle to degrees
    angle_degrees = math.degrees(angle_radians)
    return angle_degrees 

# Function to  clamp value to stay within the given range [min_val, max_val].
def clamp(value, min_val, max_val):
    return max(min(value, max_val), min_val)

# Function to Apply a slight deviation to values in the local domain while ensuring they stay within the global domain.
def apply_deviation_within_domain(global_domain, local_domain, deviation_percentage=0.1):
    # Unpack global and local domains
    min_global, max_global = global_domain
    min_local, max_local = local_domain
    # Calculate the allowable deviation as a percentage of the local domain range
    deviation_range = (max_local - min_local) * deviation_percentage
    # Apply random deviation to the local domain values
    new_min = min_local + random.uniform(-deviation_range, deviation_range)
    new_max = max_local + random.uniform(-deviation_range, deviation_range)
    # Ensure the new values stay within the global domain by clamping
    new_min = clamp(new_min, min_global, max_global)
    new_max = clamp(new_max, min_global, max_global)
    return new_min, new_max

# Function to find corresponding dimensions
def find_matching_lengths(pairs, width):
    # Define tolerance (10% of difference max and min)
    widths = [pair[1] for pair in pairs]
    max_width = max(widths)
    min_width = min(widths)
    tolerance = 0.1*(max_width - min_width)
    # Define the domain around the random width (± tolerance)
    lower_bound = width - tolerance
    upper_bound = width + tolerance
    # Filter the pairs where the length is within the domain
    matching_pairs = [pair for pair in pairs if lower_bound <= pair[1] <= upper_bound]
    # If there are no matching pairs, random choice
    if not matching_pairs:
        selected_pair = random.choice(pairs)
        return selected_pair[0]
    else:
        # Randomly select one of the matching pairs and return the corresponding width
        selected_pair = random.choice(matching_pairs)
        # Return the matching lenght
        return selected_pair[0]

# Function to calculate the angle between 2 lines
def calculate_angle_between_lines(point_start, point_end1, point_end2):
    # Define the vectors based on the starting point and endpoints
    vector1 = [point_end1[0] - point_start[0], point_end1[1] - point_start[1]]
    vector2 = [point_end2[0] - point_start[0], point_end2[1] - point_start[1]]
    # Calculate the dot product of the two vectors
    dot_product = vector1[0] * vector2[0] + vector1[1] * vector2[1]
    # Calculate the magnitudes (lengths) of the two vectors
    magnitude1 = math.sqrt(vector1[0]**2 + vector1[1]**2)
    magnitude2 = math.sqrt(vector2[0]**2 + vector2[1]**2)
    # Calculate the cosine of the angle
    cos_theta = dot_product / (magnitude1 * magnitude2)
    # Calculate the angle in radians
    angle_radians = math.acos(cos_theta)
    # Convert the angle to degrees (optional)
    angle_degrees = math.degrees(angle_radians)
    return angle_degrees

#####################################################################################

# SHORTCUTS FOR LEGIBILITY:
# generic_parcels: "gp"
# corner_parcels: "gp"

###################################
""" INPUTS, LISTS AND CONSTANTS """

# Boundary curves are the input
boundary_curves = boundaries

# Set tolerance for geometric comparison
tolerance = 1e-5

# Set the random seed to ensure reproducible results
random.seed(random_seed)

# Initialize output
all_parcels = []
all_parcels_building_generation = []

##########################
""" SETTING THE SCENE """

for boundary_curve in boundary_curves:

    # Boundary curve input
    boundary_curve = rs.coercecurve(boundary_curve)  
    boundary_area = rs.CurveArea(boundary_curve)
    boundary_area = round(boundary_area[0],2)

    # Create scalar for input data
    reference_area = data_package[24]
    scalar_area = boundary_area / reference_area
    scalar = round(math.sqrt(scalar_area),2)

    # Data package input and varialble initialization
    if data_package is not None:
        corner_parcel_type = data_package[0]
        corner_dim = rg.Interval(scalar * data_package[3], scalar * data_package[4])
        if len(data_package[8]) == 1:
            gp_lengths_mean = scalar * data_package[7]
            gp_lengths_domain = rg.Interval(scalar * data_package[8][0], scalar * data_package[9])
            gp_lengths_sd = data_package[10]
            indentation_reference_length = data_package[21]
        if len(data_package[8]) > 1:
            r_idx = random.choice([0, len(data_package[8])-1])
            gp_lengths_mean = data_package[7][r_idx]
            gp_lengths_domain = rg.Interval(data_package[8][r_idx], data_package[9][r_idx])
            gp_lengths_sd = data_package[10][r_idx]
            indentation_reference_length = data_package[21][r_idx]
        gp_widths_mean = scalar * data_package[11]
        gp_widths_domain = rg.Interval(scalar * data_package[12], scalar * data_package[13])
        gp_widths_sd = data_package[14]
        gp_count_per_edge = data_package[15]
        indentation_count = data_package[16]
        gp_dim_pairs = data_package[17]
        gp_dim_pairs = [[round(x * scalar,1) for x in pairs] for pairs in gp_dim_pairs]
        cp_dim_pairs = data_package[20]
        cp_dim_pairs = [[round(x * (scalar + (1-scalar)/2),1) for x in pairs] for pairs in cp_dim_pairs]
        penta_threshold = 20
        cp_angles = data_package[23]
    else:
        print("Analysis data package is required as input.")


    # Initialize lists to store data and geometry
    generic_parcels = []
    corner_parcels = []
    cp_vertices = []
    cp_config = []


    ###################################
    """ BOUNDARY POLYGON DISSECTION """

    # Get the boundary polygon edges and vertices
    boundary_pts = rs.PolylineVertices(boundary_curve)
    if len(boundary_pts) < 4:
        raise ValueError("Invalid Boundary, must have at least three vertices")
    if boundary_pts[0] != boundary_pts[len(boundary_pts)-1]:
        raise ValueError("Boundary Polygon must be a closed Polyline Curve")

    # Ensure counter-clockwise order for consistent polyline construction
    if signed_area(boundary_pts) < 0:
        boundary_pts.reverse()  # Reverse the order to make it counter-clockwise

    # Create a list of edges (based on boundary point index)
    edges = [(boundary_pts[i], boundary_pts[(i + 1) % len(boundary_pts)]) for i in range(len(boundary_pts) - 1)]

    # Cap the corner dimension domain, if it is larger than two thirds of the shortest edge
    edge_lengths = []
    for edge in edges:
        length = edge[0].DistanceTo(edge[1])
        edge_lengths.append(length)

    # Create unit vectors, to ensure accurate geometric operations according to the boundary edge vectors.
    unit_vecs = []
    for i in range(len(boundary_pts)-1):
        unit_vecs.append(compute_vector(edges[i]))

    # Split corner dim lists
    cp_dim_duo = []
    cp_dim_trio = []

    # Iterate over the original list and sort based on the length of each nested list
    for dimension_pair in cp_dim_pairs:
        if len(dimension_pair) == 3:
            cp_dim_trio.append(dimension_pair)
        elif len(dimension_pair) == 2:
            cp_dim_duo.append(dimension_pair)


    ##############################
    """ CREATE CORNER PARCELS """

    # Configurations for while loop
    i = 0 # Initialize the loop counter i
    max_iterations = len(boundary_pts) * 2  # Allow for double the length of boundary points as a safeguard
    safeguard = 0 #  Initialize safeguard to prevent infinite loops
    first_iteration = True
    stored_width = 0
    boundary_limit = len(boundary_pts) - 1 

    # Iterate over each corner
    while i < (boundary_limit) and safeguard < max_iterations:
        
        # Increment safeguard to track progress
        safeguard += 1

        # For legibility of code
        j = (i-1) % len(edges) 
        k = (i+1) % len(edges)

        if first_iteration:
            control_dist = edges[j][0].DistanceTo(edges[j][1])
            if control_dist < penta_threshold:
                first_iteration = False
                continue
            else:
                first_iteration = False

        # Establish edge distances
        edge_distance_1 = edges[i][0].DistanceTo(edges[i][1])
        edge_distance_2 = edges[j][0].DistanceTo(edges[j][1])
        edge_distance_3 = edges[k][0].DistanceTo(edges[k][1])  

        # Get relevant angles of boundary polygon
        bp_angle = calculate_angle_between_edges(rev_vector(unit_vecs[j]), unit_vecs[i])

        # Assign corner config based upon threshold
        control_dist = edges[i][0].DistanceTo(edges[i][1])
        
        if control_dist > penta_threshold:
            corner_parcel_type = "quadrilateral"
            
        elif control_dist <= penta_threshold:
            corner_parcel_type = "pentalateral"
            
        # Get relevant angle of boundary polygon
        bp_angle = calculate_angle_between_edges(rev_vector(unit_vecs[j]), unit_vecs[i])


        # Create quadrilateral corner parcel
        if corner_parcel_type == "quadrilateral" and bp_angle <= 130: 
            
            # Get relevant angles of boundary polygon
            bp_angle = calculate_angle_between_edges(rev_vector(unit_vecs[j]), unit_vecs[i])

            # Generate random width and height for each corner parcel based upon the corner dimensions
            cp_dim_choice = random.choice(cp_dim_duo)
            cp_dim_local = rg.Interval(cp_dim_choice[0], cp_dim_choice[1])
 
            # If assigned domain exceeds half of edges dimensions, cap the width
            corner_width_1, corner_width_2 = apply_deviation_within_domain(corner_dim, cp_dim_local, deviation_percentage=0.25)
            if edge_distance_1/2 < corner_width_1:
                corner_width_1 = round(random.uniform(edge_distance_1 * (1/4), edge_distance_1 * (1/3)))
            elif edge_distance_2/2 < corner_width_2:
                corner_width_2 = round(random.uniform(edge_distance_2 * (1/4), edge_distance_2 * (1/3)))

            # Get angles
            r = random.randint(0, (len(cp_angles)-1))
            angle_1 = cp_angles[r][0]
            angle_2 = cp_angles[r][1]

            # Avoid overlap if angle is very acute
            if bp_angle < 60:
                angle_1 = 90
                angle_2 = 90
                if corner_width_2 > corner_width_1:
                    # Make sure that when the angle is very acute, the corner parcel doesn't become too small
                    if corner_width_2 < (corner_dim[0]+corner_dim[1])/2:
                        corner_width_2 = random.uniform((corner_dim[0]+corner_dim[1])/2, corner_dim[1])
                    corner_width_1 = corner_width_2
                else:
                    if corner_width_1 < (corner_dim[0]+corner_dim[1])/2:
                        corner_width_1 = random.uniform((corner_dim[0]+corner_dim[1])/2, corner_dim[1])
                    corner_width_2 = corner_width_1

            elif bp_angle >= 60 and bp_angle <= 80:
                angle_1 = 90
                angle_2 = 90
                if corner_width_1 > corner_width_2:
                    corner_width_2 = random.uniform(corner_width_1 * 0.7, corner_width_1 * 0.9)
                else:
                    corner_width_1 = random.uniform(corner_width_2 * 0.7, corner_width_2 * 0.9)


            # Adjust corner parcel angles if boundary polygon angle is obtuse
            if bp_angle >= 100:
                angle_correction = (bp_angle - random.uniform(85, 95)) * 0.5
                angle_2 = angle_2 - angle_correction
                     
            # Control stored width
            if corner_width_2 > edge_distance_1 - stored_width:
                corner_width_2 = stored_width                     
            
            # Construct polyline vertices
            cp_0 = edges[i][0] 
            cp_1 = rs.PointAdd(cp_0, unit_vecs[i] * corner_width_1)
            cp_3 = rs.PointAdd(cp_0, rev_vector(unit_vecs[j]) * corner_width_2)
            cp_2 = find_intersection(cp_1, angle_vec(edges[i][0], edges[i][1], angle_1), cp_3, angle_vec(edges[j][0], edges[j][1], angle_2))

            # Create quadrilateral polyline
            corner_polyline = [cp_0, cp_1, cp_2, cp_3, cp_0]
            corner_parcels.append(rs.AddPolyline(corner_polyline))
            cp_vertices.append(corner_polyline)
            cp_config.append("quadrilateral")

            # Increment loop counter by 1
            i += 1

            # Store width to compare in next iteration
            stored_width = corner_width_1


        # Create pentalateral corner parcels if angle is larger than 130°
        elif corner_parcel_type == "quadrilateral" and bp_angle > 130:

            # If assigned domain exceeds half of edges dimensions, cap the width
            corner_width_1, corner_width_2 = apply_deviation_within_domain(corner_dim, cp_dim_local, deviation_percentage=0.25)
            if edge_distance_1/2 < corner_width_1:
                corner_width_1 = round(random.uniform(edge_distance_1 * (1/4), edge_distance_1 * (1/3)))
            elif edge_distance_2/2 < corner_width_2:
                corner_width_2 = round(random.uniform(edge_distance_2 * (1/4), edge_distance_2 * (1/3)))
            corner_height, corner_height_2 = apply_deviation_within_domain(corner_dim, cp_dim_local, deviation_percentage=0.25)

            # Check if height is larger than 1/2 of the shortest edge distance
            min_edge_length = min(edge_lengths)
            if corner_height > (1/2)*min_edge_length:
                corner_height = random.uniform((1/3)*min_edge_length, (1/2)*min_edge_length)

            # Get angles
            r = random.randint(0, (len(cp_angles)-1))
            angle_1 = cp_angles[r][0]
            angle_2 = cp_angles[r][1]

            # Construct polyline vertices
            cp_0 = edges[i][0]
            cp_1 = rs.PointAdd(cp_0, unit_vecs[i] * corner_width_1)
            cp_2 = rs.PointAdd(cp_1, angle_vec(edges[i][0], edges[i][1], angle_1) * corner_height)
            cp_4 = rs.PointAdd(cp_0, rev_vector(unit_vecs[j]) * corner_width_2)
            cp_3 = rs.PointAdd(cp_4, angle_vec(edges[j][0], edges[j][1], angle_2) * corner_height)

            # Determine possible intersection(s) to ensure appropriate geometry of corner parcel
            control_curve_1 = rg.Polyline([cp_1, cp_2]).ToNurbsCurve() 
            control_curve_2 = rg.Polyline([cp_3, cp_4]).ToNurbsCurve()
            intersection = rg.Intersect.Intersection.CurveCurve(control_curve_1, control_curve_2, tolerance, tolerance)

            # If the curves do not intersect, create pentalateral corner parcel
            if intersection.Count == 0:
                corner_polyline = [cp_0, cp_1, cp_2, cp_3, cp_4, cp_0]
                corner_parcels.append(rs.AddPolyline(corner_polyline)) # Construct current iteration of corner
                cp_vertices.append(corner_polyline)
                cp_config.append("pentalateral_1c")
                test = cp_0

            # If they intersect (since corner_height is too large) create quadrilateral parcel instead, even if the boundary edges' angle is obtuse
            elif intersection[0].IsPoint:
                cp_2 = intersection[0].PointA
                cp_3 = cp_4  # Adjust index, so that it is consistent with the other quadrilateral corner parcels
                corner_polyline = [cp_0, cp_1, cp_2, cp_3, cp_0]
                corner_parcels.append(rs.AddPolyline(corner_polyline))
                cp_vertices.append(corner_polyline)
                cp_config.append("quadrilateral")  

            # Increment loop counter by 1
            i += 1


        # Create pentalateral corner parcel
        elif corner_parcel_type == "pentalateral":

            # Get relevant angles of boundary polygon
            bp_angle_1 = calculate_angle_between_edges(rev_vector(unit_vecs[j]), unit_vecs[i])
            bp_angle_2 = calculate_angle_between_edges(rev_vector(unit_vecs[i]), unit_vecs[k])

            # Generate random width and height for each corner parcel based upon the corner dimensions
            # Establish reference with control distance (and look in cp dim trios)
            if not cp_dim_trio:
                corresponding_dim = find_closest_values(cp_dim_duo, control_dist)
                cp_dim_choice = random.choice(cp_dim_duo)
                cp_dim_local = rg.Interval(cp_dim_choice[0] / scalar,  cp_dim_choice[1] / scalar)
            else:
                corresponding_dim = find_closest_values(cp_dim_trio, control_dist)
                cp_dim_local = rg.Interval(corresponding_dim[0], corresponding_dim[1])
            
            corner_width_1, corner_width_2 = apply_deviation_within_domain(corner_dim, cp_dim_local, deviation_percentage=0.3)

            # Adjust dimensions according to edge distance
            if corner_width_1 < edge_distance_1/2:
                corner_width_1 = random.uniform(edge_distance_1 * (1/2), edge_distance_1*(3/4))
            if corner_width_2 < edge_distance_1/2:
                corner_width_2 = random.uniform(edge_distance_1 * (1/2), edge_distance_1*(3/4))

            # Make sure that the widths don't deviate too much from each other
            corner_width_2 = random.uniform(corner_width_1 * 0.8, corner_width_1 * 1.2)

            # Get angles
            r = random.randint(0, (len(cp_angles)-1))
            angle_1 = cp_angles[r][0]
            angle_2 = cp_angles[r][1]

            # Create reasonable widths with regards to the edge lengths
            

            # If the edge is smallest (implying that it is a pentalateral), equate the widths to avoid overlap with boundary
            if edge_distance_1 - min(edge_lengths) < tolerance:
                corner_width_1 = corner_width_2
                if corner_width_1 < edge_distance_1 and edge_distance_1 < 10:
                    corner_width_1 = edge_distance_1 * 2
                    corner_width_2 = edge_distance_1 * 2
                angle_1 = 90
                angle_2 = 90

            # Adjust widths corresponding to angle deviation for reasonable results
            if bp_angle_1 > 90:
                corner_ratio = 90/bp_angle_1
                corner_width_2 *= corner_ratio
                corner_width_1 = corner_width_2 * (1 + (1-corner_ratio))
            if bp_angle_2 > 90:
                corner_ratio = 90/bp_angle_2
                print(corner_ratio)
                corner_width_1 *= corner_ratio
                corner_width_2 = corner_width_1 * (1 + (1-corner_ratio))



            # Construct polyline vertices
            cp_0 = edges[i][0]
            cp_1 = edges[i][1]
            cp_2 = rs.PointAdd(cp_1, unit_vecs[k] * corner_width_1)
            cp_4 = rs.PointAdd(cp_0, rev_vector(unit_vecs[j]) * corner_width_2)
            cp_3 = find_intersection(cp_2, angle_vec(edges[k][0], edges[k][1], angle_1), cp_4, angle_vec(edges[j][0], edges[j][1], angle_2))

            # Create pentalateral polyline
            corner_polyline = [cp_0, cp_1, cp_2, cp_3, cp_4, cp_0]
            corner_parcels.append(rs.AddPolyline(corner_polyline))
            cp_vertices.append(corner_polyline)
            cp_config.append("pentalateral_2c")

            # Increment loop counter by 2
            i += 2



    ##############################
    """ SETTING THE SCENE TO CREATE GENERIC PARCELS """

    # Get distances between the corner parcels
    cp_distances = []

    for i in range(len(cp_vertices)):
        # For legibility of code
        j = (i-1) % len(cp_vertices) 
        k = (i+1) % len(cp_vertices)
        # Get start point of distance
        if cp_config[i] == "quadrilateral" or cp_config[i] == "pentalateral_1c":
            start_pt = cp_vertices[i][1]
        elif cp_config[i] == "pentalateral_2c":
            start_pt = cp_vertices[i][2]
        # Get end point of distance
        if cp_config[k] == "quadrilateral":
            end_pt = cp_vertices[k][3]
        elif cp_config[k] == "pentalateral_1c" or cp_config[k] == "pentalateral_2c":
            end_pt = cp_vertices[k][4]
        # Get distance
        distance = rs.Distance(start_pt, end_pt)
        cp_distances.append(distance)

    # Get generic parcel indentation count based upon indentation_reference_length
    gp_indentation_count = []

    # Get generic parcel counts based upon minimum and maximum gp_lengths
    gp_on_edge_count = []

    for cp_distance in cp_distances:

        # Get a random value in the lower and upper bound of gp_lengths
        length_dom_low = int(random.uniform(gp_lengths_domain[0] + (gp_lengths_mean - gp_lengths_domain[0])*(3/4), gp_lengths_mean))
        length_dom_upper = int(random.uniform(gp_lengths_mean, gp_lengths_domain[1] - (gp_lengths_domain[1] - gp_lengths_mean)*(3/4)))

        # Create bounds (these are somewhat arbitrary)
        indentation_ref_lower_bound = int(random.uniform(length_dom_low, indentation_reference_length * 0.8))
        indentation_ref_upper_bound = int(random.uniform(indentation_reference_length * 1.2, length_dom_upper))

        # Get generic parcel counts
        ref_length_gp_counts = random.choice([length_dom_low, length_dom_upper])
        
        # Ensure ref_length_gp_counts is smaller than cp_distance to avoid excessive counts
        if ref_length_gp_counts >= cp_distance:
            ref_length_gp_counts = cp_distance * 0.9  # Ensure it's a bit smaller than cp_distance
        
        gp_count = max(1, cp_distance // ref_length_gp_counts)  # Ensure minimum gp_count is 1
        gp_on_edge_count.append(int(gp_count))
        
        # Get indentation counts
        ref_length_indentation = round(random.uniform(indentation_ref_lower_bound, indentation_ref_upper_bound), 2)
        
        # Ensure ref_length_indentation is smaller than cp_distance to avoid negative indentation count
        if ref_length_indentation >= cp_distance:
            ref_length_indentation = cp_distance * 0.8  # Ensure it's a bit smaller than cp_distance

        if ref_length_indentation != 0: 
            indentation_count = cp_distance // ref_length_indentation
        else:
            indentation_count = 2
        
        # Avoid negative indentation count and ensure it doesn't exceed gp_count
        if indentation_count > (gp_count - 1):
            gp_indentation_count.append(int(gp_count - 1))
        else:
            gp_indentation_count.append(int(max(0, indentation_count)))


    # Ensure no overlap between the adjacent edges:
    control_cp_distance = min(cp_distances)/2
    if (control_cp_distance) < gp_widths_domain[1]:
        gp_widths_domain_cap = round(control_cp_distance*(3/4), 2)
    else:
        gp_widths_domain_cap = gp_widths_domain[1]



    ##############################
    """ CREATE GENERIC PARCELS """

    # ASSIGN WIDTHS OF GENERIC PARCELS

    unbounded = random.choice([False, True])
    avoid_overlap = False
    last_dim_diff = 0

    # Iterate through all corner parcels
    for i in range(len(corner_parcels)):

        # For legibility of code
        j = (i+1) % len(corner_parcels) 

        # Avoid overlap in last chunck of generic parcel generation
        if i == (len(corner_parcels) - 1):
            unbounded = False

        # Apply start pointsand cp_angle_1 according to cp_config
        if cp_config[i] == "quadrilateral" or cp_config[i] == "pentalateral_1c":
            strip_start_pt_bot = cp_vertices[i][1]
            strip_start_pt_top = cp_vertices[i][2]
            cp_angle_1 = calculate_angle_between_lines(cp_vertices[i][2], cp_vertices[i][1], cp_vertices[i][3])
            if cp_config[i] == "quadrilateral":
                cp_angle_3 = calculate_angle_between_lines(cp_vertices[i][0], cp_vertices[i][1], cp_vertices[i][3])
        elif cp_config[i] == "pentalateral_2c":
            strip_start_pt_bot = cp_vertices[i][2]
            strip_start_pt_top = cp_vertices[i][3]
            cp_angle_1 = calculate_angle_between_lines(cp_vertices[i][3], cp_vertices[i][2], cp_vertices[i][4])

        # Apply end points and cp_angle_2 according to cp_config
        if cp_config[j] == "quadrilateral":
            strip_end_pt_bot = cp_vertices[j][3]
            strip_end_pt_top = cp_vertices[j][2]
            cp_angle_2 = calculate_angle_between_lines(cp_vertices[j][2], cp_vertices[j][1], cp_vertices[j][3])
        elif cp_config[j] == "pentalateral_1c" or cp_config[j] == "pentalateral_2c":
            strip_end_pt_bot = cp_vertices[j][4]
            strip_end_pt_top = cp_vertices[j][3]
            cp_angle_2 = calculate_angle_between_lines(cp_vertices[j][3], cp_vertices[j][2], cp_vertices[j][4])

        # Create the geometric domain, in which the generic parcels can be generated (strips)
        strip_length_bot = rs.Distance(strip_start_pt_bot, strip_end_pt_bot)
        strip_length_top = rs.Distance(strip_start_pt_top, strip_end_pt_top)
        strip_width_1 = rs.Distance(strip_start_pt_bot, strip_start_pt_top)
        strip_width_2 = rs.Distance(strip_end_pt_bot, strip_end_pt_top)

        # Append first width separately (to avoid overlap)
        if cp_config[i] == "quadrilateral" and cp_angle_3 < 90:
            if strip_width_1 < strip_width_2:
                first_gp_width = strip_width_1
            else:
                first_gp_width = strip_width_2
        elif gp_indentation_count[i] == 0 and gp_widths_domain[0] > strip_width_2:
            first_gp_width = strip_width_2
        elif cp_angle_1 > 90:
            first_gp_width = strip_width_1
        elif cp_angle_1 <= 90 and cp_angle_2 <= 90 and avoid_overlap == False and i != (len(gp_indentation_count) - 1):
            first_gp_width = random.uniform(gp_widths_domain[0], gp_widths_domain_cap)
        else:
            first_gp_width = random.uniform(gp_widths_domain[0], strip_width_1)
        first_gp_length = find_matching_lengths(gp_dim_pairs, first_gp_width)
        if first_gp_length < last_dim_diff:
            first_gp_length = random.uniform(last_dim_diff, gp_lengths_domain[1])
        
        # Initialize generic parcel widths
        gp_widths = [first_gp_width] 

        # Append as many width values as the indentation count
        for indent in range(gp_indentation_count[i]):
            
            if unbounded == False:
                if indent == gp_indentation_count[i] - 1: 
                    if gp_widths_domain[0] > strip_width_2:
                        gp_widths.append(strip_width_2)
                    else:
                        gp_widths.append(random.uniform(gp_widths_domain[0], strip_width_2))
                elif strip_width_1 > strip_width_2:
                    gp_widths.append(random.uniform(gp_widths_domain[0], strip_width_2))
                else:
                    gp_widths.append(random.uniform(gp_widths_domain[0], strip_width_1))

            elif indent == gp_indentation_count[i] - 1:
                if gp_widths_domain[0] > strip_width_2:
                    gp_widths.append(strip_width_2)
                else:
                    gp_widths.append(random.uniform(gp_widths_domain[0], strip_width_2))

            elif cp_angle_1 > 90:         
                gp_random_width = round(random.gauss(gp_widths_mean, gp_widths_sd), 2)
                domain_control = cp_vertices[j][1].DistanceTo(cp_vertices[j][2]) + cp_vertices[j][2].DistanceTo(cp_vertices[j][3]) 
                if domain_control < gp_widths_domain_cap:
                    maximum_domain = domain_control
                elif domain_control >= gp_widths_domain_cap:
                    maximum_domain = gp_widths_domain_cap
                gp_width = max(gp_widths_domain[0], min(gp_random_width, maximum_domain), 2)
                gp_widths.append(round(max(first_gp_width, min(gp_width, maximum_domain)), 2)) # Clamp the random width to the domain

            elif cp_angle_1 < 90 or cp_angle_2 < 90:
                gp_widths.append(strip_width_1 if strip_width_1 > strip_width_2 else strip_width_2)
                unbounded = True

            else:
                gp_widths.append(round(random.uniform(gp_widths_domain[0],gp_widths_domain_cap), 2))

        # Pass over "avoid overlap" boolean for next loop
        last_width = gp_widths[len(gp_widths)-1]
        last_dim_diff = last_width - strip_width_2
        if last_dim_diff > 0:
            avoid_overlap = True
        
        # Every iteration shifts unbounded (to avoid overlap)
        unbounded = not unbounded

        # Make sure that no width falls below 5m
        for min_idx in range(len(gp_widths)-1):
            if gp_widths[min_idx] < 10:
                gp_widths[min_idx] = 10

        # Hard code the width if there is only one parcel
        if len(gp_widths) == 1:
            gp_widths = []
            if strip_width_1 <= strip_width_2:
                hardcoded_width = random.uniform(strip_width_1*(3/4), strip_width_1)
            else:
                hardcoded_width = random.uniform(strip_width_2*(3/4), strip_width_2) 
            gp_widths.append(hardcoded_width)


        # ASSIGN LENGHTS OF GENERIC PARCEL

        # Ensure that first gp length is long enough (to avoid overlap)
        if first_gp_length < last_dim_diff:
            first_gp_length = last_dim_diff

        # Create generic parcel lengths
        gp_lengths = [first_gp_length]

        # Append as many length values as the gp_on_edge_count
        for amount in range(gp_on_edge_count[i]-1):
            gp_random_length = round(random.gauss(gp_lengths_mean, gp_lengths_sd), 2)
            gp_length = max(gp_lengths_domain[0], min(gp_random_length, gp_lengths_domain[1]))
            gp_lengths.append(gp_length)

        # Adjust the generated parcel lengths to ensure their sum matches the length of strip_length_bot
        total_gp_length = sum(gp_lengths)
        scaling_factor = strip_length_bot / total_gp_length

        # Scale the lengths to match the total length of strip_length_bot
        gp_lengths_front = [gp_length * scaling_factor for gp_length in gp_lengths]

        # Clamp the values to ensure they fall within the domain
        for n in range(len(gp_lengths_front)):
            if gp_lengths_front[n] < gp_lengths_domain[0]:
                gp_lengths_front[n] = gp_lengths_domain[0]
            elif gp_lengths_front[n] > gp_lengths_domain[1]:
                gp_lengths_front[n] = gp_lengths_domain[1]
        total_length_after_adjustment = sum(gp_lengths_front)
        deviation = total_length_after_adjustment - strip_length_bot

        # Subtract deviation from the largest length in the list
        if deviation != 0:
            max_index = gp_lengths_front.index(max(gp_lengths_front))
            gp_lengths_front[max_index] -= deviation

        # Calculate proportions of parcel lengths to strip lengths and ensure same proportional distribution for strip rear end
        proportions = [length / strip_length_bot for length in gp_lengths_front]
        gp_lengths_back = [prop * strip_length_top for prop in proportions]


        # CONSTRUCT GENERIC PARCELS

        # Initialize vectors for parcel construction
        gp_vec_front = rg.Vector3d(strip_end_pt_bot.X - strip_start_pt_bot.X, strip_end_pt_bot.Y - strip_start_pt_bot.Y, 0)
        gp_vec_front.Unitize()
        gp_vec_back = rg.Vector3d(strip_end_pt_top.X - strip_start_pt_top.X, strip_end_pt_top.Y - strip_start_pt_top.Y, 0)
        gp_vec_back.Unitize()
        gp_vec_side_1 = rg.Vector3d(strip_start_pt_top.X - strip_start_pt_bot.X, strip_start_pt_top.Y - strip_start_pt_bot.Y, 0)
        gp_vec_side_1.Unitize()
        gp_vec_side_2 = rg.Vector3d(strip_end_pt_top.X - strip_end_pt_bot.X, strip_end_pt_top.Y - strip_end_pt_bot.Y, 0)
        gp_vec_side_2.Unitize()

        # Assign widths according to indentation count
        indentation_bool = [True] * (gp_indentation_count[i]) + [False] * ((gp_on_edge_count[i] - gp_indentation_count[i]) - 2)
        random.shuffle(indentation_bool)
        indentation_bool = [False] + indentation_bool + [False]
        assigned_widths = []
        idx = 0
        for n in range(gp_on_edge_count[i]):
            if indentation_bool[n] == True:
                idx = min(idx + 1, len(gp_widths) - 1)
            assigned_widths.append(gp_widths[idx])
        assigned_widths[0] = first_gp_width
        
        # Initialize lists to store cumulative lengths
        front_offset = 0
        back_offset = 0

        # Create generic parcels by iterating through the lengths
        for n in range(len(gp_lengths_front)):

            # If there is only one very slender generic parcel between corner parcels, skip that parcel
            if len(gp_lengths_front) == 1 and gp_lengths_front[n] < 5:
                continue

            # If the assigned width is smaller than 3, skip that generic parcel:
            if assigned_widths[n] < 3:
                continue

            # Calculate an interpolation factor based on the current offset:
            t_1 = front_offset / strip_length_bot
            # Interpolate the side vector between gp_vec_side_1 and gp_vec_side_2
            gp_vec_side_interpolated_1 = interpolate_vectors(gp_vec_side_1, gp_vec_side_2, t_1)

            # Calculate an interpolation factor based on the current offset:
            t_2 = (front_offset + gp_lengths_front[n]) / strip_length_bot
            # Interpolate the side vector between gp_vec_side_1 and gp_vec_side_2
            gp_vec_side_interpolated_2 = interpolate_vectors(gp_vec_side_1, gp_vec_side_2, t_2)

            # Calculate the back side reference point based on the assigned width from the gp_widths pool
            back_ref_pt = rs.PointAdd(strip_start_pt_bot, gp_vec_side_interpolated_2 * assigned_widths[n])

            # Calculate the points for the parcel based on the cumulative offsets
            front_start = rs.PointAdd(strip_start_pt_bot, gp_vec_front * front_offset)
            front_end = rs.PointAdd(strip_start_pt_bot, gp_vec_front * (front_offset + gp_lengths_front[n])) 
            back_start = rs.PointAdd(front_start, gp_vec_side_interpolated_1 * assigned_widths[n])
            back_end = rs.PointAdd(front_end, gp_vec_side_interpolated_2 * assigned_widths[n])
            test = back_start
            # back_end = rs.PointAdd(back_ref_pt, gp_vec_front * (back_offset + gp_lengths_back[n]))

            # Define the parcel points
            generic_parcel = [
                front_start,
                front_end,
                back_end,
                back_start,
                front_start
            ]

            # Add the polyline for the parcel
            generic_parcels.append(rs.AddPolyline(generic_parcel))

            # Update the offsets for the next parcel
            front_offset += gp_lengths_front[n]
            back_offset += gp_lengths_back[n]



    ###############
    """ OUTPUTS """

    # Append corner parcels and generic parcels, such that it can be read by building generation component
    all_parcel_list_for_bg = corner_parcels + generic_parcels
    all_parcels_building_generation.append(all_parcel_list_for_bg)

    # Append corner parcels and generic parcels to all parcels
    for cp in corner_parcels:
        all_parcels.append(cp)
    for gp in generic_parcels:
        all_parcels.append(gp)
# ---------- end parcel_generation ----------

# ----
# Random seed
number_slider_6 = Slider(27, range=0..100)
# ----
# PARCEL
# GENERATION
# PARCEL GENERATION
parcel_generation_2 = Python3Script(boundaries=boundaries_3, data_package=merge_data_package_3.merged_data_package, random_seed=number_slider_6)  # -> all_parcels, all_parcels_building_generation; inputs boundaries: list, data_package: list, random_seed: Int32
# ---------- parcel_generation_2: Python ----------
# Parcel Generation component

# Required inputs:
# 1. boundaries (closed polyline curve GUIDs, set input to list acces)
# 2. data_package (unique data structure, inherited from Block Analysis or Merge Parcel Data component. Set input to list access)
# 3. random_seed (integer)

import rhinoscriptsyntax as rs
import Rhino.Geometry as rg
import random
import math

#####################################################################################

""" FUNCTIONS"""

# Function to rotate two lists together
def rotate_list(lst):
    # Get a random index as the new starting point
    random_index = random.randint(0, len(lst) - 1)
    # Rotate the list using slicing
    rotated_list = lst[random_index:] + lst[:random_index]
    return rotated_list

# Function to find the closest first value in each nested list compared to a reference
def find_closest_values(nested_list, reference):
    closest_value = None
    closest_list = None
    min_difference = float('inf')  # Start with a very large value for comparison
    # Iterate over the nested lists
    for sublist in nested_list:
        first_value = sublist[0]  # Get the first value of the current nested list
        difference = abs(first_value - reference)  # Calculate the difference
        # Check if this is the smallest difference so far
        if difference < min_difference:
            min_difference = difference
            closest_value = first_value
            closest_list = sublist
    if closest_list:
        return closest_list[1:]  # Get the other two values from the closest list
    else:
        return None

# Function to calculate signed area to determine polygon orientation
def signed_area(vertices):
    area = 0.0
    n = len(vertices)
    for i in range(n):
        x1, y1, _ = vertices[i]
        x2, y2, _ = vertices[(i + 1) % n]
        area += (x1 * y2 - x2 * y1)
    return area / 2.0

# Function to create unitized vectors refering to the (counter-clockwise) direction of each edge
def compute_vector(edge):
    edge_vector = rs.VectorUnitize(rs.VectorCreate(edge[1], edge[0]))
    return edge_vector

# Function to reverse any vector
def rev_vector(vector):
    reversed_vector = rs.VectorScale(vector, -1)
    return reversed_vector

# Function to get input angle vector
def angle_vec(start_point, end_point, angle):
    direction_vector = rg.Vector3d(end_point.X - start_point.X, end_point.Y - start_point.Y, 0)
    arg = math.radians(angle)
    rotated_x = direction_vector.X * math.cos(arg) - direction_vector.Y * math.sin(arg)
    rotated_y = direction_vector.X * math.sin(arg) + direction_vector.Y * math.cos(arg)
    angle_vector = rg.Vector3d(rotated_x, rotated_y, 0)
    angle_vector.Unitize()
    return angle_vector

# Function to interpolate between two vectors
def interpolate_vectors(vec1, vec2, t):
    interpolated_vec = rg.Vector3d(
        (1 - t) * vec1.X + t * vec2.X,
        (1 - t) * vec1.Y + t * vec2.Y,
        (1 - t) * vec1.Z + t * vec2.Z
    )
    interpolated_vec.Unitize()
    return interpolated_vec

# Function to receive intersection point of two vectors
def find_intersection(start_pt_1, vec_1, start_pt_2, vec_2):
    # Solve for t and s such that start_pt_1 + t*vec_1 = start_pt_2 + s*vec_2
    denom = vec_1.X * vec_2.Y - vec_1.Y * vec_2.X
    if denom == 0:
        return None  # Parallel lines, no intersection
    t = ((start_pt_2.X - start_pt_1.X) * vec_2.Y - (start_pt_2.Y - start_pt_1.Y) * vec_2.X) / denom
    s = ((start_pt_2.X - start_pt_1.X) * vec_1.Y - (start_pt_2.Y - start_pt_1.Y) * vec_1.X) / denom
    intersection = rg.Point3d(start_pt_1.X + t * vec_1.X, start_pt_1.Y + t * vec_1.Y, 0)
    return intersection

# Function to check polyline intersection
def check_polyline_intersection(polyline1, polyline2):
    curve1 = polyline1.ToNurbsCurve()  # Convert the polylines to curve objects
    curve2 = polyline2.ToNurbsCurve()
    intersection_events = rg.Intersect.Intersection.CurveCurve(curve1, curve2, 0.001, 0.0) # Check for curve-curve intersection
    if intersection_events.Count > 0:
        return True # If any intersections are found, return True
    else:
        return False # Otherwise, return False

def calculate_if_angle_between_edges_is_smaller_than_110(unit_vec_1, unit_vec_2): 
    dot_product = rg.Vector3d.Multiply(unit_vec_1, unit_vec_2)  # Compute the dot product
    dot_product = max(min(dot_product, 1.0), -1.0)  # Clamp the value to avoid numerical issues
    # Compute the angle in radians
    angle_radians = math.acos(dot_product)
    # Convert the angle to degrees
    angle_degrees = math.degrees(angle_radians)
    if angle_degrees < 110:
        return True  # Angle is smaller than 110°
    else:
        return False  # Angle is 110° or larger

def calculate_angle_between_edges(unit_vec_1, unit_vec_2): 
    dot_product = rg.Vector3d.Multiply(unit_vec_1, unit_vec_2)  # Compute the dot product
    dot_product = max(min(dot_product, 1.0), -1.0)  # Clamp the value to avoid numerical issues
    # Compute the angle in radians
    angle_radians = math.acos(dot_product)
    # Convert the angle to degrees
    angle_degrees = math.degrees(angle_radians)
    return angle_degrees 

# Function to  clamp value to stay within the given range [min_val, max_val].
def clamp(value, min_val, max_val):
    return max(min(value, max_val), min_val)

# Function to Apply a slight deviation to values in the local domain while ensuring they stay within the global domain.
def apply_deviation_within_domain(global_domain, local_domain, deviation_percentage=0.1):
    # Unpack global and local domains
    min_global, max_global = global_domain
    min_local, max_local = local_domain
    # Calculate the allowable deviation as a percentage of the local domain range
    deviation_range = (max_local - min_local) * deviation_percentage
    # Apply random deviation to the local domain values
    new_min = min_local + random.uniform(-deviation_range, deviation_range)
    new_max = max_local + random.uniform(-deviation_range, deviation_range)
    # Ensure the new values stay within the global domain by clamping
    new_min = clamp(new_min, min_global, max_global)
    new_max = clamp(new_max, min_global, max_global)
    return new_min, new_max

# Function to find corresponding dimensions
def find_matching_lengths(pairs, width):
    # Define tolerance (10% of difference max and min)
    widths = [pair[1] for pair in pairs]
    max_width = max(widths)
    min_width = min(widths)
    tolerance = 0.1*(max_width - min_width)
    # Define the domain around the random width (± tolerance)
    lower_bound = width - tolerance
    upper_bound = width + tolerance
    # Filter the pairs where the length is within the domain
    matching_pairs = [pair for pair in pairs if lower_bound <= pair[1] <= upper_bound]
    # If there are no matching pairs, random choice
    if not matching_pairs:
        selected_pair = random.choice(pairs)
        return selected_pair[0]
    else:
        # Randomly select one of the matching pairs and return the corresponding width
        selected_pair = random.choice(matching_pairs)
        # Return the matching lenght
        return selected_pair[0]

# Function to calculate the angle between 2 lines
def calculate_angle_between_lines(point_start, point_end1, point_end2):
    # Define the vectors based on the starting point and endpoints
    vector1 = [point_end1[0] - point_start[0], point_end1[1] - point_start[1]]
    vector2 = [point_end2[0] - point_start[0], point_end2[1] - point_start[1]]
    # Calculate the dot product of the two vectors
    dot_product = vector1[0] * vector2[0] + vector1[1] * vector2[1]
    # Calculate the magnitudes (lengths) of the two vectors
    magnitude1 = math.sqrt(vector1[0]**2 + vector1[1]**2)
    magnitude2 = math.sqrt(vector2[0]**2 + vector2[1]**2)
    # Calculate the cosine of the angle
    cos_theta = dot_product / (magnitude1 * magnitude2)
    # Calculate the angle in radians
    angle_radians = math.acos(cos_theta)
    # Convert the angle to degrees (optional)
    angle_degrees = math.degrees(angle_radians)
    return angle_degrees

#####################################################################################

# SHORTCUTS FOR LEGIBILITY:
# generic_parcels: "gp"
# corner_parcels: "gp"

###################################
""" INPUTS, LISTS AND CONSTANTS """

# Boundary curves are the input
boundary_curves = boundaries

# Set tolerance for geometric comparison
tolerance = 1e-5

# Set the random seed to ensure reproducible results
random.seed(random_seed)

# Initialize output
all_parcels = []
all_parcels_building_generation = []

##########################
""" SETTING THE SCENE """

for boundary_curve in boundary_curves:

    # Boundary curve input
    boundary_curve = rs.coercecurve(boundary_curve)  
    boundary_area = rs.CurveArea(boundary_curve)
    boundary_area = round(boundary_area[0],2)

    # Create scalar for input data
    reference_area = data_package[24]
    scalar_area = boundary_area / reference_area
    scalar = round(math.sqrt(scalar_area),2)

    # Data package input and varialble initialization
    if data_package is not None:
        corner_parcel_type = data_package[0]
        corner_dim = rg.Interval(scalar * data_package[3], scalar * data_package[4])
        if len(data_package[8]) == 1:
            gp_lengths_mean = scalar * data_package[7]
            gp_lengths_domain = rg.Interval(scalar * data_package[8][0], scalar * data_package[9])
            gp_lengths_sd = data_package[10]
            indentation_reference_length = data_package[21]
        if len(data_package[8]) > 1:
            r_idx = random.choice([0, len(data_package[8])-1])
            gp_lengths_mean = data_package[7][r_idx]
            gp_lengths_domain = rg.Interval(data_package[8][r_idx], data_package[9][r_idx])
            gp_lengths_sd = data_package[10][r_idx]
            indentation_reference_length = data_package[21][r_idx]
        gp_widths_mean = scalar * data_package[11]
        gp_widths_domain = rg.Interval(scalar * data_package[12], scalar * data_package[13])
        gp_widths_sd = data_package[14]
        gp_count_per_edge = data_package[15]
        indentation_count = data_package[16]
        gp_dim_pairs = data_package[17]
        gp_dim_pairs = [[round(x * scalar,1) for x in pairs] for pairs in gp_dim_pairs]
        cp_dim_pairs = data_package[20]
        cp_dim_pairs = [[round(x * (scalar + (1-scalar)/2),1) for x in pairs] for pairs in cp_dim_pairs]
        penta_threshold = 20
        cp_angles = data_package[23]
    else:
        print("Analysis data package is required as input.")


    # Initialize lists to store data and geometry
    generic_parcels = []
    corner_parcels = []
    cp_vertices = []
    cp_config = []


    ###################################
    """ BOUNDARY POLYGON DISSECTION """

    # Get the boundary polygon edges and vertices
    boundary_pts = rs.PolylineVertices(boundary_curve)
    if len(boundary_pts) < 4:
        raise ValueError("Invalid Boundary, must have at least three vertices")
    if boundary_pts[0] != boundary_pts[len(boundary_pts)-1]:
        raise ValueError("Boundary Polygon must be a closed Polyline Curve")

    # Ensure counter-clockwise order for consistent polyline construction
    if signed_area(boundary_pts) < 0:
        boundary_pts.reverse()  # Reverse the order to make it counter-clockwise

    # Create a list of edges (based on boundary point index)
    edges = [(boundary_pts[i], boundary_pts[(i + 1) % len(boundary_pts)]) for i in range(len(boundary_pts) - 1)]

    # Cap the corner dimension domain, if it is larger than two thirds of the shortest edge
    edge_lengths = []
    for edge in edges:
        length = edge[0].DistanceTo(edge[1])
        edge_lengths.append(length)

    # Create unit vectors, to ensure accurate geometric operations according to the boundary edge vectors.
    unit_vecs = []
    for i in range(len(boundary_pts)-1):
        unit_vecs.append(compute_vector(edges[i]))

    # Split corner dim lists
    cp_dim_duo = []
    cp_dim_trio = []

    # Iterate over the original list and sort based on the length of each nested list
    for dimension_pair in cp_dim_pairs:
        if len(dimension_pair) == 3:
            cp_dim_trio.append(dimension_pair)
        elif len(dimension_pair) == 2:
            cp_dim_duo.append(dimension_pair)


    ##############################
    """ CREATE CORNER PARCELS """

    # Configurations for while loop
    i = 0 # Initialize the loop counter i
    max_iterations = len(boundary_pts) * 2  # Allow for double the length of boundary points as a safeguard
    safeguard = 0 #  Initialize safeguard to prevent infinite loops
    first_iteration = True
    stored_width = 0

    # Iterate over each corner
    while i < (len(boundary_pts)-1) and safeguard < max_iterations:
        
        # Increment safeguard to track progress
        safeguard += 1

        # For legibility of code
        j = (i-1) % len(edges) 
        k = (i+1) % len(edges)

        if first_iteration:
            control_dist = edges[j][0].DistanceTo(edges[j][1])
            if control_dist <= penta_threshold:
                first_iteration = False
                continue
            else:
                first_iteration = False

        # Establish edge distances
        edge_distance_1 = edges[i][0].DistanceTo(edges[i][1])
        edge_distance_2 = edges[j][0].DistanceTo(edges[j][1])
        edge_distance_3 = edges[k][0].DistanceTo(edges[k][1])  

        # Get relevant angles of boundary polygon
        bp_angle = calculate_angle_between_edges(rev_vector(unit_vecs[j]), unit_vecs[i])

        # Assign corner config based upon threshold
        control_dist = edges[i][0].DistanceTo(edges[i][1])
        
        if control_dist > penta_threshold:
            corner_parcel_type = "quadrilateral"
            
        elif control_dist <= penta_threshold:
            corner_parcel_type = "pentalateral"
            
        # Get relevant angle of boundary polygon
        bp_angle = calculate_angle_between_edges(rev_vector(unit_vecs[j]), unit_vecs[i])

        # Create quadrilateral corner parcel
        if corner_parcel_type == "quadrilateral" and bp_angle <= 130: 
            
            # Get relevant angles of boundary polygon
            bp_angle = calculate_angle_between_edges(rev_vector(unit_vecs[j]), unit_vecs[i])

            # Generate random width and height for each corner parcel based upon the corner dimensions
            cp_dim_choice = random.choice(cp_dim_duo)
            cp_dim_local = rg.Interval(cp_dim_choice[0], cp_dim_choice[1])
 
            # If assigned domain exceeds half of edges dimensions, cap the width
            corner_width_1, corner_width_2 = apply_deviation_within_domain(corner_dim, cp_dim_local, deviation_percentage=0.25)
            if edge_distance_1/2 < corner_width_1:
                corner_width_1 = round(random.uniform(edge_distance_1 * (1/4), edge_distance_1 * (1/3)))
            elif edge_distance_2/2 < corner_width_2:
                corner_width_2 = round(random.uniform(edge_distance_2 * (1/4), edge_distance_2 * (1/3)))

            # Get angles
            r = random.randint(0, (len(cp_angles)-1))
            angle_1 = cp_angles[r][0]
            angle_2 = cp_angles[r][1]

            # Avoid overlap if angle is very acute
            if bp_angle < 60:
                angle_1 = 90
                angle_2 = 90
                if corner_width_2 > corner_width_1:
                    corner_width_1 = corner_width_2
                else:
                    corner_width_2 = corner_width_1

            elif bp_angle >= 60 and bp_angle <= 80:
                angle_1 = 90
                angle_2 = 90
                if corner_width_1 > corner_width_2:
                    corner_width_2 = random.uniform(corner_width_1 * 0.7, corner_width_1 * 0.9)
                else:
                    corner_width_1 = random.uniform(corner_width_2 * 0.7, corner_width_2 * 0.9)


            # Adjust corner parcel angles if boundary polygon angle is obtuse
            if bp_angle >= 100:
                angle_correction = (bp_angle - random.uniform(85, 95)) * 0.5
                angle_2 = angle_2 - angle_correction
                     
            # Control stored width
            if corner_width_2 > edge_distance_1 - stored_width:
                corner_width_2 = stored_width                     
            
            # Construct polyline vertices
            cp_0 = edges[i][0] 
            cp_1 = rs.PointAdd(cp_0, unit_vecs[i] * corner_width_1)
            cp_3 = rs.PointAdd(cp_0, rev_vector(unit_vecs[j]) * corner_width_2)
            cp_2 = find_intersection(cp_1, angle_vec(edges[i][0], edges[i][1], angle_1), cp_3, angle_vec(edges[j][0], edges[j][1], angle_2))

            # Create quadrilateral polyline
            corner_polyline = [cp_0, cp_1, cp_2, cp_3, cp_0]
            corner_parcels.append(rs.AddPolyline(corner_polyline))
            cp_vertices.append(corner_polyline)
            cp_config.append("quadrilateral")

            # Increment loop counter by 1
            i += 1

            # Store width to compare in next iteration
            stored_width = corner_width_1

        # Create pentalateral corner parcels if angle is larger than 130°
        elif corner_parcel_type == "quadrilateral" and bp_angle > 130:

            # If assigned domain exceeds half of edges dimensions, cap the width
            corner_width_1, corner_width_2 = apply_deviation_within_domain(corner_dim, cp_dim_local, deviation_percentage=0.25)
            if edge_distance_1/2 < corner_width_1:
                corner_width_1 = round(random.uniform(edge_distance_1 * (1/4), edge_distance_1 * (1/3)))
            elif edge_distance_2/2 < corner_width_2:
                corner_width_2 = round(random.uniform(edge_distance_2 * (1/4), edge_distance_2 * (1/3)))
            corner_height, corner_height_2 = apply_deviation_within_domain(corner_dim, cp_dim_local, deviation_percentage=0.25)

            # Check if height is larger than 1/2 of the shortest edge distance
            min_edge_length = min(edge_lengths)
            if corner_height > (1/2)*min_edge_length:
                corner_height = random.uniform((1/3)*min_edge_length, (1/2)*min_edge_length)

            # Get angles
            r = random.randint(0, (len(cp_angles)-1))
            angle_1 = cp_angles[r][0]
            angle_2 = cp_angles[r][1]

            # Construct polyline vertices
            cp_0 = edges[i][0]
            cp_1 = rs.PointAdd(cp_0, unit_vecs[i] * corner_width_1)
            cp_2 = rs.PointAdd(cp_1, angle_vec(edges[i][0], edges[i][1], angle_1) * corner_height)
            cp_4 = rs.PointAdd(cp_0, rev_vector(unit_vecs[j]) * corner_width_2)
            cp_3 = rs.PointAdd(cp_4, angle_vec(edges[j][0], edges[j][1], angle_2) * corner_height)

            # Determine possible intersection(s) to ensure appropriate geometry of corner parcel
            control_curve_1 = rg.Polyline([cp_1, cp_2]).ToNurbsCurve() 
            control_curve_2 = rg.Polyline([cp_3, cp_4]).ToNurbsCurve()
            intersection = rg.Intersect.Intersection.CurveCurve(control_curve_1, control_curve_2, tolerance, tolerance)

            # If the curves do not intersect, create pentalateral corner parcel
            if intersection.Count == 0:
                corner_polyline = [cp_0, cp_1, cp_2, cp_3, cp_4, cp_0]
                corner_parcels.append(rs.AddPolyline(corner_polyline)) # Construct current iteration of corner
                cp_vertices.append(corner_polyline)
                cp_config.append("pentalateral_1c")
                test = cp_0

            # If they intersect (since corner_height is too large) create quadrilateral parcel instead, even if the boundary edges' angle is obtuse
            elif intersection[0].IsPoint:
                cp_2 = intersection[0].PointA
                cp_3 = cp_4  # Adjust index, so that it is consistent with the other quadrilateral corner parcels
                corner_polyline = [cp_0, cp_1, cp_2, cp_3, cp_0]
                corner_parcels.append(rs.AddPolyline(corner_polyline))
                cp_vertices.append(corner_polyline)
                cp_config.append("quadrilateral")  

            # Increment loop counter by 1
            i += 1


        # Create pentalateral corner parcel
        elif corner_parcel_type == "pentalateral":

            # Get relevant angles of boundary polygon
            bp_angle_1 = calculate_angle_between_edges(rev_vector(unit_vecs[j]), unit_vecs[i])
            bp_angle_2 = calculate_angle_between_edges(rev_vector(unit_vecs[i]), unit_vecs[k])

            # Generate random width and height for each corner parcel based upon the corner dimensions
            # Establish reference with control distance (and look in cp dim trios)
            if not cp_dim_trio:
                corresponding_dim = find_closest_values(cp_dim_duo, control_dist)
                cp_dim_choice = random.choice(cp_dim_duo)
                cp_dim_local = rg.Interval(cp_dim_choice[0] / scalar,  cp_dim_choice[1] / scalar)
            else:
                corresponding_dim = find_closest_values(cp_dim_trio, control_dist)
                cp_dim_local = rg.Interval(corresponding_dim[0], corresponding_dim[1])
            
            corner_width_1, corner_width_2 = apply_deviation_within_domain(corner_dim, cp_dim_local, deviation_percentage=0.3)

            # Adjust dimensions according to edge distance
            if corner_width_1 < edge_distance_1/2:
                corner_width_1 = random.uniform(edge_distance_1 * (1/2), edge_distance_1*(3/4))
            if corner_width_2 < edge_distance_1/2:
                corner_width_2 = random.uniform(edge_distance_1 * (1/2), edge_distance_1*(3/4))

            # Make sure that the widths don't deviate too much from each other
            corner_width_2 = random.uniform(corner_width_1 * 0.8, corner_width_2 * 1.2)

            # Adjust widths corresponding to angle deviation for reasonable results
            if bp_angle_1 > 90:
                corner_ratio = 90/bp_angle_1
                corner_width_2 *= corner_ratio
                corner_width_1 = corner_width_2 * (1 + (1-corner_ratio))
            if bp_angle_2 > 90:
                corner_ratio = 90/bp_angle_2
                print(corner_ratio)
                corner_width_1 *= corner_ratio
                corner_width_2 = corner_width_1 * (1 + (1-corner_ratio))

            # Get angles
            r = random.randint(0, (len(cp_angles)-1))
            angle_1 = cp_angles[r][0]
            angle_2 = cp_angles[r][1]

            # Construct polyline vertices
            cp_0 = edges[i][0]
            cp_1 = edges[i][1]
            cp_2 = rs.PointAdd(cp_1, unit_vecs[k] * corner_width_1)
            cp_4 = rs.PointAdd(cp_0, rev_vector(unit_vecs[j]) * corner_width_2)
            cp_3 = find_intersection(cp_2, angle_vec(edges[k][0], edges[k][1], angle_1), cp_4, angle_vec(edges[j][0], edges[j][1], angle_2))

            # Create pentalateral polyline
            corner_polyline = [cp_0, cp_1, cp_2, cp_3, cp_4, cp_0]
            corner_parcels.append(rs.AddPolyline(corner_polyline))
            cp_vertices.append(corner_polyline)
            cp_config.append("pentalateral_2c")

            # Increment loop counter by 2
            i += 2



    ##############################
    """ SETTING THE SCENE TO CREATE GENERIC PARCELS """

    # Get distances between the corner parcels
    cp_distances = []

    for i in range(len(cp_vertices)):
        # For legibility of code
        j = (i-1) % len(cp_vertices) 
        k = (i+1) % len(cp_vertices)
        # Get start point of distance
        if cp_config[i] == "quadrilateral" or cp_config[i] == "pentalateral_1c":
            start_pt = cp_vertices[i][1]
        elif cp_config[i] == "pentalateral_2c":
            start_pt = cp_vertices[i][2]
        # Get end point of distance
        if cp_config[k] == "quadrilateral":
            end_pt = cp_vertices[k][3]
        elif cp_config[k] == "pentalateral_1c" or cp_config[k] == "pentalateral_2c":
            end_pt = cp_vertices[k][4]
        # Get distance
        distance = rs.Distance(start_pt, end_pt)
        cp_distances.append(distance)

    # Get generic parcel indentation count based upon indentation_reference_length
    gp_indentation_count = []

    # Get generic parcel counts based upon minimum and maximum gp_lengths
    gp_on_edge_count = []

    for cp_distance in cp_distances:

        # Get a random value in the lower and upper bound of gp_lengths
        length_dom_low = int(random.uniform(gp_lengths_domain[0] + (gp_lengths_mean - gp_lengths_domain[0])*(3/4), gp_lengths_mean))
        length_dom_upper = int(random.uniform(gp_lengths_mean, gp_lengths_domain[1] - (gp_lengths_domain[1] - gp_lengths_mean)*(3/4)))

        # Create bounds (these are somewhat arbitrary)
        indentation_ref_lower_bound = int(random.uniform(length_dom_low, indentation_reference_length * 0.8))
        indentation_ref_upper_bound = int(random.uniform(indentation_reference_length * 1.2, length_dom_upper))

        # Get generic parcel counts
        ref_length_gp_counts = random.choice([length_dom_low, length_dom_upper])
        
        # Ensure ref_length_gp_counts is smaller than cp_distance to avoid excessive counts
        if ref_length_gp_counts >= cp_distance:
            ref_length_gp_counts = cp_distance * 0.9  # Ensure it's a bit smaller than cp_distance
        
        gp_count = max(1, cp_distance // ref_length_gp_counts)  # Ensure minimum gp_count is 1
        gp_on_edge_count.append(int(gp_count))
        
        # Get indentation counts
        ref_length_indentation = round(random.uniform(indentation_ref_lower_bound, indentation_ref_upper_bound), 2)
        
        # Ensure ref_length_indentation is smaller than cp_distance to avoid negative indentation count
        if ref_length_indentation >= cp_distance:
            ref_length_indentation = cp_distance * 0.8  # Ensure it's a bit smaller than cp_distance

        if ref_length_indentation != 0: 
            indentation_count = cp_distance // ref_length_indentation
        else:
            indentation_count = 2
        
        # Avoid negative indentation count and ensure it doesn't exceed gp_count
        if indentation_count > (gp_count - 1):
            gp_indentation_count.append(int(gp_count - 1))
        else:
            gp_indentation_count.append(int(max(0, indentation_count)))


    # Ensure no overlap between the adjacent edges:
    control_cp_distance = min(cp_distances)/2
    if (control_cp_distance) < gp_widths_domain[1]:
        gp_widths_domain_cap = round(control_cp_distance*(3/4), 2)
    else:
        gp_widths_domain_cap = gp_widths_domain[1]



    ##############################
    """ CREATE GENERIC PARCELS """

    # ASSIGN WIDTHS OF GENERIC PARCELS

    unbounded = random.choice([False, True])
    avoid_overlap = False
    last_dim_diff = 0

    # Iterate through all corner parcels
    for i in range(len(corner_parcels)):

        # For legibility of code
        j = (i+1) % len(corner_parcels) 

        # Avoid overlap in last chunck of generic parcel generation
        if i == (len(corner_parcels) - 1):
            unbounded = False

        # Apply start pointsand cp_angle_1 according to cp_config
        if cp_config[i] == "quadrilateral" or cp_config[i] == "pentalateral_1c":
            strip_start_pt_bot = cp_vertices[i][1]
            strip_start_pt_top = cp_vertices[i][2]
            cp_angle_1 = calculate_angle_between_lines(cp_vertices[i][2], cp_vertices[i][1], cp_vertices[i][3])
        elif cp_config[i] == "pentalateral_2c":
            strip_start_pt_bot = cp_vertices[i][2]
            strip_start_pt_top = cp_vertices[i][3]
            cp_angle_1 = calculate_angle_between_lines(cp_vertices[i][3], cp_vertices[i][2], cp_vertices[i][4])

        # Apply end points and cp_angle_2 according to cp_config
        if cp_config[j] == "quadrilateral":
            strip_end_pt_bot = cp_vertices[j][3]
            strip_end_pt_top = cp_vertices[j][2]
            cp_angle_2 = calculate_angle_between_lines(cp_vertices[j][2], cp_vertices[j][1], cp_vertices[j][3])
        elif cp_config[j] == "pentalateral_1c" or cp_config[j] == "pentalateral_2c":
            strip_end_pt_bot = cp_vertices[j][4]
            strip_end_pt_top = cp_vertices[j][3]
            cp_angle_2 = calculate_angle_between_lines(cp_vertices[j][3], cp_vertices[j][2], cp_vertices[j][4])

        # Create the geometric domain, in which the generic parcels can be generated (strips)
        strip_length_bot = rs.Distance(strip_start_pt_bot, strip_end_pt_bot)
        strip_length_top = rs.Distance(strip_start_pt_top, strip_end_pt_top)
        strip_width_1 = rs.Distance(strip_start_pt_bot, strip_start_pt_top)
        strip_width_2 = rs.Distance(strip_end_pt_bot, strip_end_pt_top)

        # Append first width separately (to avoid overlap)
        if gp_indentation_count[i] == 0 and gp_widths_domain[0] > strip_width_2:
            first_gp_width = strip_width_2
        elif cp_angle_1 > 90:
            first_gp_width = strip_width_1
        elif cp_angle_1 <= 90 and cp_angle_2 <= 90 and avoid_overlap == False and i != (len(gp_indentation_count) - 1):
            first_gp_width = random.uniform(gp_widths_domain[0], gp_widths_domain_cap)
        else:
            first_gp_width = random.uniform(gp_widths_domain[0], strip_width_1)
        first_gp_length = find_matching_lengths(gp_dim_pairs, first_gp_width)
        if first_gp_length < last_dim_diff:
            first_gp_length = random.uniform(last_dim_diff, gp_lengths_domain[1])
        
        # Initialize generic parcel widths
        gp_widths = [first_gp_width] 

        # Append as many width values as the indentation count
        for indent in range(gp_indentation_count[i]):
            
            if unbounded == False:
                if indent == gp_indentation_count[i] - 1: 
                    if gp_widths_domain[0] > strip_width_2:
                        gp_widths.append(strip_width_2)
                    else:
                        gp_widths.append(random.uniform(gp_widths_domain[0], strip_width_2))
                elif strip_width_1 > strip_width_2:
                    gp_widths.append(random.uniform(gp_widths_domain[0], strip_width_2))
                else:
                    gp_widths.append(random.uniform(gp_widths_domain[0], strip_width_1))

            elif indent == gp_indentation_count[i] - 1:
                if gp_widths_domain[0] > strip_width_2:
                    gp_widths.append(strip_width_2)
                else:
                    gp_widths.append(random.uniform(gp_widths_domain[0], strip_width_2))

            elif cp_angle_1 > 90:         
                gp_random_width = round(random.gauss(gp_widths_mean, gp_widths_sd), 2)
                domain_control = cp_vertices[j][1].DistanceTo(cp_vertices[j][2]) + cp_vertices[j][2].DistanceTo(cp_vertices[j][3]) 
                if domain_control < gp_widths_domain_cap:
                    maximum_domain = domain_control
                elif domain_control >= gp_widths_domain_cap:
                    maximum_domain = gp_widths_domain_cap
                gp_width = max(gp_widths_domain[0], min(gp_random_width, maximum_domain), 2)
                gp_widths.append(round(max(first_gp_width, min(gp_width, maximum_domain)), 2)) # Clamp the random width to the domain

            elif cp_angle_1 < 90 or cp_angle_2 < 90:
                gp_widths.append(strip_width_1 if strip_width_1 > strip_width_2 else strip_width_2)
                unbounded = True

            else:
                gp_widths.append(round(random.uniform(gp_widths_domain[0],gp_widths_domain_cap), 2))

        # Pass over "avoid overlap" boolean for next loop
        last_width = gp_widths[len(gp_widths)-1]
        last_dim_diff = last_width - strip_width_2
        if last_dim_diff > 0:
            avoid_overlap = True
        
        # Every iteration shifts unbounded (to avoid overlap)
        unbounded = not unbounded

        # Make sure that no width falls below 5m
        for min_idx in range(len(gp_widths)-1):
            if gp_widths[min_idx] < 10:
                gp_widths[min_idx] = 10

        # Hard code the width if there is only one parcel
        if len(gp_widths) == 1:
            gp_widths = []
            if strip_width_1 <= strip_width_2:
                hardcoded_width = random.uniform(strip_width_1*(3/4), strip_width_1)
            else:
                hardcoded_width = random.uniform(strip_width_2*(3/4), strip_width_2) 
            gp_widths.append(hardcoded_width)


        # ASSIGN LENGHTS OF GENERIC PARCEL

        # Ensure that first gp length is long enough (to avoid overlap)
        if first_gp_length < last_dim_diff:
            first_gp_length = last_dim_diff

        # Create generic parcel lengths
        gp_lengths = [first_gp_length]

        # Append as many length values as the gp_on_edge_count
        for amount in range(gp_on_edge_count[i]-1):
            gp_random_length = round(random.gauss(gp_lengths_mean, gp_lengths_sd), 2)
            gp_length = max(gp_lengths_domain[0], min(gp_random_length, gp_lengths_domain[1]))
            gp_lengths.append(gp_length)

        # Adjust the generated parcel lengths to ensure their sum matches the length of strip_length_bot
        total_gp_length = sum(gp_lengths)
        scaling_factor = strip_length_bot / total_gp_length

        # Scale the lengths to match the total length of strip_length_bot
        gp_lengths_front = [gp_length * scaling_factor for gp_length in gp_lengths]

        # Clamp the values to ensure they fall within the domain
        for n in range(len(gp_lengths_front)):
            if gp_lengths_front[n] < gp_lengths_domain[0]:
                gp_lengths_front[n] = gp_lengths_domain[0]
            elif gp_lengths_front[n] > gp_lengths_domain[1]:
                gp_lengths_front[n] = gp_lengths_domain[1]
        total_length_after_adjustment = sum(gp_lengths_front)
        deviation = total_length_after_adjustment - strip_length_bot

        # Subtract deviation from the largest length in the list
        if deviation != 0:
            max_index = gp_lengths_front.index(max(gp_lengths_front))
            gp_lengths_front[max_index] -= deviation

        # Calculate proportions of parcel lengths to strip lengths and ensure same proportional distribution for strip rear end
        proportions = [length / strip_length_bot for length in gp_lengths_front]
        gp_lengths_back = [prop * strip_length_top for prop in proportions]


        # CONSTRUCT GENERIC PARCELS

        # Initialize vectors for parcel construction
        gp_vec_front = rg.Vector3d(strip_end_pt_bot.X - strip_start_pt_bot.X, strip_end_pt_bot.Y - strip_start_pt_bot.Y, 0)
        gp_vec_front.Unitize()
        gp_vec_back = rg.Vector3d(strip_end_pt_top.X - strip_start_pt_top.X, strip_end_pt_top.Y - strip_start_pt_top.Y, 0)
        gp_vec_back.Unitize()
        gp_vec_side_1 = rg.Vector3d(strip_start_pt_top.X - strip_start_pt_bot.X, strip_start_pt_top.Y - strip_start_pt_bot.Y, 0)
        gp_vec_side_1.Unitize()
        gp_vec_side_2 = rg.Vector3d(strip_end_pt_top.X - strip_end_pt_bot.X, strip_end_pt_top.Y - strip_end_pt_bot.Y, 0)
        gp_vec_side_2.Unitize()

        # Assign widths according to indentation count
        indentation_bool = [True] * (gp_indentation_count[i]) + [False] * ((gp_on_edge_count[i] - gp_indentation_count[i]) - 2)
        random.shuffle(indentation_bool)
        indentation_bool = [False] + indentation_bool + [False]
        assigned_widths = []
        idx = 0
        for n in range(gp_on_edge_count[i]):
            if indentation_bool[n] == True:
                idx = min(idx + 1, len(gp_widths) - 1)
            assigned_widths.append(gp_widths[idx])
        
        # Initialize lists to store cumulative lengths
        front_offset = 0
        back_offset = 0

        # Create generic parcels by iterating through the lengths
        for n in range(len(gp_lengths_front)):

            # If there is only one very slender generic parcel between corner parcels, skip that parcel
            if len(gp_lengths_front) == 1 and gp_lengths_front[n] < 5:
                continue

            # Calculate an interpolation factor based on the current offset:
            t_1 = front_offset / strip_length_bot
            # Interpolate the side vector between gp_vec_side_1 and gp_vec_side_2
            gp_vec_side_interpolated_1 = interpolate_vectors(gp_vec_side_1, gp_vec_side_2, t_1)

            # Calculate an interpolation factor based on the current offset:
            t_2 = (front_offset + gp_lengths_front[n]) / strip_length_bot
            # Interpolate the side vector between gp_vec_side_1 and gp_vec_side_2
            gp_vec_side_interpolated_2 = interpolate_vectors(gp_vec_side_1, gp_vec_side_2, t_2)

            # Calculate the back side reference point based on the assigned width from the gp_widths pool
            back_ref_pt = rs.PointAdd(strip_start_pt_bot, gp_vec_side_interpolated_2 * assigned_widths[n])

            # Calculate the points for the parcel based on the cumulative offsets
            front_start = rs.PointAdd(strip_start_pt_bot, gp_vec_front * front_offset)
            front_end = rs.PointAdd(strip_start_pt_bot, gp_vec_front * (front_offset + gp_lengths_front[n])) 
            back_start = rs.PointAdd(front_start, gp_vec_side_interpolated_1 * assigned_widths[n])
            back_end = rs.PointAdd(front_end, gp_vec_side_interpolated_2 * assigned_widths[n])
            test = back_start
            # back_end = rs.PointAdd(back_ref_pt, gp_vec_front * (back_offset + gp_lengths_back[n]))

            # Define the parcel points
            generic_parcel = [
                front_start,
                front_end,
                back_end,
                back_start,
                front_start
            ]

            # Add the polyline for the parcel
            generic_parcels.append(rs.AddPolyline(generic_parcel))

            # Update the offsets for the next parcel
            front_offset += gp_lengths_front[n]
            back_offset += gp_lengths_back[n]



    ###############
    """ OUTPUTS """

    # Append corner parcels and generic parcels, such that it can be read by building generation component
    all_parcel_list_for_bg = corner_parcels + generic_parcels
    all_parcels_building_generation.append(all_parcel_list_for_bg)

    # Append corner parcels and generic parcels to all parcels
    for cp in corner_parcels:
        all_parcels.append(cp)
    for gp in generic_parcels:
        all_parcels.append(gp)
# ---------- end parcel_generation_2 ----------

# ----
# Random seed
number_slider_7 = Slider(47, range=0..100)

# ----
# PARCEL GENERATION
parcel_generation_3 = Python3Script(boundaries=boundaries_2, data_package=merge_data_package_2.merged_data_package, random_seed=number_slider_7)  # -> all_parcels, all_parcels_building_generation; inputs boundaries: list, data_package: list, random_seed: Int32; same code as parcel_generation

# ----
# 08.10.2024
# Current reference analysis
number_slider_8 = Slider(11, range=0..11)

# ----
# Random seed
number_slider_9 = Slider(49, range=0..100)

# ----
# ENABLE
# BUILDING GENERATION
# Floor-Area-Ratio
building_generation = Python3Script(
    boundaries=boundaries,
    all_parcels_building_generation=parcel_generation.all_parcels_building_generation,
    floor_area_ratio=Slider(11, range=0..11),
    corner_buildings_map=merge_building_data.corner_buildings_map_merged,
    generic_buildings_map=merge_building_data.generic_buildings_map_merged,
    data_package=merge_data_package.merged_data_package,
    random_seed=number_slider_9)  # -> footprints, extrusions; inputs boundaries: list, all_parcels_building_generation: list, corner_buildings_map: list, generic_buildings_map: list, data_package: list; disabled
# ---------- building_generation: Python ----------
import Rhino
import rhinoscriptsyntax as rs
import Rhino.Geometry as rg
import Grasshopper
import random

#####################################################################################

""" FUNCTIONS"""

# Function to find the best match for each element in dimension pairs by calculating the deviation 
def find_best_matches(dimensions_list, buildings_map, aspect_ratio_weight):
    def_building_map = []
    # Make a copy of the buildings_map to modify during iteration
    available_buildings = buildings_map.copy() 
    original_buildings = buildings_map.copy()  # Keep the original list to reset later
    # Iterate through each dimension pair in dimensions_list
    for i in range(len(dimensions_list)):
        min_deviation = float("inf")
        best_match_index = None
        # Loop through each element in the available_buildings
        for j in range(len(available_buildings)):
            # Calculate the deviation for dimensions
            dim_deviation = abs(dimensions_list[i][0][0] - available_buildings[j][0][0]) + abs(dimensions_list[i][0][1] - available_buildings[j][0][1])
            # Calculate the aspect ratio deviation with aspect_ratio_weight
            aspect_ratio_deviation = aspect_ratio_weight * abs(dimensions_list[i][1] - available_buildings[j][1])
            # Calculate the total deviation
            total_deviation = dim_deviation + aspect_ratio_deviation
            # Check if this is the best match so far
            if total_deviation < min_deviation:
                min_deviation = total_deviation
                best_match_index = j 
        # Append the best match's building indices to def_building_map
        if best_match_index is not None:
            best_match = available_buildings[best_match_index]
            def_building_map.append(best_match[2])  # Extract and append building indices
            # Remove the matched building from available_buildings list so it can't be reused
            available_buildings.pop(best_match_index)
        # Reset the available_buildings list when its length is less than 2
        if len(available_buildings) < 2:
            available_buildings = original_buildings.copy()  # Reset to the original list
    return def_building_map



# Function to extrude polyline to closed brep
def extrude_polyline(polyline_curve, height):
    # Define tolerance
    tolerance = 0.001
    # Rebuild the polyline if necessary
    if not polyline_curve.IsClosed:
        polyline_curve.MakeClosed(tolerance)
    # Ensure the curve is consistently oriented upwards (positive Z)
    if not polyline_curve.ClosedCurveOrientation(rg.Plane.WorldXY) == rg.CurveOrientation.CounterClockwise:
        polyline_curve.Reverse()
    # Define the extrusion vector along the positive Z-axis, ensuring height is always positive
    extrusion_vector = rg.Vector3d(0, 0, abs(height))
    # Create the extrusion as an Extrusion object
    extrusion = rg.Extrusion.Create(polyline_curve, abs(height), True)
    # Convert the Extrusion object into a Brep
    brep = extrusion.ToBrep()
    # If the Brep is successfully created and is solid, return it
    if brep and brep.IsSolid:
        return brep
    else:
        # Try to cap planar holes if needed
        capped_brep = brep.CapPlanarHoles(tolerance)
        if capped_brep and capped_brep.IsSolid:
            return capped_brep
        else:
            return brep


# Function to check if any building footprint lies inside another and classify their relationship.
def check_building_footprints_inside(building_footprints, building_vertices, tolerance):
    # Initialize variables
    building_footprint_inside = False
    idx_outline_inside = None
    idx_outline_surrounding = None
    # Loop through all building footprints
    for j, footprint in enumerate(building_footprints):
        footprint = rs.coercecurve(footprint)
        # Loop through all other building vertices to check containment
        for k, vertices in enumerate(building_vertices):
            if j == k:
                continue
            # Flag to track if any point is outside
            is_outside = False
            # Check each vertex of the footprint
            for vertex in vertices:
                result = footprint.Contains(vertex, rg.Plane.WorldXY, tolerance)
                # If any point is outside, set the flag and break out of the loop
                if result != rg.PointContainment.Inside and result != rg.PointContainment.Coincident:
                    is_outside = True
                    break  # Break out of the 'vertices' loop and go to the next set of 'vertices' (k)
            # If any point was outside, skip to the next 'k'
            if is_outside:
                continue
            # Otherwise, if no point is outside, consider the footprint as "inside"
            building_footprint_inside = True
            idx_outline_inside = k
            idx_outline_surrounding = j
            return building_footprint_inside, idx_outline_inside, idx_outline_surrounding
    # Return results (False if no footprint was found inside another), and ints for the indeces
    return building_footprint_inside, idx_outline_inside, idx_outline_surrounding

# Clean mapped polyline if there are duplicate vertices
def clean_polyline(polyline):
    # Get the list of vertices of the polyline
    vertices = list(polyline.ToNurbsCurve().Points)
    # Check if the first and last vertices are the same
    if vertices[0].Location.DistanceTo(vertices[-1].Location) < tolerance:
        # Remove any consecutive duplicates from the end
        while len(vertices) > 1 and vertices[-2].Location.DistanceTo(vertices[-1].Location) < tolerance:
            vertices.pop(-1)
    # Ensure the polyline is closed by adding the first vertex at the end
    if vertices[0].Location.DistanceTo(vertices[-1].Location) >= tolerance:
        vertices.append(vertices[0])
    # Create a new polyline from the cleaned vertices
    cleaned_curve = rg.Polyline([v.Location for v in vertices]).ToNurbsCurve()
    return cleaned_curve


### Functions used for quadrilateral building mapping ###

def extract_vertices_from_curve(quadrilateral_curve):
    polyline = quadrilateral_curve.ToPolyline()
    vertices = list(polyline.ToArray())
    # Remove the last vertex if it's identical to the first vertex
    if vertices[0].DistanceTo(vertices[-1]) < 1e-6:  # Use a small tolerance
        vertices.pop()  # Remove the last vertex
    return vertices

# Function to generate a grid inside a quadrilateral parcel. Uses a bilinear interpolation between the edges of the quadrilateral.
def generate_grid_in_quadrilateral_parcel(parcel_vertices, grid_resolution):
    grid_points = []
    # Get the four corners of the quadrilateral
    v0, v1, v2, v3 = parcel_vertices
    for u in range(grid_resolution + 1):
        u_ratio = u / grid_resolution  # The relative position along the U direction (horizontal)
        # Interpolate between v0->v3 (left) and v1->v2 (right) edges
        left_interp = v0 + (v3 - v0) * u_ratio
        right_interp = v1 + (v2 - v1) * u_ratio
        for v in range(grid_resolution + 1):
            v_ratio = v / grid_resolution  # The relative position along the V direction (vertical)
            # Interpolate between the left and right edges at the current u_ratio
            grid_point = left_interp + (right_interp - left_interp) * v_ratio
            grid_points.append(grid_point)
    return grid_points

# Function to map the building indices to the corresponding points of the quadrilateral parcel's grid.
def map_indices_to_points(building_indices, grid):
    mapped_building_vertices = [grid[index] for index in building_indices]
    return mapped_building_vertices



### Functions used for pentalateral building mapping ###

# Function to compute the centroid (geometric center) of a list of 3D points (vertices).
def compute_centroid(vertices):
    sum_x = sum(v.X for v in vertices)
    sum_y = sum(v.Y for v in vertices)
    sum_z = sum(v.Z for v in vertices)
    num_vertices = len(vertices)
    return rg.Point3d(sum_x / num_vertices, sum_y / num_vertices, sum_z / num_vertices)

# Function to subdivide a triangle into four smaller triangles by adding midpoints on its edges.
def subdivide_triangle(v0, v1, v2):
    # Compute midpoints
    mid_v0_v1 = v0 + (v1 - v0) * 0.5
    mid_v1_v2 = v1 + (v2 - v1) * 0.5
    mid_v2_v0 = v2 + (v0 - v2) * 0.5
    # Create smaller triangles
    triangles = [
        (v0, mid_v0_v1, mid_v2_v0),
        (mid_v0_v1, v1, mid_v1_v2),
        (mid_v2_v0, mid_v1_v2, v2),
        (mid_v0_v1, mid_v1_v2, mid_v2_v0)
    ]
    # Return triangles and midpoints as potential intersection points
    return triangles, [mid_v0_v1, mid_v1_v2, mid_v2_v0]

# Function to subdivide the triangles of a pentalateral parcel iteratively with consistent indexing.
def generate_grid_in_pentalateral_parcel(vertices, center):
    # Create initial triangles (center to adjacent vertices)
    triangles = []
    indexed_points = []  # Track points in a consistent order
    indexed_points.append(center)  # Start with the centroid having index 0
    iterations = 3
    # Add the original vertices with consistent indexing
    indexed_points.extend(vertices)  # Add pentagon vertices (these will get indices 1-5)
    for i in range(len(vertices)):
        v0 = vertices[i]
        v1 = vertices[(i + 1) % len(vertices)]
        triangles.append((center, v0, v1))
    # Subdivide the triangles iteratively
    for _ in range(iterations):
        new_triangles = []
        for tri in triangles:
            # Subdivide the triangle and get the new midpoints
            subdivided, midpoints = subdivide_triangle(*tri)
            # Check each midpoint and assign it an index if it's new
            for midpoint in midpoints:
                if midpoint not in indexed_points:
                    indexed_points.append(midpoint)
            new_triangles.extend(subdivided)
        triangles = new_triangles
    # Returns the subdivided triangles and indexed intersection points.
    return triangles, indexed_points


#####################################################################################

# SHORTCUTS FOR LEGIBILITY:
# generic_parcels: "gp"
# corner_parcels: "gp"



###################################
""" INPUTS, LISTS AND CONSTANTS """

# Initialize outputs
footprints = []
extrusions = []

# Iterate through all boundaries and respective parcels
for i, boundary in enumerate(boundaries):

    boundary = rs.coercecurve(boundary)

    # Inputs
    boundary_curve = boundary
    boundary_area = round(rs.CurveArea(boundary_curve)[0], 2)
    all_parcels_gh_curve_objects = all_parcels_building_generation[i]
    all_parcels = []
    for gh_curve in all_parcels_gh_curve_objects:
        rhino_curve = gh_curve.Value
        all_parcels.append(rhino_curve)

    floor_area_ratio = floor_area_ratio
    b_mean_height = data_package[25]
    b_min_height = data_package[26]
    b_max_height = data_package[27]
    b_height_std = data_package[28]

    # Set tolerance for geometric comparison
    tolerance = 1e-3

    # Set grid resolution (for mapping). Must be the same as data anylsis component for proper mapping!
    grid_resolution = 30

    # Set random seed for reproducible results
    random.seed(random_seed)

    # Get the boundary polygon edges and vertices
    boundary_pts = rs.PolylineVertices(boundary_curve)
    if len(boundary_pts) < 4:
        raise ValueError("Invalid Boundary, must have at least three vertices")
    if boundary_pts[0] != boundary_pts[len(boundary_pts)-1]:
        raise ValueError("Boundary Polygon must be a closed Polyline Curve")

    # Split the corner_buildings_map to lists for pentalateral and quadrilateral corner parcels
    cp_buildings_map_quad = []
    cp_buildings_map_penta = []

    for nested_list in corner_buildings_map:
        if len(nested_list[0]) == 2:
            cp_buildings_map_quad.append(nested_list)
        elif len(nested_list[0]) == 3:
            cp_buildings_map_penta.append(nested_list)



    #######################
    """ PARCEL ANALYSIS """

    # Ensure the boundary_polygon is a valid curve
    if rs.IsCurve(boundary_curve) and boundary_curve is not None:
        boundary_curve = rs.coercecurve(boundary_curve)  # Convert the boundary polygon to a RhinoCommon curve

        # Initialize lists to store polyline curves
        gp_curves = []
        cp_quad_curves = []
        cp_penta_c1_curves = []
        cp_penta_c2_curves = []

        # Initialize lists to store vertices
        gp_vertices = []
        cp_quad_vertices = []
        cp_penta_c1_vertices = []
        cp_penta_c2_vertices = []

        # Iterate over each parcel curve, received from the input
        # Assign the iterated parcel to their respective list
        for parcel in all_parcels:
            parcel_curve = rs.coercecurve(parcel)  # Convert to RhinoCommon curve
            parcel_vertices = parcel_curve.ToPolyline().ToArray()

            # Explode the parcel into individual segments (edges)
            parcel_edges = parcel_curve.DuplicateSegments()
            boundary_edges = []  # To hold the edges of the parcel that lie on the boundary polygon

            # Check each edge of the parcel to see if it lies close to the boundary polygon
            for edge in parcel_edges:
                start_pt = edge.PointAtStart
                end_pt = edge.PointAtEnd

                # Find the closest points on the boundary polygon to the start and end points of the edge
                success_start, param_start = boundary_curve.ClosestPoint(start_pt)
                success_end, param_end = boundary_curve.ClosestPoint(end_pt)

                # Get the actual points on the boundary polygon for comparison
                boundary_pt_1 = boundary_curve.PointAt(param_start) if success_start else None
                boundary_pt_2 = boundary_curve.PointAt(param_end) if success_end else None

                # Compare the distance between the parcel edge and the boundary polygon
                if boundary_pt_1 and boundary_pt_2:
                    start_dist = start_pt.DistanceTo(boundary_pt_1)
                    end_dist = end_pt.DistanceTo(boundary_pt_2)

                    # If both distances are within the tolerance, consider it a boundary edge
                    if start_dist < tolerance and end_dist < tolerance:
                        boundary_edges.append(edge)

            # After checking the edges, classify each parcel based on the number of boundary edges
            if len(boundary_edges) == 1:
                gp_curves.append(parcel_curve)
                gp_vertices.append(parcel_vertices)

            elif len(boundary_edges) == 2:
                if len(parcel_vertices) == 5:
                    cp_quad_curves.append(parcel_curve)
                    cp_quad_vertices.append(parcel_vertices)
                elif len(parcel_vertices) == 6:
                    cp_penta_c1_curves.append(parcel_curve)
                    cp_penta_c1_vertices.append(parcel_vertices)
                    
            elif len(boundary_edges) == 3:
                cp_penta_c2_curves.append(parcel_curve)
                cp_penta_c2_vertices.append(parcel_vertices)

    # Get dimensions duos or trios for comparison with building maps
    gp_dim_pairs = []
    for vertices in gp_vertices:
        length = round(vertices[0].DistanceTo(vertices[1]),2)
        width = round(vertices[1].DistanceTo(vertices[2]),2)
        ratio = round(length / width, 2)
        gp_dim_pairs.append([[length, width], ratio])

    cp_quad_dim_pairs = []
    for vertices in cp_quad_vertices:
        width_1 = round(vertices[0].DistanceTo(vertices[1]),2)
        width_2 = round(vertices[0].DistanceTo(vertices[3]),2)
        ratio = round(width_1 / width_2, 2)
        cp_quad_dim_pairs.append([[width_1, width_2], ratio])

    cp_penta_dim_trios = []
    for vertices in cp_penta_c1_vertices:
        dim_1 = round(vertices[2].DistanceTo(vertices[3]),2)
        dim_2 = round(vertices[3].DistanceTo(vertices[4]),2)
        dim_3 = round(vertices[2].DistanceTo(vertices[1]),2)
        ratio = round(dim_1 / dim_2, 2)
        cp_penta_dim_trios.append([[dim_1, dim_2, dim_3], ratio])
    for vertices in cp_penta_c2_vertices:
        dim_1 = round(vertices[0].DistanceTo(vertices[1]),2)
        dim_2 = round(vertices[1].DistanceTo(vertices[2]),2)
        dim_3 = round(vertices[0].DistanceTo(vertices[4]),2)
        ratio = round(dim_1 / dim_2, 2)
        cp_penta_dim_trios.append([[dim_1, dim_2, dim_3], ratio])

    # Add lists together (ensuring consistent index)
    cp_penta_curves = cp_penta_c1_curves + cp_penta_c2_curves
    cp_penta_vertices = cp_penta_c1_vertices + cp_penta_c2_vertices

    # Determine new mean height based upon FAR
    if floor_area_ratio is not None:
        # Get areas of parcels
        gp_areas = []
        for gp_curve in gp_curves:
            gp_curve = rs.coercecurve(gp_curve)
            gp_area = rs.CurveArea(gp_curve)
            gp_areas.append(gp_area[0])

        cp_quad_areas = []
        for cp_curve in cp_quad_curves:
            cp_curve = rs.coercecurve(cp_curve)
            cp_area = rs.CurveArea(cp_curve)
            cp_quad_areas.append(cp_area[0])

        cp_penta_areas = []
        for cp_curve in cp_penta_curves:
            cp_curve = rs.coercecurve(cp_curve)
            cp_area = rs.CurveArea(cp_curve)
            cp_penta_areas.append(cp_area[0])    

        all_areas = gp_areas + cp_quad_areas + cp_penta_areas
        total_parcel_area = round(sum(all_areas), 2)
        # Assumption: floor height = 2.5m
        floor_height = 2.5
        b_mean_height = boundary_area * floor_area_ratio * floor_height / total_parcel_area
        if b_max_height < b_mean_height:
            b_max_height = b_mean_height
        if b_min_height > b_mean_height:
            b_min_height = b_mean_height



    #######################################
    """ ASSING BUILDING MAPS TO PARCELS """

    # When comparing the dimensions and aspect ratios, give aspect ratios more weight:
    aspect_ratio_weight = 100

    # Assign generic building map
    gp_building_map = find_best_matches(gp_dim_pairs, generic_buildings_map, aspect_ratio_weight)

    # Assign quadrilateral corner building map
    cp_quad_building_map = find_best_matches(cp_quad_dim_pairs, cp_buildings_map_quad, aspect_ratio_weight)

    # Assign pentalateral corner building map
    if cp_penta_dim_trios:
        cp_penta_building_map = find_best_matches(cp_penta_dim_trios, cp_buildings_map_penta, aspect_ratio_weight)
    else:
        print("ok")
        print(cp_buildings_map_penta)
        cp_penta_building_map = find_best_matches(cp_quad_dim_pairs, cp_buildings_map_penta, aspect_ratio_weight)




    ################################
    """ CREATE GENERIC BUILDINGS """

    # Initialize list to store generic bulidings
    generic_buildings_footprints = []
    generic_buildings_3D = []

    # Loop through all generic parcels
    for i, generic_parcel in enumerate(gp_curves):

        # Extract vertices from generic parcel
        generic_parcel = rs.coercecurve(generic_parcel)
        gp_vertices = extract_vertices_from_curve(generic_parcel)

        # Generate grid for quadrilateral parcel
        gp_grid = generate_grid_in_quadrilateral_parcel(gp_vertices, grid_resolution)

        # Initialize lists for 3D building creation
        building_footprints = []
        building_vertices = []
        building_dist_sum = []
        building_vertices_distance_to_edge = [[] for _ in range(len(gp_building_map[i]))]

        # Loop through all buildings on parcel
        for j in range(len(gp_building_map[i])):
            gp_building_indeces = gp_building_map[i][j]
            mapped_building_vertices = map_indices_to_points(gp_building_indeces, gp_grid)

            # Ensure the polyline is closed by appending the first vertex at the end if needed
            if mapped_building_vertices[0].DistanceTo(mapped_building_vertices[-1]) > tolerance:
                mapped_building_vertices.append(mapped_building_vertices[0])

            # Create generic building footprint and append to generic building footprints
            generic_building_outline = rs.AddPolyline(mapped_building_vertices)
            generic_buildings_footprints.append(generic_building_outline)

            # Measure distance of building footprints to edge
            generic_building_curve = rs.coercecurve(generic_building_outline)
            building_footprints.append(generic_building_curve)
            gb_vertices = generic_building_curve.ToPolyline().ToArray()
            building_vertices.append(gb_vertices)
            for vertex in gb_vertices:
                dist_1 = round(vertex.DistanceTo(gp_vertices[0]), 2)
                dist_2 = round(vertex.DistanceTo(gp_vertices[1]), 2)
                building_vertices_distance_to_edge[j].append(dist_1)
                building_vertices_distance_to_edge[j].append(dist_2)

        # Distance from boundary edge for reasonable height distribution
        for j in range(len(building_vertices_distance_to_edge)):
            weighted_dist = sum(building_vertices_distance_to_edge[j]) / len(building_vertices_distance_to_edge[j])
            dist_sum = round(weighted_dist ,2)
            building_dist_sum.append(dist_sum)

        # Get a height from data package (or from the FAR calculation)
        b_gauss_height = round(random.gauss(b_mean_height, b_height_std))
        height = int(max(b_min_height, min(b_gauss_height, b_max_height)))

        # Figure out if any footprint lies on another one
        building_footprint_inside, idx_outline_inside, idx_outline_surrounding = check_building_footprints_inside(building_footprints, building_vertices, tolerance)

        # Get a height from data package
        b_gauss_height = round(random.gauss(b_mean_height, b_height_std))
        height = int(max(b_min_height, min(b_gauss_height, b_max_height)))

        # Create generic building extrustions
        # Address the buildings with the outline inside:
        if building_footprint_inside == True:
            # First, address the buildings with the outline inside:
            surrounding_footprint = rs.coercecurve(building_footprints[idx_outline_surrounding])
            inside_footprint = rs.coercecurve(building_footprints[idx_outline_inside])
            surrounding_building = extrude_polyline(surrounding_footprint, height)
            inside_building = extrude_polyline(inside_footprint, height + 3)
            generic_buildings_3D.append(surrounding_building)
            generic_buildings_3D.append(inside_building)
            height = height + random.choice([-3, 3])

            # Delete the larger index first to avoid index shift issues
            indices_to_remove = sorted([idx_outline_surrounding, idx_outline_inside], reverse=True)
            for index in indices_to_remove:
                for lst in [building_footprints, building_dist_sum]:
                    del lst[index]

        # Sort lists according to buliding distance to edge sum
        if len(building_footprints) > 0:
            sorted_pairs = sorted(zip(building_dist_sum, building_footprints), key=lambda x: x[0], reverse=True)
            building_dist_sum, building_footprints = zip(*sorted_pairs)

            for footprint in building_footprints:      
                footprint = rs.coercecurve(footprint)
                generic_building = extrude_polyline(footprint, height)
                generic_buildings_3D.append(generic_building)
                rng = random.uniform(0,1)
                if rng < 0.2:
                    if height > 6:
                        height = height - 6
                else:
                    if height > 3:
                        height = height - 3



    ################################
    """ CREATE CORNER BUILDINGS """

    # Initialize list to store generic bulidings
    corner_buildings_footprints = []
    corner_buildings_3D = []

    # Loop through all quadrilateral corner parcels
    for i, corner_parcel_quad in enumerate(cp_quad_curves):

        # Extract vertices from quadrilateral corner parcel
        corner_parcel = rs.coercecurve(corner_parcel_quad)
        cp_vertices = extract_vertices_from_curve(corner_parcel)

        # Generate grid for quadrilateral parcel
        cp_grid = generate_grid_in_quadrilateral_parcel(cp_vertices, grid_resolution)

        # Initialize lists for 3D building creation
        building_footprints = []
        building_vertices = []
        building_dist_sum = []
        building_vertices_distance_to_edge = [[] for _ in range(len(cp_quad_building_map[i]))]   

        # Loop through all buildings on parcel
        for j in range(len(cp_quad_building_map[i])):
            cp_building_indeces = cp_quad_building_map[i][j]
            mapped_building_vertices = map_indices_to_points(cp_building_indeces, cp_grid)

            # Ensure the polyline is closed by appending the first vertex at the end if needed
            if mapped_building_vertices[0].DistanceTo(mapped_building_vertices[-1]) > tolerance:
                mapped_building_vertices.append(mapped_building_vertices[0])

            # Create corner building footprint and append to building footprints
            corner_building_outline = rs.AddPolyline(mapped_building_vertices)
            corner_buildings_footprints.append(corner_building_outline)

            # Measure distance of building footprints edges
            corner_building_curve = rs.coercecurve(corner_building_outline)
            building_footprints.append(corner_building_curve)
            cb_vertices = corner_building_curve.ToPolyline().ToArray()
            building_vertices.append(cb_vertices)
            for vertex in cb_vertices:
                dist_1 = round(vertex.DistanceTo(cp_vertices[0]), 2)
                dist_2 = round(vertex.DistanceTo(cp_vertices[1]), 2)
                dist_3 = round(vertex.DistanceTo(cp_vertices[3]), 2)
                building_vertices_distance_to_edge[j].append(dist_1)
                building_vertices_distance_to_edge[j].append(dist_2)
                building_vertices_distance_to_edge[j].append(dist_3)

        # Distance from boundary edge for reasonable height distribution
        for j in range(len(building_vertices_distance_to_edge)):
            weighted_dist = sum(building_vertices_distance_to_edge[j]) / len(building_vertices_distance_to_edge[j])
            dist_sum = round(weighted_dist ,2)
            building_dist_sum.append(dist_sum)

        # Get a height from data package (or from the FAR calculation)
        b_gauss_height = round(random.gauss(b_mean_height, b_height_std))
        height = int(max(b_min_height, min(b_gauss_height, b_max_height)))

        # Figure out if any footprint lies on another one
        building_footprint_inside, idx_outline_inside, idx_outline_surrounding = check_building_footprints_inside(building_footprints, building_vertices, tolerance)

        # Create corner building extrustions
        # Address the buildings with the outline inside:
        if building_footprint_inside == True:
            surrounding_footprint = rs.coercecurve(building_footprints[idx_outline_surrounding])
            surrounding_footprint = clean_polyline(surrounding_footprint)
            inside_footprint = rs.coercecurve(building_footprints[idx_outline_inside])
            inside_footprint = clean_polyline(inside_footprint)
            surrounding_building = extrude_polyline(surrounding_footprint, height)
            inside_building = extrude_polyline(inside_footprint, height + 3)
            corner_buildings_3D.append(surrounding_building)
            corner_buildings_3D.append(inside_building)
            height = height + random.choice([-3, 3])

            # Delete the larger index first to avoid index shift issues
            indices_to_remove = sorted([idx_outline_surrounding, idx_outline_inside], reverse=True)
            for index in indices_to_remove:
                for lst in [building_footprints, building_dist_sum]:
                    del lst[index]

        # Address rest of the buildings
        # Sort lists according to buliding distance to edge sum
        if len(building_footprints) > 0:
            sorted_pairs = sorted(zip(building_dist_sum, building_footprints), key=lambda x: x[0], reverse=True)
            building_dist_sum, building_footprints = zip(*sorted_pairs)
            for footprint in building_footprints:           
                footprint = rs.coercecurve(footprint)
                footprint = clean_polyline(footprint)
                corner_building = extrude_polyline(footprint, height)
                corner_buildings_3D.append(corner_building)
                rng = random.uniform(0,1)
                if rng < 0.2:
                    if height > 6:
                        height = height - 6
                else:
                    if height > 3:
                        height = height - 3

    print(len(cp_penta_curves))
    print(len(cp_penta_building_map))
    # Loop through all pentalateral corner parcels
    for i, corner_parcel in enumerate(cp_penta_curves):
        
        # Extract vertices from pentalateral corner parcel
        cp_polyline = corner_parcel.ToPolyline()
        cp_vertices = list(cp_polyline.ToArray())

        # Compute centroid
        center = compute_centroid(cp_vertices)

        # Generate a "grid" by subdividing the parcel through triangulation
        cp_triangles, cp_indexed_points = generate_grid_in_pentalateral_parcel(cp_vertices, center)

        # Initialize lists for 3D building creation
        building_footprints = []
        building_vertices = []
        building_dist_sum = []
        building_vertices_distance_to_edge = [[] for _ in range(len(cp_penta_building_map[i]))]   

        # Loop through all buildings on parcel
        for j in range(len(cp_penta_building_map[i])):
            cp_building_indeces = cp_penta_building_map[i][j]
            mapped_building_vertices = map_indices_to_points(cp_building_indeces, cp_indexed_points)

            # Ensure the polyline is closed by appending the first vertex at the end if needed
            if mapped_building_vertices[0].DistanceTo(mapped_building_vertices[-1]) > tolerance:
                mapped_building_vertices.append(mapped_building_vertices[0])

            # Create generic building footprint and append to generic building footprints
            corner_building_outline = rs.AddPolyline(mapped_building_vertices)
            corner_buildings_footprints.append(corner_building_outline)

            # Measure distance of building footprints edges
            corner_building_curve = rs.coercecurve(corner_building_outline)
            building_footprints.append(corner_building_curve)
            cb_vertices = corner_building_curve.ToPolyline().ToArray()
            building_vertices.append(cb_vertices)
            for vertex in cb_vertices:
                dist_1 = round(vertex.DistanceTo(cp_vertices[0]), 2)
                dist_2 = round(vertex.DistanceTo(cp_vertices[1]), 2)
                building_vertices_distance_to_edge[j].append(dist_1)
                building_vertices_distance_to_edge[j].append(dist_2)


        # Distance from boundary edge for reasonable height distribution
        for j in range(len(building_vertices_distance_to_edge)):
            weighted_dist = sum(building_vertices_distance_to_edge[j]) / len(building_vertices_distance_to_edge[j])
            dist_sum = round(weighted_dist ,2)
            building_dist_sum.append(dist_sum)      

        # Get a height from data package (or from the FAR calculation)
        b_gauss_height = round(random.gauss(b_mean_height, b_height_std))
        height = int(max(b_min_height, min(b_gauss_height, b_max_height)))  

        # Figure out if any footprint lies on another one
        building_footprint_inside, idx_outline_inside, idx_outline_surrounding = check_building_footprints_inside(building_footprints, building_vertices, tolerance)

        # Create corner building extrustions
        # Address the buildings with the outline inside:
        if building_footprint_inside == True:
            surrounding_footprint = rs.coercecurve(building_footprints[idx_outline_surrounding])
            surrounding_footprint = clean_polyline(surrounding_footprint)
            inside_footprint = rs.coercecurve(building_footprints[idx_outline_inside])
            inside_footprint = clean_polyline(inside_footprint)
            surrounding_building = extrude_polyline(surrounding_footprint, height)
            inside_building = extrude_polyline(inside_footprint, height + 3)
            corner_buildings_3D.append(surrounding_building)
            corner_buildings_3D.append(inside_building)
            height = height + random.choice([-3, 3])

            # Delete the larger index first to avoid index shift issues
            indices_to_remove = sorted([idx_outline_surrounding, idx_outline_inside], reverse=True)
            for index in indices_to_remove:
                for lst in [building_footprints, building_dist_sum]:
                    del lst[index]

        # Address rest of the buildings
        # Sort lists according to buliding distance to edge sum
        if len(building_footprints) > 0:
            sorted_pairs = sorted(zip(building_dist_sum, building_footprints), key=lambda x: x[0], reverse=True)
            building_dist_sum, building_footprints = zip(*sorted_pairs)
            for footprint in building_footprints:
                footprint = rs.coercecurve(footprint)
                footprint = clean_polyline(footprint)
                corner_building = extrude_polyline(footprint, height)
                corner_buildings_3D.append(corner_building)
                rng = random.uniform(0,1)
                if rng < 0.2:
                    if height > 6:
                        height = height - 6
                else:
                    if height > 3:
                        height = height - 3

    ################
    """ OUTPUTS """

    for gb_footprint in generic_buildings_footprints:
        footprints.append(gb_footprint)
    for cb_footprint in corner_buildings_footprints:
        footprints.append(cb_footprint)
    for gb_3D in generic_buildings_3D:
        extrusions.append(gb_3D)
    for cp_3D in corner_buildings_3D:
        extrusions.append(cp_3D)
# ---------- end building_generation ----------
# ----
# BUILDING
# GENERATION
# ENABLE
# BUILDING GENERATION
# Floor-Area-Ratio
building_generation_2 = Python3Script(
    boundaries=boundaries_3,
    all_parcels_building_generation=parcel_generation_2.all_parcels_building_generation,
    floor_area_ratio=Slider(11, range=0..11),
    corner_buildings_map=merge_building_data.corner_buildings_map_merged,
    generic_buildings_map=merge_building_data.generic_buildings_map_merged,
    data_package=merge_data_package_3.merged_data_package,
    random_seed=number_slider_9)  # -> footprints, extrusions; inputs boundaries: list, all_parcels_building_generation: list, corner_buildings_map: list, generic_buildings_map: list, data_package: list; disabled
# ---------- building_generation_2: Python ----------
import Rhino
import rhinoscriptsyntax as rs
import Rhino.Geometry as rg
import Grasshopper
import random

#####################################################################################

""" FUNCTIONS"""

# Function to find the best match for each element in dimension pairs by calculating the deviation 
def find_best_matches(dimensions_list, buildings_map, aspect_ratio_weight):
    def_building_map = []
    # Make a copy of the buildings_map to modify during iteration
    available_buildings = buildings_map.copy() 
    original_buildings = buildings_map.copy()  # Keep the original list to reset later
    # Iterate through each dimension pair in dimensions_list
    for i in range(len(dimensions_list)):
        min_deviation = float("inf")
        best_match_index = None
        # Loop through each element in the available_buildings
        for j in range(len(available_buildings)):
            # Calculate the deviation for dimensions
            dim_deviation = abs(dimensions_list[i][0][0] - available_buildings[j][0][0]) + abs(dimensions_list[i][0][1] - available_buildings[j][0][1])
            # Calculate the aspect ratio deviation with aspect_ratio_weight
            aspect_ratio_deviation = aspect_ratio_weight * abs(dimensions_list[i][1] - available_buildings[j][1])
            # Calculate the total deviation
            total_deviation = dim_deviation + aspect_ratio_deviation
            # Check if this is the best match so far
            if total_deviation < min_deviation:
                min_deviation = total_deviation
                best_match_index = j 
        # Append the best match's building indices to def_building_map
        if best_match_index is not None:
            best_match = available_buildings[best_match_index]
            def_building_map.append(best_match[2])  # Extract and append building indices
            # Remove the matched building from available_buildings list so it can't be reused
            available_buildings.pop(best_match_index)
        # Reset the available_buildings list when its length is less than 2
        if len(available_buildings) < 2:
            available_buildings = original_buildings.copy()  # Reset to the original list
    return def_building_map



# Function to extrude polyline to closed brep
def extrude_polyline(polyline_curve, height):
    # Define tolerance
    tolerance = 0.001
    # Rebuild the polyline if necessary
    if not polyline_curve.IsClosed:
        polyline_curve.MakeClosed(tolerance)
    # Ensure the curve is consistently oriented upwards (positive Z)
    if not polyline_curve.ClosedCurveOrientation(rg.Plane.WorldXY) == rg.CurveOrientation.CounterClockwise:
        polyline_curve.Reverse()
    # Define the extrusion vector along the positive Z-axis, ensuring height is always positive
    extrusion_vector = rg.Vector3d(0, 0, abs(height))
    # Create the extrusion as an Extrusion object
    extrusion = rg.Extrusion.Create(polyline_curve, abs(height), True)
    # Convert the Extrusion object into a Brep
    brep = extrusion.ToBrep()
    # If the Brep is successfully created and is solid, return it
    if brep and brep.IsSolid:
        return brep
    else:
        # Try to cap planar holes if needed
        capped_brep = brep.CapPlanarHoles(tolerance)
        if capped_brep and capped_brep.IsSolid:
            return capped_brep
        else:
            return brep


# Function to check if any building footprint lies inside another and classify their relationship.
def check_building_footprints_inside(building_footprints, building_vertices, tolerance):
    # Initialize variables
    building_footprint_inside = False
    idx_outline_inside = None
    idx_outline_surrounding = None
    # Loop through all building footprints
    for j, footprint in enumerate(building_footprints):
        footprint = rs.coercecurve(footprint)
        # Loop through all other building vertices to check containment
        for k, vertices in enumerate(building_vertices):
            if j == k:
                continue
            # Flag to track if any point is outside
            is_outside = False
            # Check each vertex of the footprint
            for vertex in vertices:
                result = footprint.Contains(vertex, rg.Plane.WorldXY, tolerance)
                # If any point is outside, set the flag and break out of the loop
                if result != rg.PointContainment.Inside and result != rg.PointContainment.Coincident:
                    is_outside = True
                    break  # Break out of the 'vertices' loop and go to the next set of 'vertices' (k)
            # If any point was outside, skip to the next 'k'
            if is_outside:
                continue
            # Otherwise, if no point is outside, consider the footprint as "inside"
            building_footprint_inside = True
            idx_outline_inside = k
            idx_outline_surrounding = j
            return building_footprint_inside, idx_outline_inside, idx_outline_surrounding
    # Return results (False if no footprint was found inside another), and ints for the indeces
    return building_footprint_inside, idx_outline_inside, idx_outline_surrounding

# Clean mapped polyline if there are duplicate vertices
def clean_polyline(polyline):
    # Get the list of vertices of the polyline
    vertices = list(polyline.ToNurbsCurve().Points)
    # Check if the first and last vertices are the same
    if vertices[0].Location.DistanceTo(vertices[-1].Location) < tolerance:
        # Remove any consecutive duplicates from the end
        while len(vertices) > 1 and vertices[-2].Location.DistanceTo(vertices[-1].Location) < tolerance:
            vertices.pop(-1)
    # Ensure the polyline is closed by adding the first vertex at the end
    if vertices[0].Location.DistanceTo(vertices[-1].Location) >= tolerance:
        vertices.append(vertices[0])
    # Create a new polyline from the cleaned vertices
    cleaned_curve = rg.Polyline([v.Location for v in vertices]).ToNurbsCurve()
    return cleaned_curve


### Functions used for quadrilateral building mapping ###

def extract_vertices_from_curve(quadrilateral_curve):
    polyline = quadrilateral_curve.ToPolyline()
    vertices = list(polyline.ToArray())
    # Remove the last vertex if it's identical to the first vertex
    if vertices[0].DistanceTo(vertices[-1]) < 1e-6:  # Use a small tolerance
        vertices.pop()  # Remove the last vertex
    return vertices

# Function to generate a grid inside a quadrilateral parcel. Uses a bilinear interpolation between the edges of the quadrilateral.
def generate_grid_in_quadrilateral_parcel(parcel_vertices, grid_resolution):
    grid_points = []
    # Get the four corners of the quadrilateral
    v0, v1, v2, v3 = parcel_vertices
    for u in range(grid_resolution + 1):
        u_ratio = u / grid_resolution  # The relative position along the U direction (horizontal)
        # Interpolate between v0->v3 (left) and v1->v2 (right) edges
        left_interp = v0 + (v3 - v0) * u_ratio
        right_interp = v1 + (v2 - v1) * u_ratio
        for v in range(grid_resolution + 1):
            v_ratio = v / grid_resolution  # The relative position along the V direction (vertical)
            # Interpolate between the left and right edges at the current u_ratio
            grid_point = left_interp + (right_interp - left_interp) * v_ratio
            grid_points.append(grid_point)
    return grid_points

# Function to map the building indices to the corresponding points of the quadrilateral parcel's grid.
def map_indices_to_points(building_indices, grid):
    mapped_building_vertices = [grid[index] for index in building_indices]
    return mapped_building_vertices



### Functions used for pentalateral building mapping ###

# Function to compute the centroid (geometric center) of a list of 3D points (vertices).
def compute_centroid(vertices):
    sum_x = sum(v.X for v in vertices)
    sum_y = sum(v.Y for v in vertices)
    sum_z = sum(v.Z for v in vertices)
    num_vertices = len(vertices)
    return rg.Point3d(sum_x / num_vertices, sum_y / num_vertices, sum_z / num_vertices)

# Function to subdivide a triangle into four smaller triangles by adding midpoints on its edges.
def subdivide_triangle(v0, v1, v2):
    # Compute midpoints
    mid_v0_v1 = v0 + (v1 - v0) * 0.5
    mid_v1_v2 = v1 + (v2 - v1) * 0.5
    mid_v2_v0 = v2 + (v0 - v2) * 0.5
    # Create smaller triangles
    triangles = [
        (v0, mid_v0_v1, mid_v2_v0),
        (mid_v0_v1, v1, mid_v1_v2),
        (mid_v2_v0, mid_v1_v2, v2),
        (mid_v0_v1, mid_v1_v2, mid_v2_v0)
    ]
    # Return triangles and midpoints as potential intersection points
    return triangles, [mid_v0_v1, mid_v1_v2, mid_v2_v0]

# Function to subdivide the triangles of a pentalateral parcel iteratively with consistent indexing.
def generate_grid_in_pentalateral_parcel(vertices, center):
    # Create initial triangles (center to adjacent vertices)
    triangles = []
    indexed_points = []  # Track points in a consistent order
    indexed_points.append(center)  # Start with the centroid having index 0
    iterations = 3
    # Add the original vertices with consistent indexing
    indexed_points.extend(vertices)  # Add pentagon vertices (these will get indices 1-5)
    for i in range(len(vertices)):
        v0 = vertices[i]
        v1 = vertices[(i + 1) % len(vertices)]
        triangles.append((center, v0, v1))
    # Subdivide the triangles iteratively
    for _ in range(iterations):
        new_triangles = []
        for tri in triangles:
            # Subdivide the triangle and get the new midpoints
            subdivided, midpoints = subdivide_triangle(*tri)
            # Check each midpoint and assign it an index if it's new
            for midpoint in midpoints:
                if midpoint not in indexed_points:
                    indexed_points.append(midpoint)
            new_triangles.extend(subdivided)
        triangles = new_triangles
    # Returns the subdivided triangles and indexed intersection points.
    return triangles, indexed_points


#####################################################################################

# SHORTCUTS FOR LEGIBILITY:
# generic_parcels: "gp"
# corner_parcels: "gp"



###################################
""" INPUTS, LISTS AND CONSTANTS """

# Initialize outputs
footprints = []
extrusions = []

# Iterate through all boundaries and respective parcels
for i, boundary in enumerate(boundaries):

    boundary = rs.coercecurve(boundary)

    # Inputs
    boundary_curve = boundary
    boundary_area = round(rs.CurveArea(boundary_curve)[0], 2)
    all_parcels_gh_curve_objects = all_parcels_building_generation[i]
    all_parcels = []
    for gh_curve in all_parcels_gh_curve_objects:
        rhino_curve = gh_curve.Value
        all_parcels.append(rhino_curve)

    floor_area_ratio = floor_area_ratio
    b_mean_height = data_package[25]
    b_min_height = data_package[26]
    b_max_height = data_package[27]
    b_height_std = data_package[28]

    # Set tolerance for geometric comparison
    tolerance = 1e-3

    # Set grid resolution (for mapping). Must be the same as data anylsis component for proper mapping!
    grid_resolution = 30

    # Set random seed for reproducible results
    random.seed(random_seed)

    # Get the boundary polygon edges and vertices
    boundary_pts = rs.PolylineVertices(boundary_curve)
    if len(boundary_pts) < 4:
        raise ValueError("Invalid Boundary, must have at least three vertices")
    if boundary_pts[0] != boundary_pts[len(boundary_pts)-1]:
        raise ValueError("Boundary Polygon must be a closed Polyline Curve")

    # Split the corner_buildings_map to lists for pentalateral and quadrilateral corner parcels
    cp_buildings_map_quad = []
    cp_buildings_map_penta = []

    for nested_list in corner_buildings_map:
        if len(nested_list[0]) == 2:
            cp_buildings_map_quad.append(nested_list)
        elif len(nested_list[0]) == 3:
            cp_buildings_map_penta.append(nested_list)



    #######################
    """ PARCEL ANALYSIS """

    # Ensure the boundary_polygon is a valid curve
    if rs.IsCurve(boundary_curve) and boundary_curve is not None:
        boundary_curve = rs.coercecurve(boundary_curve)  # Convert the boundary polygon to a RhinoCommon curve

        # Initialize lists to store polyline curves
        gp_curves = []
        cp_quad_curves = []
        cp_penta_c1_curves = []
        cp_penta_c2_curves = []

        # Initialize lists to store vertices
        gp_vertices = []
        cp_quad_vertices = []
        cp_penta_c1_vertices = []
        cp_penta_c2_vertices = []

        # Iterate over each parcel curve, received from the input
        # Assign the iterated parcel to their respective list
        for parcel in all_parcels:
            parcel_curve = rs.coercecurve(parcel)  # Convert to RhinoCommon curve
            parcel_vertices = parcel_curve.ToPolyline().ToArray()

            # Explode the parcel into individual segments (edges)
            parcel_edges = parcel_curve.DuplicateSegments()
            boundary_edges = []  # To hold the edges of the parcel that lie on the boundary polygon

            # Check each edge of the parcel to see if it lies close to the boundary polygon
            for edge in parcel_edges:
                start_pt = edge.PointAtStart
                end_pt = edge.PointAtEnd

                # Find the closest points on the boundary polygon to the start and end points of the edge
                success_start, param_start = boundary_curve.ClosestPoint(start_pt)
                success_end, param_end = boundary_curve.ClosestPoint(end_pt)

                # Get the actual points on the boundary polygon for comparison
                boundary_pt_1 = boundary_curve.PointAt(param_start) if success_start else None
                boundary_pt_2 = boundary_curve.PointAt(param_end) if success_end else None

                # Compare the distance between the parcel edge and the boundary polygon
                if boundary_pt_1 and boundary_pt_2:
                    start_dist = start_pt.DistanceTo(boundary_pt_1)
                    end_dist = end_pt.DistanceTo(boundary_pt_2)

                    # If both distances are within the tolerance, consider it a boundary edge
                    if start_dist < tolerance and end_dist < tolerance:
                        boundary_edges.append(edge)

            # After checking the edges, classify each parcel based on the number of boundary edges
            if len(boundary_edges) == 1:
                gp_curves.append(parcel_curve)
                gp_vertices.append(parcel_vertices)

            elif len(boundary_edges) == 2:
                if len(parcel_vertices) == 5:
                    cp_quad_curves.append(parcel_curve)
                    cp_quad_vertices.append(parcel_vertices)
                elif len(parcel_vertices) == 6:
                    cp_penta_c1_curves.append(parcel_curve)
                    cp_penta_c1_vertices.append(parcel_vertices)
                    
            elif len(boundary_edges) == 3:
                cp_penta_c2_curves.append(parcel_curve)
                cp_penta_c2_vertices.append(parcel_vertices)

    # Get dimensions duos or trios for comparison with building maps
    gp_dim_pairs = []
    for vertices in gp_vertices:
        length = round(vertices[0].DistanceTo(vertices[1]),2)
        width = round(vertices[1].DistanceTo(vertices[2]),2)
        ratio = round(length / width, 2)
        gp_dim_pairs.append([[length, width], ratio])

    cp_quad_dim_pairs = []
    for vertices in cp_quad_vertices:
        width_1 = round(vertices[0].DistanceTo(vertices[1]),2)
        width_2 = round(vertices[0].DistanceTo(vertices[3]),2)
        ratio = round(width_1 / width_2, 2)
        cp_quad_dim_pairs.append([[width_1, width_2], ratio])

    cp_penta_dim_trios = []
    for vertices in cp_penta_c1_vertices:
        dim_1 = round(vertices[2].DistanceTo(vertices[3]),2)
        dim_2 = round(vertices[3].DistanceTo(vertices[4]),2)
        dim_3 = round(vertices[2].DistanceTo(vertices[1]),2)
        ratio = round(dim_1 / dim_2, 2)
        cp_penta_dim_trios.append([[dim_1, dim_2, dim_3], ratio])
    for vertices in cp_penta_c2_vertices:
        dim_1 = round(vertices[0].DistanceTo(vertices[1]),2)
        dim_2 = round(vertices[1].DistanceTo(vertices[2]),2)
        dim_3 = round(vertices[0].DistanceTo(vertices[4]),2)
        ratio = round(dim_1 / dim_2, 2)
        cp_penta_dim_trios.append([[dim_1, dim_2, dim_3], ratio])

    # Add lists together (ensuring consistent index)
    cp_penta_curves = cp_penta_c1_curves + cp_penta_c2_curves
    cp_penta_vertices = cp_penta_c1_vertices + cp_penta_c2_vertices

    # Determine new mean height based upon FAR
    if floor_area_ratio is not None:
        # Get areas of parcels
        gp_areas = []
        for gp_curve in gp_curves:
            gp_curve = rs.coercecurve(gp_curve)
            gp_area = rs.CurveArea(gp_curve)
            gp_areas.append(gp_area[0])

        cp_quad_areas = []
        for cp_curve in cp_quad_curves:
            cp_curve = rs.coercecurve(cp_curve)
            cp_area = rs.CurveArea(cp_curve)
            cp_quad_areas.append(cp_area[0])

        cp_penta_areas = []
        for cp_curve in cp_penta_curves:
            cp_curve = rs.coercecurve(cp_curve)
            cp_area = rs.CurveArea(cp_curve)
            cp_penta_areas.append(cp_area[0])    

        all_areas = gp_areas + cp_quad_areas + cp_penta_areas
        total_parcel_area = round(sum(all_areas), 2)
        # Assumption: floor height = 2.5m
        floor_height = 2.5
        b_mean_height = boundary_area * floor_area_ratio * floor_height / total_parcel_area
        if b_max_height < b_mean_height:
            b_max_height = b_mean_height
        if b_min_height > b_mean_height:
            b_min_height = b_mean_height



    #######################################
    """ ASSING BUILDING MAPS TO PARCELS """

    # When comparing the dimensions and aspect ratios, give aspect ratios more weight:
    aspect_ratio_weight = 100

    # Assign generic building map
    gp_building_map = find_best_matches(gp_dim_pairs, generic_buildings_map, aspect_ratio_weight)

    # Assign quadrilateral corner building map
    cp_quad_building_map = find_best_matches(cp_quad_dim_pairs, cp_buildings_map_quad, aspect_ratio_weight)

    # Assign pentalateral corner building map
    if cp_penta_dim_trios:
        cp_penta_building_map = find_best_matches(cp_penta_dim_trios, cp_buildings_map_penta, aspect_ratio_weight)
    else:
        print(cp_buildings_map_penta)
        cp_penta_building_map = find_best_matches(cp_quad_dim_pairs, cp_buildings_map_penta, aspect_ratio_weight)




    ################################
    """ CREATE GENERIC BUILDINGS """

    # Initialize list to store generic bulidings
    generic_buildings_footprints = []
    generic_buildings_3D = []

    # Loop through all generic parcels
    for i, generic_parcel in enumerate(gp_curves):

        # Extract vertices from generic parcel
        generic_parcel = rs.coercecurve(generic_parcel)
        gp_vertices = extract_vertices_from_curve(generic_parcel)

        # Generate grid for quadrilateral parcel
        gp_grid = generate_grid_in_quadrilateral_parcel(gp_vertices, grid_resolution)

        # Initialize lists for 3D building creation
        building_footprints = []
        building_vertices = []
        building_dist_sum = []
        building_vertices_distance_to_edge = [[] for _ in range(len(gp_building_map[i]))]

        # Loop through all buildings on parcel
        for j in range(len(gp_building_map[i])):
            gp_building_indeces = gp_building_map[i][j]
            mapped_building_vertices = map_indices_to_points(gp_building_indeces, gp_grid)

            # Ensure the polyline is closed by appending the first vertex at the end if needed
            if mapped_building_vertices[0].DistanceTo(mapped_building_vertices[-1]) > tolerance:
                mapped_building_vertices.append(mapped_building_vertices[0])

            # Create generic building footprint and append to generic building footprints
            generic_building_outline = rs.AddPolyline(mapped_building_vertices)
            generic_buildings_footprints.append(generic_building_outline)

            # Measure distance of building footprints to edge
            generic_building_curve = rs.coercecurve(generic_building_outline)
            building_footprints.append(generic_building_curve)
            gb_vertices = generic_building_curve.ToPolyline().ToArray()
            building_vertices.append(gb_vertices)
            for vertex in gb_vertices:
                dist_1 = round(vertex.DistanceTo(gp_vertices[0]), 2)
                dist_2 = round(vertex.DistanceTo(gp_vertices[1]), 2)
                building_vertices_distance_to_edge[j].append(dist_1)
                building_vertices_distance_to_edge[j].append(dist_2)

        # Distance from boundary edge for reasonable height distribution
        for j in range(len(building_vertices_distance_to_edge)):
            weighted_dist = sum(building_vertices_distance_to_edge[j]) / len(building_vertices_distance_to_edge[j])
            dist_sum = round(weighted_dist ,2)
            building_dist_sum.append(dist_sum)

        # Get a height from data package (or from the FAR calculation)
        b_gauss_height = round(random.gauss(b_mean_height, b_height_std))
        height = int(max(b_min_height, min(b_gauss_height, b_max_height)))

        # Figure out if any footprint lies on another one
        building_footprint_inside, idx_outline_inside, idx_outline_surrounding = check_building_footprints_inside(building_footprints, building_vertices, tolerance)

        # Get a height from data package
        b_gauss_height = round(random.gauss(b_mean_height, b_height_std))
        height = int(max(b_min_height, min(b_gauss_height, b_max_height)))

        # Create generic building extrustions
        # Address the buildings with the outline inside:
        if building_footprint_inside == True:
            # First, address the buildings with the outline inside:
            surrounding_footprint = rs.coercecurve(building_footprints[idx_outline_surrounding])
            inside_footprint = rs.coercecurve(building_footprints[idx_outline_inside])
            surrounding_building = extrude_polyline(surrounding_footprint, height)
            inside_building = extrude_polyline(inside_footprint, height + 3)
            generic_buildings_3D.append(surrounding_building)
            generic_buildings_3D.append(inside_building)
            height = height + random.choice([-3, 3])

            # Delete the larger index first to avoid index shift issues
            indices_to_remove = sorted([idx_outline_surrounding, idx_outline_inside], reverse=True)
            for index in indices_to_remove:
                for lst in [building_footprints, building_dist_sum]:
                    del lst[index]

        # Sort lists according to buliding distance to edge sum
        if len(building_footprints) > 0:
            sorted_pairs = sorted(zip(building_dist_sum, building_footprints), key=lambda x: x[0], reverse=True)
            building_dist_sum, building_footprints = zip(*sorted_pairs)

            for footprint in building_footprints:      
                footprint = rs.coercecurve(footprint)
                generic_building = extrude_polyline(footprint, height)
                generic_buildings_3D.append(generic_building)
                rng = random.uniform(0,1)
                if rng < 0.2:
                    if height > 6:
                        height = height - 6
                else:
                    if height > 3:
                        height = height - 3



    ################################
    """ CREATE CORNER BUILDINGS """

    # Initialize list to store generic bulidings
    corner_buildings_footprints = []
    corner_buildings_3D = []

    # Loop through all quadrilateral corner parcels
    for i, corner_parcel_quad in enumerate(cp_quad_curves):

        # Extract vertices from quadrilateral corner parcel
        corner_parcel = rs.coercecurve(corner_parcel_quad)
        cp_vertices = extract_vertices_from_curve(corner_parcel)

        # Generate grid for quadrilateral parcel
        cp_grid = generate_grid_in_quadrilateral_parcel(cp_vertices, grid_resolution)

        # Initialize lists for 3D building creation
        building_footprints = []
        building_vertices = []
        building_dist_sum = []
        building_vertices_distance_to_edge = [[] for _ in range(len(cp_quad_building_map[i]))]   

        # Loop through all buildings on parcel
        for j in range(len(cp_quad_building_map[i])):
            cp_building_indeces = cp_quad_building_map[i][j]
            mapped_building_vertices = map_indices_to_points(cp_building_indeces, cp_grid)

            # Ensure the polyline is closed by appending the first vertex at the end if needed
            if mapped_building_vertices[0].DistanceTo(mapped_building_vertices[-1]) > tolerance:
                mapped_building_vertices.append(mapped_building_vertices[0])

            # Create corner building footprint and append to building footprints
            corner_building_outline = rs.AddPolyline(mapped_building_vertices)
            corner_buildings_footprints.append(corner_building_outline)

            # Measure distance of building footprints edges
            corner_building_curve = rs.coercecurve(corner_building_outline)
            building_footprints.append(corner_building_curve)
            cb_vertices = corner_building_curve.ToPolyline().ToArray()
            building_vertices.append(cb_vertices)
            for vertex in cb_vertices:
                dist_1 = round(vertex.DistanceTo(cp_vertices[0]), 2)
                dist_2 = round(vertex.DistanceTo(cp_vertices[1]), 2)
                dist_3 = round(vertex.DistanceTo(cp_vertices[3]), 2)
                building_vertices_distance_to_edge[j].append(dist_1)
                building_vertices_distance_to_edge[j].append(dist_2)
                building_vertices_distance_to_edge[j].append(dist_3)

        # Distance from boundary edge for reasonable height distribution
        for j in range(len(building_vertices_distance_to_edge)):
            weighted_dist = sum(building_vertices_distance_to_edge[j]) / len(building_vertices_distance_to_edge[j])
            dist_sum = round(weighted_dist ,2)
            building_dist_sum.append(dist_sum)

        # Get a height from data package (or from the FAR calculation)
        b_gauss_height = round(random.gauss(b_mean_height, b_height_std))
        height = int(max(b_min_height, min(b_gauss_height, b_max_height)))

        # Figure out if any footprint lies on another one
        building_footprint_inside, idx_outline_inside, idx_outline_surrounding = check_building_footprints_inside(building_footprints, building_vertices, tolerance)

        # Create corner building extrustions
        # Address the buildings with the outline inside:
        if building_footprint_inside == True:
            surrounding_footprint = rs.coercecurve(building_footprints[idx_outline_surrounding])
            surrounding_footprint = clean_polyline(surrounding_footprint)
            inside_footprint = rs.coercecurve(building_footprints[idx_outline_inside])
            inside_footprint = clean_polyline(inside_footprint)
            surrounding_building = extrude_polyline(surrounding_footprint, height)
            inside_building = extrude_polyline(inside_footprint, height + 3)
            corner_buildings_3D.append(surrounding_building)
            corner_buildings_3D.append(inside_building)
            height = height + random.choice([-3, 3])

            # Delete the larger index first to avoid index shift issues
            indices_to_remove = sorted([idx_outline_surrounding, idx_outline_inside], reverse=True)
            for index in indices_to_remove:
                for lst in [building_footprints, building_dist_sum]:
                    del lst[index]

        # Address rest of the buildings
        # Sort lists according to buliding distance to edge sum
        if len(building_footprints) > 0:
            sorted_pairs = sorted(zip(building_dist_sum, building_footprints), key=lambda x: x[0], reverse=True)
            building_dist_sum, building_footprints = zip(*sorted_pairs)
            for footprint in building_footprints:           
                footprint = rs.coercecurve(footprint)
                footprint = clean_polyline(footprint)
                corner_building = extrude_polyline(footprint, height)
                corner_buildings_3D.append(corner_building)
                rng = random.uniform(0,1)
                if rng < 0.2:
                    if height > 6:
                        height = height - 6
                else:
                    if height > 3:
                        height = height - 3

    print(len(cp_penta_curves))
    print(len(cp_penta_building_map))
    # Loop through all pentalateral corner parcels
    for i, corner_parcel in enumerate(cp_penta_curves):
        
        # Extract vertices from pentalateral corner parcel
        cp_polyline = corner_parcel.ToPolyline()
        cp_vertices = list(cp_polyline.ToArray())

        # Compute centroid
        center = compute_centroid(cp_vertices)

        # Generate a "grid" by subdividing the parcel through triangulation
        cp_triangles, cp_indexed_points = generate_grid_in_pentalateral_parcel(cp_vertices, center)

        # Initialize lists for 3D building creation
        building_footprints = []
        building_vertices = []
        building_dist_sum = []
        building_vertices_distance_to_edge = [[] for _ in range(len(cp_penta_building_map[i]))]   

        # Loop through all buildings on parcel
        for j in range(len(cp_penta_building_map[i])):
            cp_building_indeces = cp_penta_building_map[i][j]
            mapped_building_vertices = map_indices_to_points(cp_building_indeces, cp_indexed_points)

            # Ensure the polyline is closed by appending the first vertex at the end if needed
            if mapped_building_vertices[0].DistanceTo(mapped_building_vertices[-1]) > tolerance:
                mapped_building_vertices.append(mapped_building_vertices[0])

            # Create generic building footprint and append to generic building footprints
            corner_building_outline = rs.AddPolyline(mapped_building_vertices)
            corner_buildings_footprints.append(corner_building_outline)

            # Measure distance of building footprints edges
            corner_building_curve = rs.coercecurve(corner_building_outline)
            building_footprints.append(corner_building_curve)
            cb_vertices = corner_building_curve.ToPolyline().ToArray()
            building_vertices.append(cb_vertices)
            for vertex in cb_vertices:
                dist_1 = round(vertex.DistanceTo(cp_vertices[0]), 2)
                dist_2 = round(vertex.DistanceTo(cp_vertices[1]), 2)
                building_vertices_distance_to_edge[j].append(dist_1)
                building_vertices_distance_to_edge[j].append(dist_2)


        # Distance from boundary edge for reasonable height distribution
        for j in range(len(building_vertices_distance_to_edge)):
            weighted_dist = sum(building_vertices_distance_to_edge[j]) / len(building_vertices_distance_to_edge[j])
            dist_sum = round(weighted_dist ,2)
            building_dist_sum.append(dist_sum)      

        # Get a height from data package (or from the FAR calculation)
        b_gauss_height = round(random.gauss(b_mean_height, b_height_std))
        height = int(max(b_min_height, min(b_gauss_height, b_max_height)))  

        # Figure out if any footprint lies on another one
        building_footprint_inside, idx_outline_inside, idx_outline_surrounding = check_building_footprints_inside(building_footprints, building_vertices, tolerance)

        # Create corner building extrustions
        # Address the buildings with the outline inside:
        if building_footprint_inside == True:
            surrounding_footprint = rs.coercecurve(building_footprints[idx_outline_surrounding])
            surrounding_footprint = clean_polyline(surrounding_footprint)
            inside_footprint = rs.coercecurve(building_footprints[idx_outline_inside])
            inside_footprint = clean_polyline(inside_footprint)
            surrounding_building = extrude_polyline(surrounding_footprint, height)
            inside_building = extrude_polyline(inside_footprint, height + 3)
            corner_buildings_3D.append(surrounding_building)
            corner_buildings_3D.append(inside_building)
            height = height + random.choice([-3, 3])

            # Delete the larger index first to avoid index shift issues
            indices_to_remove = sorted([idx_outline_surrounding, idx_outline_inside], reverse=True)
            for index in indices_to_remove:
                for lst in [building_footprints, building_dist_sum]:
                    del lst[index]

        # Address rest of the buildings
        # Sort lists according to buliding distance to edge sum
        if len(building_footprints) > 0:
            sorted_pairs = sorted(zip(building_dist_sum, building_footprints), key=lambda x: x[0], reverse=True)
            building_dist_sum, building_footprints = zip(*sorted_pairs)
            for footprint in building_footprints:
                footprint = rs.coercecurve(footprint)
                footprint = clean_polyline(footprint)
                corner_building = extrude_polyline(footprint, height)
                corner_buildings_3D.append(corner_building)
                rng = random.uniform(0,1)
                if rng < 0.2:
                    if height > 6:
                        height = height - 6
                else:
                    if height > 3:
                        height = height - 3

    ################
    """ OUTPUTS """

    for gb_footprint in generic_buildings_footprints:
        footprints.append(gb_footprint)
    for cb_footprint in corner_buildings_footprints:
        footprints.append(cb_footprint)
    for gb_3D in generic_buildings_3D:
        extrusions.append(gb_3D)
    for cp_3D in corner_buildings_3D:
        extrusions.append(cp_3D)
# ---------- end building_generation_2 ----------

# ----
# ENABLE
# BUILDING GENERATION
# Floor-Area-Ratio
building_generation_3 = Python3Script(
    boundaries=boundaries_2,
    all_parcels_building_generation=parcel_generation_3.all_parcels_building_generation,
    floor_area_ratio=number_slider_8,
    corner_buildings_map=merge_building_data.corner_buildings_map_merged,
    generic_buildings_map=merge_building_data.generic_buildings_map_merged,
    data_package=merge_data_package_2.merged_data_package,
    random_seed=number_slider_9)  # -> footprints, extrusions; inputs boundaries: list, all_parcels_building_generation: list, corner_buildings_map: list, generic_buildings_map: list, data_package: list; disabled; same code as building_generation
